# Grasshopper definition plotter.gh (Grasshopper 1.0.7)
# plug-ins: Human

# ---- group: PEN TOOL TABLE per-pen XYZ datum (independent of plot order): collet -> cal point -> adjust tip -> STORE
pen_to_calibrate = ValueList({"Pen 1 [BLACK FINE]": 1, "Pen 2 [BLACK BOLD]": 2, "Pen 3 [BLACK ROLLER]": 3, "Pen 4 [RED FINE]": 4, "Pen 5 [CUSTOM 1]": 5, "Pen 6 [CUSTOM 2]": 6, "Pen 7 [CUSTOM 3]": 7, "Pen 8 [CUSTOM 4]": 8}, selected="Pen 3 [BLACK ROLLER]")
cal_commit_trim_to_datum = Button()
# PEN CALIBRATION
cal_1_go_to_collet_fit_pen = Button()
cal_apply_this_pen_offset = Button()
cal_3_store_this_pen = Button()
cal_2_go_to_cal_point = Button()
cal_clear_this_pen = Button()
cal_show_table = Button()
pencal = GhPythonScript(
    collet=cal_1_go_to_collet_fit_pen,
    cal_pos=cal_2_go_to_cal_point,
    store=cal_3_store_this_pen,
    apply=cal_apply_this_pen_offset,
    commit=cal_commit_trim_to_datum,
    table=cal_show_table,
    clear=cal_clear_this_pen,
    pen=pen_to_calibrate)  # -> out, a
#   port collet: see component description
# ---------- pencal: Python ----------
# PEN TOOL TABLE - per-pen XYZ calibration, like CNC tool offsets.
#
# A pen's calibration belongs to the PEN SLOT, not to the plotting order, so
# re-ordering passes never invalidates it. Once every pen you use is calibrated,
# swapping mid-plot needs no babystepping: the machine already knows exactly
# where each tip sits.
#
# Per pen:
#   1) collet  -> parks high so you can fit the pen from underneath
#   2) cal_pos -> drops to the calibration point at nominal draw height
#   3) adjust the pen in the collet (or jog Z) until the tip just touches
#   4) store   -> saves that exact position as this pen's datum
# Pen 1 is the datum; the others are stored relative to it.
#
# COMMIT folds a live trim into the stored datum: if you babystep mid-plot to
# fix a pen sitting high, commit makes that correction permanent instead of
# losing it at the end of the job. Nothing moves when it runs. Pen 1 is the
# datum so it cannot absorb a trim - that error belongs in pen_down_z.
# Inputs: collet, cal_pos, store, apply, commit, table, clear (buttons), pen(1-8)
import urllib
import urllib2

HOST = 'http://192.168.1.23:7125'
PEN = int(pen) if pen is not None else 1
if PEN < 1:
    PEN = 1
if PEN > 8:
    PEN = 8


def send(cmd):
    url = HOST + '/printer/gcode/script?script=' + urllib.quote(cmd)
    return urllib2.urlopen(urllib2.Request(url, ''), timeout=60).getcode()


def read_table():
    import json
    try:
        u = HOST + '/printer/objects/query?save_variables=variables'
        d = json.loads(urllib2.urlopen(u, timeout=8).read())
        v = d['result']['status']['save_variables']['variables']
        ref = v.get('pen_cal_1')
        rows = []
        for n in range(1, 9):
            me = v.get('pen_cal_%d' % n)
            if not me:
                continue
            if ref and n != 1:
                rows.append('pen %d: dX%+.2f dY%+.2f dZ%+.2f' % (
                    n, me[0] - ref[0], me[1] - ref[1], me[2] - ref[2]))
            else:
                rows.append('pen %d: X%.2f Y%.2f Z%.2f (datum)' % (n, me[0], me[1], me[2]))
        if not rows:
            return 'no pens calibrated yet'
        return ' | '.join(rows)
    except Exception as e:
        return 'table read failed: %s' % str(e)


msg = 'PEN %d selected  |  %s' % (PEN, read_table())
try:
    if collet:
        send('PEN_COLLET')
        msg = 'at collet position - fit pen %d from underneath, then CAL POS' % PEN
    elif cal_pos:
        send('PEN_CAL_POS')
        msg = 'at cal point - set pen %d tip so it just touches, then STORE' % PEN
    elif store:
        send('PEN_CALIBRATE PEN=%d' % PEN)
        msg = 'PEN %d STORED  |  %s' % (PEN, read_table())
    elif apply:
        send('PEN_APPLY PEN=%d' % PEN)
        msg = 'pen %d offsets applied  |  %s' % (PEN, read_table())
    elif commit:
        if PEN == 1:
            msg = ('pen 1 is the DATUM - a trim on it cannot be stored (it would '
                   'just re-zero itself). Adjust pen_down_z instead, or re-run '
                   'STORE at the cal dot to move the datum.')
        else:
            send('PEN_COMMIT PEN=%d' % PEN)
            msg = 'pen %d trim committed to its datum  |  %s' % (PEN, read_table())
    elif table:
        send('PEN_TABLE')
        msg = 'TABLE: %s' % read_table()
    elif clear:
        send('PEN_CLEAR_CAL PEN=%d' % PEN)
        msg = 'pen %d cleared  |  %s' % (PEN, read_table())
except Exception as e:
    msg = 'FAILED: %s' % str(e)

print(msg)
# ---------- end pencal ----------

# ---- group: JOG head XY (as you look down at the bed)
jog_head_x = Button()
jog_home_g28 = Button()
jog_head_y = Button()
jog_head_y_2 = Button()
jog_head_x_2 = Button()

# ----
jog_z_step_mm = Slider(1, range=0.1..10)
jog_step_mm = Slider(2.5, range=0.1..50)

# ---- group: JOG head Z
jog_head_z_down = Button()
jog_head_z_up = Button()

# ----
pull_registration_from_printer = Button()

pen_line_weight_mm = Slider(0.45, range=0.05..3)
pen_for_width = ValueList({"Pen 1 [BLACK FINE]": 1, "Pen 2 [BLACK BOLD]": 2, "Pen 3 [BLACK ROLLER]": 3, "Pen 4 [RED FINE]": 4, "Pen 5 [CUSTOM 1]": 5, "Pen 6 [CUSTOM 2]": 6, "Pen 7 [CUSTOM 3]": 7, "Pen 8 [CUSTOM 4]": 8}, selected="Pen 3 [BLACK ROLLER]")
preview_px_per_mm = Slider(6, range=1..30)
save_pen_width = Button()
penwidth = GhPythonScript(pen=pen_for_width, width=pen_line_weight_mm, save=save_pen_width, px_per_mm=preview_px_per_mm)  # -> out, w, table, t1, t2, t3, t4, t5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
#   port pen: Which pen slot (1-8) to record a line weight for.
# ---------- penwidth: Python ----------
# PEN WIDTHS - the line weight each pen actually lays down.
#
# Design-time metadata, so it lives here rather than on the printer (the
# machine never needs it; Grasshopper does, on every solve). Stored in
# pen_widths.json next to the definition.
# Feed `w` into anything that needs to know how fat the pen is:
#   THINOUT.spacing      - cull strokes the pen cannot separate
#   POINTILLISM.pen_width - spiral pitch for filled dots
#   HATCH/HILBERT.inset   - keep fills off their own boundary
# Set a pen: pick it, set `width`, press `save`. Reading needs no press.
# `px_per_mm` converts the stored widths into preview thicknesses t1..t8 for
# Custom Preview Lineweights. NOTE those are SCREEN PIXELS, so the preview
# shows relative weight faithfully but is not true-scale and does not track
# zoom - it is a reading aid, not a simulation.
# Inputs: pen(1-8), width(mm), save(button), px_per_mm
# Outputs: w (this pen's stored width), table (all of them), t1..t8 (px)
import json
import os

WFILE = r'C:\Users\john.chandler\voron_plotter\pen_widths.json'
PEN_NAMES = {1: 'BLACK FINE', 2: 'BLACK BOLD', 3: 'BLACK ROLLER', 4: 'RED FINE',
             5: 'CUSTOM 1', 6: 'CUSTOM 2', 7: 'CUSTOM 3', 8: 'CUSTOM 4'}
DEFAULT = 0.45

PN = int(pen) if pen is not None else 1
if PN < 1:
    PN = 1
if PN > 8:
    PN = 8
WD = float(width) if width is not None else DEFAULT
if WD < 0.01:
    WD = 0.01

data = {}
try:
    fh = open(WFILE)
    data = json.loads(fh.read())
    fh.close()
except:
    data = {}

if save:
    data[str(PN)] = round(WD, 3)
    try:
        fh = open(WFILE, 'w')
        fh.write(json.dumps(data))
        fh.close()
        note = 'SAVED pen %d = %.2fmm' % (PN, WD)
    except Exception as e:
        note = 'save failed: %s' % str(e)
else:
    note = ''

w = data.get(str(PN), DEFAULT)
rows = []
for n in range(1, 9):
    if str(n) in data:
        rows.append('%d[%s] %.2f' % (n, PEN_NAMES.get(n, '?'), data[str(n)]))
table = ' | '.join(rows) if rows else 'nothing saved yet (defaults to %.2fmm)' % DEFAULT

PPM = float(px_per_mm) if px_per_mm is not None else 6.0
if PPM < 0.1:
    PPM = 0.1
_t = []
for n in range(1, 9):
    _wn = data.get(str(n), DEFAULT)
    _px = int(round(_wn * PPM))
    if _px < 1:
        _px = 1
    _t.append(_px)
t1, t2, t3, t4, t5, t6, t7, t8 = _t

msg = 'pen %d [%s] = %.2fmm' % (PN, PEN_NAMES.get(PN, '?'), w)
if note:
    msg = note + '  ->  ' + table
else:
    msg = msg + '   |   ' + table
print(msg)
# ---------- end penwidth ----------

teach_back_left_p2 = Button()
teach_front_left_p0 = Button()
teach_front_right_p1 = Button()

# ---- group: OPTICAL REGISTRATION bed camera -> paper corners (calibrate once, then capture)
cam_1_calibrate_needs_the_4_point_pairs = Button()
cam_threshold_1_auto = Slider(-1, range=-1..255)
cam_mark_diameter_mm = Slider(9, range=3..20)
cam_grid_marks_per_axis = Slider(3, range=2..5)
cam_min_bright_fraction = Slider(0.02, range=0.005..0.5)
cam_grid_inset_mm = Slider(45, range=20..120)
cam_park_gantry_before_capture = BooleanToggle(True)
cam_2_capture_find_sheet = Button()
cam_3_apply_to_registration = Button()
papercam_on_off_bypass = BooleanToggle(False)
cam_save_annotated_frame = BooleanToggle(True)
cam_snapshot_url = Panel("http://192.168.1.23/webcam/?action=snapshot")
cam_park_macro = Panel("PLOT_CAM_PARK")
papercam = GhPythonScript(
    url=cam_snapshot_url,
    thresh=cam_threshold_1_auto,
    min_area=cam_min_bright_fraction,
    grid_n=cam_grid_marks_per_axis,
    inset=cam_grid_inset_mm,
    mark_d=cam_mark_diameter_mm,
    calibrate=cam_1_calibrate_needs_the_4_point_pairs,
    park=cam_park_gantry_before_capture,
    park_cmd=cam_park_macro,
    capture=cam_2_capture_find_sheet,
    apply=cam_3_apply_to_registration,
    debug=cam_save_annotated_frame)  # -> out, corners, target_crvs; disabled
#   port url: Snapshot URL of the bed camera, the still image the detector reads.
#   port grid_n: How many calibration marks per axis on the bed sheet. A 3x3 grid means 3 here.
#   port inset: Distance in mm from the bed edge to the outermost calibration marks.
#   port mark_d: Diameter in mm of a drawn calibration mark, used to sanity-check what the camera found.
#   port calibrate: Button. Solves the camera-to-bed mapping from the drawn mark grid. Run once, then only if the camera moves.
#   port park: Park the gantry clear of the camera before capturing. The X beam sits right across the lens otherwise.
#   port park_cmd: Macro used to park the gantry for a capture.
#   port capture: Button. Takes a frame and finds the sheet in it.
#   port apply: Button. Sends the found sheet corners to the printer as the paper registration.
#   port debug: Save an annotated frame showing what the detector actually saw. The first thing to turn on when detection misbehaves. (bool)
#   port on: Enable the optical registration block. Off = the camera is ignored entirely. (bool)
# ---------- papercam: Python ----------
# -*- coding: utf-8 -*-
# PAPERCAM - optical paper registration from the bed camera.
#
# Replaces jogging the pen to three corners by hand: grab a frame, find the
# sheet, and hand the same three corners to the existing registration.
#
# The camera is fixed and the bed is flat, so image -> bed is exactly a
# HOMOGRAPHY (a plane-to-plane projective map, 8 degrees of freedom). That is
# what makes a single calibration hold: it absorbs the camera's tilt, its
# offset, and the lens's scale in one 3x3 matrix, and stays valid as long as
# nothing moves the camera. Autofocus is off in crowsnest (focus_absolute=2),
# which is what keeps that assumption true between sessions.
#
# CALIBRATE once: give four points you can see in the frame whose bed
# coordinates you know, as `calib_img` (pixels) and `calib_bed` (mm), then press
# `calibrate`. The matrix is written to camera_calibration.json and reused.
#
# DETECT: `capture` grabs a frame, thresholds it (paper is far brighter than the
# bed), takes the convex hull of the bright region, simplifies it to a quad and
# maps those corners through the homography into bed mm. `apply` writes them to
# paper_registration.json in the same shape the manual TEACH buttons produce, so
# everything downstream is unchanged.
#
# Outputs `corners` as front-left, front-right, back-left - the P0/P1/P2 the
# rest of the pipeline already expects.
# Inputs: url(snapshot), thresh(0-255, -1 = auto), min_area(fraction of frame),
#         calib_img(list of 4 image points), calib_bed(list of 4 bed points),
#         calibrate(button), capture(button), apply(button), debug(bool), on(bool)
import Rhino
import Rhino.Geometry as rg
import scriptcontext as sc
import math
import json
import System
import System.Drawing as SD
from System.Collections.Generic import List
try:
    sc.doc = ghdoc
except:
    pass

CALFILE = r'C:\Users\john.chandler\voron_plotter\camera_calibration.json'
REGFILE = r'C:\Users\john.chandler\voron_plotter\paper_registration.json'
DBGIMG = r'C:\Users\john.chandler\voron_plotter\screenshots\papercam_debug.png'


def solve8(M, rhs):
    """Gaussian elimination with partial pivoting on an 8x8 system"""
    n = len(rhs)
    a = []
    for i in range(n):
        row = list(M[i])
        row.append(rhs[i])
        a.append(row)
    for col in range(n):
        piv = col
        best = abs(a[col][col])
        for r in range(col + 1, n):
            if abs(a[r][col]) > best:
                best = abs(a[r][col]); piv = r
        if best < 1e-12:
            return None
        if piv != col:
            a[col], a[piv] = a[piv], a[col]
        d = a[col][col]
        for k in range(col, n + 1):
            a[col][k] /= d
        for r in range(n):
            if r == col:
                continue
            f = a[r][col]
            if f == 0.0:
                continue
            for k in range(col, n + 1):
                a[r][k] -= f * a[col][k]
    return [a[i][n] for i in range(n)]


def homography(src, dst):
    """4 correspondences -> 3x3 H with h33 = 1, mapping src -> dst.

    Each pair contributes two rows of the standard DLT system:
      x' = (h0 x + h1 y + h2) / (h6 x + h7 y + 1)
      y' = (h3 x + h4 y + h5) / (h6 x + h7 y + 1)
    cross-multiplied so the unknowns stay linear."""
    if len(src) < 4 or len(dst) < 4:
        return None
    M = []; rhs = []
    for i in range(4):
        x, y = src[i]
        u, v = dst[i]
        M.append([x, y, 1.0, 0.0, 0.0, 0.0, -u * x, -u * y]); rhs.append(u)
        M.append([0.0, 0.0, 0.0, x, y, 1.0, -v * x, -v * y]); rhs.append(v)
    h = solve8(M, rhs)
    if h is None:
        return None
    return [h[0], h[1], h[2], h[3], h[4], h[5], h[6], h[7], 1.0]


def homography_n(src, dst):
    """least-squares homography from N>=4 correspondences.

    Four points give an exact fit, which means it fits any error in those four
    perfectly and tells you nothing. With more marks the system is
    over-determined, so the residual per mark becomes a real measurement - of
    lens distortion, of a mark drawn slightly off, of the camera having shifted.
    Solved through the normal equations (A^T A x = A^T b) on the same 8-unknown
    DLT rows."""
    n = len(src)
    if n < 4 or len(dst) < n:
        return None
    if n == 4:
        return homography(src, dst)
    ATA = []
    for i in range(8):
        ATA.append([0.0] * 8)
    ATb = [0.0] * 8
    for i in range(n):
        x, y = src[i]
        u, v = dst[i]
        rows = ([x, y, 1.0, 0.0, 0.0, 0.0, -u * x, -u * y],
                [0.0, 0.0, 0.0, x, y, 1.0, -v * x, -v * y])
        rhs = (u, v)
        for r in range(2):
            row = rows[r]
            for a in range(8):
                if row[a] == 0.0:
                    continue
                ATb[a] += row[a] * rhs[r]
                for b2 in range(8):
                    if row[b2] != 0.0:
                        ATA[a][b2] += row[a] * row[b2]
    h = solve8(ATA, ATb)
    if h is None:
        return None
    return [h[0], h[1], h[2], h[3], h[4], h[5], h[6], h[7], 1.0]


def apply_h(H, x, y):
    d = H[6] * x + H[7] * y + H[8]
    if abs(d) < 1e-12:
        return None
    return ((H[0] * x + H[1] * y + H[2]) / d,
            (H[3] * x + H[4] * y + H[5]) / d)


def grab(url):
    """one frame from the MJPG snapshot endpoint"""
    try:
        from System.Net import WebClient
        from System.IO import MemoryStream
        wc = WebClient()
        data = wc.DownloadData(url)
        ms = MemoryStream(data)
        bm = SD.Bitmap(ms)
        return bm
    except Exception, e:
        return None


def send_gcode(host, cmd):
    """fire a command at Moonraker and wait for the motion to finish"""
    try:
        import urllib
        import urllib2
        u = host + '/printer/gcode/script?script=' + urllib.quote(cmd)
        urllib2.urlopen(urllib2.Request(u, ''), timeout=60)
        return True
    except:
        return False


def gray_of(bm, maxw):
    """downscaled 8-bit luminance as a flat list, plus its size"""
    from System.Drawing.Imaging import PixelFormat, ImageLockMode
    from System.Runtime.InteropServices import Marshal
    w = bm.Width; h = bm.Height
    f = 1.0
    if w > maxw:
        f = float(maxw) / float(w)
    tw = int(w * f); th = int(h * f)
    conv = SD.Bitmap(tw, th, PixelFormat.Format24bppRgb)
    g = SD.Graphics.FromImage(conv)
    g.InterpolationMode = SD.Drawing2D.InterpolationMode.HighQualityBilinear
    g.DrawImage(bm, 0, 0, tw, th)
    g.Dispose()
    d = conv.LockBits(SD.Rectangle(0, 0, tw, th), ImageLockMode.ReadOnly, PixelFormat.Format24bppRgb)
    stride = d.Stride
    nb = abs(stride) * th
    buf = System.Array.CreateInstance(System.Byte, nb)
    Marshal.Copy(d.Scan0, buf, 0, nb)
    conv.UnlockBits(d); conv.Dispose()
    out = []
    for yy in range(th):
        ro = yy * stride
        for xx in range(tw):
            i = ro + xx * 3
            out.append(int(0.114 * buf[i] + 0.587 * buf[i + 1] + 0.299 * buf[i + 2]))
    return out, tw, th, (float(w) / tw)


def otsu(gr):
    """threshold that best splits the histogram - paper vs bed, no tuning"""
    hist = [0] * 256
    for v in gr:
        hist[v] += 1
    tot = len(gr)
    sm = 0.0
    for i in range(256):
        sm += i * hist[i]
    sB = 0.0; wB = 0; best = -1.0; bt = 128
    for t in range(256):
        wB += hist[t]
        if wB == 0:
            continue
        wF = tot - wB
        if wF == 0:
            break
        sB += t * hist[t]
        mB = sB / wB
        mF = (sm - sB) / wF
        var = wB * wF * (mB - mF) * (mB - mF)
        if var > best:
            best = var; bt = t
    return bt


def hull_of(pts):
    """Andrew monotone chain convex hull"""
    p = sorted(set(pts))
    if len(p) < 3:
        return p
    lo = []
    for q in p:
        while len(lo) >= 2 and ((lo[-1][0]-lo[-2][0])*(q[1]-lo[-2][1]) - (lo[-1][1]-lo[-2][1])*(q[0]-lo[-2][0])) <= 0:
            lo.pop()
        lo.append(q)
    up = []
    for q in reversed(p):
        while len(up) >= 2 and ((up[-1][0]-up[-2][0])*(q[1]-up[-2][1]) - (up[-1][1]-up[-2][1])*(q[0]-up[-2][0])) <= 0:
            up.pop()
        up.append(q)
    return lo[:-1] + up[:-1]


def quad_from_hull(hull):
    """the 4 hull vertices enclosing the most area.

    A sheet photographed at an angle is a general quadrilateral, not a
    rectangle, so fitting a min-area RECTANGLE would systematically clip the
    corners. Picking the best 4 hull points keeps the true projected shape."""
    n = len(hull)
    if n < 4:
        return None
    if n > 40:
        step = n / 40 + 1
        hull = [hull[i] for i in range(0, n, step)]
        n = len(hull)
    best = None; bq = None
    for i in range(n):
        for j in range(i + 1, n):
            for k in range(j + 1, n):
                for l in range(k + 1, n):
                    q = [hull[i], hull[j], hull[k], hull[l]]
                    a = 0.0
                    for m in range(4):
                        x1, y1 = q[m]
                        x2, y2 = q[(m + 1) % 4]
                        a += x1 * y2 - x2 * y1
                    a = abs(a) * 0.5
                    if best is None or a > best:
                        best = a; bq = q
    return bq, best


def blobs(gr, w, h, t, amin, amax):
    """dark connected regions whose area falls in a band.

    The bed is dark too, so a plain dark threshold catches everything - but the
    bed comes out as one enormous component and a drawn mark as a small round
    one, so filtering on area is what separates them. It also means this works
    whether the marks are on one big sheet or on separate scraps of tape."""
    seen = [False] * (w * h)
    out = []
    for sy in range(h):
        base = sy * w
        for sx in range(w):
            i = base + sx
            if seen[i] or gr[i] > t:
                continue
            stack = [i]
            seen[i] = True
            cells = []
            over = False
            while stack:
                p = stack.pop()
                cells.append(p)
                if len(cells) > amax:
                    over = True
                    break
                py = p // w
                px = p - py * w
                if px > 0:
                    q = p - 1
                    if not seen[q] and gr[q] <= t:
                        seen[q] = True; stack.append(q)
                if px < w - 1:
                    q = p + 1
                    if not seen[q] and gr[q] <= t:
                        seen[q] = True; stack.append(q)
                if py > 0:
                    q = p - w
                    if not seen[q] and gr[q] <= t:
                        seen[q] = True; stack.append(q)
                if py < h - 1:
                    q = p + w
                    if not seen[q] and gr[q] <= t:
                        seen[q] = True; stack.append(q)
            if over or len(cells) < amin:
                continue
            n = len(cells)
            x0 = w; x1 = -1; y0 = h; y1 = -1
            sxs = 0.0; sys = 0.0
            for p in cells:
                py = p // w
                px = p - py * w
                sxs += px; sys += py
                if px < x0: x0 = px
                if px > x1: x1 = px
                if py < y0: y0 = py
                if py > y1: y1 = py
            bw = x1 - x0 + 1.0
            bh = y1 - y0 + 1.0
            # An X covers only about a fifth of its bounding box (2*L*w / L^2),
            # against ~0.79 for a filled disc - so the fill test has to be loose
            # enough to admit a cross while still rejecting long thin strokes
            # and the huge single blob the bed itself forms. The squareness test
            # below does most of the discriminating for an X.
            fill = n / (bw * bh)
            if fill < 0.10 or fill > 0.95:
                continue
            if bw / bh > 2.0 or bh / bw > 2.0:
                continue
            out.append((sxs / n, sys / n, n, x0, y0, x1, y1))
    return out


def lock_rgb(bm):
    """full-resolution pixels, kept as a raw buffer - building a 900k-entry
    Python list just to sample a few hundred points would cost more than the
    whole detection"""
    from System.Drawing.Imaging import PixelFormat, ImageLockMode
    from System.Runtime.InteropServices import Marshal
    w = bm.Width; h = bm.Height
    conv = SD.Bitmap(w, h, PixelFormat.Format24bppRgb)
    g = SD.Graphics.FromImage(conv)
    g.DrawImage(bm, 0, 0, w, h)
    g.Dispose()
    d = conv.LockBits(SD.Rectangle(0, 0, w, h), ImageLockMode.ReadOnly, PixelFormat.Format24bppRgb)
    stride = d.Stride
    nb = abs(stride) * h
    buf = System.Array.CreateInstance(System.Byte, nb)
    Marshal.Copy(d.Scan0, buf, 0, nb)
    conv.UnlockBits(d); conv.Dispose()
    return buf, stride, w, h


def lum_at(buf, stride, w, h, x, y):
    """bilinear luminance. Nearest-neighbour quantises every scan to a whole
    pixel, which puts a floor under the corner accuracy no matter how finely
    the scan steps - it cost about 0.6mm on the bed before this."""
    xf = math.floor(x); yf = math.floor(y)
    xi = int(xf); yi = int(yf)
    if xi < 0 or yi < 0 or xi + 1 >= w or yi + 1 >= h:
        return None
    fx = x - xf; fy = y - yf
    i00 = yi * stride + xi * 3
    i10 = i00 + 3
    i01 = i00 + stride
    i11 = i01 + 3
    v00 = 0.114 * buf[i00] + 0.587 * buf[i00 + 1] + 0.299 * buf[i00 + 2]
    v10 = 0.114 * buf[i10] + 0.587 * buf[i10 + 1] + 0.299 * buf[i10 + 2]
    v01 = 0.114 * buf[i01] + 0.587 * buf[i01 + 1] + 0.299 * buf[i01 + 2]
    v11 = 0.114 * buf[i11] + 0.587 * buf[i11 + 1] + 0.299 * buf[i11 + 2]
    return (v00 * (1.0 - fx) * (1.0 - fy) + v10 * fx * (1.0 - fy)
            + v01 * (1.0 - fx) * fy + v11 * fx * fy)


def refine_quad(buf, stride, w, h, quad, t):
    """sub-pixel corners by fitting the four edges.

    The hull vertices of a thresholded mask land wherever the pixel grid
    happened to cross the paper, which at any sane downscale is a millimetre or
    two out. Instead, walk along each edge, scan ACROSS it to find where the
    brightness actually crosses the threshold (interpolating between the two
    straddling samples), least-squares fit a line through those crossings, and
    intersect neighbouring lines. Corner accuracy then comes from ~40 edge
    samples rather than from one pixel."""
    SPAN = 14.0        # how far either side of the nominal edge to look, px
    STEP = 0.25
    N = 44
    lines = []
    for e in range(4):
        ax, ay = quad[e]
        bx, by = quad[(e + 1) % 4]
        dx = bx - ax; dy = by - ay
        L = math.sqrt(dx*dx + dy*dy)
        if L < 1e-6:
            return None
        dx /= L; dy /= L
        nx = -dy; ny = dx
        got = []
        for k in range(N):
            f = 0.12 + 0.76 * (float(k) / (N - 1))   # keep clear of the corners
            px = ax + dx * L * f
            py = ay + dy * L * f
            prev = None; prevs = None
            cross = None
            s = -SPAN
            while s <= SPAN:
                v = lum_at(buf, stride, w, h, px + nx * s, py + ny * s)
                if v is None:
                    prev = None; s += STEP; continue
                if prev is not None and ((prev - t) * (v - t) < 0.0):
                    # linear interpolation to the exact crossing
                    fr = (t - prev) / (v - prev) if (v - prev) != 0 else 0.5
                    sc = prevs + fr * STEP
                    cross = (px + nx * sc, py + ny * sc)
                    break
                prev = v; prevs = s
                s += STEP
            if cross:
                got.append(cross)
        if len(got) < 6:
            return None
        # total-least-squares line through the crossings
        mx = 0.0; my = 0.0
        for q in got:
            mx += q[0]; my += q[1]
        mx /= len(got); my /= len(got)
        sxx = 0.0; syy = 0.0; sxy = 0.0
        for q in got:
            ddx = q[0] - mx; ddy = q[1] - my
            sxx += ddx*ddx; syy += ddy*ddy; sxy += ddx*ddy
        th = 0.5 * math.atan2(2.0 * sxy, sxx - syy)
        lines.append((mx, my, math.cos(th), math.sin(th)))
    out = []
    for e in range(4):
        x1, y1, c1, s1 = lines[(e - 1) % 4]
        x2, y2, c2, s2 = lines[e]
        den = c1 * s2 - s1 * c2
        if abs(den) < 1e-9:
            return None
        tt = ((x2 - x1) * s2 - (y2 - y1) * c2) / den
        out.append((x1 + c1 * tt, y1 + s1 * tt))
    # out[e] is the meeting of edge e-1 and edge e, i.e. quad vertex e
    return out


# crowsnest's own port (8080) is NOT reachable from outside the pi - only the
# nginx proxy path is. Verified: :8080 refuses the connection, /webcam/ answers.
#   overhead cam -> /webcam/    (cam bedcam,  USB port 1.1)
#   low side cam -> /webcam2/   (cam lifecam, USB port 1.2)
URL = str(url) if url else 'http://192.168.1.23/webcam/?action=snapshot'
HOST = 'http://192.168.1.23:7125'
PARK = True if park is None else bool(park)
PARKCMD = str(park_cmd) if park_cmd else 'PLOT_CAM_PARK'
THRESH = int(thresh) if thresh is not None else -1
MINA = float(min_area) if min_area is not None else 0.02
DEBUG = True if debug is None else bool(debug)
ON = True if on is None else bool(on)

# ---- calibration target ----
# Marks are DRAWN rather than stuck on and measured: the machine already knows
# exactly where it put the pen, so their coordinates are exact by construction,
# and the calibration ends up mapping the camera to MACHINE coordinates - where
# the toolhead actually goes - rather than to the bed as an object.
# The pen sits 58mm in front of the nozzle, so it can only reach Y 0..292.
BEDX = 350.0
PENY = 292.0
GRIDN = int(grid_n) if grid_n is not None else 3
if GRIDN < 2: GRIDN = 2
if GRIDN > 5: GRIDN = 5
INSET = float(inset) if inset is not None else 45.0
MARKD = float(mark_d) if mark_d is not None else 9.0
if MARKD < 3.0: MARKD = 3.0
_gx = []
_gy = []
for i in range(GRIDN):
    f = float(i) / (GRIDN - 1)
    _gx.append(INSET + (BEDX - 2.0 * INSET) * f)
    _gy.append(INSET + (PENY - 2.0 * INSET) * f)
GRID = []
for yy in _gy:
    for xx in _gx:
        GRID.append((xx, yy))

# Marks are an X, not a filled disc. A spiral-filled disc floods as soon as the
# pen is wider than the spiral pitch - a 1mm felt nib on a 0.4mm pitch is 2.5x
# overlap and just makes a blob, which carries no more positional information
# than a cross and a great deal more ink. The centroid of a symmetric X is its
# crossing point, so detection is unchanged in principle and far cheaper to draw.
target_crvs = []
for (mx, my) in GRID:
    r = MARKD * 0.5
    for (ax, ay, bx, by) in ((-r, -r, r, r), (-r, r, r, -r)):
        lp = List[rg.Point3d]()
        lp.Add(rg.Point3d(mx + ax, my + ay, 0))
        lp.Add(rg.Point3d(mx + bx, my + by, 0))
        target_crvs.append(rg.PolylineCurve(lp))

corners = []
info = ''
H = None
try:
    _fh = open(CALFILE)
    _cal = json.loads(_fh.read())
    _fh.close()
    H = _cal.get('H')
except:
    H = None

if not ON:
    info = '[BYPASSED]'
else:
    did = False
    # ---- calibrate ----
    if calibrate:
        did = True
        parked = ''
        if PARK:
            parked = 'parked | ' if send_gcode(HOST, PARKCMD) else 'PARK FAILED | '
        bm = grab(URL)
        if bm is None:
            info = 'no frame from %s' % URL
        else:
            gr, gw, gh_, scl = gray_of(bm, 640)
            t = otsu(gr) if THRESH < 0 else THRESH
            # marks are DARK on a light sheet - the inverse of finding the sheet
            # itself, which is light on a dark bed
            amin = 8
            amax = int(gw * gh_ * 0.02)
            found = blobs(gr, gw, gh_, t, amin, amax)
            if len(found) < 4:
                info = ('%sfound only %d mark(s) - need at least 4. '
                        'threshold %d, %d blobs in band. Is the target drawn and the sheet lit?') % (
                    parked, len(found), t, len(found))
            else:
                pts = [(q[0] * scl, q[1] * scl) for q in found]
                # correspondence without a homography yet: the four extreme
                # detections must be the four grid corners, whatever the
                # rotation or flip, so they give a rough map to predict the rest
                ext = [None, None, None, None]
                bestv = [None, None, None, None]
                for (px, py) in pts:
                    for k, v in ((0, px + py), (1, -(px + py)), (2, px - py), (3, -(px - py))):
                        if bestv[k] is None or v > bestv[k]:
                            bestv[k] = v; ext[k] = (px, py)
                gminx = min(_gx); gmaxx = max(_gx)
                gminy = min(_gy); gmaxy = max(_gy)
                gc = [(gminx, gminy), (gmaxx, gmaxy), (gmaxx, gminy), (gminx, gmaxy)]
                rough = homography(ext, gc)
                if rough is None:
                    info = '%scould not fit a rough map to the outermost marks' % parked
                else:
                    src = []; dst = []; used = []
                    for (gxp, gyp) in GRID:
                        bi = -1; bd = None
                        for i in range(len(pts)):
                            if i in used:
                                continue
                            m = apply_h(rough, pts[i][0], pts[i][1])
                            if m is None:
                                continue
                            d = math.sqrt((m[0] - gxp) ** 2 + (m[1] - gyp) ** 2)
                            if bd is None or d < bd:
                                bd = d; bi = i
                        if bi >= 0 and bd is not None and bd < 40.0:
                            used.append(bi)
                            src.append(pts[bi]); dst.append((gxp, gyp))
                    if len(src) < 4:
                        info = '%smatched only %d mark(s) to the grid' % (parked, len(src))
                    else:
                        Hn = homography_n(src, dst)
                        if Hn is None:
                            info = '%ssolve failed - marks may be collinear' % parked
                        else:
                            res = []
                            for i in range(len(src)):
                                m = apply_h(Hn, src[i][0], src[i][1])
                                res.append(math.sqrt((m[0]-dst[i][0])**2 + (m[1]-dst[i][1])**2))
                            res_s = sorted(res)
                            _fh = open(CALFILE, 'w')
                            _fh.write(json.dumps({'H': Hn, 'marks': len(src),
                                                  'worst_mm': res_s[-1],
                                                  'note': 'image px -> bed mm'}))
                            _fh.close()
                            H = Hn
                            info = ('%sCALIBRATED on %d of %d marks | residual mean %.3f mm, '
                                    'worst %.3f mm | threshold %d, %d blobs seen') % (
                                parked, len(src), len(GRID),
                                sum(res) / len(res), res_s[-1], t, len(found))
            bm.Dispose()

    # ---- capture + detect ----
    if capture and not did:
        did = True
        if H is None:
            info = 'not calibrated yet - set calib_img / calib_bed and press calibrate'
        else:
            # An overhead camera looks straight through the gantry, so the beam
            # has to be moved off the sheet before the frame is any use. The
            # back strip is already the exclusion zone the pen cannot reach, so
            # parking there costs no printable area. PLOT_CAM_PARK ends in M400
            # so this returns only once the motion has actually finished.
            parked = ''
            if PARK:
                if send_gcode(HOST, PARKCMD):
                    parked = 'parked | '
                else:
                    parked = 'PARK FAILED (printer off?) | '
            bm = grab(URL)
            if bm is None:
                info = 'no frame from %s (printer off, or wrong URL?)' % URL
            else:
                gr, gw, gh_, scl = gray_of(bm, 640)
                t = otsu(gr) if THRESH < 0 else THRESH
                pts = []
                for yy in range(gh_):
                    ro = yy * gw
                    for xx in range(gw):
                        if gr[ro + xx] > t:
                            pts.append((xx, yy))
                frac = float(len(pts)) / float(gw * gh_)
                if frac < MINA:
                    info = 'nothing bright enough found (%.1f%% of frame over threshold %d)' % (frac * 100.0, t)
                elif frac > 0.9:
                    info = 'almost the whole frame is bright (threshold %d) - is the bed lit too evenly?' % t
                else:
                    hl = hull_of(pts)
                    res = quad_from_hull(hl)
                    if res is None:
                        info = 'could not fit a quad to the bright region'
                    else:
                        quad, area = res
                        # image px are in the DOWNSCALED frame; undo that
                        full = [(q[0] * scl, q[1] * scl) for q in quad]
                        # then pull the corners onto the real edges, sub-pixel
                        refined = None
                        try:
                            _b, _s, _w, _h = lock_rgb(bm)
                            refined = refine_quad(_b, _s, _w, _h, full, float(t))
                        except:
                            refined = None
                        if refined:
                            full = refined
                        bed = []
                        for (qx, qy) in full:
                            m = apply_h(H, qx, qy)
                            if m:
                                bed.append(m)
                        if len(bed) < 4:
                            info = 'homography could not map the corners'
                        else:
                            # name them the way the pipeline expects:
                            # P0 front-left, P1 front-right, P2 back-left
                            cy = sum([q[1] for q in bed]) / 4.0
                            cx = sum([q[0] for q in bed]) / 4.0
                            front = [q for q in bed if q[1] <= cy]
                            back = [q for q in bed if q[1] > cy]
                            if len(front) == 2 and len(back) == 2:
                                front.sort()
                                back.sort()
                                p0 = front[0]; p1 = front[1]; p2 = back[0]
                                corners = [rg.Point3d(p0[0], p0[1], 0),
                                           rg.Point3d(p1[0], p1[1], 0),
                                           rg.Point3d(p2[0], p2[1], 0)]
                                w_mm = math.sqrt((p1[0]-p0[0])**2 + (p1[1]-p0[1])**2)
                                h_mm = math.sqrt((p2[0]-p0[0])**2 + (p2[1]-p0[1])**2)
                                skew = math.degrees(math.atan2(p1[1]-p0[1], p1[0]-p0[0]))
                                # local scale from the homography at each corner -
                                # tells you how much a pixel is worth there, which
                                # is the honest measure of how far to trust it
                                mmpx = []
                                for (qx, qy) in full:
                                    a = apply_h(H, qx, qy)
                                    b1 = apply_h(H, qx + 1.0, qy)
                                    b2 = apply_h(H, qx, qy + 1.0)
                                    if a and b1 and b2:
                                        d1 = math.sqrt((b1[0]-a[0])**2 + (b1[1]-a[1])**2)
                                        d2 = math.sqrt((b2[0]-a[0])**2 + (b2[1]-a[1])**2)
                                        mmpx.append(0.5 * (d1 + d2))
                                sc_txt = ''
                                if mmpx:
                                    sc_txt = ' | %.3f-%.3f mm/px at the corners' % (min(mmpx), max(mmpx))
                                info = ('%sFOUND paper %.1f x %.1f mm, skew %+.2f deg | '
                                        'threshold %d (%s), %.0f%% of frame%s | '
                                        'P0 %.1f,%.1f  P1 %.1f,%.1f  P2 %.1f,%.1f') % (
                                    parked, w_mm, h_mm, skew, t, 'auto' if THRESH < 0 else 'manual',
                                    frac * 100.0, sc_txt, p0[0], p0[1], p1[0], p1[1], p2[0], p2[1])
                            else:
                                info = 'corners did not split cleanly front/back - check the calibration'
                        if DEBUG:
                            try:
                                g2 = SD.Graphics.FromImage(bm)
                                pen = SD.Pen(SD.Color.Lime, 3.0)
                                for m in range(4):
                                    a = full[m]; b = full[(m + 1) % 4]
                                    g2.DrawLine(pen, float(a[0]), float(a[1]), float(b[0]), float(b[1]))
                                g2.Dispose()
                                bm.Save(DBGIMG, SD.Imaging.ImageFormat.Png)
                            except:
                                pass
                bm.Dispose()

    # ---- apply ----
    if apply and not did:
        did = True
        if len(corners) < 3:
            info = 'nothing to apply - press capture first'
        else:
            try:
                _fh = open(REGFILE, 'w')
                _fh.write(json.dumps({'p0': [corners[0].X, corners[0].Y],
                                      'p1': [corners[1].X, corners[1].Y],
                                      'p2': [corners[2].X, corners[2].Y]}))
                _fh.close()
                info = 'written to paper_registration.json - PULL registration to load it'
            except Exception, e:
                info = 'could not write registration: %s' % str(e)

    if not did:
        if H is None:
            info = 'idle - NOT CALIBRATED'
        else:
            info = 'idle - calibrated, press capture'

print(info)
# ---------- end papercam ----------

# ----
paperreg = GhPythonScript(
    home=jog_home_g28,
    jog_xm=jog_head_x,
    jog_xp=jog_head_x_2,
    jog_ym=jog_head_y_2,
    jog_yp=jog_head_y,
    jog_zd=jog_head_z_down,
    jog_zu=jog_head_z_up,
    teach_fl=teach_front_left_p0,
    teach_fr=teach_front_right_p1,
    teach_bl=teach_back_left_p2,
    jog=jog_step_mm,
    jog_z=jog_z_step_mm,
    pull=pull_registration_from_printer)  # -> out, reg_json
#   port home: see component description
# ---------- paperreg: Python ----------
# PAPER REGISTRATION - teach the printer where the sheet actually is, and read
# the answer back. One console for the whole story.
#
# Workflow: home, load a pen, then jog the PEN TIP to each paper corner in turn
# and press the matching TEACH button. Three corners define the sheet's origin,
# width, height, rotation and skew.
#
# PULL used to be its own component (REGSYNC) sitting beside this one, which was
# always odd: teaching a corner ALREADY pulls automatically so the preview can
# update live, so the separate box only existed for the manual case. Same job,
# same group, one output - it belongs here.
#
#   jog buttons    : move the toolhead by `jog` mm (X-/X+/Y-/Y+), Z by `jog_z`
#   teach_fl/fr/bl : store the current position as front-left / front-right /
#                    back-left, then auto-pull so the paper outline updates
#   pull           : re-read the taught corners from the printer by hand
#   home           : G28 (do this first - jogging needs a homed machine)
#
# Outputs `reg_json`: a one-line summary of the registration currently on file,
# which PLACE consumes and the receipt panel displays.
# Inputs: home, jog_xm, jog_xp, jog_ym, jog_yp, jog_zd, jog_zu,
#         teach_fl, teach_fr, teach_bl, pull (buttons), jog(mm), jog_z(mm)
import urllib
import urllib2
import json
import math

HOST = 'http://192.168.1.23:7125'
REGFILE = r'C:\Users\john.chandler\voron_plotter\paper_registration.json'


def pull_registration():
    """fetch the taught corners and write the registration file. Returns a short
    status string. Missing corners are tolerated - a half-taught paper keeps the
    corners it has so the preview can update after EACH teach."""
    try:
        u = HOST + '/printer/objects/query?save_variables=variables'
        d = json.loads(urllib2.urlopen(u, timeout=8).read())
        v = d['result']['status']['save_variables']['variables']
        got = {}
        for k, nm in [('paper_p0', 'p0'), ('paper_p1', 'p1'), ('paper_p2', 'p2')]:
            if k in v and v[k]:
                got[nm] = v[k]
        if len(got) < 3:
            try:
                fh = open(REGFILE)
                old = json.loads(fh.read())
                fh.close()
                for nm in ['p0', 'p1', 'p2']:
                    if nm not in got and nm in old:
                        got[nm] = old[nm]
            except:
                pass
        if len(got) < 3:
            return 'pulled %d/3 corners (teach the rest)' % len(got)
        fh = open(REGFILE, 'w')
        fh.write(json.dumps({'p0': got['p0'], 'p1': got['p1'], 'p2': got['p2']}))
        fh.close()
        ux = got['p1'][0] - got['p0'][0]
        uy = got['p1'][1] - got['p0'][1]
        vx = got['p2'][0] - got['p0'][0]
        vy = got['p2'][1] - got['p0'][1]
        w = math.sqrt(ux * ux + uy * uy)
        h = math.sqrt(vx * vx + vy * vy)
        rot = math.degrees(math.atan2(uy, ux))
        return 'paper now %.0fx%.0fmm rot %.1fdeg' % (w, h, rot)
    except Exception as e:
        return 'pull failed: %s' % str(e)


JOG = float(jog) if jog is not None else 5.0
if JOG < 0.0:
    JOG = 0.0
JOGZ = float(jog_z) if jog_z is not None else 1.0
if JOGZ < 0.0:
    JOGZ = 0.0


def send(cmd):
    url = HOST + '/printer/gcode/script?script=' + urllib.quote(cmd)
    return urllib2.urlopen(urllib2.Request(url, ''), timeout=10).getcode()


def pos():
    try:
        u = HOST + '/printer/objects/query?toolhead=position,homed_axes'
        d = json.loads(urllib2.urlopen(u, timeout=6).read())
        t = d['result']['status']['toolhead']
        return (t['position'][0], t['position'][1], t['position'][2], t['homed_axes'])
    except:
        return None


msg = 'jog the PEN TIP to a corner, then TEACH  (jog %.1fmm, Z %.1fmm)' % (JOG, JOGZ)
did = None
taught = False
try:
    if home:
        send('G28'); did = 'homed'
    elif jog_xm:
        send('G91'); send('G0 X%.3f F6000' % -JOG); send('G90'); did = 'X -%.1f' % JOG
    elif jog_xp:
        send('G91'); send('G0 X%.3f F6000' % JOG); send('G90'); did = 'X +%.1f' % JOG
    elif jog_ym:
        send('G91'); send('G0 Y%.3f F6000' % -JOG); send('G90'); did = 'Y -%.1f' % JOG
    elif jog_yp:
        send('G91'); send('G0 Y%.3f F6000' % JOG); send('G90'); did = 'Y +%.1f' % JOG
    elif jog_zd:
        send('G91'); send('G0 Z%.3f F900' % -JOGZ); send('G90'); did = 'Z -%.1f' % JOGZ
    elif jog_zu:
        send('G91'); send('G0 Z%.3f F900' % JOGZ); send('G90'); did = 'Z +%.1f' % JOGZ
    elif teach_fl:
        send('PAPER_SET_FL'); did = 'TAUGHT front-left (P0)'; taught = True
    elif teach_fr:
        send('PAPER_SET_FR'); did = 'TAUGHT front-right (P1)'; taught = True
    elif teach_bl:
        send('PAPER_SET_BL'); did = 'TAUGHT back-left (P2)'; taught = True
    elif pull:
        did = 'PULLED'; taught = True
    if taught:
        msg = '%s  ->  %s' % (did, pull_registration())
    elif did is not None:
        p = pos()
        if p is not None:
            msg = '%s  |  nozzle X %.1f Y %.1f Z %.1f  (homed: %s)' % (
                did, p[0], p[1], p[2], p[3] if p[3] else 'NO')
        else:
            msg = '%s (sent)' % did
except Exception as e:
    msg = 'FAILED: %s' % str(e)

# ---- always report the registration currently on file -----------------------
# This is what PLACE reads. It is emitted on EVERY solve, not only after a pull,
# so a fresh session already knows where the paper is.
try:
    fh = open(REGFILE)
    reg = json.loads(fh.read())
    fh.close()
    ux = reg['p1'][0] - reg['p0'][0]; uy = reg['p1'][1] - reg['p0'][1]
    vx = reg['p2'][0] - reg['p0'][0]; vy = reg['p2'][1] - reg['p0'][1]
    w = math.sqrt(ux * ux + uy * uy); h = math.sqrt(vx * vx + vy * vy)
    rot = math.degrees(math.atan2(uy, ux))
    reg_json = ('paper %.0fx%.0fmm rot %.1fdeg | P0(%.1f,%.1f) P1(%.1f,%.1f) P2(%.1f,%.1f)'
                % (w, h, rot, reg['p0'][0], reg['p0'][1], reg['p1'][0],
                   reg['p1'][1], reg['p2'][0], reg['p2'][1]))
except Exception as e:
    reg_json = 'no valid registration file (%s)' % str(e)

print(msg)
# ---------- end paperreg ----------

pulled_registration_receipt = Panel(paperreg.reg_json)

# ---- group: IMAGE INPUTS one image, one frame, one crop - feeds every image processor
image_crop_l_t_r_b_0_1_blank_whole = TONECropLTRB()
image_frame_art_rect_mm = Curve(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)

# ----
# IMAGE
# INPUTS
input_image = FilePath("C:\Users\john.chandler\Downloads\images (1).jpg")

# ---- group: PROCESSOR - TONE REGIONS image -> closed tone bands. Feeds the region fills
tone_min_area_mm2 = Slider(10, range=0..60)
tone_detail_mm = Slider(0.3, range=0.3..4)
tone_inset_mm = Slider(0, range=0..5)
tone_blur_mm = Slider(2, range=0..8)
tone_gamma = Slider(0.7, range=0.2..3)
tone_keep_region_outline = BooleanToggle(False)
tone_on_off_passthrough = TONEOnOffPassthrough(True)
# HATCH &
# LINE
# GENERATORS
tone_bands = Slider(8, range=2..10)
tone_invert = BooleanToggle(False)
tone = TONE(
    crvs=image_frame_art_rect_mm,
    image=input_image,
    nbands=tone_bands,
    detail=tone_detail_mm,
    invert=tone_invert,
    gamma=tone_gamma,
    inset=tone_inset_mm,
    keep_edge=tone_keep_region_outline,
    on=tone_on_off_passthrough,
    smooth=tone_blur_mm,
    min_area=tone_min_area_mm2,
    frame=image_frame_art_rect_mm,
    crop=image_frame_art_rect_mm)  # -> out, out_crvs, bands; inputs crvs: list, crop: list
# ---------- tone: Python ----------
# TONE REGIONS - an image cut into closed tone bands, so photographs can drive
# the region fills.
#
# Every fill in this pipeline (HATCH, PAWFILL, HILBERT, ...) takes CLOSED curves
# and fills what is inside. The image processors all went the other way - ASCII,
# POINTILLISM and SEPARATION each turn an image straight into marks - so there
# was no way to hatch a photograph. This is the missing link: image in, closed
# regions out, one set per tone band.
#
# Two outputs, and both are useful on their own:
#   out_crvs - every band boundary as linework. A posterised portrait in
#              outline, drawable as-is.
#   bands    - a tree, one branch per band, darkest first. Feed branch 0 into a
#              tight hatch, branch 2 into a loose one, branch 3 into PAWFILL.
#
# Bands are cut by DIFFERENCE, not by nesting. Contouring at a threshold gives
# "everything darker than L", so the bands would sit inside one another and any
# fill would be laid two, three, four times over the darkest areas - a blot on
# paper and a waste of plotting time. Subtracting the next threshold down leaves
# bands that tile the region exactly once.
#
# The sampling grid is padded with a border of background value so that every
# contour closes inside the grid. An unclosed chain is fine for CONTOUR, which
# only draws lines; here it would be a region with no inside.
#
# PROCESSOR CONTRACT: closed curves in (`crvs`) -> band boundaries out
# (`out_crvs`), plus `bands` as a tree.
# Inputs: crvs(list, closed), image(file path), nbands(int), detail(mm grid),
#         invert(bool), gamma(float, <1 opens shadows), inset(mm),
#         keep_edge(bool), on(bool bypass), frame(curve), crop(4 numbers)
import Rhino
import Rhino.Geometry as rg
import rhinoscriptsyntax as rs
import scriptcontext as sc
import math, clr, System
from System.Collections.Generic import List
import Grasshopper as gh
from Grasshopper import DataTree
from Grasshopper.Kernel.Data import GH_Path
try:
    sc.doc = ghdoc
except:
    pass

clr.AddReference("System.Drawing")
import System.Drawing as SD
clr.AddReferenceToFileAndPath(r"C:\Users\john.chandler\AppData\Roaming\McNeel\Rhinoceros\packages\7.0\Clipper2GH\1.3.2\Clipper2Lib.dll")
from Clipper2Lib import Paths64, Path64, Point64, Clipper, JoinType, EndType, FillRule

SCALE = 1000.0

NB = int(nbands) if nbands is not None else 4
if NB < 2: NB = 2
if NB > 10: NB = 10
DET = float(detail) if detail is not None else 1.2
if DET < 0.3: DET = 0.3
INV = False if invert is None else bool(invert)
# Blur radius in mm, applied to the sampled grid before contouring. Fur, hair
# and film grain sit right on the band thresholds and each speck becomes its own
# closed loop: an unsmoothed photo of a cat produced 675 regions, most of them
# smaller than the pen. Blurring first is what turns a photograph into shapes
# rather than confetti.
SMOOTH = float(smooth) if smooth is not None else 1.5
if SMOOTH < 0.0: SMOOTH = 0.0
# Drop regions below this area. Even after blurring there is a tail of specks;
# anything the pen cannot draw as a recognisable shape is just travel time and
# a dot of ink. Applies to holes as well as islands.
MINA = float(min_area) if min_area is not None else 4.0
if MINA < 0.0: MINA = 0.0
GAM = float(gamma) if gamma is not None else 1.0
if GAM < 0.1: GAM = 0.1
if GAM > 4.0: GAM = 4.0
# Crop as four fractions of the source image, left/top/right/bottom, origin at
# the TOP-LEFT because that is how a photograph is read and how every image
# editor reports a selection. Photographs almost never arrive framed the way the
# drawing wants them - this one is a cat with a third of the picture given over
# to a window - and cropping outside then re-exporting loses the link between
# the canvas and the file it came from. Empty or malformed means the whole image.
CROP = None
try:
    if crop is not None:
        _cv = [float(v) for v in crop]
        if len(_cv) == 4:
            cl = max(0.0, min(1.0, _cv[0])); ct = max(0.0, min(1.0, _cv[1]))
            cr = max(0.0, min(1.0, _cv[2])); cbm = max(0.0, min(1.0, _cv[3]))
            if cr - cl > 0.01 and cbm - ct > 0.01:
                CROP = (cl, ct, cr, cbm)
except:
    CROP = None
INS = float(inset) if inset is not None else 0.0
if INS < 0.0: INS = 0.0
EDGE = False if keep_edge is None else bool(keep_edge)
ON = True if on is None else bool(on)
IMG = None
if image is not None:
    try:
        IMG = str(image).strip('"')
    except:
        IMG = None

cs = []
n_open = 0
if crvs:
    for c in crvs:
        cc = c if isinstance(c, rg.Curve) else rs.coercecurve(c)
        if cc is None:
            continue
        if not cc.IsClosed:
            n_open += 1
            continue
        cs.append(cc)

out_crvs = []
bands = DataTree[object]()
info = ''

if not ON:
    out_crvs = cs
    info = '[BYPASSED]'
elif not cs:
    info = 'needs closed regions'
elif not IMG:
    info = 'needs an image file'
else:
    bmp = None
    try:
        bmp = SD.Bitmap(IMG)
    except:
        bmp = None
    if bmp is None:
        info = 'could not open %s' % IMG
    else:
        bb = rg.BoundingBox.Empty
        for c in cs:
            bb.Union(c.GetBoundingBox(True))
        x0 = bb.Min.X; y0 = bb.Min.Y
        wid = bb.Max.X - x0; hei = bb.Max.Y - y0
        nx = int(math.ceil(wid / DET)) + 1
        ny = int(math.ceil(hei / DET)) + 1
        # Hard cap. The grid is scanned once per band, so cost grows as
        # nx*ny*bands - at 700 square that is a quarter of a billion cell tests
        # in IronPython and the solve never returns.
        CAP = 340
        clipped = (nx > CAP or ny > CAP)
        if nx > CAP: nx = CAP
        if ny > CAP: ny = CAP
        sx = wid / float(nx); sy = hei / float(ny)

        # ---- downsample the image to the grid, once, in native code ----------
        # Point-sampling one pixel per grid node aliases badly on fur: a hard
        # edge lands on or between nodes and the band boundary crawls. Averaging
        # is what a photo needs - but doing it in Python via GetPixel is around
        # a million calls at this grid size and never returns. Drawing the image
        # into a grid-sized bitmap makes GDI+ do the filtering, then LockBits
        # reads the result in one go.
        # The crop is applied here, at the one place the image meets the grid:
        # everything downstream sees a picture of size iw x ih and neither knows
        # nor cares that it is a window onto a larger file.
        sxp = 0.0; syp = 0.0
        iw = bmp.Width; ih = bmp.Height
        if CROP is not None:
            sxp = CROP[0] * iw; syp = CROP[1] * ih
            iw = (CROP[2] - CROP[0]) * bmp.Width
            ih = (CROP[3] - CROP[1]) * bmp.Height
        else:
            iw = float(iw); ih = float(ih)
        # WHERE the photo sits is deliberately independent of the mask. Fitting
        # to the region's own bounding box seems natural until you swap a full
        # rectangle for a silhouette: the box narrows, the photo is re-fitted
        # into it, and every feature slides off the shape it belonged to. Pass
        # the original picture rectangle as `frame` and the mask can then be any
        # shape without moving the image. Falls back to the region box when no
        # frame is given, which is right for the simple full-bleed case.
        fx0 = x0; fy0 = y0; fw = wid; fh = hei
        if frame is not None:
            try:
                fc = frame if isinstance(frame, rg.Curve) else rs.coercecurve(frame)
                if fc is not None:
                    fbb = fc.GetBoundingBox(True)
                    fx0 = fbb.Min.X; fy0 = fbb.Min.Y
                    fw = fbb.Max.X - fx0; fh = fbb.Max.Y - fy0
            except:
                pass
        sc_img = min(fw / float(iw), fh / float(ih))     # contain, centred
        dw = iw * sc_img; dh = ih * sc_img
        ox = fx0 + (fw - dw) * 0.5
        oy = fy0 + (fh - dh) * 0.5
        gw = nx + 1; gh_ = ny + 1
        small = SD.Bitmap(gw, gh_, SD.Imaging.PixelFormat.Format24bppRgb)
        gfx = SD.Graphics.FromImage(small)
        gfx.Clear(SD.Color.White)            # outside the photo reads as white
        gfx.InterpolationMode = SD.Drawing2D.InterpolationMode.HighQualityBicubic
        dx0 = (ox - x0) / sx
        dy0 = (oy - y0) / sy
        dxw = dw / sx
        dyh = dh / sy
        # model Y runs up, image Y runs down: flip by drawing bottom-anchored
        gfx.DrawImage(bmp, SD.RectangleF(float(dx0), float(gh_ - dy0 - dyh),
                                         float(dxw), float(dyh)),
                      SD.RectangleF(float(sxp), float(syp),
                                    float(iw), float(ih)),
                      SD.GraphicsUnit.Pixel)
        gfx.Dispose()
        bmp.Dispose()
        from System.Drawing.Imaging import ImageLockMode, PixelFormat
        from System.Runtime.InteropServices import Marshal
        dat = small.LockBits(SD.Rectangle(0, 0, gw, gh_), ImageLockMode.ReadOnly,
                             PixelFormat.Format24bppRgb)
        stride = dat.Stride
        nbytes = abs(stride) * gh_
        buf = System.Array.CreateInstance(System.Byte, nbytes)
        Marshal.Copy(dat.Scan0, buf, 0, nbytes)
        small.UnlockBits(dat)
        small.Dispose()
        L = []
        for j in range(gh_):
            row = []
            ro = (gh_ - 1 - j) * stride      # row 0 of L is the BOTTOM of the image
            for i in range(gw):
                b = buf[ro + i*3]; g_ = buf[ro + i*3 + 1]; r = buf[ro + i*3 + 2]
                row.append((0.299*r + 0.587*g_ + 0.114*b) / 255.0)
            L.append(row)

        # ---- blur the sampled grid ------------------------------------------
        # Separable box blur, three passes, which approximates a Gaussian well
        # enough and costs O(n) per pass instead of O(r^2) per pixel.
        rad = int(round(SMOOTH / max(sx, sy)))
        if rad > 0:
            for _pass in range(3):
                for j in range(gh_):
                    row = L[j]
                    acc = []
                    run = 0.0
                    for i in range(gw):
                        run += row[i]
                        acc.append(run)
                    nr = []
                    for i in range(gw):
                        a = i - rad - 1; b = i + rad
                        if b > gw - 1: b = gw - 1
                        hi_ = acc[b]
                        lo_ = acc[a] if a >= 0 else 0.0
                        nr.append((hi_ - lo_) / float(b - (a if a >= 0 else -1)))
                    L[j] = nr
                for i in range(gw):
                    acc = []
                    run = 0.0
                    for j in range(gh_):
                        run += L[j][i]
                        acc.append(run)
                    for j in range(gh_):
                        a = j - rad - 1; b = j + rad
                        if b > gh_ - 1: b = gh_ - 1
                        hi_ = acc[b]
                        lo_ = acc[a] if a >= 0 else 0.0
                        L[j][i] = (hi_ - lo_) / float(b - (a if a >= 0 else -1))

        # region membership on the same grid
        plane = rg.Plane.WorldXY
        tol = 0.001
        regions = cs
        M = []
        for j in range(ny + 1):
            mrow = []
            py = y0 + j * sy
            for i in range(nx + 1):
                p3 = rg.Point3d(x0 + i * sx, py, 0)
                hits = 0
                for c in regions:
                    if c.Contains(p3, plane, tol) == rg.PointContainment.Inside:
                        hits += 1
                mrow.append((hits % 2) == 1)
            M.append(mrow)

        # auto-levels across what is actually inside the region, so a photo that
        # never reaches black or white still uses every band
        lo = 1e9; hi = -1e9
        for j in range(ny + 1):
            for i in range(nx + 1):
                if M[j][i]:
                    if L[j][i] < lo: lo = L[j][i]
                    if L[j][i] > hi: hi = L[j][i]
        if hi <= lo:
            hi = lo + 1e-6
        for j in range(ny + 1):
            for i in range(nx + 1):
                t = (L[j][i] - lo) / (hi - lo)
                if t < 0.0: t = 0.0
                if t > 1.0: t = 1.0
                if GAM != 1.0:
                    t = math.pow(t, GAM)
                L[j][i] = (1.0 - t) if INV else t

        # ---- pad the grid with a ring of "light" ------------------------------
        # Without this, a dark area running off the edge of the photo produces an
        # OPEN chain, and closing it later joins its two ends with a straight
        # line across the picture - which is why the first attempt on a
        # full-bleed photo came back as two flat shades instead of a cat. One
        # ring of maximum-value nodes guarantees every contour closes inside the
        # grid, and it closes along the picture edge where it belongs.
        PADV = 1.0
        for j in range(len(L)):
            L[j].insert(0, PADV)
            L[j].append(PADV)
        L.insert(0, [PADV] * (len(L[0])))
        L.append([PADV] * (len(L[0])))
        nx = nx + 2
        ny = ny + 2
        x0 = x0 - sx
        y0 = y0 - sy

        TABLE = {0: [], 1: [(0, 3)], 2: [(0, 1)], 3: [(1, 3)], 4: [(1, 2)],
                 5: [(0, 3), (1, 2)], 6: [(0, 2)], 7: [(2, 3)], 8: [(2, 3)],
                 9: [(0, 2)], 10: [(0, 1), (2, 3)], 11: [(1, 2)], 12: [(1, 3)],
                 13: [(0, 1)], 14: [(0, 3)], 15: []}

        # region as Clipper paths, used to trim every band
        rpaths = Paths64()
        for c in regions:
            plc = c.ToPolyline(0.05, 0.2, 0.01, 1e6)
            if plc is None: continue
            pth = Path64()
            for i in range(plc.PointCount - 1):
                p = plc.Point(i)
                pth.Add(Point64(int(round(p.X*SCALE)), int(round(p.Y*SCALE))))
            rpaths.Add(pth)
        rpaths = Clipper.Union(rpaths, FillRule.EvenOdd)
        if INS > 0.01:
            sh = Clipper.InflatePaths(rpaths, -INS*SCALE, JoinType.Round, EndType.Polygon)
            if sh is not None and sh.Count > 0:
                rpaths = sh

        # ---- one closed contour set per threshold ----------------------------
        # threshold k separates band k-1 from band k; darkest first
        prev = None
        nseg = 0
        for k in range(NB):
            if k == NB - 1:
                cur = None                    # lightest band is "the remainder"
            else:
                lev = (k + 1) / float(NB)
                segs = []
                for j in range(ny):
                    for i in range(nx):
                        v00 = L[j][i]; v10 = L[j][i+1]
                        v11 = L[j+1][i+1]; v01 = L[j+1][i]
                        idx = 0
                        if v00 > lev: idx |= 1
                        if v10 > lev: idx |= 2
                        if v11 > lev: idx |= 4
                        if v01 > lev: idx |= 8
                        pairs = TABLE[idx]
                        if not pairs: continue
                        ax = x0 + i*sx; ay = y0 + j*sy
                        bx = ax + sx; by = ay + sy
                        ept = {}
                        if abs(v10-v00) > 1e-12: ept[0] = (ax + (lev-v00)/(v10-v00)*sx, ay)
                        if abs(v11-v10) > 1e-12: ept[1] = (bx, ay + (lev-v10)/(v11-v10)*sy)
                        if abs(v11-v01) > 1e-12: ept[2] = (ax + (lev-v01)/(v11-v01)*sx, by)
                        if abs(v01-v00) > 1e-12: ept[3] = (ax, ay + (lev-v00)/(v01-v00)*sy)
                        for pr in pairs:
                            if pr[0] in ept and pr[1] in ept:
                                _a = ept[pr[0]]; _b = ept[pr[1]]
                                if (_a[0]-_b[0])**2 + (_a[1]-_b[1])**2 > 1e-10:
                                    segs.append((_a, _b))
                nseg += len(segs)
                # chain into loops
                q = min(sx, sy) * 0.25
                if q < 1e-6: q = 1e-6
                endmap = {}
                for si in range(len(segs)):
                    for e in (0, 1):
                        p = segs[si][e]
                        key = (int(round(p[0]/q)), int(round(p[1]/q)))
                        if key not in endmap: endmap[key] = []
                        endmap[key].append((si, e))
                used = [False]*len(segs)
                cur = Paths64()
                for si in range(len(segs)):
                    if used[si]: continue
                    used[si] = True
                    chain = [segs[si][0], segs[si][1]]
                    for endsel in (1, 0):
                        grew = True
                        while grew:
                            grew = False
                            p = chain[-1] if endsel == 1 else chain[0]
                            key = (int(round(p[0]/q)), int(round(p[1]/q)))
                            if key not in endmap: continue
                            for pair in endmap[key]:
                                sj = pair[0]; ej = pair[1]
                                if used[sj]: continue
                                used[sj] = True
                                oth = segs[sj][1-ej]
                                if endsel == 1: chain.append(oth)
                                else: chain.insert(0, oth)
                                grew = True
                                break
                    if len(chain) < 4: continue
                    pth = Path64()
                    last = None
                    for pnt in chain:
                        key = (int(round(pnt[0]*SCALE)), int(round(pnt[1]*SCALE)))
                        if key == last: continue
                        pth.Add(Point64(key[0], key[1]))
                        last = key
                    if pth.Count >= 3:
                        cur.Add(pth)
                if cur.Count:
                    cur = Clipper.Union(cur, FillRule.EvenOdd)

            # band k = (everything darker than this threshold) minus the band
            # already claimed by the darker thresholds
            if cur is None:
                band = Clipper.Difference(rpaths, prev, FillRule.NonZero) if prev is not None else rpaths
            else:
                inside = Clipper.Intersect(cur, rpaths, FillRule.NonZero)
                if prev is None:
                    band = inside
                else:
                    band = Clipper.Difference(inside, prev, FillRule.NonZero)
                prev = inside
            pathk = GH_Path(k)
            made = 0
            dropped = 0
            if band is not None:
                for pth in band:
                    if pth.Count < 3: continue
                    if MINA > 0.0:
                        # Clipper area is signed (holes wind the other way), so
                        # test the magnitude - a speck is a speck either way
                        a_mm = abs(Clipper.Area(pth)) / (SCALE * SCALE)
                        if a_mm < MINA:
                            dropped += 1
                            continue
                    lp = List[rg.Point3d]()
                    for pt in pth:
                        lp.Add(rg.Point3d(pt.X/SCALE, pt.Y/SCALE, 0))
                    lp.Add(rg.Point3d(pth[0].X/SCALE, pth[0].Y/SCALE, 0))
                    pc = rg.PolylineCurve(lp)
                    bands.Add(pc, pathk)
                    out_crvs.append(pc)
                    made += 1
            if made == 0:
                bands.AddRange([], pathk)

        if EDGE:
            for c in cs:
                out_crvs.append(c)
        counts = []
        for k in range(NB):
            counts.append(str(bands.Branch(GH_Path(k)).Count))
        info = '%d bands (darkest first): %s curves | grid %dx%d, blur %.1fmm (%d cells), min area %.1fmm2 | levels %.2f-%.2f' % (
            NB, '/'.join(counts), nx, ny, SMOOTH, rad, MINA, lo, hi)
        if CROP is not None:
            info += ' | crop %.2f,%.2f-%.2f,%.2f' % CROP
        if clipped:
            info += ' | GRID CAPPED at %d - raise `detail` for a coarser but faster pass' % CAP
        if n_open:
            info += ' | %d open curve(s) skipped' % n_open

print(info)
# ---------- end tone ----------

# ----
genes = GenePool(Decimals=2, Maximum=100, Minimum=0, Value=[50, 50, 50, 50, 50, 50, 50, 50, 50, 50])

# ---- group: PROCESSOR - PAW PRINTS closed regions -> scattered cat-paw motifs
paw_fill_inset_mm_0_outline = Slider(0, range=0..3)
paw_pitch_mm_0_auto = Slider(0, range=0..60)
paw_size_variation_0_1 = Slider(0.18, range=0..0.9)
paw_jitter_0_1 = Slider(0.45, range=0..1)
paw_spin_deg = Slider(360, range=0..360)
paw_size_mm = Slider(14, range=4..40)
pawfill_on_off_passthrough = PAWFILLOnOffPassthrough(True)
paw_keep_region_outline = BooleanToggle(True)
paw_seed = Slider(3, range=1..999)
pawfill = PAWFILL(
    size=paw_size_mm,
    spacing=paw_pitch_mm_0_auto,
    jitter=paw_jitter_0_1,
    spin=paw_spin_deg,
    vary=paw_size_variation_0_1,
    fill=paw_fill_inset_mm_0_outline,
    seed=paw_seed,
    keep_edge=paw_keep_region_outline,
    on=pawfill_on_off_passthrough)  # -> out, out_crvs; inputs crvs: list; disabled
# ---------- pawfill: Python ----------
# PAW FILL processor - scatters cat-paw prints across CLOSED regions.
#
# A motif fill rather than a line fill: instead of covering the region with
# strokes, it tiles it with one repeated drawn shape. Same contract as the other
# region fills, so it chains with them - hatch a shape, then paw-print over it.
#
# Each paw is 5 closed curves (heel pad + 4 toes), drawn as OUTLINES because
# that is what a pen actually does. Set `fill` above zero to add concentric
# insets inside each pad and darken them toward the solid look of the source
# artwork.
#
# Placement is a staggered grid with jitter rather than pure random scatter.
# Pure random clumps - it puts two paws on top of each other and leaves holes
# elsewhere - and on a plotter a clump is not just ugly, it is a blot where the
# pen goes over the same paper repeatedly. The grid guarantees the spacing and
# the jitter removes the regularity.
#
# Paws are kept WHOLE: a candidate is dropped unless it fits entirely inside the
# region. Clipping a paw at the boundary leaves recognisable fragments (half a
# toe, a sliced heel) that read as mistakes, where a missing paw reads as
# deliberate spacing.
#
# PROCESSOR CONTRACT: closed curves in (`crvs`) -> paw linework out (`out_crvs`).
# Inputs: crvs(list, closed), size(mm, paw height), spacing(mm, grid pitch),
#         jitter(0..1), spin(deg, random rotation range), vary(0..1, size
#         variation), fill(mm, 0 = outline only), seed(int), keep_edge(bool),
#         on(bool bypass)
import Rhino
import Rhino.Geometry as rg
import rhinoscriptsyntax as rs
import scriptcontext as sc
import math, clr
from System.Collections.Generic import List
try:
    sc.doc = ghdoc
except:
    pass

_HAVE_CLIP = False
try:
    clr.AddReferenceToFileAndPath(r"C:\Users\john.chandler\AppData\Roaming\McNeel\Rhinoceros\packages\7.0\Clipper2GH\1.3.2\Clipper2Lib.dll")
    from Clipper2Lib import Paths64, Path64, Point64, Clipper, JoinType, EndType, FillRule
    _HAVE_CLIP = True
except:
    _HAVE_CLIP = False

SIZE = float(size) if size is not None else 12.0
if SIZE < 1.0:
    SIZE = 1.0
# 0 means auto, not zero pitch. A slider cannot send "blank", so the value that
# would otherwise be meaningless is the one that asks for the default.
SP = float(spacing) if spacing is not None else 0.0
if SP <= 0.0:
    SP = SIZE * 1.55
if SP < SIZE * 0.6:
    SP = SIZE * 0.6          # below this they collide however the jitter falls
JIT = float(jitter) if jitter is not None else 0.45
if JIT < 0.0: JIT = 0.0
if JIT > 1.0: JIT = 1.0
SPIN = float(spin) if spin is not None else 360.0
VARY = float(vary) if vary is not None else 0.18
if VARY < 0.0: VARY = 0.0
if VARY > 0.9: VARY = 0.9
FILL = float(fill) if fill is not None else 0.0
if FILL < 0.0: FILL = 0.0
SEED = int(seed) if seed is not None else 1
EDGE = True if keep_edge is None else bool(keep_edge)
ON = True if on is None else bool(on)

# Deterministic LCG. Python's `random` carries state between solves, so the
# same definition would re-scatter every time anything upstream changed - and a
# plot you have half-drawn must not move because you nudged a slider.
_rs = [(SEED * 1103515245 + 12345) & 0x7fffffff]
def _rnd():
    _rs[0] = (_rs[0] * 1103515245 + 12345) & 0x7fffffff
    return _rs[0] / float(0x7fffffff)

# ---- the motif ---------------------------------------------------------------
# Heel is a rounded triangle, apex up. An earlier version dipped the top-centre
# control point inward to suggest the lobes a real pad has; interpolated through
# only ten points that read as a notch bitten out of the pad, not as a lobe. At
# 12mm drawn with a 0.3mm nib none of that detail survives anyway, so the shape
# is kept clean and the silhouette does the work.
# Twelve points rather than ten, with a close pair either side of the apex, so
# the interpolation rounds the top instead of driving it to a spike. A pointed
# pad reads as a leaf; the blunt apex is what makes it a paw.
_HEEL = [(0.00, 0.00), (0.08, -0.03), (0.19, -0.17), (0.28, -0.35),
         (0.26, -0.47), (0.14, -0.52), (0.00, -0.53), (-0.14, -0.52),
         (-0.26, -0.47), (-0.28, -0.35), (-0.19, -0.17), (-0.08, -0.03)]
# (angle from vertical, toe half-width, toe half-height). Middle toes sit
# higher and larger than the outer pair, which is what makes it read as a paw
# rather than four dots on an arc.
#
# Sized and spread so adjacent toes do not touch. Overlapping toes are not just
# ugly here: every crossing is a spot the pen inks twice, which on absorbent
# paper blots and on the plot itself doubles the travel.
_TOES = [(-63.0, 0.062, 0.085), (-23.0, 0.070, 0.095),
         (23.0, 0.070, 0.095), (63.0, 0.062, 0.085)]
_TOE_R = 0.34
_TOE_Y = -0.10

def _paw_unit():
    """the 5 closed curves of one paw, normalised to 1.0 tall about the origin"""
    out = []
    pts = List[rg.Point3d]()
    for (x, y) in _HEEL:
        pts.Add(rg.Point3d(x, y, 0))
    pts.Add(rg.Point3d(_HEEL[0][0], _HEEL[0][1], 0))
    # PERIODIC closure. A plain interpolated curve joined with MakeClosed meets
    # itself at the seam without matching tangents, which put a visible cusp
    # right on the apex - the most looked-at point of the whole motif. Periodic
    # knots make the seam continuous, so where it starts stops mattering.
    heel = None
    try:
        heel = rg.Curve.CreateInterpolatedCurve(pts, 3, rg.CurveKnotStyle.ChordPeriodic)
    except:
        heel = None
    if heel is None:
        heel = rg.Curve.CreateInterpolatedCurve(pts, 3)
        if heel is not None:
            heel.MakeClosed(0.001)
    if heel is not None:
        out.append(heel)
    for (adeg, rx, ry) in _TOES:
        a = math.radians(adeg)
        cx = _TOE_R * math.sin(a)
        cy = _TOE_Y + _TOE_R * math.cos(a)
        pl = rg.Plane(rg.Point3d(cx, cy, 0), rg.Vector3d.ZAxis)
        pl.Rotate(a, rg.Vector3d.ZAxis, rg.Point3d(cx, cy, 0))
        out.append(rg.Ellipse(pl, rx, ry).ToNurbsCurve())
    # Normalise so `size` genuinely means the drawn height in mm. Without this
    # the control points quietly set the scale, and every tweak to the motif
    # would change what the size slider meant.
    bb = rg.BoundingBox.Empty
    for c in out:
        bb.Union(c.GetBoundingBox(True))
    h = bb.Max.Y - bb.Min.Y
    if h > 0.001:
        k = 1.0 / h
        cy = (bb.Max.Y + bb.Min.Y) * 0.5
        xf = (rg.Transform.Scale(rg.Plane.WorldXY, k, k, 1.0)
              * rg.Transform.Translation(0, -cy, 0))
        for c in out:
            c.Transform(xf)
    return out

_UNIT = _paw_unit()

cs = []
n_open = 0
if crvs:
    for c in crvs:
        cc = c if isinstance(c, rg.Curve) else rs.coercecurve(c)
        if cc is None:
            continue
        if not cc.IsClosed:
            n_open += 1
            continue
        cs.append(cc)

def _inside(px, py):
    """even-odd across every region curve, so a closed curve nested inside
    another is a hole and gets no paws - same convention as HATCH"""
    hits = 0
    p = rg.Point3d(px, py, 0)
    for c in cs:
        try:
            if c.Contains(p, rg.Plane.WorldXY, 0.001) == rg.PointContainment.Inside:
                hits += 1
        except:
            pass
    return (hits % 2) == 1

out_crvs = []
info = ''
n_paw = 0
n_drop = 0
if not ON:
    out_crvs = cs
    info = '[BYPASSED]'
elif not cs:
    info = 'needs closed regions'
else:
    if EDGE:
        for c in cs:
            out_crvs.append(c)
    bb = rg.BoundingBox.Empty
    for c in cs:
        bb.Union(c.GetBoundingBox(True))
    # radius that certainly contains a paw at full jittered size, used both to
    # test containment and to keep the grid clear of the boundary
    rmax = 0.52 * SIZE * (1.0 + VARY)
    nx = int((bb.Max.X - bb.Min.X) / SP) + 2
    ny = int((bb.Max.Y - bb.Min.Y) / (SP * 0.87)) + 2
    for iy in range(ny):
        for ix in range(nx):
            # staggered rows: half a pitch every other row, which is how a
            # hex packing beats a square grid for looking unplanned
            sx = bb.Min.X + (ix + (0.5 if (iy % 2) else 0.0)) * SP
            sy = bb.Min.Y + iy * SP * 0.87
            px = sx + (_rnd() - 0.5) * SP * JIT
            py = sy + (_rnd() - 0.5) * SP * JIT
            rot = math.radians(_rnd() * SPIN)
            scl = SIZE * (1.0 + (_rnd() - 0.5) * 2.0 * VARY)
            # cheap reject first: centre out of the region, or too close to the
            # edge for the whole paw to fit
            if not _inside(px, py):
                n_drop += 1
                continue
            ok = True
            for k in range(12):
                a = k * math.pi / 6.0
                if not _inside(px + rmax*math.cos(a), py + rmax*math.sin(a)):
                    ok = False
                    break
            if not ok:
                n_drop += 1
                continue
            xf = (rg.Transform.Translation(px, py, 0)
                  * rg.Transform.Rotation(rot, rg.Vector3d.ZAxis, rg.Point3d(0, 0, 0))
                  * rg.Transform.Scale(rg.Plane.WorldXY, scl, scl, 1.0))
            pads = []
            for u in _UNIT:
                d = u.DuplicateCurve()
                d.Transform(xf)
                pads.append(d)
                out_crvs.append(d)
            n_paw += 1
            # ---- optional concentric darkening inside each pad ----
            if FILL > 0.01 and _HAVE_CLIP:
                SCALE = 1000.0
                for pad in pads:
                    paths = Paths64()
                    plc = pad.ToPolyline(0.05, 0.2, 0.01, 1e6)
                    if plc is None:
                        continue
                    path = Path64()
                    for i in range(plc.PointCount - 1):
                        q = plc.Point(i)
                        path.Add(Point64(int(round(q.X*SCALE)), int(round(q.Y*SCALE))))
                    paths.Add(path)
                    paths = Clipper.Union(paths, FillRule.EvenOdd)
                    d = FILL
                    rounds = 0
                    while rounds < 200:
                        sh = Clipper.InflatePaths(paths, -d*SCALE, JoinType.Round, EndType.Polygon)
                        if sh is None or sh.Count == 0:
                            break
                        for pth in sh:
                            if pth.Count < 3:
                                continue
                            ip = List[rg.Point3d]()
                            for pt in pth:
                                ip.Add(rg.Point3d(pt.X/SCALE, pt.Y/SCALE, 0))
                            ip.Add(rg.Point3d(pth[0].X/SCALE, pth[0].Y/SCALE, 0))
                            out_crvs.append(rg.PolylineCurve(ip))
                        d += FILL
                        rounds += 1
    info = '%d paws, %d rejected for not fitting | size %.1fmm pitch %.1fmm jitter %.2f' % (
        n_paw, n_drop, SIZE, SP, JIT)
    if FILL > 0.01 and not _HAVE_CLIP:
        info += ' | FILL IGNORED: Clipper2 not loaded, outlines only'
    if n_open:
        info += ' | %d open curve(s) skipped' % n_open
    if n_paw == 0:
        info += ' | nothing placed - region may be smaller than one paw'

print(info)
# ---------- end pawfill ----------

# ---- group: PATTERN - WARPED MESH
dot_regularity_0_loose_1_strict = Slider(0.6, range=0..1)
attractor_reach_mm = Slider(15, range=5..120)
grid_spacing_mm = Slider(2, range=2..12)
attractor_strength = Slider(43.3, range=0..120)
rows_lines = Slider(60, range=5..60)
cols_lines = Slider(75, range=10..100)
gen = GhPythonScript(
    rows=rows_lines,
    spacing=grid_spacing_mm,
    cols=cols_lines,
    strength=attractor_strength,
    falloff=attractor_reach_mm,
    dot_reg=dot_regularity_0_loose_1_strict)  # -> out, crvs, pts
#   port rows: How many horizontal lines the mesh is built from. More rows = denser weave and a longer plot.
# ---------- gen: Python ----------
import Rhino.Geometry as rg
import math
from System.Collections.Generic import List
R = int(rows) if rows else 30
C = int(cols) if cols else 50
SP = float(spacing) if spacing else 5.0
STR = float(strength) if strength is not None else 50.0
FO = float(falloff) if falloff else 45.0
T = float(dot_reg) if dot_reg is not None else 0.5
if T < 0.0: T = 0.0
if T > 1.0: T = 1.0
W = (C-1)*SP; H = (R-1)*SP
att = [rg.Point3d(0.30*W,0.65*H,0), rg.Point3d(0.72*W,0.28*H,0), rg.Point3d(0.50*W,0.50*H,0)]
grid = []
for r in range(R):
    rowpts = []
    for c in range(C):
        x = c*SP; y = r*SP
        ddx = 0.0; ddy = 0.0
        for A in att:
            vx = x - A.X; vy = y - A.Y
            w = STR * math.exp(-(vx*vx+vy*vy)/(FO*FO))
            ddx += (vx/FO)*w; ddy += (vy/FO)*w
        rowpts.append(rg.Point3d(x+ddx, y+ddy, 0))
    grid.append(rowpts)
crvs = []
for r in range(R):
    pl = List[rg.Point3d]()
    for c in range(C): pl.Add(grid[r][c])
    cv = rg.Curve.CreateInterpolatedCurve(pl, 3)
    if cv: crvs.append(cv)
for c in range(C):
    pl = List[rg.Point3d]()
    for r in range(R): pl.Add(grid[r][c])
    cv = rg.Curve.CreateInterpolatedCurve(pl, 3)
    if cv: crvs.append(cv)
a = crvs
# ---- cell centers, filtered to regular-ish cells ----
# thresholds from regularity T: stricter T -> rounder, more uniform cells only
# dots go in OPEN cells (stretched bulge interiors) and are culled from
# COMPRESSED zones (dense pile-up rings): min cell size is the main filter,
# no upper size cap. Shape checks still cull sheared/folded transition cells.
er_min = 0.2 + 0.3*T        # min short/long edge ratio (shape quality)
ar_lo = 0.5 + 0.5*T         # min area vs nominal: compressed cells get no dot
nomA = SP*SP
pts = []
kept = 0; total = 0
for r in range(R-1):
    for c in range(C-1):
        total += 1
        q = [grid[r][c], grid[r][c+1], grid[r+1][c+1], grid[r+1][c]]
        e = []
        bad = False
        for i in range(4):
            a_ = q[i]; b_ = q[(i+1)%4]
            el = math.sqrt((b_.X-a_.X)*(b_.X-a_.X)+(b_.Y-a_.Y)*(b_.Y-a_.Y))
            if el < 1e-6: bad = True
            e.append(el)
        if bad: continue
        if min(e)/max(e) < er_min: continue
        area = 0.0
        for i in range(4):
            a_ = q[i]; b_ = q[(i+1)%4]
            area += a_.X*b_.Y - b_.X*a_.Y
        area = area/2.0
        if area <= 0: continue     # flipped/overlapping cell
        convex = True; s0 = 0
        for i in range(4):
            a_ = q[i]; b_ = q[(i+1)%4]; c_ = q[(i+2)%4]
            cr = (b_.X-a_.X)*(c_.Y-b_.Y) - (b_.Y-a_.Y)*(c_.X-b_.X)
            if abs(cr) < 1e-9: continue
            sgn = 1 if cr > 0 else -1
            if s0 == 0: s0 = sgn
            elif sgn != s0:
                convex = False; break
        if not convex: continue
        ar = area/nomA
        if ar < ar_lo: continue
        pts.append(rg.Point3d((q[0].X+q[1].X+q[2].X+q[3].X)/4.0, (q[0].Y+q[1].Y+q[2].Y+q[3].Y)/4.0, 0))
        kept += 1
print('cells: %d/%d kept (regularity %.2f)' % (kept, total, T))
# output param renamed a -> crvs; alias so GhPython finds it
crvs = a
# ---------- end gen ----------

# ---- group: BORDER / FRAME a rule around the artwork - drawn in artwork space so it lands with the picture
frame_inset_mm_ve_outside = Slider(-6, range=-40..40)
frame_corner_radius_mm = Slider(0, range=0..30)
frame_corners = FrameCorners({"plain": 0, "corner ticks": 1, "crosses": 2, "open corners (crop marks)": 3}, selected="plain")
frame_tick_gap_mm = Slider(4, range=0..30)
frame_rule_gap_mm = Slider(2, range=0..20)
frame_rules = Slider(2, range=1..8)
frame = FRAME(
    rect=image_frame_art_rect_mm,
    inset=frame_inset_mm_ve_outside,
    lines=frame_rules,
    gap=frame_rule_gap_mm,
    radius=frame_corner_radius_mm,
    corners=frame_corners,
    tick=frame_tick_gap_mm)  # -> out, out_crvs
# ---------- frame: Python ----------
# BORDER / FRAME - a tunable rule around the artwork.
#
# Every plot that reads as a finished print has one, and until now it meant
# hand-drawing a rectangle in Rhino and internalising it - which meant it never
# tracked the artwork when the size or the placement changed. This takes the
# same rect the image processors already use and draws a proper border from it,
# so the frame and the picture stay in step by construction.
#
# Drawn in ARTWORK space, before PLACE. That is deliberate: the frame is part of
# the drawing, so it scales, rotates and lands with everything else. A border
# generated after placement would sit in machine coordinates and drift off the
# page the moment `fit to paper` changed.
#
#   inset   mm in from the rect edge. NEGATIVE pushes the frame outside it, which
#           is usually what you want - a border touching the artwork looks like
#           a mistake.
#   lines   how many concentric rules
#   gap     mm between them
#   radius  corner radius, 0 = square
#   corners 0 plain | 1 corner ticks | 2 crosses | 3 open corners (crop marks)
#   tick    length in mm of the ticks, crosses, or the corner gap in mode 3
#
# PROCESSOR CONTRACT: a rect in, border curves out (`out_crvs`) -> a LAYER slot.
# Inputs: rect(curve), inset(mm), lines(int), gap(mm), radius(mm),
#         corners(int 0-3), tick(mm), on(bool bypass)
import Rhino.Geometry as rg
import rhinoscriptsyntax as rs
import scriptcontext as sc
try:
    sc.doc = ghdoc
except:
    pass

ON = True if on is None else bool(on)
INSET = float(inset) if inset is not None else -6.0
N = int(lines) if lines is not None else 2
if N < 1: N = 1
if N > 12: N = 12
GAP = float(gap) if gap is not None else 2.0
if GAP < 0.0: GAP = 0.0
RAD = float(radius) if radius is not None else 0.0
if RAD < 0.0: RAD = 0.0
CORN = int(corners) if corners is not None else 0
if CORN < 0: CORN = 0
if CORN > 3: CORN = 3
TICK = float(tick) if tick is not None else 4.0
if TICK < 0.0: TICK = 0.0

out_crvs = []
info = ''

rc = None
if rect is not None:
    rc = rect if isinstance(rect, rg.Curve) else rs.coercecurve(rect)

if not ON:
    info = '[BYPASSED]'
elif rc is None:
    info = 'needs a rect (wire the artwork frame)'
else:
    bb = rc.GetBoundingBox(True)
    x0 = bb.Min.X; y0 = bb.Min.Y; x1 = bb.Max.X; y1 = bb.Max.Y
    made = 0
    skipped = 0
    for i in range(N):
        d = INSET + i * GAP
        ax0 = x0 + d; ay0 = y0 + d; ax1 = x1 - d; ay1 = y1 - d
        w = ax1 - ax0; h = ay1 - ay0
        # An inset deep enough to invert the rect would fold the border inside
        # out. Stop rather than emit a knot the pen has to draw.
        if w <= 0.5 or h <= 0.5:
            skipped += 1
            continue
        if CORN == 3:
            # open corners: four separate rules, each held back from the corner
            t = TICK
            if t * 2.0 >= w: t = (w - 0.5) / 2.0
            if t * 2.0 >= h: t = min(t, (h - 0.5) / 2.0)
            if t < 0.0: t = 0.0
            segs = [((ax0 + t, ay0), (ax1 - t, ay0)),
                    ((ax1, ay0 + t), (ax1, ay1 - t)),
                    ((ax1 - t, ay1), (ax0 + t, ay1)),
                    ((ax0, ay1 - t), (ax0, ay0 + t))]
            for a, b in segs:
                ln = rg.LineCurve(rg.Point3d(a[0], a[1], 0), rg.Point3d(b[0], b[1], 0))
                out_crvs.append(ln); made += 1
        else:
            pl = rg.Polyline([rg.Point3d(ax0, ay0, 0), rg.Point3d(ax1, ay0, 0),
                              rg.Point3d(ax1, ay1, 0), rg.Point3d(ax0, ay1, 0),
                              rg.Point3d(ax0, ay0, 0)])
            crv = pl.ToNurbsCurve()
            if RAD > 0.0:
                r = RAD
                if r > (w / 2.0 - 0.1): r = w / 2.0 - 0.1
                if r > (h / 2.0 - 0.1): r = h / 2.0 - 0.1
                if r > 0.0:
                    f = rg.Curve.CreateFilletCornersCurve(crv, r, 0.001, 0.001)
                    if f is not None:
                        crv = f
            out_crvs.append(crv); made += 1
            if CORN in (1, 2) and i == 0:
                # ticks / crosses ride on the OUTERMOST rule only - repeating them
                # on every concentric line reads as noise, not as a corner mark
                for cx, cy, sx, sy in ((ax0, ay0, -1.0, -1.0), (ax1, ay0, 1.0, -1.0),
                                       (ax1, ay1, 1.0, 1.0), (ax0, ay1, -1.0, 1.0)):
                    out_crvs.append(rg.LineCurve(
                        rg.Point3d(cx, cy, 0), rg.Point3d(cx + sx * TICK, cy, 0)))
                    out_crvs.append(rg.LineCurve(
                        rg.Point3d(cx, cy, 0), rg.Point3d(cx, cy + sy * TICK, 0)))
                    made += 2
                    if CORN == 2:
                        out_crvs.append(rg.LineCurve(
                            rg.Point3d(cx - sx * TICK, cy, 0), rg.Point3d(cx, cy, 0)))
                        out_crvs.append(rg.LineCurve(
                            rg.Point3d(cx, cy - sy * TICK, 0), rg.Point3d(cx, cy, 0)))
                        made += 2
    STYLE = ['plain', 'corner ticks', 'crosses', 'open corners']
    info = 'FRAME: %d curves | %d rule(s) inset %.1f gap %.1f, %s' % (
        len(out_crvs), N - skipped, INSET, GAP, STYLE[CORN])
    if RAD > 0.0:
        info += ', radius %.1f' % RAD
    if skipped:
        info += ' | %d rule(s) dropped - inset deeper than the rect is wide' % skipped
    if INSET > 0.0:
        info += ' | inset is POSITIVE so the frame sits INSIDE the artwork'
print(info)
# ---------- end frame ----------

# ---- group: PROCESSOR - CONTOUR / ISO-LINES noise terrain -> topographic linework
contour_hill_scale_mm = Slider(45, range=2..200)
contour_detail_mm = Slider(1.5, range=0.4..6)
contour_inset_mm = Slider(0.75, range=0..5)
contour_levels = Slider(12, range=1..60)
contour_seed = Slider(1, range=1..100)
contour_on_off_passthrough = CONTOUROnOffPassthrough(True)
contour_keep_edge = BooleanToggle(True)
contour = GhPythonScript(
    crvs=tone.bands,
    levels=contour_levels,
    scale=contour_hill_scale_mm,
    detail=contour_detail_mm,
    seed=contour_seed,
    inset=contour_inset_mm,
    keep_edge=contour_keep_edge,
    on=contour_on_off_passthrough)  # -> out, out_crvs; inputs crvs: list
# ---------- contour: Python ----------
# CONTOUR / ISO-LINE processor - treats the region as terrain (a procedural
# noise height field) and draws its contour lines: topographic-map linework.
# Marching squares on a grid, then the raw segments are chained end-to-end into
# long continuous contours (a whole level often plots as a handful of strokes).
# PROCESSOR CONTRACT: closed curves in (`crvs`) -> contour lines out (`out_crvs`).
# Inputs: crvs(list, closed), levels(int, number of contour lines),
#         scale(mm, size of the hills), detail(mm, grid step - smaller = smoother
#         but slower), seed(int), inset(mm), keep_edge(bool), on(bool bypass)
import Rhino
import Rhino.Geometry as rg
import rhinoscriptsyntax as rs
import scriptcontext as sc
import math, clr
from System.Collections.Generic import List
try:
    sc.doc = ghdoc
except:
    pass

clr.AddReferenceToFileAndPath(r"C:\Users\john.chandler\AppData\Roaming\McNeel\Rhinoceros\packages\7.0\Clipper2GH\1.3.2\Clipper2Lib.dll")
from Clipper2Lib import Paths64, Path64, Point64, Clipper, JoinType, EndType, FillRule


def lattice(ix, iy, sd):
    n = (ix * 73856093) ^ (iy * 19349663) ^ (sd * 83492791)
    n = n & 0x7FFFFFFF
    n = (n * 1103515245 + 12345) & 0x7FFFFFFF
    return (n % 65536) / 65535.0


def vnoise(x, y, sd):
    ix = int(math.floor(x))
    iy = int(math.floor(y))
    fx = x - ix
    fy = y - iy
    ux = fx * fx * (3.0 - 2.0 * fx)
    uy = fy * fy * (3.0 - 2.0 * fy)
    v00 = lattice(ix, iy, sd)
    v10 = lattice(ix + 1, iy, sd)
    v01 = lattice(ix, iy + 1, sd)
    v11 = lattice(ix + 1, iy + 1, sd)
    a = v00 + (v10 - v00) * ux
    b = v01 + (v11 - v01) * ux
    return a + (b - a) * uy


def height_at(x, y, sc_mm, sd):
    """three-octave fBm terrain in roughly 0..1 (pure function)"""
    h = vnoise(x / sc_mm, y / sc_mm, sd)
    h = h + 0.5 * vnoise(x / (sc_mm * 0.5), y / (sc_mm * 0.5), sd + 11)
    h = h + 0.25 * vnoise(x / (sc_mm * 0.25), y / (sc_mm * 0.25), sd + 23)
    return h / 1.75


def shrink_regions(curve_list, amount, scale):
    paths = Paths64()
    for c in curve_list:
        plc = c.ToPolyline(0.05, 0.2, 0.01, 1e6)
        if plc is None:
            continue
        path = Path64()
        for i in range(plc.PointCount - 1):
            p = plc.Point(i)
            path.Add(Point64(int(round(p.X * scale)), int(round(p.Y * scale))))
        paths.Add(path)
    norm = Clipper.Union(paths, FillRule.EvenOdd)
    sh = Clipper.InflatePaths(norm, -amount * scale, JoinType.Round, EndType.Polygon)
    out = []
    if sh is not None:
        for path in sh:
            if path.Count < 3:
                continue
            pts = List[rg.Point3d]()
            for pt in path:
                pts.Add(rg.Point3d(pt.X / scale, pt.Y / scale, 0))
            pts.Add(rg.Point3d(path[0].X / scale, path[0].Y / scale, 0))
            out.append(rg.PolylineCurve(pts))
    return out


LEV = int(levels) if levels is not None else 12
if LEV < 1:
    LEV = 1
if LEV > 60:
    LEV = 60
SCL = float(scale) if scale is not None else 45.0
if SCL < 2.0:
    SCL = 2.0
DET = float(detail) if detail is not None else 1.5
if DET < 0.4:
    DET = 0.4
SEED = int(seed) if seed is not None else 1
INS = float(inset) if inset is not None else 0.75
if INS < 0.0:
    INS = 0.0
EDGE = True if keep_edge is None else bool(keep_edge)
ON = True if on is None else bool(on)

cs = []
n_open = 0
if crvs:
    for c in crvs:
        cc = c if isinstance(c, rg.Curve) else rs.coercecurve(c)
        if cc is None:
            continue
        if not cc.IsClosed:
            n_open += 1
            continue
        cs.append(cc)

out_crvs = []
info = ''
if not ON:
    out_crvs = cs
    info = '[BYPASSED]'
elif cs:
    if EDGE:
        for c in cs:
            out_crvs.append(c)

    regions = cs
    if INS > 0.01:
        shrunk = shrink_regions(cs, INS, 1000.0)
        if shrunk:
            regions = shrunk

    bb = rg.BoundingBox.Empty
    for c in regions:
        bb.Union(c.GetBoundingBox(True))
    x0 = bb.Min.X
    y0 = bb.Min.Y
    wid = bb.Max.X - x0
    hei = bb.Max.Y - y0
    nx = int(math.ceil(wid / DET)) + 1
    ny = int(math.ceil(hei / DET)) + 1
    if nx > 700:
        nx = 700
    if ny > 700:
        ny = 700
    sx = wid / float(nx)
    sy = hei / float(ny)

    plane = rg.Plane.WorldXY
    tol = 0.001
    # sample the height field and region membership on the grid
    H = []
    INMASK = []
    for j in range(ny + 1):
        hrow = []
        mrow = []
        py = y0 + j * sy
        for i in range(nx + 1):
            px = x0 + i * sx
            hrow.append(height_at(px, py, SCL, SEED))
            p3 = rg.Point3d(px, py, 0)
            hits = 0
            for c in regions:
                if c.Contains(p3, plane, tol) == rg.PointContainment.Inside:
                    hits += 1
            mrow.append((hits % 2) == 1)
        H.append(hrow)
        INMASK.append(mrow)

    hmin = 1e9
    hmax = -1e9
    for j in range(ny + 1):
        for i in range(nx + 1):
            if INMASK[j][i]:
                if H[j][i] < hmin:
                    hmin = H[j][i]
                if H[j][i] > hmax:
                    hmax = H[j][i]
    if hmax <= hmin:
        hmax = hmin + 1.0

    # marching squares: edge pairs per case (e0 bottom, e1 right, e2 top, e3 left)
    TABLE = {0: [], 1: [(0, 3)], 2: [(0, 1)], 3: [(1, 3)], 4: [(1, 2)],
             5: [(0, 3), (1, 2)], 6: [(0, 2)], 7: [(2, 3)], 8: [(2, 3)],
             9: [(0, 2)], 10: [(0, 1), (2, 3)], 11: [(1, 2)], 12: [(1, 3)],
             13: [(0, 1)], 14: [(0, 3)], 15: []}

    n_seg_total = 0
    for lv in range(LEV):
        L = hmin + (hmax - hmin) * (lv + 0.5) / LEV
        segs = []
        for j in range(ny):
            for i in range(nx):
                if not (INMASK[j][i] and INMASK[j][i + 1] and INMASK[j + 1][i] and INMASK[j + 1][i + 1]):
                    continue
                v00 = H[j][i]
                v10 = H[j][i + 1]
                v11 = H[j + 1][i + 1]
                v01 = H[j + 1][i]
                idx = 0
                if v00 > L:
                    idx |= 1
                if v10 > L:
                    idx |= 2
                if v11 > L:
                    idx |= 4
                if v01 > L:
                    idx |= 8
                pairs = TABLE[idx]
                if not pairs:
                    continue
                ax = x0 + i * sx
                ay = y0 + j * sy
                bx = ax + sx
                by = ay + sy
                ept = {}
                if abs(v10 - v00) > 1e-12:
                    ept[0] = (ax + (L - v00) / (v10 - v00) * sx, ay)
                if abs(v11 - v10) > 1e-12:
                    ept[1] = (bx, ay + (L - v10) / (v11 - v10) * sy)
                if abs(v11 - v01) > 1e-12:
                    ept[2] = (ax + (L - v01) / (v11 - v01) * sx, by)
                if abs(v01 - v00) > 1e-12:
                    ept[3] = (ax, ay + (L - v00) / (v01 - v00) * sy)
                for pr in pairs:
                    if pr[0] in ept and pr[1] in ept:
                        _a = ept[pr[0]]
                        _b = ept[pr[1]]
                        # skip degenerate segments (level through a cell corner
                        # makes both edge points coincide -> invalid curves)
                        if (_a[0]-_b[0])**2 + (_a[1]-_b[1])**2 > 1e-8:
                            segs.append((_a, _b))
        n_seg_total += len(segs)
        if not segs:
            continue

        # chain segments into continuous contours via an endpoint hash
        q = DET * 0.25
        if q < 1e-6:
            q = 1e-6
        endmap = {}
        for si in range(len(segs)):
            for e in [0, 1]:
                p = segs[si][e]
                key = (int(round(p[0] / q)), int(round(p[1] / q)))
                if key not in endmap:
                    endmap[key] = []
                endmap[key].append((si, e))
        used = []
        for si in range(len(segs)):
            used.append(False)
        for si in range(len(segs)):
            if used[si]:
                continue
            used[si] = True
            chain = [segs[si][0], segs[si][1]]
            for endsel in [1, 0]:
                grew = True
                while grew:
                    grew = False
                    p = chain[-1] if endsel == 1 else chain[0]
                    key = (int(round(p[0] / q)), int(round(p[1] / q)))
                    if key not in endmap:
                        continue
                    for pair in endmap[key]:
                        sj = pair[0]
                        ej = pair[1]
                        if used[sj]:
                            continue
                        other = segs[sj][1 - ej]
                        used[sj] = True
                        if endsel == 1:
                            chain.append(other)
                        else:
                            chain.insert(0, other)
                        grew = True
                        break
            # drop duplicate consecutive vertices (quantised endpoints can
            # merge), then emit only genuinely drawable chains
            clean = [chain[0]]
            for pnt in chain[1:]:
                if (pnt[0]-clean[-1][0])**2 + (pnt[1]-clean[-1][1])**2 > 1e-8:
                    clean.append(pnt)
            _tot = 0.0
            for k in range(1, len(clean)):
                _tot += math.sqrt((clean[k][0]-clean[k-1][0])**2 + (clean[k][1]-clean[k-1][1])**2)
            if len(clean) >= 2 and _tot > 0.1:
                lp = List[rg.Point3d]()
                for pnt in clean:
                    lp.Add(rg.Point3d(pnt[0], pnt[1], 0))
                out_crvs.append(rg.PolylineCurve(lp))
    info = '%d levels, scale %.0fmm, grid %dx%d, %d segments chained' % (LEV, SCL, nx, ny, n_seg_total)

print('%d regions (%d open skipped) -> %d contour(s) | %s' % (len(cs), n_open, len(out_crvs), info))
# ---------- end contour ----------

# ---- group: PROCESSOR - DIFFERENTIAL GROWTH self-repelling loop folds into coral forms
growth_repulsion_mm = Slider(5, range=0.2..15)
growth_detail_mm = Slider(2, range=0.4..10)
growth_inset_mm = Slider(0.75, range=0..5)
growth_iterations = Slider(100, range=1..600)
growth_seed = Slider(1, range=1..100)
growth_on_off_passthrough = GROWTHOnOffPassthrough(True)
growth_keep_edge = BooleanToggle(True)
growth = GhPythonScript(
    iterations=growth_iterations,
    detail=growth_detail_mm,
    repulsion=growth_repulsion_mm,
    seed=growth_seed,
    inset=growth_inset_mm,
    keep_edge=growth_keep_edge,
    on=growth_on_off_passthrough)  # -> out, out_crvs; inputs crvs: list; disabled
# ---------- growth: Python ----------
# DIFFERENTIAL GROWTH processor - a closed loop that repels itself, pulls on its
# own neighbours and subdivides as it stretches, folding into coral / brain /
# intestinal forms. Grows inside the input region and is stopped by its walls,
# so the region acts as a mould.
# Output is ONE continuous closed stroke - ideal for plotting.
# PROCESSOR CONTRACT: closed curves in (`crvs`) -> grown curve out (`out_crvs`).
# Inputs: crvs(list, closed - the container), iterations(int, growth steps),
#         detail(mm, edge length before an edge splits - smaller = finer folds),
#         repulsion(mm, personal space between strands), seed(int),
#         inset(mm), keep_edge(bool), on(bool bypass)
import Rhino
import Rhino.Geometry as rg
import rhinoscriptsyntax as rs
import scriptcontext as sc
import math, clr
from System.Collections.Generic import List
try:
    sc.doc = ghdoc
except:
    pass

clr.AddReferenceToFileAndPath(r"C:\Users\john.chandler\AppData\Roaming\McNeel\Rhinoceros\packages\7.0\Clipper2GH\1.3.2\Clipper2Lib.dll")
from Clipper2Lib import Paths64, Path64, Point64, Clipper, JoinType, EndType, FillRule


def nextrand(state):
    state[0] = (state[0] * 1103515245 + 12345) & 0x7FFFFFFF
    return state[0] / 2147483647.0


def shrink_regions(curve_list, amount, scale):
    paths = Paths64()
    for c in curve_list:
        plc = c.ToPolyline(0.05, 0.2, 0.01, 1e6)
        if plc is None:
            continue
        path = Path64()
        for i in range(plc.PointCount - 1):
            p = plc.Point(i)
            path.Add(Point64(int(round(p.X * scale)), int(round(p.Y * scale))))
        paths.Add(path)
    norm = Clipper.Union(paths, FillRule.EvenOdd)
    sh = Clipper.InflatePaths(norm, -amount * scale, JoinType.Round, EndType.Polygon)
    out = []
    if sh is not None:
        for path in sh:
            if path.Count < 3:
                continue
            pts = List[rg.Point3d]()
            for pt in path:
                pts.Add(rg.Point3d(pt.X / scale, pt.Y / scale, 0))
            pts.Add(rg.Point3d(path[0].X / scale, path[0].Y / scale, 0))
            out.append(rg.PolylineCurve(pts))
    return out


ITER = int(iterations) if iterations is not None else 150
if ITER < 1:
    ITER = 1
if ITER > 600:
    ITER = 600
DET = float(detail) if detail is not None else 2.0
if DET < 0.4:
    DET = 0.4
REP = float(repulsion) if repulsion is not None else 3.0
if REP < 0.2:
    REP = 0.2
SEED = int(seed) if seed is not None else 1
INS = float(inset) if inset is not None else 0.75
if INS < 0.0:
    INS = 0.0
EDGE = True if keep_edge is None else bool(keep_edge)
ON = True if on is None else bool(on)
MAXNODES = 2500

cs = []
n_open = 0
if crvs:
    for c in crvs:
        cc = c if isinstance(c, rg.Curve) else rs.coercecurve(c)
        if cc is None:
            continue
        if not cc.IsClosed:
            n_open += 1
            continue
        cs.append(cc)

out_crvs = []
info = ''
if not ON:
    out_crvs = cs
    info = '[BYPASSED]'
elif cs:
    if EDGE:
        for c in cs:
            out_crvs.append(c)

    regions = cs
    if INS > 0.01:
        shrunk = shrink_regions(cs, INS, 1000.0)
        if shrunk:
            regions = shrunk

    bb = rg.BoundingBox.Empty
    for c in regions:
        bb.Union(c.GetBoundingBox(True))
    x0 = bb.Min.X
    y0 = bb.Min.Y
    wid = bb.Max.X - x0
    hei = bb.Max.Y - y0
    cxm = x0 + wid * 0.5
    cym = y0 + hei * 0.5

    # inside bitmap - the container walls
    gc = max(0.4, DET * 0.4)
    nx = int(math.ceil(wid / gc)) + 2
    ny = int(math.ceil(hei / gc)) + 2
    plane = rg.Plane.WorldXY
    tol = 0.001
    inside = []
    for j in range(ny):
        row = []
        py = y0 + (j - 0.5) * gc
        for i in range(nx):
            px = x0 + (i - 0.5) * gc
            hits = 0
            p3 = rg.Point3d(px, py, 0)
            for c in regions:
                if c.Contains(p3, plane, tol) == rg.PointContainment.Inside:
                    hits += 1
            row.append((hits % 2) == 1)
        inside.append(row)

    # seed ring at the centre. Start it GENEROUS and already node-dense: a tiny
    # seed gets flooded with injected nodes faster than repulsion can spread
    # them, which piles a tangle in the middle instead of folding cleanly.
    r0 = min(wid, hei) * 0.22
    if r0 < DET * 2.0:
        r0 = DET * 2.0
    n0 = int(2.0 * math.pi * r0 / DET)
    if n0 < 16:
        n0 = 16
    nodes = []
    for i in range(n0):
        a = 2.0 * math.pi * i / n0
        nodes.append([cxm + math.cos(a) * r0, cym + math.sin(a) * r0])

    rng = [(SEED * 2654435761) & 0x7FFFFFFF]
    ATTR = 0.22
    REPF = 0.45
    JIT = 0.06
    GROW = 0.022          # fraction of nodes injected per iteration
    cellsz = REP

    for it in range(ITER):
        n = len(nodes)
        if n < 3:
            break
        # spatial hash for this step
        hgrid = {}
        for i in range(n):
            key = (int(nodes[i][0] / cellsz), int(nodes[i][1] / cellsz))
            if key not in hgrid:
                hgrid[key] = []
            hgrid[key].append(i)

        moves = []
        for i in range(n):
            moves.append([0.0, 0.0])
        for i in range(n):
            xi = nodes[i][0]
            yi = nodes[i][1]
            ip = (i - 1) % n
            inx = (i + 1) % n
            # attraction: slide toward the midpoint of my neighbours
            mx = (nodes[ip][0] + nodes[inx][0]) * 0.5
            my = (nodes[ip][1] + nodes[inx][1]) * 0.5
            moves[i][0] += (mx - xi) * ATTR
            moves[i][1] += (my - yi) * ATTR
            # repulsion from nearby strands
            gi = int(xi / cellsz)
            gj = int(yi / cellsz)
            for dj in [-1, 0, 1]:
                for di in [-1, 0, 1]:
                    key = (gi + di, gj + dj)
                    if key not in hgrid:
                        continue
                    for jn in hgrid[key]:
                        if jn == i or jn == ip or jn == inx:
                            continue
                        dx = xi - nodes[jn][0]
                        dy = yi - nodes[jn][1]
                        d2 = dx * dx + dy * dy
                        if d2 < 1e-9 or d2 > REP * REP:
                            continue
                        d = math.sqrt(d2)
                        f = (REP - d) / REP * REPF
                        moves[i][0] += (dx / d) * f
                        moves[i][1] += (dy / d) * f
            moves[i][0] += (nextrand(rng) - 0.5) * JIT
            moves[i][1] += (nextrand(rng) - 0.5) * JIT

        # clamp each step: all nodes move simultaneously, so an unclamped shove
        # lets crowded nodes leap PAST each other and knot the loop permanently
        lim = DET * 0.30
        for i in range(n):
            mag = math.sqrt(moves[i][0] * moves[i][0] + moves[i][1] * moves[i][1])
            if mag > lim and mag > 1e-9:
                moves[i][0] = moves[i][0] / mag * lim
                moves[i][1] = moves[i][1] / mag * lim
            nxp = nodes[i][0] + moves[i][0]
            nyp = nodes[i][1] + moves[i][1]
            bi = int((nxp - x0) / gc) + 1
            bj = int((nyp - y0) / gc) + 1
            if 0 <= bj < ny and 0 <= bi < nx and inside[bj][bi]:
                nodes[i][0] = nxp
                nodes[i][1] = nyp

        # GROWTH: split stretched edges, AND inject new nodes at random edges.
        # The injection is what actually drives the folding - the loop gains
        # more nodes than its current outline can hold, repulsion shoves them
        # apart, and the perimeter has to buckle.
        if len(nodes) < MAXNODES:
            n = len(nodes)
            inject = int(n * GROW) + 1
            picks = {}
            for t in range(inject):
                pk = int(nextrand(rng) * n)
                if pk >= n:
                    pk = n - 1
                picks[pk] = True
            grown = []
            for i in range(n):
                grown.append(nodes[i])
                jn = (i + 1) % n
                dx = nodes[jn][0] - nodes[i][0]
                dy = nodes[jn][1] - nodes[i][1]
                dlen = math.sqrt(dx * dx + dy * dy)
                if dlen > DET or (i in picks):
                    grown.append([nodes[i][0] + dx * 0.5, nodes[i][1] + dy * 0.5])
                if len(grown) >= MAXNODES:
                    break
            nodes = grown

    lp = List[rg.Point3d]()
    for q in nodes:
        lp.Add(rg.Point3d(q[0], q[1], 0))
    if nodes:
        lp.Add(rg.Point3d(nodes[0][0], nodes[0][1], 0))
    if lp.Count > 3:
        out_crvs.append(rg.PolylineCurve(lp))
    info = '%d iterations -> %d nodes, detail %.1fmm, repulsion %.1fmm, seed %d' % (ITER, len(nodes), DET, REP, SEED)

print('%d regions (%d open skipped) -> %d stroke(s) | %s' % (len(cs), n_open, len(out_crvs), info))
# ---------- end growth ----------

# ---- group: PROCESSOR - HILBERT FILL closed regions -> one continuous space-filling stroke
hilbert_join_gaps_mm = Slider(2, range=0..10)
hilbert_order_density = Slider(6, range=1..8)
hilbert_inset_mm = Slider(0.75, range=0..5)
hilbert_on_off_passthrough = HILBERTOnOffPassthrough(True)
hilbert_keep_edge = BooleanToggle(True)
hilbert = GhPythonScript(
    crvs=flatten(tone.bands),
    order=hilbert_order_density,
    join=hilbert_join_gaps_mm,
    inset=hilbert_inset_mm,
    keep_edge=hilbert_keep_edge,
    on=hilbert_on_off_passthrough)  # -> out, out_crvs; inputs crvs: list; disabled
# ---------- hilbert: Python ----------
# HILBERT FILL processor - fills closed regions with a space-filling Hilbert
# curve. Unlike scanline hatch (one pen lift per line), a Hilbert fill is ONE
# CONTINUOUS STROKE per region: minimal lifts, fast, and a distinctive woven
# texture. Nested closed curves become holes (even-odd containment).
# PROCESSOR CONTRACT: closed curves in (`crvs`) -> fill linework out (`out_crvs`).
# Inputs: crvs(list, closed), order(int 1-8, density: line spacing = side/2^order),
#         inset(mm, keeps the fill off the boundary ~ half pen width),
#         join(mm, rejoin fragments whose gap is under this - the curve zigzags
#              across the boundary and would otherwise shatter into hundreds of
#              strokes; keep it well under your smallest hole so joins never
#              bridge a void. 0 = no joining),
#         keep_edge(bool, also output the region outline), on(bool bypass)
import Rhino
import Rhino.Geometry as rg
import rhinoscriptsyntax as rs
import scriptcontext as sc
import math, clr
from System.Collections.Generic import List
try:
    sc.doc = ghdoc
except:
    pass

clr.AddReferenceToFileAndPath(r"C:\Users\john.chandler\AppData\Roaming\McNeel\Rhinoceros\packages\7.0\Clipper2GH\1.3.2\Clipper2Lib.dll")
from Clipper2Lib import Paths64, Path64, Point64, Clipper, JoinType, EndType, FillRule


def hilbert_xy(order_n, d):
    """d-th point (0..n*n-1) on a Hilbert curve filling an n x n grid,
    n = 2**order_n. Pure function - no free variables (GhPython scope safety)."""
    n = 1 << order_n
    x = 0
    y = 0
    t = d
    s = 1
    while s < n:
        rx = 1 & (t // 2)
        ry = 1 & (t ^ rx)
        if ry == 0:
            if rx == 1:
                x = s - 1 - x
                y = s - 1 - y
            tmp = x
            x = y
            y = tmp
        x = x + s * rx
        y = y + s * ry
        t = t // 4
        s = s * 2
    return x, y


def shrink_regions(curve_list, amount, scale):
    """Clipper2 inset, normalising winding via even-odd union first so nested
    curves stay holes instead of exploding outward."""
    paths = Paths64()
    for c in curve_list:
        plc = c.ToPolyline(0.05, 0.2, 0.01, 1e6)
        if plc is None:
            continue
        path = Path64()
        for i in range(plc.PointCount - 1):
            p = plc.Point(i)
            path.Add(Point64(int(round(p.X * scale)), int(round(p.Y * scale))))
        paths.Add(path)
    norm = Clipper.Union(paths, FillRule.EvenOdd)
    sh = Clipper.InflatePaths(norm, -amount * scale, JoinType.Round, EndType.Polygon)
    out = []
    if sh is not None:
        for path in sh:
            if path.Count < 3:
                continue
            pts = List[rg.Point3d]()
            for pt in path:
                pts.Add(rg.Point3d(pt.X / scale, pt.Y / scale, 0))
            pts.Add(rg.Point3d(path[0].X / scale, path[0].Y / scale, 0))
            out.append(rg.PolylineCurve(pts))
    return out


ORD = int(order) if order is not None else 5
if ORD < 1:
    ORD = 1
if ORD > 8:
    ORD = 8
INS = float(inset) if inset is not None else 0.75
if INS < 0.0:
    INS = 0.0
JOIN = float(join) if join is not None else 2.0
if JOIN < 0.0:
    JOIN = 0.0
EDGE = True if keep_edge is None else bool(keep_edge)
ON = True if on is None else bool(on)

cs = []
n_open = 0
if crvs:
    for c in crvs:
        cc = c if isinstance(c, rg.Curve) else rs.coercecurve(c)
        if cc is None:
            continue
        if not cc.IsClosed:
            n_open += 1
            continue
        cs.append(cc)

out_crvs = []
info = ''
if not ON:
    out_crvs = cs
    info = '[BYPASSED]'
elif cs:
    if EDGE:
        for c in cs:
            out_crvs.append(c)

    regions = cs
    if INS > 0.01:
        shrunk = shrink_regions(cs, INS, 1000.0)
        if shrunk:
            regions = shrunk

    bb = rg.BoundingBox.Empty
    for c in regions:
        bb.Union(c.GetBoundingBox(True))
    wid = bb.Max.X - bb.Min.X
    hei = bb.Max.Y - bb.Min.Y
    side = max(wid, hei) * 1.02
    if side < 0.001:
        side = 1.0
    cx = (bb.Min.X + bb.Max.X) / 2.0
    cy = (bb.Min.Y + bb.Max.Y) / 2.0
    ox = cx - side / 2.0
    oy = cy - side / 2.0
    n = 1 << ORD
    cell = side / float(n)
    total = n * n

    # walk the Hilbert sequence, keeping runs of points inside the region.
    # even-odd containment -> nested curves read as holes.
    tol = 0.001
    plane = rg.Plane.WorldXY
    run = []
    prev_pt = None
    prev_in = False
    for d in range(total):
        gx, gy = hilbert_xy(ORD, d)
        px = ox + (gx + 0.5) * cell
        py = oy + (gy + 0.5) * cell
        pt = rg.Point3d(px, py, 0)
        hits = 0
        for c in regions:
            if c.Contains(pt, plane, tol) == rg.PointContainment.Inside:
                hits += 1
        isin = (hits % 2) == 1

        if isin and not prev_in:
            # entering: trim back to the boundary crossing
            entry = None
            if prev_pt is not None:
                seg = rg.LineCurve(prev_pt, pt)
                best_t = None
                for c in regions:
                    xev = rg.Intersect.Intersection.CurveCurve(seg, c, tol, tol)
                    if xev is not None:
                        for ev in xev:
                            if best_t is None or ev.ParameterA > best_t:
                                best_t = ev.ParameterA
                if best_t is not None:
                    entry = seg.PointAt(best_t)
            # rejoin to the previous run if the excursion was tiny (a boundary
            # zigzag), otherwise flush and start a fresh stroke
            gap_pt = entry if entry is not None else pt
            if run and JOIN > 0.0 and run[-1].DistanceTo(gap_pt) <= JOIN:
                if entry is not None:
                    run.append(entry)
                run.append(pt)
            else:
                if len(run) > 1:
                    lp = List[rg.Point3d]()
                    for q in run:
                        lp.Add(q)
                    out_crvs.append(rg.PolylineCurve(lp))
                run = []
                if entry is not None:
                    run.append(entry)
                run.append(pt)
        elif isin and prev_in:
            run.append(pt)
        elif (not isin) and prev_in:
            # leaving: extend to the boundary, hold the run open in case the
            # curve comes straight back (JOIN decides at the next entry)
            seg = rg.LineCurve(prev_pt, pt)
            best_t = None
            for c in regions:
                xev = rg.Intersect.Intersection.CurveCurve(seg, c, tol, tol)
                if xev is not None:
                    for ev in xev:
                        if best_t is None or ev.ParameterA < best_t:
                            best_t = ev.ParameterA
            if best_t is not None:
                run.append(seg.PointAt(best_t))
            if JOIN <= 0.0:
                if len(run) > 1:
                    lp = List[rg.Point3d]()
                    for q in run:
                        lp.Add(q)
                    out_crvs.append(rg.PolylineCurve(lp))
                run = []
        prev_pt = pt
        prev_in = isin
    if len(run) > 1:
        lp = List[rg.Point3d]()
        for q in run:
            lp.Add(q)
        out_crvs.append(rg.PolylineCurve(lp))
    info = 'order %d (%dx%d), line spacing %.2fmm, %d pts, join %.1fmm' % (ORD, n, n, cell, total, JOIN)

print('%d regions (%d open skipped) -> %d stroke(s) | %s' % (len(cs), n_open, len(out_crvs), info))
# ---------- end hilbert ----------

# ---- group: PROCESSOR - FLOW FIELD closed regions -> streamlines through a noise field
flow_scale_mm_swirls = Slider(60, range=5..300)
flow_spacing_mm = Slider(2, range=0.5..8)
flow_turbulence = Slider(2, range=0..3)
flow_inset_mm = Slider(0.75, range=0..5)
flowfield_on_off_passthrough = FLOWFIELDOnOffPassthrough(True)
flow_seed = Slider(1, range=1..100)
flowfield = GhPythonScript(
    spacing=flow_spacing_mm,
    scale=flow_scale_mm_swirls,
    turbulence=flow_turbulence,
    seed=flow_seed,
    inset=flow_inset_mm,
    on=flowfield_on_off_passthrough)  # -> out, out_crvs; inputs crvs: list; disabled
# ---------- flowfield: Python ----------
# FLOW FIELD processor - fills closed regions with streamlines traced through a
# procedural noise field. Produces long, flowing, continuous strokes (few pen
# lifts) with the signature look of generative plotter art.
# Streamlines are kept evenly spaced (Jobard & Lefebvre style): a new line stops
# when it comes within `spacing` of an already-drawn one, so the field fills
# without clumping.
# PROCESSOR CONTRACT: closed curves in (`crvs`) -> flow linework out (`out_crvs`).
# Inputs: crvs(list, closed), spacing(mm between streamlines), scale(mm, size of
#         the field's swirls), turbulence(0-3, how much the field twists),
#         seed(int), inset(mm), on(bool bypass)
import Rhino
import Rhino.Geometry as rg
import rhinoscriptsyntax as rs
import scriptcontext as sc
import math, clr
from System.Collections.Generic import List
try:
    sc.doc = ghdoc
except:
    pass

clr.AddReferenceToFileAndPath(r"C:\Users\john.chandler\AppData\Roaming\McNeel\Rhinoceros\packages\7.0\Clipper2GH\1.3.2\Clipper2Lib.dll")
from Clipper2Lib import Paths64, Path64, Point64, Clipper, JoinType, EndType, FillRule


def lattice(ix, iy, sd):
    """deterministic 0..1 hash at an integer lattice point (pure function)"""
    n = (ix * 73856093) ^ (iy * 19349663) ^ (sd * 83492791)
    n = n & 0x7FFFFFFF
    n = (n * 1103515245 + 12345) & 0x7FFFFFFF
    return (n % 65536) / 65535.0


def vnoise(x, y, sd):
    """smooth value noise in 0..1 (bilinear + smoothstep between lattice points)"""
    ix = int(math.floor(x))
    iy = int(math.floor(y))
    fx = x - ix
    fy = y - iy
    ux = fx * fx * (3.0 - 2.0 * fx)
    uy = fy * fy * (3.0 - 2.0 * fy)
    v00 = lattice(ix, iy, sd)
    v10 = lattice(ix + 1, iy, sd)
    v01 = lattice(ix, iy + 1, sd)
    v11 = lattice(ix + 1, iy + 1, sd)
    a = v00 + (v10 - v00) * ux
    b = v01 + (v11 - v01) * ux
    return a + (b - a) * uy


def field_angle(x, y, sc_mm, turb, sd):
    """two-octave noise -> flow direction in radians (pure function)"""
    n = vnoise(x / sc_mm, y / sc_mm, sd)
    n = n + 0.5 * vnoise(x / (sc_mm * 0.45), y / (sc_mm * 0.45), sd + 17)
    return (n / 1.5) * turb * 2.0 * math.pi


def shrink_regions(curve_list, amount, scale):
    paths = Paths64()
    for c in curve_list:
        plc = c.ToPolyline(0.05, 0.2, 0.01, 1e6)
        if plc is None:
            continue
        path = Path64()
        for i in range(plc.PointCount - 1):
            p = plc.Point(i)
            path.Add(Point64(int(round(p.X * scale)), int(round(p.Y * scale))))
        paths.Add(path)
    norm = Clipper.Union(paths, FillRule.EvenOdd)
    sh = Clipper.InflatePaths(norm, -amount * scale, JoinType.Round, EndType.Polygon)
    out = []
    if sh is not None:
        for path in sh:
            if path.Count < 3:
                continue
            pts = List[rg.Point3d]()
            for pt in path:
                pts.Add(rg.Point3d(pt.X / scale, pt.Y / scale, 0))
            pts.Add(rg.Point3d(path[0].X / scale, path[0].Y / scale, 0))
            out.append(rg.PolylineCurve(pts))
    return out


SP = float(spacing) if spacing is not None else 2.0
if SP < 0.3:
    SP = 0.3
SCL = float(scale) if scale is not None else 60.0
if SCL < 1.0:
    SCL = 1.0
TURB = float(turbulence) if turbulence is not None else 1.0
SEED = int(seed) if seed is not None else 1
INS = float(inset) if inset is not None else 0.75
if INS < 0.0:
    INS = 0.0
ON = True if on is None else bool(on)

cs = []
n_open = 0
if crvs:
    for c in crvs:
        cc = c if isinstance(c, rg.Curve) else rs.coercecurve(c)
        if cc is None:
            continue
        if not cc.IsClosed:
            n_open += 1
            continue
        cs.append(cc)

out_crvs = []
info = ''
if not ON:
    out_crvs = cs
    info = '[BYPASSED]'
elif cs:
    regions = cs
    if INS > 0.01:
        shrunk = shrink_regions(cs, INS, 1000.0)
        if shrunk:
            regions = shrunk

    bb = rg.BoundingBox.Empty
    for c in regions:
        bb.Union(c.GetBoundingBox(True))
    x0 = bb.Min.X
    y0 = bb.Min.Y
    wid = bb.Max.X - x0
    hei = bb.Max.Y - y0

    STEP = max(0.4, SP * 0.5)          # integration step
    MAXPTS = 400                       # per streamline
    TOTALCAP = 120000                  # global safety cap

    # --- precompute an inside-bitmap once (native Contains is the slow part) ---
    gc = max(STEP, SP * 0.5)
    nx = int(math.ceil(wid / gc)) + 2
    ny = int(math.ceil(hei / gc)) + 2
    plane = rg.Plane.WorldXY
    tol = 0.001
    inside = []
    for j in range(ny):
        row = []
        py = y0 + (j - 0.5) * gc
        for i in range(nx):
            px = x0 + (i - 0.5) * gc
            pt = rg.Point3d(px, py, 0)
            hits = 0
            for c in regions:
                if c.Contains(pt, plane, tol) == rg.PointContainment.Inside:
                    hits += 1
            row.append((hits % 2) == 1)
        inside.append(row)

    # --- occupancy grid for streamline separation ---
    og = max(SP, 0.3)
    onx = int(math.ceil(wid / og)) + 3
    ony = int(math.ceil(hei / og)) + 3
    occ = {}

    seeds = []
    ss = SP * 0.9
    sny = int(math.ceil(hei / ss)) + 1
    snx = int(math.ceil(wid / ss)) + 1
    for j in range(sny):
        for i in range(snx):
            seeds.append((x0 + i * ss, y0 + j * ss))

    made_pts = 0
    for sd_i in range(len(seeds)):
        if made_pts > TOTALCAP:
            break
        sxp = seeds[sd_i][0]
        syp = seeds[sd_i][1]
        gi = int((sxp - x0) / og) + 1
        gj = int((syp - y0) / og) + 1
        busy = False
        for dj in [-1, 0, 1]:
            for di in [-1, 0, 1]:
                if (gi + di, gj + dj) in occ:
                    for q in occ[(gi + di, gj + dj)]:
                        dx = q[0] - sxp
                        dy = q[1] - syp
                        if dx * dx + dy * dy < SP * SP:
                            busy = True
                            break
                if busy:
                    break
            if busy:
                break
        if busy:
            continue
        bi = int((sxp - x0) / gc) + 1
        bj = int((syp - y0) / gc) + 1
        if bj < 0 or bj >= ny or bi < 0 or bi >= nx or not inside[bj][bi]:
            continue

        # trace backwards then forwards from the seed
        chain = []
        for direction in [-1.0, 1.0]:
            px = sxp
            py = syp
            leg = []
            for k in range(MAXPTS):
                ang = field_angle(px, py, SCL, TURB, SEED)
                mx = px + math.cos(ang) * STEP * 0.5 * direction
                my = py + math.sin(ang) * STEP * 0.5 * direction
                ang2 = field_angle(mx, my, SCL, TURB, SEED)
                px = px + math.cos(ang2) * STEP * direction
                py = py + math.sin(ang2) * STEP * direction
                bi = int((px - x0) / gc) + 1
                bj = int((py - y0) / gc) + 1
                if bj < 0 or bj >= ny or bi < 0 or bi >= nx or not inside[bj][bi]:
                    break
                gi = int((px - x0) / og) + 1
                gj = int((py - y0) / og) + 1
                hit = False
                for dj in [-1, 0, 1]:
                    for di in [-1, 0, 1]:
                        key = (gi + di, gj + dj)
                        if key in occ:
                            for q in occ[key]:
                                dx = q[0] - px
                                dy = q[1] - py
                                if dx * dx + dy * dy < SP * SP:
                                    hit = True
                                    break
                        if hit:
                            break
                    if hit:
                        break
                if hit:
                    break
                leg.append((px, py))
            if direction < 0:
                leg.reverse()
                chain = leg + [(sxp, syp)]
            else:
                chain = chain + leg
        if len(chain) < 3:
            continue
        lp = List[rg.Point3d]()
        for q in chain:
            lp.Add(rg.Point3d(q[0], q[1], 0))
            gi = int((q[0] - x0) / og) + 1
            gj = int((q[1] - y0) / og) + 1
            if (gi, gj) not in occ:
                occ[(gi, gj)] = []
            occ[(gi, gj)].append(q)
        made_pts += len(chain)
        out_crvs.append(rg.PolylineCurve(lp))
    info = 'spacing %.2fmm, scale %.0fmm, turb %.2f, seed %d, %d pts' % (SP, SCL, TURB, SEED, made_pts)

print('%d regions (%d open skipped) -> %d streamline(s) | %s' % (len(cs), n_open, len(out_crvs), info))
# ---------- end flowfield ----------

# ---- group: PROCESSOR - SERPENTINE scanline fill, pen stays down (boustrophedon)
serp_join_gaps_mm = Slider(6, range=0..30)
serp_spacing_mm = Slider(1.5, range=0.25..10)
serp_angle_deg = Slider(0, range=0..180)
serp_inset_mm = Slider(0.75, range=0..5)
serpentine_on_off_passthrough = SERPENTINEOnOffPassthrough(True)
serp_keep_edge = BooleanToggle(True)
serpentine = GhPythonScript(
    spacing=serp_spacing_mm,
    angle=serp_angle_deg,
    join=serp_join_gaps_mm,
    inset=serp_inset_mm,
    keep_edge=serp_keep_edge,
    on=serpentine_on_off_passthrough)  # -> out, out_crvs; inputs crvs: list; disabled
# ---------- serpentine: Python ----------
# SERPENTINE processor - scanline fill with alternate lines joined at the ends
# (boustrophedon). Same look as a parallel-line hatch, but the pen stays DOWN
# and snakes back and forth: hundreds of pen lifts become a handful. The
# practical workhorse fill.
# Nested closed curves are holes (even-odd). Where a hole or a concave edge
# breaks the snake, `join` decides whether to keep the pen down (small gap) or
# lift and start a new stroke (large gap - e.g. across a void).
# PROCESSOR CONTRACT: closed curves in (`crvs`) -> fill linework out (`out_crvs`).
# Inputs: crvs(list, closed), spacing(mm between lines), angle(deg),
#         join(mm, max end-to-end gap to keep the pen down; 0 = never join),
#         inset(mm), keep_edge(bool), on(bool bypass)
import Rhino
import Rhino.Geometry as rg
import rhinoscriptsyntax as rs
import scriptcontext as sc
import math, clr
from System.Collections.Generic import List
try:
    sc.doc = ghdoc
except:
    pass

clr.AddReferenceToFileAndPath(r"C:\Users\john.chandler\AppData\Roaming\McNeel\Rhinoceros\packages\7.0\Clipper2GH\1.3.2\Clipper2Lib.dll")
from Clipper2Lib import Paths64, Path64, Point64, Clipper, JoinType, EndType, FillRule


def shrink_regions(curve_list, amount, scale):
    paths = Paths64()
    for c in curve_list:
        plc = c.ToPolyline(0.05, 0.2, 0.01, 1e6)
        if plc is None:
            continue
        path = Path64()
        for i in range(plc.PointCount - 1):
            p = plc.Point(i)
            path.Add(Point64(int(round(p.X * scale)), int(round(p.Y * scale))))
        paths.Add(path)
    norm = Clipper.Union(paths, FillRule.EvenOdd)
    sh = Clipper.InflatePaths(norm, -amount * scale, JoinType.Round, EndType.Polygon)
    out = []
    if sh is not None:
        for path in sh:
            if path.Count < 3:
                continue
            pts = List[rg.Point3d]()
            for pt in path:
                pts.Add(rg.Point3d(pt.X / scale, pt.Y / scale, 0))
            pts.Add(rg.Point3d(path[0].X / scale, path[0].Y / scale, 0))
            out.append(rg.PolylineCurve(pts))
    return out


SP = float(spacing) if spacing is not None else 1.5
if SP < 0.25:
    SP = 0.25
ANG = float(angle) if angle is not None else 0.0
JOIN = float(join) if join is not None else 6.0
if JOIN < 0.0:
    JOIN = 0.0
INS = float(inset) if inset is not None else 0.75
if INS < 0.0:
    INS = 0.0
EDGE = True if keep_edge is None else bool(keep_edge)
ON = True if on is None else bool(on)

cs = []
n_open = 0
if crvs:
    for c in crvs:
        cc = c if isinstance(c, rg.Curve) else rs.coercecurve(c)
        if cc is None:
            continue
        if not cc.IsClosed:
            n_open += 1
            continue
        cs.append(cc)

out_crvs = []
info = ''
if not ON:
    out_crvs = cs
    info = '[BYPASSED]'
elif cs:
    if EDGE:
        for c in cs:
            out_crvs.append(c)

    regions = cs
    if INS > 0.01:
        shrunk = shrink_regions(cs, INS, 1000.0)
        if shrunk:
            regions = shrunk

    bb = rg.BoundingBox.Empty
    for c in regions:
        bb.Union(c.GetBoundingBox(True))
    cxm = (bb.Min.X + bb.Max.X) / 2.0
    cym = (bb.Min.Y + bb.Max.Y) / 2.0
    half = 0.6 * math.sqrt((bb.Max.X - bb.Min.X) ** 2 + (bb.Max.Y - bb.Min.Y) ** 2) + SP
    ar = math.radians(ANG)
    dvx = math.cos(ar)
    dvy = math.sin(ar)
    nx = -dvy
    ny = dvx
    nlines = int((2.0 * half) / SP) + 1
    tol = 0.001
    segs2 = []

    # collect every scanline segment, indexed by line
    segs = []
    byline = {}
    for k in range(nlines):
        off = -half + k * SP
        bx = cxm + nx * off
        by = cym + ny * off
        pa = rg.Point3d(bx - dvx * half, by - dvy * half, 0)
        pb = rg.Point3d(bx + dvx * half, by + dvy * half, 0)
        lc = rg.LineCurve(pa, pb)
        ts = []
        for c in regions:
            xev = rg.Intersect.Intersection.CurveCurve(lc, c, tol, tol)
            if xev is not None:
                for ev in xev:
                    ts.append(ev.ParameterA)
        if len(ts) < 2:
            continue
        ts.sort()
        segs = []
        i = 0
        while i < len(ts) - 1:
            t0 = ts[i]
            t1 = ts[i + 1]
            p0 = lc.PointAt(t0)
            p1 = lc.PointAt(t1)
            if p0.DistanceTo(p1) > 0.15:
                segs.append((p0, p1))
            i += 2
        for s in segs:
            idx = len(segs2)
            segs2.append((k, s[0], s[1]))
            if k not in byline:
                byline[k] = []
            byline[k].append(idx)

    # greedy snake: from the end of the current segment, hop to the nearest
    # unused segment within the next couple of scanlines. On a plain region
    # that is a pure boustrophedon; around a hole it finishes one side, lifts
    # once, then snakes back up the other.
    n_seg = len(segs2)
    used = []
    for i in range(n_seg):
        used.append(False)
    remaining = n_seg
    run = []
    ck = 0
    guard = 0
    while remaining > 0 and guard < 200000:
        guard += 1
        if not run:
            start = -1
            for i in range(n_seg):
                if not used[i]:
                    start = i
                    break
            if start < 0:
                break
            used[start] = True
            remaining -= 1
            run = [segs2[start][1], segs2[start][2]]
            ck = segs2[start][0]
            continue
        endp = run[-1]
        best = -1
        bestd = None
        bestflip = False
        for kk in [ck, ck + 1, ck + 2]:
            if kk not in byline:
                continue
            for i in byline[kk]:
                if used[i]:
                    continue
                d0 = endp.DistanceTo(segs2[i][1])
                d1 = endp.DistanceTo(segs2[i][2])
                if d1 < d0:
                    d = d1
                    fl = True
                else:
                    d = d0
                    fl = False
                if bestd is None or d < bestd:
                    bestd = d
                    best = i
                    bestflip = fl
        if best >= 0 and JOIN > 0.0 and bestd <= JOIN:
            used[best] = True
            remaining -= 1
            if bestflip:
                run.append(segs2[best][2])
                run.append(segs2[best][1])
            else:
                run.append(segs2[best][1])
                run.append(segs2[best][2])
            ck = segs2[best][0]
        else:
            if len(run) > 1:
                lp = List[rg.Point3d]()
                for q in run:
                    lp.Add(q)
                out_crvs.append(rg.PolylineCurve(lp))
            run = []
    if len(run) > 1:
        lp = List[rg.Point3d]()
        for q in run:
            lp.Add(q)
        out_crvs.append(rg.PolylineCurve(lp))
    info = 'spacing %.2fmm, angle %.0f, %d segments, join %.1fmm' % (SP, ANG, n_seg, JOIN)

print('%d regions (%d open skipped) -> %d stroke(s) | %s' % (len(cs), n_open, len(out_crvs), info))
# ---------- end serpentine ----------

# ---- group: PATTERN - CONCENTRIC CIRCLES graph-driven radial spacing
circle_density_outer_edge = Slider(1, range=0.2..5)
circle_base_spacing_mm = Slider(12.6, range=0.5..30)
circle_inner_radius_mm = Slider(63.3, range=0..100)
circle_density_centre = Slider(1, range=0.2..5)
circle_min_gap_mm = Slider(1, range=0.05..5)
circle_density_inner = Slider(1, range=0.2..5)
circle_count = Slider(58, range=1..200)
circle_graph_range = Range(Domain=Domain(0, 1), Steps=circle_count)
circle_spacing_graph = GraphMapper(circle_graph_range)
circles_centre_xy_pad = MDSlider(
    SliderMode=0,
    slider_value=Point(0.5571342602, 0.4285824424, 0),
    x_domain=Domain(0, 350),
    y_domain=Domain(0, 350),
    z_domain=Domain(0, 1))
circles = GhPythonScript(
    graph=circle_spacing_graph,
    center=circles_centre_xy_pad,
    count=circle_count,
    spacing=circle_base_spacing_mm,
    inner=circle_inner_radius_mm,
    min_gap=circle_min_gap_mm,
    density_center=circle_density_centre,
    density_inner=circle_density_inner,
    density_outer=circle_density_outer_edge)  # -> out, crvs; inputs graph: list; disabled
#   port graph: Graph mapper curve that shapes how ring spacing changes from centre to edge.
#   port center: Centre of the rings, from the XY pad.
#   port count: How many rings to draw.
#   port spacing: Base distance between rings in mm, before the graph reshapes it.
#   port inner: Radius in mm of the innermost ring.
#   port min_gap: Rings are never allowed closer than this in mm, so the pen cannot flood an area.
#   port density_center: Ring density at the centre.
#   port density_inner: Ring density in the inner band.
#   port density_outer: Ring density at the outer edge.
# ---------- circles: Python ----------
# CONCENTRIC CIRCLES generator - nested circles with DIRECT density control at
# three radial zones: centre (innermost), inner (mid-radius) and outer edge.
# Density = how tightly the rings pack. Higher density -> smaller gaps -> more
# rings crowded into that zone. The three values are smoothly blended along the
# radius, so you sculpt the distribution with three sliders.
#   density_center : t = 0   (the middle)
#   density_inner  : t = 0.5 (mid-radius)
#   density_outer  : t = 1   (outer edge)
# `graph` is an OPTIONAL freeform multiplier (wire a Graph Mapper if you want a
# custom profile on top of the three zones); unwired it is neutral.
# Output: crvs (concentric circle curves, ready for a LAYER slot or a processor)
import Rhino.Geometry as rg
import rhinoscriptsyntax as rs
import scriptcontext as sc
try:
    sc.doc = ghdoc
except:
    pass

CNT = int(count) if count is not None else 40
if CNT < 1:
    CNT = 1
SP = float(spacing) if spacing is not None else 5.0
if SP < 0.01:
    SP = 0.01
INNER = float(inner) if inner is not None else 2.0
if INNER < 0.0:
    INNER = 0.0
MING = float(min_gap) if min_gap is not None else 0.15
if MING < 0.0:
    MING = 0.0

DC = float(density_center) if density_center is not None else 1.0
DM = float(density_inner) if density_inner is not None else 1.0
DO = float(density_outer) if density_outer is not None else 1.0
if DC < 0.05:
    DC = 0.05
if DM < 0.05:
    DM = 0.05
if DO < 0.05:
    DO = 0.05

# centre point - from an XY pad, else bed centre
cx = 175.0
cy = 175.0
if center is not None:
    p = center if isinstance(center, rg.Point3d) else rs.coerce3dpoint(center)
    if p is not None:
        cx = p.X
        cy = p.Y

# optional freeform multiplier (Graph Mapper output); neutral if unwired
gv = []
if graph:
    for g in graph:
        try:
            gv.append(float(g))
        except:
            pass
if not gv:
    gv = [1.0]


def density_at(u):
    """smooth 3-point blend of the centre/inner/outer densities (pure - no free
    vars: reads the module-level DC/DM/DO, no closures)"""
    if u <= 0.5:
        f = u / 0.5
        f = f * f * (3.0 - 2.0 * f)
        return DC * (1.0 - f) + DM * f
    f = (u - 0.5) / 0.5
    f = f * f * (3.0 - 2.0 * f)
    return DM * (1.0 - f) + DO * f


def graph_at(u):
    vals = gv
    n = len(vals)
    if n == 1:
        return vals[0]
    x = u * (n - 1)
    i = int(x)
    if i >= n - 1:
        return vals[-1]
    f = x - i
    return vals[i] * (1.0 - f) + vals[i + 1] * f


crvs = []
radii = []
pl = rg.Plane.WorldXY
pl.Origin = rg.Point3d(cx, cy, 0)
r = INNER
for i in range(CNT):
    u = i / float(CNT - 1) if CNT > 1 else 0.0
    d = density_at(u)
    if d < 0.05:
        d = 0.05
    gap = SP / d * graph_at(u)
    if gap < MING:
        gap = MING
    r += gap
    crvs.append(rg.Circle(pl, r).ToNurbsCurve())
    radii.append(r)

print('%d circles, radii %.1f..%.1f mm | density c/i/o = %.2f/%.2f/%.2f%s' % (
    CNT, radii[0] if radii else 0.0, radii[-1] if radii else 0.0, DC, DM, DO,
    ' x graph' if len(gv) > 1 else ''))
# ---------- end circles ----------

# ---- group: SVG IMPORT any .svg -> pen-assigned curves (paths, arcs, transforms)
# CURVE
# GENERATORS
svg_size_mm_0_native = Slider(0, range=0..400)
svg_tolerance_mm = Slider(0.15, range=0.02..1)
svg_pen_mode_0 = Slider(1, range=1..8)
svg_pen_mapping = ValueList({"ONE PEN": 0, "BY LAYER": 1, "BY COLOUR": 2}, selected="BY LAYER")
svg_origin_at_0_0 = BooleanToggle(True)
svg_file = FilePath("C:\Users\john.chandler\Downloads\Fairlady_Z_(RZ34)_logo.svg")
svgin = GhPythonScript(
    file=svg_file,
    size=svg_size_mm_0_native,
    pen_mode=svg_pen_mapping,
    pen=svg_pen_mode_0,
    tol=svg_tolerance_mm,
    origin=svg_origin_at_0_0)  # -> out, out_crvs, out_pens; disabled
#   port file: Path to the source file.
# ---------- svgin: Python ----------
# -*- coding: utf-8 -*-
# SVG IMPORT - vector artwork from anywhere into the plot pipeline.
#
# Reads a real-world .svg (Illustrator, Inkscape, Figma, plotter libraries) and
# emits plotter curves with a pen number each. Everything is flattened to
# polylines because that is what the pen draws anyway; `tol` sets how finely
# curves and arcs are sampled.
#
# Covers the parts of SVG that describe a line: every path command including
# relative forms, arcs and the smooth/shorthand curves, plus rect/circle/
# ellipse/line/polyline/polygon, and transforms composed down the whole element
# tree. Fills are ignored - a pen plotter draws outlines.
#
# PEN ASSIGNMENT (`pen_mode`):
#   0 EVERYTHING -> `pen`
#   1 BY LAYER   -> each top-level <g> becomes the next pen (Illustrator and
#                   Inkscape both write layers as top-level groups)
#   2 BY COLOUR  -> each distinct stroke colour becomes the next pen, in the
#                   order first seen
# Modes 1 and 2 wrap after 8, and report the mapping so you know what loads when.
#
# GENERATOR CONTRACT: file in -> `out_crvs` + `out_pens` out, `on` bypass.
# Inputs: file(path), size(mm on the longest side, 0 = the file's own size),
#         pen_mode(0/1/2), pen(1-8, used by mode 0), tol(mm flattening
#         tolerance), origin(bool: place min corner at 0,0), on(bool bypass)
import Rhino
import Rhino.Geometry as rg
import scriptcontext as sc
import math
import re
import xml.etree.ElementTree as ET
from System.Collections.Generic import List
try:
    sc.doc = ghdoc
except:
    pass

NUM = re.compile(r'[-+]?(?:\d*\.\d+|\d+\.?)(?:[eE][-+]?\d+)?')
CMD = re.compile(r'([MmZzLlHhVvCcSsQqTtAa])')
XF = re.compile(r'(matrix|translate|scale|rotate|skewX|skewY)\s*\(([^)]*)\)')
UNIT = {'mm': 1.0, 'cm': 10.0, 'in': 25.4, 'pt': 25.4 / 72.0, 'pc': 25.4 / 6.0,
        'px': 25.4 / 96.0, '': 25.4 / 96.0}


def nums(s):
    out = []
    for m in NUM.finditer(s):
        t = m.group(0)
        if t in ('.', '-', '+', '-.', '+.'):
            continue
        out.append(float(t))
    return out


def to_mm(v):
    """a length attribute like '210mm' or '793.7' -> mm"""
    if v is None:
        return None
    v = str(v).strip()
    for u in ('mm', 'cm', 'in', 'pt', 'pc', 'px'):
        if v.endswith(u):
            n = nums(v)
            return (n[0] * UNIT[u]) if n else None
    n = nums(v)
    return n[0] * UNIT[''] if n else None


def mat_mul(m, n):
    """compose m then n as (a,b,c,d,e,f); apply(m*n, p) == apply(m, apply(n, p))"""
    a1, b1, c1, d1, e1, f1 = m
    a2, b2, c2, d2, e2, f2 = n
    return (a1 * a2 + c1 * b2,
            b1 * a2 + d1 * b2,
            a1 * c2 + c1 * d2,
            b1 * c2 + d1 * d2,
            a1 * e2 + c1 * f2 + e1,
            b1 * e2 + d1 * f2 + f1)


def parse_xf(s):
    m = (1.0, 0.0, 0.0, 1.0, 0.0, 0.0)
    if not s:
        return m
    for kind, body in XF.findall(s):
        v = nums(body)
        if kind == 'matrix' and len(v) >= 6:
            t = (v[0], v[1], v[2], v[3], v[4], v[5])
        elif kind == 'translate':
            t = (1.0, 0.0, 0.0, 1.0, v[0] if v else 0.0, v[1] if len(v) > 1 else 0.0)
        elif kind == 'scale':
            sx = v[0] if v else 1.0
            sy = v[1] if len(v) > 1 else sx
            t = (sx, 0.0, 0.0, sy, 0.0, 0.0)
        elif kind == 'rotate':
            a = math.radians(v[0]) if v else 0.0
            ca = math.cos(a); sa = math.sin(a)
            t = (ca, sa, -sa, ca, 0.0, 0.0)
            if len(v) >= 3:
                cx = v[1]; cy = v[2]
                t = mat_mul((1.0, 0.0, 0.0, 1.0, cx, cy),
                            mat_mul(t, (1.0, 0.0, 0.0, 1.0, -cx, -cy)))
        elif kind == 'skewX':
            t = (1.0, 0.0, math.tan(math.radians(v[0] if v else 0.0)), 1.0, 0.0, 0.0)
        elif kind == 'skewY':
            t = (1.0, math.tan(math.radians(v[0] if v else 0.0)), 0.0, 1.0, 0.0, 0.0)
        else:
            continue
        m = mat_mul(m, t)
    return m


def bez3(p0, p1, p2, p3, tol):
    """cubic -> points. Segment count from the control polygon, which bounds
    the true arc length, so the sampling never under-resolves a tight curve."""
    L = (math.sqrt((p1[0]-p0[0])**2 + (p1[1]-p0[1])**2)
         + math.sqrt((p2[0]-p1[0])**2 + (p2[1]-p1[1])**2)
         + math.sqrt((p3[0]-p2[0])**2 + (p3[1]-p2[1])**2))
    n = int(L / tol) + 2
    if n > 400:
        n = 400
    out = []
    for i in range(1, n + 1):
        t = float(i) / n
        u = 1.0 - t
        out.append((u*u*u*p0[0] + 3*u*u*t*p1[0] + 3*u*t*t*p2[0] + t*t*t*p3[0],
                    u*u*u*p0[1] + 3*u*u*t*p1[1] + 3*u*t*t*p2[1] + t*t*t*p3[1]))
    return out


def bez2(p0, p1, p2, tol):
    L = (math.sqrt((p1[0]-p0[0])**2 + (p1[1]-p0[1])**2)
         + math.sqrt((p2[0]-p1[0])**2 + (p2[1]-p1[1])**2))
    n = int(L / tol) + 2
    if n > 400:
        n = 400
    out = []
    for i in range(1, n + 1):
        t = float(i) / n
        u = 1.0 - t
        out.append((u*u*p0[0] + 2*u*t*p1[0] + t*t*p2[0],
                    u*u*p0[1] + 2*u*t*p1[1] + t*t*p2[1]))
    return out


def arc_to(p0, rx, ry, rot, large, sweep, p1, tol):
    """SVG endpoint-parameterised arc -> points (F.6.5 of the spec)"""
    if rx == 0.0 or ry == 0.0:
        return [p1]
    rx = abs(rx); ry = abs(ry)
    phi = math.radians(rot)
    cs = math.cos(phi); sn = math.sin(phi)
    dx2 = (p0[0] - p1[0]) / 2.0
    dy2 = (p0[1] - p1[1]) / 2.0
    x1 = cs * dx2 + sn * dy2
    y1 = -sn * dx2 + cs * dy2
    # scale the radii up if they cannot span the chord
    lam = (x1*x1) / (rx*rx) + (y1*y1) / (ry*ry)
    if lam > 1.0:
        s = math.sqrt(lam)
        rx *= s; ry *= s
    num = rx*rx*ry*ry - rx*rx*y1*y1 - ry*ry*x1*x1
    den = rx*rx*y1*y1 + ry*ry*x1*x1
    if den == 0.0:
        return [p1]
    if num < 0.0:
        num = 0.0
    co = math.sqrt(num / den)
    if large == sweep:
        co = -co
    cx1 = co * rx * y1 / ry
    cy1 = -co * ry * x1 / rx
    cx = cs * cx1 - sn * cy1 + (p0[0] + p1[0]) / 2.0
    cy = sn * cx1 + cs * cy1 + (p0[1] + p1[1]) / 2.0
    def ang(ux, uy, vx, vy):
        d = math.sqrt((ux*ux + uy*uy) * (vx*vx + vy*vy))
        if d == 0.0:
            return 0.0
        c = (ux*vx + uy*vy) / d
        if c < -1.0: c = -1.0
        if c > 1.0: c = 1.0
        a = math.acos(c)
        if ux*vy - uy*vx < 0.0:
            a = -a
        return a
    th0 = ang(1.0, 0.0, (x1 - cx1) / rx, (y1 - cy1) / ry)
    dth = ang((x1 - cx1) / rx, (y1 - cy1) / ry, (-x1 - cx1) / rx, (-y1 - cy1) / ry)
    if not sweep and dth > 0.0:
        dth -= 2.0 * math.pi
    elif sweep and dth < 0.0:
        dth += 2.0 * math.pi
    rmax = rx if rx > ry else ry
    n = int(abs(dth) * rmax / tol) + 2
    if n > 400:
        n = 400
    out = []
    for i in range(1, n + 1):
        th = th0 + dth * float(i) / n
        ex = rx * math.cos(th); ey = ry * math.sin(th)
        out.append((cs * ex - sn * ey + cx, sn * ex + cs * ey + cy))
    return out


def path_polys(d, tol):
    """path `d` -> list of point lists, in the element's own coordinates"""
    toks = CMD.split(d)
    polys = []
    cur = []
    cx = 0.0; cy = 0.0        # current point
    sx = 0.0; sy = 0.0        # sub-path start
    px = 0.0; py = 0.0        # last cubic control, for S
    qx = 0.0; qy = 0.0        # last quadratic control, for T
    prev = ''
    i = 1
    while i < len(toks):
        c = toks[i]
        args = nums(toks[i + 1]) if i + 1 < len(toks) else []
        i += 2
        rel = c.islower()
        C = c.upper()
        if C == 'M':
            j = 0
            while j + 1 < len(args) + 1 and j + 1 <= len(args) - 1 + 1:
                if j + 1 > len(args) - 1:
                    break
                x = args[j]; y = args[j + 1]
                if rel:
                    x += cx; y += cy
                if j == 0:
                    if len(cur) > 1:
                        polys.append(cur)
                    cur = [(x, y)]
                    sx = x; sy = y
                else:
                    cur.append((x, y))     # extra pairs after M are implicit L
                cx = x; cy = y
                j += 2
        elif C == 'Z':
            if len(cur) > 1:
                cur.append((sx, sy))
                polys.append(cur)
            cur = [(sx, sy)]
            cx = sx; cy = sy
        elif C == 'L':
            j = 0
            while j + 1 < len(args) + 1 and j + 1 <= len(args) - 1 + 1:
                if j + 1 > len(args) - 1:
                    break
                x = args[j]; y = args[j + 1]
                if rel:
                    x += cx; y += cy
                cur.append((x, y)); cx = x; cy = y
                j += 2
        elif C == 'H':
            for v in args:
                x = cx + v if rel else v
                cur.append((x, cy)); cx = x
        elif C == 'V':
            for v in args:
                y = cy + v if rel else v
                cur.append((cx, y)); cy = y
        elif C == 'C':
            j = 0
            while j + 5 < len(args):
                x1 = args[j]; y1 = args[j+1]; x2 = args[j+2]
                y2 = args[j+3]; x = args[j+4]; y = args[j+5]
                if rel:
                    x1 += cx; y1 += cy; x2 += cx; y2 += cy; x += cx; y += cy
                for q in bez3((cx, cy), (x1, y1), (x2, y2), (x, y), tol):
                    cur.append(q)
                px = x2; py = y2; cx = x; cy = y
                j += 6
        elif C == 'S':
            j = 0
            while j + 3 < len(args):
                x2 = args[j]; y2 = args[j+1]; x = args[j+2]; y = args[j+3]
                if rel:
                    x2 += cx; y2 += cy; x += cx; y += cy
                if prev in ('C', 'S'):
                    x1 = 2.0 * cx - px; y1 = 2.0 * cy - py
                else:
                    x1 = cx; y1 = cy
                for q in bez3((cx, cy), (x1, y1), (x2, y2), (x, y), tol):
                    cur.append(q)
                px = x2; py = y2; cx = x; cy = y
                j += 4
        elif C == 'Q':
            j = 0
            while j + 3 < len(args):
                x1 = args[j]; y1 = args[j+1]; x = args[j+2]; y = args[j+3]
                if rel:
                    x1 += cx; y1 += cy; x += cx; y += cy
                for q in bez2((cx, cy), (x1, y1), (x, y), tol):
                    cur.append(q)
                qx = x1; qy = y1; cx = x; cy = y
                j += 4
        elif C == 'T':
            j = 0
            while j + 1 < len(args):
                x = args[j]; y = args[j+1]
                if rel:
                    x += cx; y += cy
                if prev in ('Q', 'T'):
                    x1 = 2.0 * cx - qx; y1 = 2.0 * cy - qy
                else:
                    x1 = cx; y1 = cy
                for q in bez2((cx, cy), (x1, y1), (x, y), tol):
                    cur.append(q)
                qx = x1; qy = y1; cx = x; cy = y
                j += 2
        elif C == 'A':
            j = 0
            while j + 6 < len(args):
                rx = args[j]; ry = args[j+1]; rot = args[j+2]
                la = args[j+3] != 0.0; sw = args[j+4] != 0.0
                x = args[j+5]; y = args[j+6]
                if rel:
                    x += cx; y += cy
                for q in arc_to((cx, cy), rx, ry, rot, la, sw, (x, y), tol):
                    cur.append(q)
                cx = x; cy = y
                j += 7
        prev = C
    if len(cur) > 1:
        polys.append(cur)
    return polys


def shape_polys(tag, at, tol):
    """rect / circle / ellipse / line / polyline / polygon -> point lists"""
    def f(k, dv=0.0):
        v = at.get(k)
        if v is None:
            return dv
        n = nums(v)
        return n[0] if n else dv
    if tag == 'rect':
        x = f('x'); y = f('y'); w = f('width'); h = f('height')
        rx = f('rx', -1.0); ry = f('ry', -1.0)
        if rx < 0 and ry < 0:
            rx = 0.0; ry = 0.0
        elif rx < 0:
            rx = ry
        elif ry < 0:
            ry = rx
        if rx > w / 2.0: rx = w / 2.0
        if ry > h / 2.0: ry = h / 2.0
        if w <= 0 or h <= 0:
            return []
        if rx <= 0 or ry <= 0:
            return [[(x, y), (x+w, y), (x+w, y+h), (x, y+h), (x, y)]]
        d = ('M%f,%f H%f A%f,%f 0 0 1 %f,%f V%f A%f,%f 0 0 1 %f,%f '
             'H%f A%f,%f 0 0 1 %f,%f V%f A%f,%f 0 0 1 %f,%f Z') % (
            x+rx, y, x+w-rx, rx, ry, x+w, y+ry, y+h-ry, rx, ry, x+w-rx, y+h,
            x+rx, rx, ry, x, y+h-ry, y+ry, rx, ry, x+rx, y)
        return path_polys(d, tol)
    if tag == 'circle':
        cx = f('cx'); cy = f('cy'); r = f('r')
        if r <= 0:
            return []
        n = int(2.0 * math.pi * r / tol) + 8
        if n > 720: n = 720
        return [[(cx + r*math.cos(2.0*math.pi*i/n), cy + r*math.sin(2.0*math.pi*i/n))
                 for i in range(n + 1)]]
    if tag == 'ellipse':
        cx = f('cx'); cy = f('cy'); rx = f('rx'); ry = f('ry')
        if rx <= 0 or ry <= 0:
            return []
        rmax = rx if rx > ry else ry
        n = int(2.0 * math.pi * rmax / tol) + 8
        if n > 720: n = 720
        return [[(cx + rx*math.cos(2.0*math.pi*i/n), cy + ry*math.sin(2.0*math.pi*i/n))
                 for i in range(n + 1)]]
    if tag == 'line':
        return [[(f('x1'), f('y1')), (f('x2'), f('y2'))]]
    if tag in ('polyline', 'polygon'):
        v = nums(at.get('points', ''))
        pts = []
        for i in range(0, len(v) - 1, 2):
            pts.append((v[i], v[i+1]))
        if len(pts) < 2:
            return []
        if tag == 'polygon':
            pts.append(pts[0])
        return [pts]
    return []


def prop(at, name):
    v = at.get(name)
    st = at.get('style', '')
    if st:
        m = re.search(r'(?:^|;)\s*' + name + r'\s*:\s*([^;]+)', st)
        if m:
            v = m.group(1).strip()
    if v is None:
        return None
    v = v.strip().lower()
    if v in ('none', 'transparent'):
        return None
    return v


def colour_of(at):
    """stroke first, then fill. Plenty of real artwork (most Illustrator
    exports) carries its colour as a fill on a closed shape and never sets a
    stroke at all - and the pen outlines it either way, so fill is the right
    fallback rather than 'no colour'."""
    c = prop(at, 'stroke')
    if c:
        return c
    return prop(at, 'fill')


def hidden(at):
    if at.get('display') == 'none':
        return True
    st = at.get('style', '')
    if 'display:none' in st.replace(' ', ''):
        return True
    if 'visibility:hidden' in st.replace(' ', ''):
        return True
    return False


PATH_TAGS = ('path', 'rect', 'circle', 'ellipse', 'line', 'polyline', 'polygon')
# containers whose contents are templates or metadata, never drawn where they sit
SKIP_TAGS = ('defs', 'clipPath', 'mask', 'marker', 'symbol', 'pattern',
             'title', 'desc', 'metadata', 'style', 'script', 'filter')

SVGFILE = None
if file is not None:
    try:
        SVGFILE = str(file).strip('"')
    except:
        SVGFILE = None
SIZE = float(size) if size is not None else 0.0
if SIZE < 0.0:
    SIZE = 0.0
PMODE = int(pen_mode) if pen_mode is not None else 0
PEN = int(pen) if pen is not None else 1
if PEN < 1: PEN = 1
if PEN > 8: PEN = 8
TOL = float(tol) if tol is not None else 0.2
if TOL < 0.01:
    TOL = 0.01
ORIGIN = True if origin is None else bool(origin)
ON = True if on is None else bool(on)

out_crvs = []
out_pens = []
info = ''
if not ON:
    info = '[BYPASSED]'
elif not SVGFILE:
    info = 'no file - point `file` at an .svg'
else:
    try:
        tree = ET.parse(SVGFILE)
        root = tree.getroot()
    except Exception, e:
        root = None
        info = 'could not read the SVG: %s' % str(e)
    if root is not None:
        # ---- document scale: user units -> mm ----
        vb = nums(root.get('viewBox', '') or '')
        w_mm = to_mm(root.get('width'))
        h_mm = to_mm(root.get('height'))
        if len(vb) >= 4 and vb[2] > 0 and vb[3] > 0:
            vbw = vb[2]; vbh = vb[3]; vbx = vb[0]; vby = vb[1]
        else:
            vbw = w_mm / UNIT[''] if w_mm else 100.0
            vbh = h_mm / UNIT[''] if h_mm else 100.0
            vbx = 0.0; vby = 0.0
        if w_mm and vbw > 0:
            u2mm = w_mm / vbw
        elif h_mm and vbh > 0:
            u2mm = h_mm / vbh
        else:
            u2mm = UNIT['']           # bare numbers are px
        # ---- walk the tree, composing transforms ----
        layers = []
        colours = []
        raw = []                      # (points, layer_index, colour)
        stack = [(root, (1.0, 0.0, 0.0, 1.0, 0.0, 0.0), -1, None)]
        # children of the root in document order are the "layers"
        top = []
        for ch in list(root):
            top.append(ch)
        n_hidden = 0
        for li in range(len(top)):
            el = top[li]
            work = [(el, parse_xf(root.get('transform')), li, colour_of(root.attrib))]
            while work:
                node, m, lay, inh = work.pop()
                at = node.attrib
                if hidden(at):
                    n_hidden += 1
                    continue
                tag = node.tag
                if '}' in tag:
                    tag = tag.split('}')[1]
                if tag in SKIP_TAGS:
                    continue
                m2 = mat_mul(m, parse_xf(at.get('transform')))
                # presentation attributes inherit, so a <g fill="#f00"> colours
                # every path beneath it that does not set its own
                col = colour_of(at) or inh
                if tag in PATH_TAGS:
                    if tag == 'path':
                        pls = path_polys(at.get('d', ''), TOL / max(u2mm, 1e-9))
                    else:
                        pls = shape_polys(tag, at, TOL / max(u2mm, 1e-9))
                    for pl in pls:
                        pts = []
                        for (x, y) in pl:
                            pts.append((m2[0]*x + m2[2]*y + m2[4],
                                        m2[1]*x + m2[3]*y + m2[5]))
                        raw.append((pts, lay, col))
                else:
                    kids = list(node)
                    for q in range(len(kids) - 1, -1, -1):
                        work.append((kids[q], m2, lay, col))
            nm = el.get('{http://www.inkscape.org/namespaces/inkscape}label') or el.get('id') or ('group %d' % (li + 1))
            layers.append(nm)
        # Only layers that actually drew something get a pen. A <defs> block or an
        # empty group would otherwise consume an index and shift every real layer.
        drew = []
        for pts, lay, col in raw:
            if lay not in drew:
                drew.append(lay)
        drew.sort()
        lay_pen = {}
        for i in range(len(drew)):
            lay_pen[drew[i]] = (i % 8) + 1
        layers = [layers[i] for i in drew if i < len(layers)]
        # ---- fit / place ----
        if raw:
            xs = []; ys = []
            for pts, lay, col in raw:
                for (x, y) in pts:
                    xs.append(x); ys.append(y)
            x0 = min(xs); x1 = max(xs); y0 = min(ys); y1 = max(ys)
            w_u = x1 - x0; h_u = y1 - y0
            s = u2mm
            if SIZE > 0.0:
                big = w_u if w_u > h_u else h_u
                if big > 0:
                    s = SIZE / big
            ox = -x0 * s if ORIGIN else (vbx * -s)
            oy = y1 * s if ORIGIN else (vby + vbh) * s
            seen = []
            for pts, lay, col in raw:
                lp = List[rg.Point3d]()
                for (x, y) in pts:
                    # SVG y runs down the page; the bed's runs up
                    lp.Add(rg.Point3d(x * s + ox, oy - y * s, 0))
                if lp.Count < 2:
                    continue
                if PMODE == 1:
                    pn = lay_pen.get(lay, PEN)
                elif PMODE == 2:
                    key = col if col else '(no stroke)'
                    if key not in seen:
                        seen.append(key)
                    pn = (seen.index(key) % 8) + 1
                else:
                    pn = PEN
                out_crvs.append(rg.PolylineCurve(lp))
                out_pens.append(pn)
            tot = 0.0
            for c in out_crvs:
                tot += c.GetLength()
            bits = ['%d curves, %.2fm of line' % (len(out_crvs), tot / 1000.0)]
            bits.append('%.1f x %.1f mm' % (w_u * s, h_u * s))
            bits.append('tol %.2fmm' % TOL)
            if PMODE == 1:
                bits.append('by layer: ' + ', '.join(
                    ['pen%d=%s' % ((i % 8) + 1, layers[i][:14]) for i in range(len(layers))]))
            elif PMODE == 2:
                bits.append('by colour: ' + ', '.join(
                    ['pen%d=%s' % ((i % 8) + 1, seen[i]) for i in range(len(seen))]))
            else:
                bits.append('all on pen %d' % PEN)
            if n_hidden:
                bits.append('%d hidden element(s) skipped' % n_hidden)
            info = ' | '.join(bits)
        else:
            info = 'parsed, but found no drawable geometry'

print(info)
# ---------- end svgin ----------

# ---- group: PROCESSOR - TRUCHET random tiles -> woven labyrinths
truchet_inset_mm = Slider(0.75, range=0..5)
truchet_cell_mm = Slider(8, range=1..40)
truchet_style = ValueList({"arcs (woven)": 0, "diagonals (maze)": 1}, selected="arcs (woven)")
truchet_seed = Slider(1, range=1..100)
truchet_on_off_passthrough = TRUCHETOnOffPassthrough(True)
truchet_keep_edge = BooleanToggle(True)
truchet = GhPythonScript(
    cell=truchet_cell_mm,
    style=truchet_style,
    seed=truchet_seed,
    inset=truchet_inset_mm,
    keep_edge=truchet_keep_edge,
    on=truchet_on_off_passthrough)  # -> out, out_crvs; inputs crvs: list; disabled
# ---------- truchet: Python ----------
# TRUCHET processor - fills closed regions with randomly rotated Truchet tiles.
# Each tile carries two quarter-arcs (or two diagonals) joining edge midpoints,
# so neighbouring tiles link up into long meandering loops - woven labyrinths
# from almost no code. Touching ends are chained into continuous strokes, so a
# whole field plots with very few pen lifts.
# PROCESSOR CONTRACT: closed curves in (`crvs`) -> tile linework out (`out_crvs`).
# Inputs: crvs(list, closed), cell(mm tile size), seed(int), style(0 arcs,
#         1 diagonals), inset(mm), keep_edge(bool), on(bool bypass)
import Rhino
import Rhino.Geometry as rg
import rhinoscriptsyntax as rs
import scriptcontext as sc
import math, clr
from System.Collections.Generic import List
try:
    sc.doc = ghdoc
except:
    pass

clr.AddReferenceToFileAndPath(r"C:\Users\john.chandler\AppData\Roaming\McNeel\Rhinoceros\packages\7.0\Clipper2GH\1.3.2\Clipper2Lib.dll")
from Clipper2Lib import Paths64, Path64, Point64, Clipper, JoinType, EndType, FillRule


def tile_flip(ix, iy, sd):
    """deterministic 0/1 per tile (pure function)"""
    n = (ix * 73856093) ^ (iy * 19349663) ^ (sd * 83492791)
    n = n & 0x7FFFFFFF
    n = (n * 1103515245 + 12345) & 0x7FFFFFFF
    return (n >> 16) & 1


def arc_pts(cx, cy, r, a0, a1, n):
    """polyline points along an arc (pure function)"""
    out = []
    for i in range(n + 1):
        a = a0 + (a1 - a0) * (float(i) / n)
        out.append((cx + math.cos(a) * r, cy + math.sin(a) * r))
    return out


def shrink_regions(curve_list, amount, scale):
    paths = Paths64()
    for c in curve_list:
        plc = c.ToPolyline(0.05, 0.2, 0.01, 1e6)
        if plc is None:
            continue
        path = Path64()
        for i in range(plc.PointCount - 1):
            p = plc.Point(i)
            path.Add(Point64(int(round(p.X * scale)), int(round(p.Y * scale))))
        paths.Add(path)
    norm = Clipper.Union(paths, FillRule.EvenOdd)
    sh = Clipper.InflatePaths(norm, -amount * scale, JoinType.Round, EndType.Polygon)
    out = []
    if sh is not None:
        for path in sh:
            if path.Count < 3:
                continue
            pts = List[rg.Point3d]()
            for pt in path:
                pts.Add(rg.Point3d(pt.X / scale, pt.Y / scale, 0))
            pts.Add(rg.Point3d(path[0].X / scale, path[0].Y / scale, 0))
            out.append(rg.PolylineCurve(pts))
    return out


CELL = float(cell) if cell is not None else 8.0
if CELL < 0.5:
    CELL = 0.5
SEED = int(seed) if seed is not None else 1
STYLE = int(style) if style is not None else 0
INS = float(inset) if inset is not None else 0.75
if INS < 0.0:
    INS = 0.0
EDGE = True if keep_edge is None else bool(keep_edge)
ON = True if on is None else bool(on)

cs = []
n_open = 0
if crvs:
    for c in crvs:
        cc = c if isinstance(c, rg.Curve) else rs.coercecurve(c)
        if cc is None:
            continue
        if not cc.IsClosed:
            n_open += 1
            continue
        cs.append(cc)

out_crvs = []
info = ''
if not ON:
    out_crvs = cs
    info = '[BYPASSED]'
elif cs:
    if EDGE:
        for c in cs:
            out_crvs.append(c)

    regions = cs
    if INS > 0.01:
        shrunk = shrink_regions(cs, INS, 1000.0)
        if shrunk:
            regions = shrunk

    bb = rg.BoundingBox.Empty
    for c in regions:
        bb.Union(c.GetBoundingBox(True))
    x0 = bb.Min.X
    y0 = bb.Min.Y
    ncx = int(math.ceil((bb.Max.X - x0) / CELL))
    ncy = int(math.ceil((bb.Max.Y - y0) / CELL))
    plane = rg.Plane.WorldXY
    tol = 0.001
    arcseg = 8
    r = CELL * 0.5

    # build tile strokes, keeping only tiles whose centre is inside the region
    strokes = []
    n_tiles = 0
    for jy in range(ncy):
        for ix in range(ncx):
            tx = x0 + ix * CELL
            ty = y0 + jy * CELL
            ctr = rg.Point3d(tx + r, ty + r, 0)
            hits = 0
            for c in regions:
                if c.Contains(ctr, plane, tol) == rg.PointContainment.Inside:
                    hits += 1
            if (hits % 2) == 0:
                continue
            n_tiles += 1
            flip = tile_flip(ix, jy, SEED)
            if STYLE == 1:
                if flip == 0:
                    strokes.append([(tx, ty + r), (tx + r, ty)])
                    strokes.append([(tx + r, ty + CELL), (tx + CELL, ty + r)])
                else:
                    strokes.append([(tx, ty + r), (tx + r, ty + CELL)])
                    strokes.append([(tx + r, ty), (tx + CELL, ty + r)])
            else:
                if flip == 0:
                    strokes.append(arc_pts(tx, ty, r, 0.0, math.pi * 0.5, arcseg))
                    strokes.append(arc_pts(tx + CELL, ty + CELL, r, math.pi, math.pi * 1.5, arcseg))
                else:
                    strokes.append(arc_pts(tx + CELL, ty, r, math.pi * 0.5, math.pi, arcseg))
                    strokes.append(arc_pts(tx, ty + CELL, r, math.pi * 1.5, math.pi * 2.0, arcseg))

    # chain strokes that share endpoints into continuous runs (fewer pen lifts)
    jt = CELL * 0.05
    used = [False] * len(strokes)
    for si in range(len(strokes)):
        if used[si]:
            continue
        used[si] = True
        chain = list(strokes[si])
        # grow from BOTH ends - arcs meet at edge midpoints, so a Truchet field
        # links into long meandering loops if you follow them both ways
        for endsel in [1, 0]:
            grew = True
            while grew:
                grew = False
                if endsel == 1:
                    ex = chain[-1][0]
                    ey = chain[-1][1]
                else:
                    ex = chain[0][0]
                    ey = chain[0][1]
                for sj in range(len(strokes)):
                    if used[sj]:
                        continue
                    s = strokes[sj]
                    fwd = (abs(s[0][0] - ex) < jt and abs(s[0][1] - ey) < jt)
                    bwd = (abs(s[-1][0] - ex) < jt and abs(s[-1][1] - ey) < jt)
                    if not fwd and not bwd:
                        continue
                    used[sj] = True
                    piece = list(s)
                    if bwd:
                        piece.reverse()
                    if endsel == 1:
                        chain = chain + piece[1:]
                    else:
                        piece.reverse()
                        chain = piece[:-1] + chain
                    grew = True
                    break
        lp = List[rg.Point3d]()
        for q in chain:
            lp.Add(rg.Point3d(q[0], q[1], 0))
        out_crvs.append(rg.PolylineCurve(lp))
    info = 'cell %.1fmm, %d tiles, style %s, seed %d' % (CELL, n_tiles, 'diagonals' if STYLE == 1 else 'arcs', SEED)

print('%d regions (%d open skipped) -> %d stroke(s) | %s' % (len(cs), n_open, len(out_crvs), info))
# ---------- end truchet ----------

# ---- group: PROCESSOR - HATCH closed regions -> parallel line fill. Per-band spacing/angle lists
hatch_inset_mm = Slider(0.75, range=0..5)
hatch_on_off_passthrough = HATCHOnOffPassthrough(True)
hatch_mode = ValueList({"parallel lines": 0, "concentric": 1}, selected="parallel lines")
hatch_keep_edge = BooleanToggle(True)
hatch_spacing_per_band = Number(Tree({0}: [0.55], {1}: [1.1], {2}: [2.4], {3}: [6], {4}: [400]))
hatch_angle_per_band = Number(Tree({0}: [45], {1}: [135], {2}: [45], {3}: [135], {4}: [0]))
hatch = GhPythonScript(
    crvs=tone.bands,
    spacing=hatch_spacing_per_band,
    angle=hatch_angle_per_band,
    mode=hatch_mode,
    inset=hatch_inset_mm,
    keep_edge=hatch_keep_edge,
    on=hatch_on_off_passthrough)  # -> out, out_crvs; inputs crvs: list; disabled
# ---------- hatch: Python ----------
# HATCH processor - turns CLOSED regions into solid pen fills.
# Two modes: 0 = parallel line hatch (even-odd, holes supported: nest a closed
# curve inside another and it becomes a void), 1 = concentric fill (successive
# insets via the Clipper2 polygon engine - crash-proof offsets).
# PROCESSOR CONTRACT: closed curves in (`crvs`) -> fill linework out (`out_crvs`).
# Inputs: crvs(list, closed), spacing(mm), angle(deg, lines mode), mode(0/1),
#         inset(mm, first offset from the edge ~ half pen width), keep_edge(bool),
#         on(bool bypass)
import Rhino
import Rhino.Geometry as rg
import rhinoscriptsyntax as rs
import scriptcontext as sc
import math, clr
from System.Collections.Generic import List
try:
    sc.doc = ghdoc
except:
    pass

clr.AddReferenceToFileAndPath(r"C:\Users\john.chandler\AppData\Roaming\McNeel\Rhinoceros\packages\7.0\Clipper2GH\1.3.2\Clipper2Lib.dll")
from Clipper2Lib import Paths64, Path64, Point64, Clipper, JoinType, EndType, FillRule

def _to_paths(curve_list, scale):
    """closed curves -> Paths64, normalized via even-odd union so nested
    curves become proper holes with correct winding"""
    paths = Paths64()
    for c in curve_list:
        plc = c.ToPolyline(0.05, 0.2, 0.01, 1e6)
        if plc is None:
            continue
        path = Path64()
        for i in range(plc.PointCount - 1):
            p = plc.Point(i)
            path.Add(Point64(int(round(p.X*scale)), int(round(p.Y*scale))))
        paths.Add(path)
    return Clipper.Union(paths, FillRule.EvenOdd)

SP = float(spacing) if spacing is not None else 1.5
if SP < 0.25:
    SP = 0.25
ANG = float(angle) if angle is not None else 45.0
MODE = int(mode) if mode is not None else 0
INS = float(inset) if inset is not None else 0.75
if INS < 0.0:
    INS = 0.0
EDGE = True if keep_edge is None else bool(keep_edge)
ON = True if on is None else bool(on)

cs = []
n_open = 0
if crvs:
    for c in crvs:
        cc = c if isinstance(c, rg.Curve) else rs.coercecurve(c)
        if cc is None:
            continue
        if not cc.IsClosed:
            n_open += 1
            continue
        cs.append(cc)

out_crvs = []
if not ON:
    out_crvs = cs
elif cs:
    if EDGE:
        for c in cs:
            out_crvs.append(c)
    if MODE == 1:
        # ---- concentric fill via Clipper2 insets ----
        SCALE = 1000.0
        paths = _to_paths(cs, SCALE)
        d = INS if INS > 0.01 else SP
        rounds = 0
        while rounds < 2000:
            sh = Clipper.InflatePaths(paths, -d*SCALE, JoinType.Round, EndType.Polygon)
            if sh is None or sh.Count == 0:
                break
            for path in sh:
                if path.Count < 3:
                    continue
                pts = List[rg.Point3d]()
                for pt in path:
                    pts.Add(rg.Point3d(pt.X/SCALE, pt.Y/SCALE, 0))
                pts.Add(rg.Point3d(path[0].X/SCALE, path[0].Y/SCALE, 0))
                out_crvs.append(rg.PolylineCurve(pts))
            d += SP
            rounds += 1
    else:
        # ---- parallel line hatch, even-odd across ALL region curves ----
        bb = rg.BoundingBox.Empty
        for c in cs:
            bb.Union(c.GetBoundingBox(True))
        cxm = (bb.Min.X+bb.Max.X)/2.0
        cym = (bb.Min.Y+bb.Max.Y)/2.0
        half = 0.6*math.sqrt((bb.Max.X-bb.Min.X)**2 + (bb.Max.Y-bb.Min.Y)**2) + SP
        ar = math.radians(ANG)
        dvx = math.cos(ar); dvy = math.sin(ar)
        nx = -dvy; ny = dvx
        # shrink the region by `inset` first so hatch lines stay off the edge
        regions = cs
        if INS > 0.01:
            SCALE = 1000.0
            paths = _to_paths(cs, SCALE)
            sh = Clipper.InflatePaths(paths, -INS*SCALE, JoinType.Round, EndType.Polygon)
            regions = []
            if sh is not None:
                for path in sh:
                    if path.Count < 3:
                        continue
                    pts = List[rg.Point3d]()
                    for pt in path:
                        pts.Add(rg.Point3d(pt.X/SCALE, pt.Y/SCALE, 0))
                    pts.Add(rg.Point3d(path[0].X/SCALE, path[0].Y/SCALE, 0))
                    regions.append(rg.PolylineCurve(pts))
        nlines = int((2.0*half)/SP) + 1
        made = 0
        for k in range(nlines):
            off = -half + k*SP
            bx = cxm + nx*off; by = cym + ny*off
            pa = rg.Point3d(bx - dvx*half, by - dvy*half, 0)
            pb = rg.Point3d(bx + dvx*half, by + dvy*half, 0)
            lc = rg.LineCurve(pa, pb)
            ts = []
            for c in regions:
                xev = rg.Intersect.Intersection.CurveCurve(lc, c, 0.001, 0.001)
                if xev is not None:
                    for ev in xev:
                        ts.append(ev.ParameterA)
            if len(ts) < 2:
                continue
            ts.sort()
            i = 0
            while i < len(ts) - 1:
                t0 = ts[i]; t1 = ts[i+1]
                seg = lc.Trim(t0, t1)
                if seg is not None and seg.GetLength() > 0.15:
                    out_crvs.append(seg)
                    made += 1
                i += 2
print('%d regions (%d open skipped) -> %d fill curves | mode=%s sp=%.2f' % (
    len(cs), n_open, len(out_crvs), 'concentric' if MODE == 1 else 'lines', SP))
# ---------- end hatch ----------

# ---- group: PATTERN - RADIAL DROPS
radial_wavelength_mm = Slider(12, range=3..40)
radial_centre_xy_pad = MDSlider(
    SliderMode=0,
    slider_value=Point(0.3746534726, 0.4011087056, 0),
    x_domain=Domain(0, 350),
    y_domain=Domain(0, 350),
    z_domain=Domain(0, 1))
radial_2nd_drop_0_1 = Slider(0.35, range=0..1)
radial_radius_mm = Slider(120, range=30..170)
radial_decay_mm = Slider(80, range=10..200)
radial_amplitude = Slider(3, range=0..10)
radial_rays = Slider(90, range=12..240)
depoint = DeconstructPoint(Point=radial_centre_xy_pad, System=PlaneXY(0, 0, 0))  # -> XCoordinate, YCoordinate, ZCoordinate
radial = GhPythonScript(
    rays=radial_rays,
    radius=radial_radius_mm,
    wavelength=radial_wavelength_mm,
    amplitude=radial_amplitude,
    decay=radial_decay_mm,
    drop2=radial_2nd_drop_0_1,
    ctr_x=depoint.XCoordinate,
    ctr_y=depoint.YCoordinate)  # -> out, crvs; disabled
#   port rays: How many lines radiate from the centre.
#   port radius: Outer radius of the pattern in mm.
#   port wavelength: Distance in mm between ripple rings.
#   port amplitude: How far each ring displaces a ray.
#   port decay: Distance in mm over which the ripple fades to nothing. Small = a tight splash.
#   port drop2: Strength of a second drop, 0 to 1. 0 = a single clean splash.
#   port ctr_x: Centre X of the splash, from the XY pad.
#   port ctr_y: Centre Y of the splash, from the XY pad.
# ---------- radial: Python ----------
import Rhino.Geometry as rg
import math
from System.Collections.Generic import List
# radial drop-ripples: rays from center, tangential sine displacement in-phase
# across rays -> concentric wavefronts (top-down raindrop view)
N = int(rays) if rays else 90
R = float(radius) if radius else 120.0
LAM = float(wavelength) if wavelength else 12.0
AMP = float(amplitude) if amplitude is not None else 3.0
DL = float(decay) if decay else 80.0
D2 = float(drop2) if drop2 is not None else 0.35
CX = float(ctr_x) if ctr_x is not None else 0.0
CY = float(ctr_y) if ctr_y is not None else 0.0
r0 = 4.0
S = [(CX, CY, 1.0)]
if D2 > 0.01:
    S.append((CX + 0.38*R*math.cos(0.8), CY + 0.38*R*math.sin(0.8), D2))
crvs = []
step = 1.0
for i in range(N):
    ang = 2.0*math.pi*i/N
    ca = math.cos(ang); sa = math.sin(ang)
    pl = List[rg.Point3d]()
    r = r0
    while r <= R:
        x = CX + ca*r; y = CY + sa*r
        ddx = 0.0; ddy = 0.0
        for src in S:
            vx = x - src[0]; vy = y - src[1]
            ds = math.sqrt(vx*vx + vy*vy)
            if ds < 0.5: ds = 0.5
            d = AMP*src[2]*math.sin(6.283185307*ds/LAM)*math.exp(-ds/DL)
            ddx += d*(-vy/ds); ddy += d*(vx/ds)
        pl.Add(rg.Point3d(x+ddx, y+ddy, 0))
        r += step
    if pl.Count >= 2:
        cv = rg.Curve.CreateInterpolatedCurve(pl, 3)
        if cv: crvs.append(cv)
a = crvs
print('%d rays, %d sources' % (N, len(S)))
# output param renamed a -> crvs; alias so GhPython finds it
crvs = a
# ---------- end radial ----------

# ---- group: PATTERN - LAKE RIPPLES
pinch_amplitude_0_1_5 = Slider(0.8, range=0..1.5)
surface_height_mm = Slider(160, range=10..250)
surface_width_mm = Slider(240, range=30..320)
perspective_1_4 = Slider(2.5, range=1..4)
wavelength_mm = Slider(30, range=3..40)
rows_lines_2 = Slider(60, range=12..240)
seed = Slider(7, range=0..99)
ripple = GhPythonScript(
    rows=rows_lines_2,
    width=surface_width_mm,
    wavelength=wavelength_mm,
    amplitude=pinch_amplitude_0_1_5,
    height=surface_height_mm,
    perspective=perspective_1_4,
    seed=seed)  # -> out, crvs; disabled
#   port rows: How many lines the water surface is drawn with.
#   port width: Width of the surface in mm.
#   port wavelength: Distance in mm between wave crests. Small = choppy, large = a long swell.
#   port amplitude: How sharply each crest pinches, 0 to 1.5. Above about 1.2 the crests start to cross.
#   port height: Height of the surface in mm.
#   port perspective: How strongly rows bunch toward the horizon, 1 (flat on) to 4 (steep).
#   port seed: Changes the wave pattern without changing its character. Same seed = same drawing.
# ---------- ripple: Python ----------
import Rhino.Geometry as rg
import math, random
from System.Collections.Generic import List
# oblique lake-surface: stacked horizontal wave bands, perspective-compressed
# toward the far (top) edge, organic multi-octave wobble, rows pinch where
# displacement approaches local spacing (the lens shapes in water photos).
NR = int(rows) if rows else 60
W = float(width) if width else 240.0
HT = float(height) if height else 160.0
LAM = float(wavelength) if wavelength else 30.0
AMP = float(amplitude) if amplitude is not None else 0.8
PERSP = float(perspective) if perspective else 2.5
SEED = int(seed) if seed is not None else 7
random.seed(SEED)
p1b = random.random()*6.283; p2b = random.random()*6.283; p3b = random.random()*6.283
d1 = (random.random()-0.5)*2.2; d2 = (random.random()-0.5)*3.4; d3 = (random.random()-0.5)*4.8
crvs = []
ws = []; tot = 0.0
for i in range(NR-1):
    t = i/float(NR-2) if NR > 2 else 0.0
    w_ = 1.0 + (PERSP-1.0)*t     # near rows (bottom) spaced wider
    ws.append(w_); tot += w_
ys_rows = [0.0]
y = 0.0
for w_ in ws:
    y += w_*HT/tot
    ys_rows.append(y)
step = 1.5
for i in range(NR):
    t = i/float(NR-1) if NR > 1 else 0.0
    yrow = ys_rows[i]
    sp_local = (ws[i-1] if i > 0 else ws[0])*HT/tot
    ls = 0.35 + 0.65*t           # waves grow toward the foreground
    A = AMP*sp_local*0.9
    Lr = LAM*(0.5 + 0.8*t)
    ph1 = p1b + t*d1*6.283
    ph2 = p2b + t*d2*6.283
    ph3 = p3b + t*d3*6.283
    pl = List[rg.Point3d]()
    x = 0.0
    while x <= W:
        u = x/Lr
        n = (math.sin(u*6.283+ph1) + 0.55*math.sin(u*6.283*1.93+ph2) + 0.3*math.sin(u*6.283*3.71+ph3))/1.85
        pl.Add(rg.Point3d(x, HT - (yrow + A*n*ls), 0))
        x += step
    if pl.Count >= 2:
        cv = rg.Curve.CreateInterpolatedCurve(pl, 3)
        if cv: crvs.append(cv)
a = crvs
print('%d rows, persp %.1f, seed %d' % (NR, PERSP, SEED))
# output param renamed a -> crvs; alias so GhPython finds it
crvs = a
# ---------- end ripple ----------

# ---- group: PROCESSOR - ASCII SHADER image -> drawn characters, matched by SHAPE or density
ascii_edge_0_density_1_shape = Slider(0.3, range=0..1)
ascii_row_aspect = Slider(1.2, range=0.4..2.5)
ascii_cell_mm = Slider(3, range=0.8..20)
ascii_gamma = Slider(2.2, range=0.1..4)
ascii_on_off_passthrough = ASCIIOnOffPassthrough(True)
ascii_charset = Panel(" .:-=+*#%8B")
ascii_invert = BooleanToggle(False)
ascii = GhPythonScript(
    crvs=image_frame_art_rect_mm,
    image=input_image,
    cell=ascii_cell_mm,
    charset=ascii_charset,
    gamma=ascii_gamma,
    aspect=ascii_row_aspect,
    edge=ascii_edge_0_density_1_shape,
    invert=ascii_invert,
    on=ascii_on_off_passthrough)  # -> out, out_crvs; inputs crvs: list
# ---------- ascii: Python ----------
# -*- coding: utf-8 -*-
# ASCII SHADER - renders an image as drawn characters, matched by SHAPE.
#
# A luminance ramp (map cell brightness -> one char from " .-=+*%#@") throws away
# everything except average darkness, so edges turn to mush. Instead each cell is
# sampled in a 3x3 grid of regions, giving a 9-component "shape vector", and the
# character whose own ink distribution best matches that vector is chosen. An
# edge running bottom-left to top-right lights up those regions and picks "/";
# a horizontal edge picks "-" or "_"; a vertical one picks "|". Density still
# falls out of it, because a dark cell matches a dense glyph.
# Character vectors are measured from the real stroke geometry, so they stay
# true if the font changes. (Technique after alexharri.com/blog/ascii-rendering.)
# PROCESSOR CONTRACT: closed region(s) in (`crvs`) -> character strokes out.
# Inputs: crvs(list, closed), image(file path), cell(mm character pitch),
#         charset(str, characters allowed - order irrelevant), gamma(tone curve),
#         aspect(row pitch / cell), edge(0-1 shape-vs-density weighting),
#         invert(bool), on(bool bypass)
import Rhino
import Rhino.Geometry as rg
import rhinoscriptsyntax as rs
import scriptcontext as sc
import math
import sys
import System
import System.Drawing as SD
from System.Collections.Generic import List
try:
    sc.doc = ghdoc
except:
    pass

FONTDIR = r'C:\Users\john.chandler\voron_plotter'
if FONTDIR not in sys.path:
    sys.path.append(FONTDIR)
import strokefont
reload(strokefont)

NR = 3          # sampling grid per cell (NR x NR regions -> NR*NR dimensions)


def load_source(path, maxdim):
    """the image, scaled so its longest side is at most maxdim"""
    try:
        src = SD.Bitmap(path)
        w = src.Width
        h = src.Height
        if w <= maxdim and h <= maxdim:
            return src
        f = float(maxdim) / float(max(w, h))
        tw = int(w * f)
        th = int(h * f)
        if tw < 1:
            tw = 1
        if th < 1:
            th = 1
        conv = SD.Bitmap(tw, th, SD.Imaging.PixelFormat.Format24bppRgb)
        gfx = SD.Graphics.FromImage(conv)
        gfx.InterpolationMode = SD.Drawing2D.InterpolationMode.HighQualityBilinear
        gfx.DrawImage(src, 0, 0, tw, th)
        gfx.Dispose()
        src.Dispose()
        return conv
    except:
        return None


def region_grid(bmp, gw, gh, dx, dy, dw, dh):
    """Resample the image straight onto the region grid, once, in native code.

    The old path read 4 subsamples per region (36 image reads per cell, plus
    coordinate math and tuple lookups in the innermost loop) which cost 6.6s of
    this component's 12.7s. At normal cell sizes a region spans barely one image
    pixel, so that subsampling was mostly re-reading the same pixel anyway.
    Letting GDI+ scale the image to exactly one pixel per region does the
    filtering properly AND leaves one array read per region.
    Anything outside the image reads white, which is what the old bounds check
    fell back to."""
    try:
        from System.Drawing.Imaging import PixelFormat, ImageLockMode
        from System.Runtime.InteropServices import Marshal
        grid = SD.Bitmap(gw, gh, PixelFormat.Format24bppRgb)
        gfx = SD.Graphics.FromImage(grid)
        gfx.Clear(SD.Color.White)
        gfx.InterpolationMode = SD.Drawing2D.InterpolationMode.HighQualityBilinear
        gfx.PixelOffsetMode = SD.Drawing2D.PixelOffsetMode.HighQuality
        gfx.DrawImage(bmp, SD.RectangleF(dx, dy, dw, dh))
        gfx.Dispose()
        data = grid.LockBits(SD.Rectangle(0, 0, gw, gh), ImageLockMode.ReadOnly,
                             PixelFormat.Format24bppRgb)
        stride = data.Stride
        nbytes = abs(stride) * gh
        buf = System.Array.CreateInstance(System.Byte, nbytes)
        Marshal.Copy(data.Scan0, buf, 0, nbytes)
        grid.UnlockBits(data)
        grid.Dispose()
        return (buf, stride)
    except:
        return None


def char_vector(ch, cw, chh, cap):
    """ink density per region for one glyph, measured off its real strokes.
    Returns NR*NR accumulated stroke length, binned over the cell box."""
    bins = [0.0] * (NR * NR)
    polys = strokefont.text(ch, cw * 0.5, chh * 0.18, cap, 0.0, 'center')
    step = 0.08
    for pl in polys:
        for i in range(1, len(pl)):
            ax, ay = pl[i - 1]
            bx, by = pl[i]
            seg = math.sqrt((bx - ax) ** 2 + (by - ay) ** 2)
            n = int(seg / step) + 1
            for k in range(n):
                t = (k + 0.5) / n
                x = ax + (bx - ax) * t
                y = ay + (by - ay) * t
                gx = int(x / cw * NR)
                gy = int(y / chh * NR)
                if gx < 0: gx = 0
                if gx >= NR: gx = NR - 1
                if gy < 0: gy = 0
                if gy >= NR: gy = NR - 1
                bins[gy * NR + gx] += seg / n
    return bins


CELL = float(cell) if cell is not None else 4.0
if CELL < 0.8:
    CELL = 0.8
CHARSET = str(charset) if charset else " .'-_|/\\^=+*ox#%@"
GAM = float(gamma) if gamma is not None else 1.0
if GAM < 0.05:
    GAM = 0.05
ASP = float(aspect) if aspect is not None else 1.35
if ASP < 0.4:
    ASP = 0.4
EDGE = float(edge) if edge is not None else 0.65
if EDGE < 0.0:
    EDGE = 0.0
if EDGE > 1.0:
    EDGE = 1.0
INV = False if invert is None else bool(invert)
ON = True if on is None else bool(on)

IMGPATH = None
if image is not None:
    try:
        IMGPATH = str(image).strip('"')
    except:
        IMGPATH = None

cs = []
if crvs:
    for c in crvs:
        cc = c if isinstance(c, rg.Curve) else rs.coercecurve(c)
        if cc is not None and cc.IsClosed:
            cs.append(cc)

out_crvs = []
info = ''
if not ON:
    out_crvs = cs
    info = '[BYPASSED]'
elif not cs:
    info = 'needs a closed region to fill'
else:
    bmp = load_source(IMGPATH, 1600) if IMGPATH else None
    if bmp is None:
        info = 'NO IMAGE (set the image file path)'
    else:
        rowh = CELL * ASP
        cap = CELL * 0.78
        # ---- character coverage vectors, measured once from the real strokes ----
        # Both the cell and the glyph are described in ABSOLUTE terms: how much
        # ink sits in each region, 0..1. Do not normalise the cell by its own
        # peak - that throws away how dark the cell is, so every smooth region
        # of a photo becomes "uniformly full" and matches whichever glyph covers
        # all nine bins (in practice 'O', for every single cell). Comparing
        # absolute against absolute makes a dark cell pick a dense glyph and a
        # light one pick a sparse glyph, with the distribution still deciding
        # between glyphs of similar weight.
        chars = []
        raw = []
        gmax = 0.0
        dropped = []
        for ch in CHARSET:
            if ch == ' ':
                continue
            v = char_vector(ch, CELL, rowh, cap)
            tot = 0.0
            for q in v:
                tot += q
            if tot <= 0.0:
                dropped.append(ch)      # no glyph in the font - cannot be drawn
                continue
            chars.append(ch)
            raw.append(v)
            # calibrate against the DENSEST glyph's mean coverage, so the set
            # spans 0..1 the same way ink does. Scaling by the largest single
            # bin instead leaves every coverage value well below typical ink,
            # and then the densest glyph is nearest for every cell.
            m = tot / len(v)
            if m > gmax:
                gmax = m
        if gmax <= 0.0:
            gmax = 1.0
        shapes = []
        covsq = []
        dens = []
        for v in raw:
            cov = [q / gmax for q in v]
            ns = 0.0
            tot = 0.0
            for q in cov:
                ns += q * q
                tot += q
            shapes.append(cov)
            covsq.append(ns)
            dens.append(tot / len(cov))
        nch = len(chars)

        bb = rg.BoundingBox.Empty
        for c in cs:
            bb.Union(c.GetBoundingBox(True))
        x0 = bb.Min.X
        y0 = bb.Min.Y
        wid = bb.Max.X - x0
        hei = bb.Max.Y - y0
        idw = wid
        idh = hei
        ia = float(bmp.Width) / float(bmp.Height)
        ba = wid / hei if hei > 0.001 else 1.0
        if ia > ba:
            idh = wid / ia
        else:
            idw = hei * ia
        ix0 = x0 + (wid - idw) / 2.0
        iy0 = y0 + (hei - idh) / 2.0
        ncol = int(wid / CELL)
        nrow = int(hei / rowh)
        if ncol < 1:
            ncol = 1
        if nrow < 1:
            nrow = 1

        # one grid pixel per sampling region, image placed in its fitted rect.
        # grid row 0 is the TOP, so world-y (which runs up) is flipped on read.
        GW = ncol * NR
        GH = nrow * NR
        dx = (ix0 - x0) / CELL * NR
        dw = idw / CELL * NR
        jh = idh / rowh * NR
        j0 = (iy0 - y0) / rowh * NR
        dy = GH - (j0 + jh)
        grid = region_grid(bmp, GW, GH, dx, dy, dw, jh)
        bmp.Dispose()
        if grid is None:
            info = 'image resample failed'
        else:
            gbuf = grid[0]
            gstride = grid[1]

            # ---- auto-levels ----
            # Luminance weights red at 0.299, so a saturated red field reads as
            # "dark" (ink ~0.66) even though it is visually bright. An image like
            # a red sky then lands entirely in the top of the ink range and every
            # cell matches the densest glyph - the charset collapses to one
            # character. Stretch the ink range actually present onto 0..1 so the
            # whole set gets used. Measured only inside the image's own rect, so
            # the white margin around it cannot drag the low end down.
            # gamma still applies on top of this.
            hbin = [0] * 256
            c_lo = int(dx)
            c_hi = int(dx + dw)
            r_lo = int(dy)
            r_hi = int(dy + jh)
            if c_lo < 0: c_lo = 0
            if r_lo < 0: r_lo = 0
            if c_hi > GW: c_hi = GW
            if r_hi > GH: r_hi = GH
            nsamp = 0
            for rr2 in range(r_lo, r_hi, 2):
                ro = rr2 * gstride
                for cc2 in range(c_lo, c_hi, 2):
                    idx = ro + cc2 * 3
                    lum = (0.114 * gbuf[idx] + 0.587 * gbuf[idx + 1]
                           + 0.299 * gbuf[idx + 2]) * 0.00392156862745098
                    ink0 = lum if INV else 1.0 - lum
                    b2 = int(ink0 * 255.0)
                    if b2 < 0: b2 = 0
                    if b2 > 255: b2 = 255
                    hbin[b2] += 1
                    nsamp += 1
            lo = 0.0
            hi = 1.0
            if nsamp > 0:
                cut = int(nsamp * 0.01)
                acc = 0
                for b2 in range(256):
                    acc += hbin[b2]
                    if acc > cut:
                        lo = b2 / 255.0
                        break
                acc = 0
                for b2 in range(255, -1, -1):
                    acc += hbin[b2]
                    if acc > cut:
                        hi = b2 / 255.0
                        break
            if hi - lo < 0.05:          # near-flat image: leave it alone
                lo = 0.0
                hi = 1.0
            inv_span = 1.0 / (hi - lo)

            plane = rg.Plane.WorldXY
            tol = 0.001
            n_ch = 0
            # Which glyphs actually get chosen. This was added while chasing a
            # bug where EVERY cell matched 'o', and it is worth keeping: if the
            # histogram collapses onto one or two characters the match has gone
            # wrong again, and that is invisible from the drawing alone until
            # you have wasted a sheet on it. (It was previously incremented but
            # never initialised, which crashed the component on the first cell.)
            _hist = {}
            flat = GAM == 1.0
            sv = [0.0] * (NR * NR)
            for r in range(nrow):
                cy = y0 + r * rowh
                base_j = r * NR
                for cnum in range(ncol):
                    cx = x0 + cnum * CELL
                    ctr = rg.Point3d(cx + CELL * 0.5, cy + rowh * 0.5, 0)
                    hits = 0
                    for c in cs:
                        if c.Contains(ctr, plane, tol) == rg.PointContainment.Inside:
                            hits += 1
                    if (hits % 2) == 0:
                        continue
                    # ---- read this cell's NR x NR regions, one array hit each ----
                    tot = 0.0
                    col0 = cnum * NR
                    for gy in range(NR):
                        ro = (GH - 1 - (base_j + gy)) * gstride + col0 * 3
                        gb = gy * NR
                        for gx in range(NR):
                            idx = ro + gx * 3
                            lum = (0.114 * gbuf[idx] + 0.587 * gbuf[idx + 1]
                                   + 0.299 * gbuf[idx + 2]) * 0.00392156862745098
                            ink = lum if INV else 1.0 - lum
                            ink = (ink - lo) * inv_span
                            if ink < 0.0:
                                ink = 0.0
                            elif ink > 1.0:
                                ink = 1.0
                            if not flat:
                                ink = math.pow(ink, GAM)
                            sv[gb + gx] = ink
                            tot += ink
                    mean = tot / (NR * NR)
                    if mean < 0.02:
                        continue                   # effectively blank
                    # `edge` trades structure against tone: 1 = match the full
                    # spatial distribution, 0 = match only overall darkness (the
                    # plain luminance ramp). Expanding |sv-cov|^2 to
                    # |sv|^2 - 2.sv.cov + |cov|^2 lets |sv|^2, constant across
                    # candidates, drop out of the argmin - leaving a dot product.
                    best = 0
                    bestd = None
                    dw2 = (1.0 - EDGE) * (NR * NR)
                    for ci in range(nch):
                        csh = shapes[ci]
                        dot = (sv[0] * csh[0] + sv[1] * csh[1] + sv[2] * csh[2]
                               + sv[3] * csh[3] + sv[4] * csh[4] + sv[5] * csh[5]
                               + sv[6] * csh[6] + sv[7] * csh[7] + sv[8] * csh[8])
                        dd2 = mean - dens[ci]
                        d = EDGE * (covsq[ci] - 2.0 * dot) + dw2 * dd2 * dd2
                        if bestd is None or d < bestd:
                            bestd = d
                            best = ci
                    _hist[chars[best]] = _hist.get(chars[best], 0) + 1
                    for pl in strokefont.text(chars[best], cx + CELL * 0.5,
                                              cy + rowh * 0.18, cap, 0.0, 'center'):
                        lp = List[rg.Point3d]()
                        for q in pl:
                            lp.Add(rg.Point3d(q[0], q[1], 0))
                        if lp.Count > 1:
                            out_crvs.append(rg.PolylineCurve(lp))
                    n_ch += 1
            info = '%d chars on %dx%d grid, cell %.1fmm, %d-dim shape match, edge %.2f, %d glyphs, %d strokes | auto-levels %.2f-%.2f' % (
                n_ch, ncol, nrow, CELL, NR * NR, EDGE, nch, len(out_crvs), lo, hi)
            if dropped:
                info += ' | NOT IN FONT, ignored: %s' % ''.join(dropped)
            # most-used glyphs first; a healthy render spreads across many
            _pairs = []
            for _c in _hist:
                _pairs.append((_hist[_c], _c))
            _pairs.sort()
            _pairs.reverse()
            _top = []
            for (_n, _c) in _pairs[:6]:
                _top.append("%s%d" % (_c, _n))
            info += ' | %d glyphs used, top: %s' % (len(_pairs), ' '.join(_top))

print(info)
# ---------- end ascii ----------

# ---- group: PROCESSOR - POINTILLISM image -> dots. `pts` = pen taps (wire to DOTS), `out_crvs` = drawn dots
point_gamma_tone_curve = Slider(0.85, range=0.1..4)
point_screen_angle_deg = Slider(45, range=0..90)
point_cell_pitch_mm = Slider(1.8, range=0.2..10)
point_pen_width_mm = Slider(0.4, range=0.1..2)
# RASTER
# PROCESSORS
point_mode = ValueList({"density (uniform taps)": 0, "halftone grid (size = tone)": 1, "scatter (painterly)": 2}, selected="halftone grid (size = tone)")
point_max_dot_mm = Slider(0.85, range=0.05..5)
point_min_dot_mm = Slider(0, range=0..3)
point_white_cutoff = Slider(0.12, range=0..0.9)
pointillism_on_off_passthrough = POINTILLISMOnOffPassthrough(False)
point_seed = Slider(1, range=1..100)
point_invert = BooleanToggle(False)
pointillism = GhPythonScript(
    crvs=image_frame_art_rect_mm,
    image=input_image,
    mode=point_mode,
    cell=point_cell_pitch_mm,
    min_dot=point_min_dot_mm,
    max_dot=point_max_dot_mm,
    gamma=point_gamma_tone_curve,
    white_cut=point_white_cutoff,
    angle=point_screen_angle_deg,
    pen_width=point_pen_width_mm,
    invert=point_invert,
    seed=point_seed,
    on=pointillism_on_off_passthrough)  # -> out, out_crvs, pts; inputs crvs: list
# ---------- pointillism: Python ----------
# POINTILLISM - turns an image into dots inside the given region(s).
#
# A pen tap is always the same size, so tone has to come from somewhere. Three
# strategies, pick with `mode`:
#   0 density  - uniform dots, SPACING follows tone (dark = more dots).
#                Best for pen taps: wire `pts` into the DOTS block.
#   1 halftone - regular screen grid, dot SIZE follows tone. The classic
#                newsprint look. Rotate the screen with `angle` (45 is standard).
#   2 scatter  - jittered positions, size AND density follow tone. Painterly.
# Modes 1/2 output drawable circles on `out_crvs` (spiral-filled when a dot is
# fatter than the pen, so it reads solid); mode 0 leans on `pts`.
# Both outputs are always produced, so you can plot taps and circles together.
# Inputs: crvs(list, closed regions), image(file path), mode(0/1/2),
#         cell(mm, dot pitch), min_dot/max_dot(mm radius), gamma(tone curve),
#         pen_width(mm, spiral pitch), invert(bool), seed(int), on(bool bypass)
import Rhino
import Rhino.Geometry as rg
import rhinoscriptsyntax as rs
import scriptcontext as sc
import math
import System
import System.Drawing as SD
from System.Collections.Generic import List
try:
    sc.doc = ghdoc
except:
    pass


def load_image(path, maxdim):
    """-> (buffer, stride, w, h) of a 24bpp copy. LockBits + direct indexing;
    GetPixel per sample is far too slow."""
    try:
        from System.Drawing.Imaging import PixelFormat, ImageLockMode
        from System.Runtime.InteropServices import Marshal
        src = SD.Bitmap(path)
        w = src.Width
        h = src.Height
        f = 1.0
        if w > maxdim or h > maxdim:
            f = float(maxdim) / float(max(w, h))
        tw = int(w * f)
        th = int(h * f)
        if tw < 1:
            tw = 1
        if th < 1:
            th = 1
        conv = SD.Bitmap(tw, th, PixelFormat.Format24bppRgb)
        gfx = SD.Graphics.FromImage(conv)
        gfx.DrawImage(src, 0, 0, tw, th)
        gfx.Dispose()
        src.Dispose()
        data = conv.LockBits(SD.Rectangle(0, 0, tw, th), ImageLockMode.ReadOnly, PixelFormat.Format24bppRgb)
        stride = data.Stride
        nbytes = abs(stride) * th
        buf = System.Array.CreateInstance(System.Byte, nbytes)
        Marshal.Copy(data.Scan0, buf, 0, nbytes)
        conv.UnlockBits(data)
        conv.Dispose()
        return (buf, stride, tw, th)
    except:
        return None


def tone_at(x, y, img, ix0, iy0, dw, dh):
    """0 = black, 1 = white. Outside the picture reads as white (no ink)."""
    u = (x - ix0) / dw
    v = (y - iy0) / dh
    if u < 0.0 or u > 1.0 or v < 0.0 or v > 1.0:
        return 1.0
    px = int(u * (img[2] - 1))
    py = int((1.0 - v) * (img[3] - 1))
    idx = py * img[1] + px * 3
    b = img[0][idx]
    g = img[0][idx + 1]
    r = img[0][idx + 2]
    return (0.299 * r + 0.587 * g + 0.114 * b) / 255.0


def spiral_dot(cx, cy, rad, pitch):
    """one continuous spiral from the centre out - a filled dot in a single
    stroke, no pen lifts inside the dot"""
    pts = List[rg.Point3d]()
    if pitch < 0.05:
        pitch = 0.05
    turns = rad / pitch
    steps = int(turns * 16.0)
    if steps < 8:
        steps = 8
    if steps > 400:
        steps = 400
    for i in range(steps + 1):
        f = float(i) / steps
        a = f * turns * 6.283185307
        r = f * rad
        pts.Add(rg.Point3d(cx + r * math.cos(a), cy + r * math.sin(a), 0))
    for i in range(21):
        a = 6.283185307 * i / 20.0
        pts.Add(rg.Point3d(cx + rad * math.cos(a), cy + rad * math.sin(a), 0))
    return rg.PolylineCurve(pts)


MODE = int(mode) if mode is not None else 0
CELL = float(cell) if cell is not None else 2.0
if CELL < 0.2:
    CELL = 0.2
RMIN = float(min_dot) if min_dot is not None else 0.15
if RMIN < 0.0:
    RMIN = 0.0
RMAX = float(max_dot) if max_dot is not None else 1.0
if RMAX < RMIN:
    RMAX = RMIN
GAM = float(gamma) if gamma is not None else 1.0
if GAM < 0.05:
    GAM = 0.05
# white point: tones lighter than this make NO ink, and what remains is
# re-stretched over the full range. Kills the faint halo a render's soft
# background shadow leaves behind, without flattening the object's own tones.
WCUT = float(white_cut) if white_cut is not None else 0.0
if WCUT < 0.0:
    WCUT = 0.0
if WCUT > 0.95:
    WCUT = 0.95
PW = float(pen_width) if pen_width is not None else 0.4
INV = False if invert is None else bool(invert)
SEED = int(seed) if seed is not None else 1
ON = True if on is None else bool(on)
MAXDOTS = 20000

IMGPATH = None
if image is not None:
    try:
        IMGPATH = str(image).strip('"')
    except:
        IMGPATH = None

cs = []
n_open = 0
if crvs:
    for c in crvs:
        cc = c if isinstance(c, rg.Curve) else rs.coercecurve(c)
        if cc is None:
            continue
        if not cc.IsClosed:
            n_open += 1
            continue
        cs.append(cc)

out_crvs = []
pts = []
info = ''
if not ON:
    out_crvs = cs
    info = '[BYPASSED]'
elif not cs:
    info = 'no closed region - give it an area to fill'
else:
    img = load_image(IMGPATH, 1400) if IMGPATH else None
    if img is None:
        info = 'NO IMAGE (set the image file path)'
    else:
        bb = rg.BoundingBox.Empty
        for c in cs:
            bb.Union(c.GetBoundingBox(True))
        x0 = bb.Min.X
        y0 = bb.Min.Y
        wid = bb.Max.X - x0
        hei = bb.Max.Y - y0
        # fit the picture into the region, aspect preserved
        idw = wid
        idh = hei
        ia = float(img[2]) / float(img[3])
        ba = wid / hei if hei > 0.001 else 1.0
        if ia > ba:
            idh = wid / ia
        else:
            idw = hei * ia
        ix0 = x0 + (wid - idw) / 2.0
        iy0 = y0 + (hei - idh) / 2.0

        plane = rg.Plane.WorldXY
        tol = 0.001
        # ---- inside bitmap: native Curve.Contains per grid point is the
        # bottleneck (tens of thousands of calls on a fine cell), so sample the
        # region ONCE onto a grid and look it up afterwards. ----
        _gc = CELL
        if _gc < 1.2:
            _gc = 1.2                        # region edges are smooth; a fine
                                             # mask buys nothing but probe cost
        _bnx = int(wid / _gc) + 3
        _bny = int(hei / _gc) + 3
        if _bnx * _bny > 200000:            # keep the probe grid sane
            _gc = math.sqrt(wid * hei / 200000.0)
            _bnx = int(wid / _gc) + 3
            _bny = int(hei / _gc) + 3
        inside = []
        for j in range(_bny):
            row = []
            py = y0 + (j - 1) * _gc
            for i in range(_bnx):
                px = x0 + (i - 1) * _gc
                p3 = rg.Point3d(px, py, 0)
                hits = 0
                for c in cs:
                    if c.Contains(p3, plane, tol) == rg.PointContainment.Inside:
                        hits += 1
                row.append((hits % 2) == 1)
            inside.append(row)
        rng = [(SEED * 2654435761 + 12345) & 0x7FFFFFFF]
        ar = math.radians(float(angle) if angle is not None else 45.0)
        ca = math.cos(ar)
        sa = math.sin(ar)
        # Iterate ONLY the grid cells that can land inside the region. A naive
        # sweep of the full rotated square (diagonal-sized) wastes ~90% of its
        # steps outside the area - map the bbox corners into grid space instead.
        cxm = x0 + wid / 2.0
        cym = y0 + hei / 2.0
        _gi0 = None; _gi1 = None; _gj0 = None; _gj1 = None
        for _cx4, _cy4 in [(x0, y0), (x0 + wid, y0), (x0, y0 + hei), (x0 + wid, y0 + hei)]:
            _rx = _cx4 - cxm
            _ry = _cy4 - cym
            _lx = _rx * ca + _ry * sa           # inverse rotation
            _ly = -_rx * sa + _ry * ca
            _a = _lx / CELL
            _b = _ly / CELL
            if _gi0 is None or _a < _gi0: _gi0 = _a
            if _gi1 is None or _a > _gi1: _gi1 = _a
            if _gj0 is None or _b < _gj0: _gj0 = _b
            if _gj1 is None or _b > _gj1: _gj1 = _b
        _gi0 = int(math.floor(_gi0)) - 1; _gi1 = int(math.ceil(_gi1)) + 1
        _gj0 = int(math.floor(_gj0)) - 1; _gj1 = int(math.ceil(_gj1)) + 1
        n_dot = 0
        for gj in range(_gj0, _gj1 + 1):
            for gi in range(_gi0, _gi1 + 1):
                if n_dot >= MAXDOTS:
                    break
                lx = gi * CELL
                ly = gj * CELL
                if MODE != 1:
                    rng[0] = (rng[0] * 1103515245 + 12345) & 0x7FFFFFFF
                    jx = (rng[0] / 2147483647.0 - 0.5) * CELL
                    rng[0] = (rng[0] * 1103515245 + 12345) & 0x7FFFFFFF
                    jy = (rng[0] / 2147483647.0 - 0.5) * CELL
                    lx += jx
                    ly += jy
                px = cxm + lx * ca - ly * sa
                py = cym + lx * sa + ly * ca
                bi = int((px - x0) / _gc) + 1
                bj = int((py - y0) / _gc) + 1
                if bj < 0 or bj >= _bny or bi < 0 or bi >= _bnx:
                    continue
                if not inside[bj][bi]:
                    continue
                lum = tone_at(px, py, img, ix0, iy0, idw, idh)
                ink = 1.0 - lum
                if INV:
                    ink = lum
                if WCUT > 0.0:
                    if ink <= WCUT:
                        continue
                    ink = (ink - WCUT) / (1.0 - WCUT)
                ink = math.pow(ink, GAM)
                if MODE == 0:
                    # density: keep or drop this cell by tone, uniform dot
                    rng[0] = (rng[0] * 1103515245 + 12345) & 0x7FFFFFFF
                    if (rng[0] / 2147483647.0) > ink:
                        continue
                    pts.append(rg.Point3d(px, py, 0))
                    if RMIN > 0.01:
                        out_crvs.append(rg.Circle(rg.Point3d(px, py, 0), RMIN).ToNurbsCurve())
                    n_dot += 1
                else:
                    if MODE == 2:
                        rng[0] = (rng[0] * 1103515245 + 12345) & 0x7FFFFFFF
                        if (rng[0] / 2147483647.0) > ink:
                            continue
                    rad = RMIN + (RMAX - RMIN) * ink
                    if rad < 0.05 or ink < 0.02:
                        continue
                    pts.append(rg.Point3d(px, py, 0))
                    # only spiral when the dot genuinely needs more than one
                    # ring to fill - below that a single circle is cleaner than
                    # a one-turn scribble
                    if rad > PW * 1.6:
                        out_crvs.append(spiral_dot(px, py, rad, PW))
                    else:
                        out_crvs.append(rg.Circle(rg.Point3d(px, py, 0), rad).ToNurbsCurve())
                    n_dot += 1
        mnames = {0: 'density (taps)', 1: 'halftone grid', 2: 'scatter'}
        info = '%s, cell %.2fmm, dots %.2f-%.2fmm, gamma %.2f, image %dx%d%s' % (
            mnames.get(MODE, '?'), CELL, RMIN, RMAX, GAM, img[2], img[3],
            ' [capped]' if n_dot >= MAXDOTS else '')

print('%d region(s)%s -> %d dots, %d drawable | %s' % (
    len(cs), (' (%d open ignored)' % n_open) if n_open else '', len(pts), len(out_crvs), info))
# ---------- end pointillism ----------

# ---- group: PROCESSOR - STIPPLE / TSP ART blue-noise dots (-> DOTS block) + one-line tour
stipple_blob_scale_mm = Slider(150, range=2..200)
stipple_spacing_mm = Slider(2, range=0.4..10)
# HATCH/CLOSED
# REGION
# PROCESSORS
stipple_inset_mm = Slider(3, range=0..5)
stipple_contrast = Slider(2.5, range=1..5)
stipple_tsp_tour_one_line = BooleanToggle(True)
stipple_seed = Slider(1, range=1..100)
stipple_on_off_passthrough = STIPPLEOnOffPassthrough(True)
stipple = GhPythonScript(
    crvs=image_frame_art_rect_mm,
    spacing=stipple_spacing_mm,
    contrast=stipple_contrast,
    scale=stipple_blob_scale_mm,
    seed=stipple_seed,
    image=input_image,
    tsp=stipple_tsp_tour_one_line,
    inset=stipple_inset_mm,
    on=stipple_on_off_passthrough)  # -> out, out_crvs, pts; inputs crvs: list
# ---------- stipple: Python ----------
# STIPPLE / TSP-ART processor - fills closed regions with blue-noise dots whose
# density follows a noise field (dark/dense vs light/sparse), then optionally
# threads ONE continuous line through every dot (a travelling-salesman tour):
# an entire image rendered as a single unbroken stroke.
# TWO OUTPUTS:
#   pts      -> feed the DOTS block for a stippled dot field (pen taps)
#   out_crvs -> the TSP path as a single polyline, for a layer slot
# Use either or both. Sampling is Bridson Poisson-disk with a variable radius,
# so dots stay evenly spread instead of clumping.
# Inputs: crvs(list, closed), spacing(mm, min dot spacing in the DENSE areas),
#         contrast(1 = flat/even, 4 = strong light-dark variation),
#         scale(mm, size of the density blobs - noise mode only), seed(int),
#         image(file path: if given, dot density follows the PICTURE's tone
#               instead of noise - this is how you stipple a photograph),
#         tsp(bool, compute the tour - costs time on big point counts),
#         inset(mm), on(bool bypass)
import Rhino
import Rhino.Geometry as rg
import rhinoscriptsyntax as rs
import scriptcontext as sc
import math, clr
import System
import System.Drawing as SD
from System.Collections.Generic import List
try:
    sc.doc = ghdoc
except:
    pass


def load_image(path, maxdim):
    """-> (buffer, stride, w, h) of a 24bpp copy, or None. LockBits because
    GetPixel per sample would be far too slow."""
    try:
        from System.Drawing.Imaging import PixelFormat, ImageLockMode
        from System.Runtime.InteropServices import Marshal
        src = SD.Bitmap(path)
        w = src.Width
        h = src.Height
        f = 1.0
        if w > maxdim or h > maxdim:
            f = float(maxdim) / float(max(w, h))
        tw = int(w * f)
        th = int(h * f)
        if tw < 1:
            tw = 1
        if th < 1:
            th = 1
        conv = SD.Bitmap(tw, th, PixelFormat.Format24bppRgb)
        gfx = SD.Graphics.FromImage(conv)
        gfx.DrawImage(src, 0, 0, tw, th)
        gfx.Dispose()
        src.Dispose()
        data = conv.LockBits(SD.Rectangle(0, 0, tw, th), ImageLockMode.ReadOnly, PixelFormat.Format24bppRgb)
        stride = data.Stride
        nbytes = abs(stride) * th
        buf = System.Array.CreateInstance(System.Byte, nbytes)
        Marshal.Copy(data.Scan0, buf, 0, nbytes)
        conv.UnlockBits(data)
        conv.Dispose()
        return (buf, stride, tw, th)
    except:
        return None


def image_tone(x, y, img, ix0, iy0, dw, dh):
    """0 = black (dense dots), 1 = white (sparse). Outside the frame -> white."""
    u = (x - ix0) / dw
    v = (y - iy0) / dh
    if u < 0.0 or u > 1.0 or v < 0.0 or v > 1.0:
        return 1.0
    px = int(u * (img[2] - 1))
    py = int((1.0 - v) * (img[3] - 1))
    idx = py * img[1] + px * 3
    b = img[0][idx]
    g = img[0][idx + 1]
    r = img[0][idx + 2]
    return (0.299 * r + 0.587 * g + 0.114 * b) / 255.0

clr.AddReferenceToFileAndPath(r"C:\Users\john.chandler\AppData\Roaming\McNeel\Rhinoceros\packages\7.0\Clipper2GH\1.3.2\Clipper2Lib.dll")
from Clipper2Lib import Paths64, Path64, Point64, Clipper, JoinType, EndType, FillRule


def nextrand(state):
    """LCG in 0..1; state is a one-item list so it mutates without globals"""
    state[0] = (state[0] * 1103515245 + 12345) & 0x7FFFFFFF
    return state[0] / 2147483647.0


def lattice(ix, iy, sd):
    n = (ix * 73856093) ^ (iy * 19349663) ^ (sd * 83492791)
    n = n & 0x7FFFFFFF
    n = (n * 1103515245 + 12345) & 0x7FFFFFFF
    return (n % 65536) / 65535.0


def vnoise(x, y, sd):
    ix = int(math.floor(x))
    iy = int(math.floor(y))
    fx = x - ix
    fy = y - iy
    ux = fx * fx * (3.0 - 2.0 * fx)
    uy = fy * fy * (3.0 - 2.0 * fy)
    v00 = lattice(ix, iy, sd)
    v10 = lattice(ix + 1, iy, sd)
    v01 = lattice(ix, iy + 1, sd)
    v11 = lattice(ix + 1, iy + 1, sd)
    a = v00 + (v10 - v00) * ux
    b = v01 + (v11 - v01) * ux
    return a + (b - a) * uy


def density_at(x, y, sc_mm, sd):
    """0..1 tone field: 0 = dark/dense dots, 1 = light/sparse"""
    n = vnoise(x / sc_mm, y / sc_mm, sd)
    n = n + 0.5 * vnoise(x / (sc_mm * 0.4), y / (sc_mm * 0.4), sd + 31)
    n = n / 1.5
    if n < 0.0:
        n = 0.0
    if n > 1.0:
        n = 1.0
    return n


def shrink_regions(curve_list, amount, scale):
    paths = Paths64()
    for c in curve_list:
        plc = c.ToPolyline(0.05, 0.2, 0.01, 1e6)
        if plc is None:
            continue
        path = Path64()
        for i in range(plc.PointCount - 1):
            p = plc.Point(i)
            path.Add(Point64(int(round(p.X * scale)), int(round(p.Y * scale))))
        paths.Add(path)
    norm = Clipper.Union(paths, FillRule.EvenOdd)
    sh = Clipper.InflatePaths(norm, -amount * scale, JoinType.Round, EndType.Polygon)
    out = []
    if sh is not None:
        for path in sh:
            if path.Count < 3:
                continue
            pts = List[rg.Point3d]()
            for pt in path:
                pts.Add(rg.Point3d(pt.X / scale, pt.Y / scale, 0))
            pts.Add(rg.Point3d(path[0].X / scale, path[0].Y / scale, 0))
            out.append(rg.PolylineCurve(pts))
    return out


SP = float(spacing) if spacing is not None else 2.0
if SP < 0.4:
    SP = 0.4
CON = float(contrast) if contrast is not None else 2.5
if CON < 1.0:
    CON = 1.0
SCL = float(scale) if scale is not None else 50.0
if SCL < 2.0:
    SCL = 2.0
SEED = int(seed) if seed is not None else 1
TSP = True if tsp is None else bool(tsp)
IMGPATH = None
if image is not None:
    try:
        IMGPATH = str(image).strip('"')
    except:
        IMGPATH = None
INS = float(inset) if inset is not None else 0.75
if INS < 0.0:
    INS = 0.0
ON = True if on is None else bool(on)
MAXPTS = 6000

cs = []
n_open = 0
if crvs:
    for c in crvs:
        cc = c if isinstance(c, rg.Curve) else rs.coercecurve(c)
        if cc is None:
            continue
        if not cc.IsClosed:
            n_open += 1
            continue
        cs.append(cc)

out_crvs = []
pts = []
info = ''
if not ON:
    out_crvs = cs
    info = '[BYPASSED]'
elif cs:
    regions = cs
    if INS > 0.01:
        shrunk = shrink_regions(cs, INS, 1000.0)
        if shrunk:
            regions = shrunk

    bb = rg.BoundingBox.Empty
    for c in regions:
        bb.Union(c.GetBoundingBox(True))
    x0 = bb.Min.X
    y0 = bb.Min.Y
    wid = bb.Max.X - x0
    hei = bb.Max.Y - y0
    rmin = SP
    rmax = SP * CON
    # image tone drives density when supplied, otherwise the noise field does
    img = None
    imgnote = ''
    if IMGPATH:
        img = load_image(IMGPATH, 1400)
        if img is None:
            imgnote = ' (IMAGE FAILED TO LOAD - using noise)'
    idw = wid
    idh = hei
    if img is not None:
        ia = float(img[2]) / float(img[3])
        ba = wid / hei
        if ia > ba:
            idw = wid
            idh = wid / ia
        else:
            idh = hei
            idw = hei * ia
    ix0 = x0 + (wid - idw) / 2.0
    iy0 = y0 + (hei - idh) / 2.0

    # inside bitmap (native Contains is slow - do it once)
    gc = max(0.4, rmin * 0.5)
    nx = int(math.ceil(wid / gc)) + 2
    ny = int(math.ceil(hei / gc)) + 2
    plane = rg.Plane.WorldXY
    tol = 0.001
    inside = []
    for j in range(ny):
        row = []
        py = y0 + (j - 0.5) * gc
        for i in range(nx):
            px = x0 + (i - 0.5) * gc
            hits = 0
            p3 = rg.Point3d(px, py, 0)
            for c in regions:
                if c.Contains(p3, plane, tol) == rg.PointContainment.Inside:
                    hits += 1
            row.append((hits % 2) == 1)
        inside.append(row)

    # --- Bridson Poisson-disk with variable radius ---
    cell = rmin / 1.4142
    gnx = int(math.ceil(wid / cell)) + 2
    gny = int(math.ceil(hei / cell)) + 2
    grid = {}
    samples = []
    active = []
    rng = [(SEED * 2654435761) & 0x7FFFFFFF]
    reach = int(math.ceil(rmax / cell)) + 1

    # find a starting point inside the region
    for attempt in range(400):
        sx = x0 + nextrand(rng) * wid
        sy = y0 + nextrand(rng) * hei
        bi = int((sx - x0) / gc) + 1
        bj = int((sy - y0) / gc) + 1
        if 0 <= bj < ny and 0 <= bi < nx and inside[bj][bi]:
            samples.append((sx, sy))
            active.append(0)
            grid[(int((sx - x0) / cell), int((sy - y0) / cell))] = [0]
            break

    guard = 0
    while active and len(samples) < MAXPTS and guard < 400000:
        guard += 1
        ai = int(nextrand(rng) * len(active))
        if ai >= len(active):
            ai = len(active) - 1
        pi = active[ai]
        px = samples[pi][0]
        py = samples[pi][1]
        if img is not None:
            r_here = rmin + (rmax - rmin) * image_tone(px, py, img, ix0, iy0, idw, idh)
        else:
            r_here = rmin + (rmax - rmin) * density_at(px, py, SCL, SEED)
        placed = False
        for k in range(24):
            ang = nextrand(rng) * 2.0 * math.pi
            rad = r_here * (1.0 + nextrand(rng))
            cxp = px + math.cos(ang) * rad
            cyp = py + math.sin(ang) * rad
            bi = int((cxp - x0) / gc) + 1
            bj = int((cyp - y0) / gc) + 1
            if bj < 0 or bj >= ny or bi < 0 or bi >= nx or not inside[bj][bi]:
                continue
            if img is not None:
                r_c = rmin + (rmax - rmin) * image_tone(cxp, cyp, img, ix0, iy0, idw, idh)
            else:
                r_c = rmin + (rmax - rmin) * density_at(cxp, cyp, SCL, SEED)
            gi = int((cxp - x0) / cell)
            gj = int((cyp - y0) / cell)
            ok = True
            for dj in range(-reach, reach + 1):
                for di in range(-reach, reach + 1):
                    key = (gi + di, gj + dj)
                    if key not in grid:
                        continue
                    for si in grid[key]:
                        dx = samples[si][0] - cxp
                        dy = samples[si][1] - cyp
                        if dx * dx + dy * dy < r_c * r_c:
                            ok = False
                            break
                    if not ok:
                        break
                if not ok:
                    break
            if ok:
                samples.append((cxp, cyp))
                idx = len(samples) - 1
                if (gi, gj) not in grid:
                    grid[(gi, gj)] = []
                grid[(gi, gj)].append(idx)
                active.append(idx)
                placed = True
                break
        if not placed:
            active.pop(ai)

    for s in samples:
        pts.append(rg.Point3d(s[0], s[1], 0))

    # --- TSP tour: grid-accelerated nearest neighbour, then local 2-opt ---
    if TSP and len(samples) > 2:
        tgrid = {}
        tcell = rmax * 1.5
        for i in range(len(samples)):
            key = (int((samples[i][0] - x0) / tcell), int((samples[i][1] - y0) / tcell))
            if key not in tgrid:
                tgrid[key] = []
            tgrid[key].append(i)
        visited = []
        for i in range(len(samples)):
            visited.append(False)
        tour = [0]
        visited[0] = True
        cur = 0
        for step in range(len(samples) - 1):
            cx = samples[cur][0]
            cy = samples[cur][1]
            gi = int((cx - x0) / tcell)
            gj = int((cy - y0) / tcell)
            best = -1
            bestd = None
            ring = 1
            while best < 0 and ring < 200:
                for dj in range(-ring, ring + 1):
                    for di in range(-ring, ring + 1):
                        if max(abs(di), abs(dj)) != ring and ring > 1:
                            continue
                        key = (gi + di, gj + dj)
                        if key not in tgrid:
                            continue
                        for si in tgrid[key]:
                            if visited[si]:
                                continue
                            dx = samples[si][0] - cx
                            dy = samples[si][1] - cy
                            d = dx * dx + dy * dy
                            if bestd is None or d < bestd:
                                bestd = d
                                best = si
                ring += 1
            if best < 0:
                break
            visited[best] = True
            tour.append(best)
            cur = best
        # local 2-opt: uncross nearby segments (cheap, big visual win)
        for sweep in range(2):
            i = 1
            while i < len(tour) - 3:
                a1 = samples[tour[i - 1]]
                a2 = samples[tour[i]]
                jmax = i + 40
                if jmax > len(tour) - 2:
                    jmax = len(tour) - 2
                j = i + 2
                while j < jmax:
                    b1 = samples[tour[j]]
                    b2 = samples[tour[j + 1]]
                    d0 = math.hypot(a1[0] - a2[0], a1[1] - a2[1]) + math.hypot(b1[0] - b2[0], b1[1] - b2[1])
                    d1 = math.hypot(a1[0] - b1[0], a1[1] - b1[1]) + math.hypot(a2[0] - b2[0], a2[1] - b2[1])
                    if d1 < d0 - 0.0001:
                        seg = tour[i:j + 1]
                        seg.reverse()
                        tour = tour[:i] + seg + tour[j + 1:]
                        a2 = samples[tour[i]]
                    j += 1
                i += 1
        lp = List[rg.Point3d]()
        for ti in tour:
            lp.Add(rg.Point3d(samples[ti][0], samples[ti][1], 0))
        out_crvs.append(rg.PolylineCurve(lp))
    info = '%d dots, spacing %.2f-%.2fmm, density from %s%s%s' % (
        len(samples), rmin, rmax,
        ('IMAGE %dx%d' % (img[2], img[3])) if img is not None else ('noise scale %.0fmm' % SCL),
        (', TSP tour' if (TSP and len(samples) > 2) else ''), imgnote)

print('%d regions (%d open skipped) -> %d dots, %d path(s) | %s' % (len(cs), n_open, len(pts), len(out_crvs), info))
# ---------- end stipple ----------

# ----
gen_info = Panel(gen.out)
ripple_info = Panel(ripple.out)

# ---- group: DOTS pen taps: pick a source, DOTS assigns the pen, PLACE carries them. OFF = free
dots_pen = ValueList({"OFF": 0, "Pen 1 [BLACK FINE]": 1, "Pen 2 [BLACK BOLD]": 2, "Pen 3 [BLACK ROLLER]": 3, "Pen 4 [RED FINE]": 4, "Pen 5 [CUSTOM 1]": 5, "Pen 6 [CUSTOM 2]": 6, "Pen 7 [CUSTOM 3]": 7, "Pen 8 [CUSTOM 4]": 8}, selected="Pen 3 [BLACK ROLLER]")
dots_source = DOTSSource({"OFF": 0, "GEN warped mesh": 1, "POINTILLISM": 2, "STIPPLE": 3}, selected="OFF")
# DOT
# PROCESSOR
pentaps = PENTAPS(pts_gen=gen.pts, pts_point=pointillism.pts, pts_stip=stipple.pts, src=dots_source, pen=dots_pen)  # -> out, dots; inputs pts_gen: list, pts_point: list, pts_stip: list; disabled
# ---------- pentaps: Python ----------
# PEN TAPS - choose a point source and assign it a pen, in one box.
#
# Was two components wired in series (DOTSPICK -> DOTS) inside the same group,
# which is two boxes and two labels for one idea: "which dots, and which pen".
#
# Taps are DWELLS, not strokes: every point is one press of the pen. A halftone
# POINTILLISM pass emits ~10k of them, so the source list defaults to OFF and
# the info line shouts when the count gets expensive.
#
# src: 0 = OFF (channel dead, costs nothing)
#      1 = GEN (warped mesh)   2 = POINTILLISM.pts   3 = STIPPLE.pts
#
# pen 0 = OFF emits NOTHING - not an empty list of dots that still exist. Dots
# that will not plot must never reach PLACE, or they still count toward the
# artwork bounding box and shove the centring of everything else off. Same rule
# the LAYER TABLE uses for pen 0.
#
# PROCESSOR CONTRACT: candidate point streams in, placed-ready dots out.
# Inputs: pts_gen, pts_point, pts_stip (list), src (int 0-3), pen (int 0-8)
import Rhino.Geometry as rg
import rhinoscriptsyntax as rs
import scriptcontext as sc
try:
    sc.doc = ghdoc
except:
    pass

S = 0
try:
    if src is not None:
        S = int(float(str(src)))
except:
    S = 0
if S < 0: S = 0
if S > 3: S = 3
PN = 0 if pen is None else int(pen)

NAMES = ['OFF', 'GEN (warped mesh)', 'POINTILLISM', 'STIPPLE']
cands = [None, pts_gen, pts_point, pts_stip]
sel = cands[S] if S else None
raw = [p for p in sel if p is not None] if sel else []

# ingest: points, or small closed curves/circles (use their centre)
dots = []
if raw and PN >= 1:
    for d in raw:
        if isinstance(d, rg.Point3d):
            dots.append(rg.Point3d(d)); continue
        p3 = rs.coerce3dpoint(d)
        if p3 is not None:
            dots.append(rg.Point3d(p3)); continue
        c = d if isinstance(d, rg.Curve) else rs.coercecurve(d)
        if c is not None:
            bb = c.GetBoundingBox(True)
            dots.append(rg.Point3d((bb.Min.X + bb.Max.X) / 2.0,
                                   (bb.Min.Y + bb.Max.Y) / 2.0, 0))

if S == 0:
    info = 'PEN TAPS: source OFF - no pen taps'
elif PN < 1:
    info = 'PEN TAPS: %s has %d points but pen is OFF -> none emitted (kept out of placement)' % (
        NAMES[S], len(raw))
else:
    info = 'PEN TAPS: %s -> %d taps on pen %d' % (NAMES[S], len(dots), PN)
    if not raw:
        info += ' | source is empty - is that component off in the PLOT RECIPE?'
    elif len(dots) > 3000:
        info += ' | that is a LOT of pen presses - check the time estimate before plotting'
print(info)
# ---------- end pentaps ----------
pentaps_info = Panel(pentaps.out)

# ---- group: FX SPLICE drag a SLOT plug into FX IN, run ONE effect, wire its out_crvs into LAYERS
# no effect is spliced in
# FX IN - what this is: FX IN feeds the line-effects rack below (DASH / VARDASH / CROP / CA).
# It is a RELAY: a socket you drag a wire into, nothing more.
# 
# It is deliberately EMPTY. The rack is optional and off the main path,
# so nothing here touches a plot until you connect it yourself.
# 
# To use an effect:
#   1. drag a SLOT plug (or any processor's out_crvs) into FX IN
#   2. tick that effect in PLOT RECIPE
#   3. wire THAT effect's out_crvs into a LAYER slot
# 
# Wire ONE effect out, not several - they all read FX IN in parallel,
# so plugging two into the same slot draws the line twice.
fx_in_drag_a_slot_plug_here_then_wire_th = Relay()  # "FX IN < drag a SLOT plug here, then wire that fx out into LAYERS"

# ---- group: PROCESSOR - CROP clips curves to any closed shape(s); nested shapes read even-odd
crop_shapes_plug_or_internalise_closed_c = CROPShapesPlugOrInternaliseCLOSEDCurves()  # "CROP shapes (plug or internalise CLOSED curves)"
crop_mode = ValueList({"keep INSIDE": 0, "keep OUTSIDE": 1}, selected="keep INSIDE")
crop_on_off_passthrough = CROPOnOffPassthrough(True)
crop = GhPythonScript(
    crvs=fx_in_drag_a_slot_plug_here_then_wire_th,
    crop=crop_shapes_plug_or_internalise_closed_c,
    mode=crop_mode,
    on=crop_on_off_passthrough)  # -> out, out_crvs; inputs crvs: list, crop: list; disabled
# ---------- crop: Python ----------
# CROP processor - clips curves to one or more closed crop shapes of any form
# (circles, rectangles, blobs, text outlines, anything closed).
#
# Multiple crop shapes are combined EVEN-ODD, so a shape nested inside another
# reads as a hole - drop a small circle inside a big one and you crop to a ring.
# Curves are split at every boundary crossing and each piece is kept or dropped
# on its own, so a stroke can enter and leave the crop region repeatedly.
# The pressure channel (point Z) survives, since splitting preserves it.
# PROCESSOR CONTRACT: curves in (`crvs`) -> cropped curves out (`out_crvs`).
# Inputs: crvs(list, any curves), crop(list, CLOSED crop shapes),
#         mode(0 keep inside / 1 keep outside), on(bool bypass)
import Rhino
import Rhino.Geometry as rg
import rhinoscriptsyntax as rs
import scriptcontext as sc
from System.Collections.Generic import List
try:
    sc.doc = ghdoc
except:
    pass

MODE = int(mode) if mode is not None else 0
ON = True if on is None else bool(on)
TOL = 0.001
PLANE = rg.Plane.WorldXY

cs = []
if crvs:
    for c in crvs:
        cc = c if isinstance(c, rg.Curve) else rs.coercecurve(c)
        if cc is not None:
            cs.append(cc)

bounds = []
n_open = 0
if crop:
    for c in crop:
        cc = c if isinstance(c, rg.Curve) else rs.coercecurve(c)
        if cc is None:
            continue
        if not cc.IsClosed:
            n_open += 1
            continue
        bounds.append(cc)

# bounding boxes of the crop shapes, for cheap rejection
bbs = []
for b in bounds:
    bbs.append(b.GetBoundingBox(True))
bb_all = rg.BoundingBox.Empty
for b in bbs:
    bb_all.Union(b)

out_crvs = []
info = ''
if not ON:
    out_crvs = cs
    info = '[BYPASSED]'
elif not bounds:
    out_crvs = cs
    info = 'no closed crop shape - passing through untouched'
elif cs:
    n_split = 0
    n_whole = 0
    n_dropped = 0
    for c in cs:
        cbb = c.GetBoundingBox(True)
        # cheap reject: entirely clear of every crop shape
        if not cbb.IsValid:
            continue
        away = True
        for b in bbs:
            if not (cbb.Min.X > b.Max.X or cbb.Max.X < b.Min.X or
                    cbb.Min.Y > b.Max.Y or cbb.Max.Y < b.Min.Y):
                away = False
                break
        if away:
            if MODE == 1:
                out_crvs.append(c)
                n_whole += 1
            else:
                n_dropped += 1
            continue

        ts = []
        for b in bounds:
            xev = rg.Intersect.Intersection.CurveCurve(c, b, TOL, TOL)
            if xev is not None:
                for ev in xev:
                    ts.append(ev.ParameterA)
        pieces = None
        if ts:
            ts.sort()
            tl = List[float]()
            for t in ts:
                tl.Add(t)
            pieces = c.Split(tl)
        if pieces is None or len(pieces) == 0:
            pieces = [c]
        else:
            n_split += 1

        for pc in pieces:
            if pc is None:
                continue
            try:
                mid = pc.PointAtNormalizedLength(0.5)
            except:
                mid = pc.PointAtStart
            probe = rg.Point3d(mid.X, mid.Y, 0.0)   # test in plan, ignore pressure Z
            hits = 0
            for b in bounds:
                if b.Contains(probe, PLANE, TOL) == rg.PointContainment.Inside:
                    hits += 1
            inside = (hits % 2) == 1
            keep = inside if MODE == 0 else (not inside)
            if keep and pc.GetLength() > 0.05:
                out_crvs.append(pc)
            else:
                n_dropped += 1
    info = '%d crop shape(s)%s, keep %s | %d curves split, %d passed whole, %d pieces dropped' % (
        len(bounds), (' (%d open ignored)' % n_open) if n_open else '',
        'OUTSIDE' if MODE == 1 else 'INSIDE', n_split, n_whole, n_dropped)

print('%d curves -> %d | %s' % (len(cs), len(out_crvs), info))
# ---------- end crop ----------

# ---- group: PROCESSOR - VARIABLE DASH ink/gap balance driven along the line or by attractors
vardash_mode = ValueList({"along length (start -> end)": 0, "proximity to attractors": 1}, selected="along length (start -> end)")
vardash_min_ink_0_0_9 = Slider(0.08, range=0..0.9)
vardash_radius_mm = Slider(50, range=1..200)
vardash_scatter_0_1 = Slider(0.5, range=0..1)
# CURVE
# PROCESSORS
vardash_dash_mm = Slider(6, range=0.3..20)
vardash_attractors_points_and_or_curves = VARDASHAttractorsPointsAndOrCurves()
vardash_gap_mm = Slider(3, range=0.1..20)
vardash_on_off_passthrough = VARDASHOnOffPassthrough(True)
vardash_invert = BooleanToggle(False)
vardash = GhPythonScript(
    crvs=fx_in_drag_a_slot_plug_here_then_wire_th,
    dash=vardash_dash_mm,
    gap=vardash_gap_mm,
    mode=vardash_mode,
    attract=vardash_attractors_points_and_or_curves,
    radius=vardash_radius_mm,
    min_ink=vardash_min_ink_0_0_9,
    scatter=vardash_scatter_0_1,
    invert=vardash_invert,
    on=vardash_on_off_passthrough)  # -> out, out_crvs; inputs crvs: list, attract: list; disabled
#   port crvs: Curves to process. Feed a layer slot, or another processor output. (list)
# ---------- vardash: Python ----------
# VARIABLE DASH processor - dashing whose ink/gap balance CHANGES along the
# stroke. The period (dash+gap) stays constant so the rhythm reads as even,
# but the fraction of each period that is inked is driven by:
#   mode 0: position along the line (0% at the start -> 100% at the end)
#   mode 1: proximity to attractors (points and/or curves in `attract`)
# At driver = 0 the line is nearly solid; at driver = 1 it thins to `min_ink`.
# `invert` flips the direction (dissolve near vs far / start vs end).
# Pressure Z survives - pieces are sampled from the source curve.
# PROCESSOR CONTRACT: curves in (`crvs`) -> dashed curves out (`out_crvs`).
# `scatter` (0-1) de-synchronises the pattern across an array of lines: each
# curve gets a random phase shift (deterministic per curve index, so plots are
# repeatable) and each dash a little length jitter - kills the moire "columns"
# you get when parallel lines all dash in lockstep.
# Inputs: crvs(list), dash(mm), gap(mm), mode(0/1), attract(list, pts/crvs),
#         radius(mm, proximity falloff), min_ink(0-0.9, ink fraction at full
#         effect), scatter(0-1), invert(bool), on(bool bypass)
import Rhino
import Rhino.Geometry as rg
import rhinoscriptsyntax as rs
import scriptcontext as sc
import math
from System.Collections.Generic import List
try:
    sc.doc = ghdoc
except:
    pass

DASH = float(dash) if dash is not None else 6.0
if DASH < 0.3:
    DASH = 0.3
GAP = float(gap) if gap is not None else 3.0
if GAP < 0.1:
    GAP = 0.1
MODE = int(mode) if mode is not None else 0
RAD = float(radius) if radius is not None else 50.0
if RAD < 1.0:
    RAD = 1.0
MINI = float(min_ink) if min_ink is not None else 0.08
if MINI < 0.0:
    MINI = 0.0
if MINI > 0.9:
    MINI = 0.9
SCAT = float(scatter) if scatter is not None else 0.35
if SCAT < 0.0:
    SCAT = 0.0
if SCAT > 1.0:
    SCAT = 1.0
INV = False if invert is None else bool(invert)
ON = True if on is None else bool(on)
PERIOD = DASH + GAP
MAXI = 0.96                     # ink fraction at zero effect (nearly solid)
STEP = 0.8                      # sampling step along ink pieces, mm

cs = []
if crvs:
    for c in crvs:
        cc = c if isinstance(c, rg.Curve) else rs.coercecurve(c)
        if cc is not None:
            cs.append(cc)

# attractors: points and curves both welcome
apts = []
acrvs = []
if attract:
    for a in attract:
        if isinstance(a, rg.Point3d):
            apts.append(rg.Point3d(a.X, a.Y, 0))
            continue
        p3 = rs.coerce3dpoint(a)
        if p3 is not None:
            apts.append(rg.Point3d(p3.X, p3.Y, 0))
            continue
        ac = a if isinstance(a, rg.Curve) else rs.coercecurve(a)
        if ac is not None:
            acrvs.append(ac)

def at_len(cum, pts, s):
    """point at arc length s, interpolated from a prebuilt table.

    Curve.LengthParameter costs ~680us a call because it solves for arc length
    every single time; dashing a page of linework asks for it ~10k times, which
    was 7 of this component's 11.6 seconds. Sampling each curve once up front
    and interpolating turns that into a binary search. Z is interpolated too, so
    the pressure channel survives exactly as it did before."""
    n = len(cum)
    if s <= 0.0:
        return pts[0]
    if s >= cum[n - 1]:
        return pts[n - 1]
    lo = 0
    hi = n - 1
    while hi - lo > 1:
        mid = (lo + hi) // 2
        if cum[mid] <= s:
            lo = mid
        else:
            hi = mid
    span = cum[hi] - cum[lo]
    f = 0.0 if span < 1e-12 else (s - cum[lo]) / span
    a = pts[lo]
    b = pts[hi]
    return rg.Point3d(a.X + (b.X - a.X) * f,
                      a.Y + (b.Y - a.Y) * f,
                      a.Z + (b.Z - a.Z) * f)


out_crvs = []
info = ''
if not ON:
    out_crvs = cs
    info = '[BYPASSED]'
elif cs:
    n_pieces = 0
    for ci in range(len(cs)):
        c = cs[ci]
        L = c.GetLength()
        if L < 0.05:
            continue
        # sample this curve once into an arc-length table (see at_len)
        tn = int(L / (STEP * 0.5))
        if tn < 16:
            tn = 16
        if tn > 20000:
            tn = 20000
        tts = c.DivideByCount(tn, True)
        if not tts:
            continue
        tpts = []
        for tt in tts:
            tpts.append(c.PointAt(tt))
        tcum = [0.0]
        for k in range(1, len(tpts)):
            tcum.append(tcum[k - 1] + tpts[k - 1].DistanceTo(tpts[k]))
        # work in the table's own metric so dashes stay evenly spaced in it
        L = tcum[len(tcum) - 1]
        if L < 0.05:
            continue
        # deterministic per-curve LCG for phase + jitter (repeatable plots)
        rst = ((ci + 1) * 2654435761 + 12345) & 0x7FFFFFFF
        rst = (rst * 1103515245 + 12345) & 0x7FFFFFFF
        phase = (rst / 2147483647.0) * PERIOD * SCAT
        s = -phase          # virtual pattern start before the curve begins
        ink = True
        guard = 0
        while s < L - 0.02 and guard < 20000:
            guard += 1
            s_eval = s if s > 0.0 else 0.0
            pt = at_len(tcum, tpts, s_eval)
            # driver value 0..1 at this position
            if MODE == 1:
                d = 1e9
                probe = rg.Point3d(pt.X, pt.Y, 0)
                for ap in apts:
                    dd = probe.DistanceTo(ap)
                    if dd < d:
                        d = dd
                for ac in acrvs:
                    rc2, t2 = ac.ClosestPoint(probe)
                    if rc2:
                        q = ac.PointAt(t2)
                        dd = math.sqrt((q.X-probe.X)**2 + (q.Y-probe.Y)**2)
                        if dd < d:
                            d = dd
                if d > 1e8:
                    v = 0.0
                else:
                    v = 1.0 - d / RAD
                    if v < 0.0:
                        v = 0.0
                    if v > 1.0:
                        v = 1.0
            else:
                v = s / L
            if INV:
                v = 1.0 - v
            duty = MAXI - (MAXI - MINI) * v
            ink_len = PERIOD * duty
            gap_len = PERIOD - ink_len
            # per-segment length jitter
            if SCAT > 0.001:
                rst = (rst * 1103515245 + 12345) & 0x7FFFFFFF
                jit = 1.0 + ((rst / 2147483647.0) * 2.0 - 1.0) * 0.5 * SCAT
                ink_len = ink_len * jit
                gap_len = gap_len * jit
            if ink:
                e = s + ink_len
                s0 = s if s > 0.0 else 0.0        # clip the phase-shifted start
                e0 = e if e < L else L
                if e0 - s0 > 0.05:
                    n = int((e0 - s0) / STEP)
                    if n < 1:
                        n = 1
                    lp = List[rg.Point3d]()
                    for k in range(n + 1):
                        lp.Add(at_len(tcum, tpts, s0 + (e0 - s0) * k / float(n)))
                    if lp.Count >= 2:
                        out_crvs.append(rg.PolylineCurve(lp))
                        n_pieces += 1
                s = e
            else:
                s = s + gap_len
            ink = not ink
    info = 'P=%.1fmm, ink %.0f%%..%.0f%%, %s%s, scatter %.2f, %d pieces' % (
        PERIOD, MINI*100, MAXI*100,
        ('proximity r=%.0fmm (%d pts, %d crvs)' % (RAD, len(apts), len(acrvs))) if MODE == 1 else 'along length',
        ' [inverted]' if INV else '', SCAT, n_pieces)

print('%d curves -> %d dashes | %s' % (len(cs), len(out_crvs), info))
# ---------- end vardash ----------

# ---- group: PROCESSOR - DASH even ink/gap dashing
dash_length_mm = Slider(6, range=0.2..30)
dash_phase_mm = Slider(0, range=0..60)
dash_gap_mm = Slider(3, range=0..30)
dash_on_off_passthrough = DASHOnOffPassthrough(True)
dash = GhPythonScript(
    crvs=fx_in_drag_a_slot_plug_here_then_wire_th,
    dash=dash_length_mm,
    gap=dash_gap_mm,
    phase=dash_phase_mm,
    on=dash_on_off_passthrough)  # -> out, out_crvs; inputs crvs: list; disabled
#   port crvs: Curves to process. Feed a layer slot, or another processor output. (list)
# ---------- dash: Python ----------
# DASH processor - template for curves->curves processing blocks.
# THE PROCESSOR CONTRACT: input `crvs` (list of curves, art-space mm) -> output
# `out_crvs` (list of curves). Splice between any generator and a LAYER slot;
# blocks chain in any order. `on` = bypass toggle (False passes curves through
# untouched, so a chain can be A/B'd without rewiring).
# DASH: walks each curve emitting alternating dash/gap segments.
# Inputs: crvs(list), dash(mm), gap(mm), phase(mm, slides the pattern), on(bool)
import Rhino.Geometry as rg
import rhinoscriptsyntax as rs
import scriptcontext as sc
try:
    sc.doc = ghdoc
except:
    pass

DASH = float(dash) if dash is not None else 6.0
if DASH < 0.2:
    DASH = 0.2
GAP = float(gap) if gap is not None else 3.0
if GAP < 0.0:
    GAP = 0.0
PHASE = float(phase) if phase is not None else 0.0
ON = True if on is None else bool(on)

cs = []
if crvs:
    for c in crvs:
        cc = c if isinstance(c, rg.Curve) else rs.coercecurve(c)
        if cc is not None:
            cs.append(cc)

out_crvs = []
if not ON or GAP <= 0.01:
    out_crvs = cs                      # bypass
else:
    period = DASH + GAP
    for c in cs:
        clen = c.GetLength()
        if clen is None or clen < 0.05:
            continue
        s = -(PHASE % period)
        made = 0
        while s < clen:
            a = s
            b = s + DASH
            if a < 0.0:
                a = 0.0
            if b > clen:
                b = clen
            if b > a + 0.05:
                ok_a = c.LengthParameter(a)
                ok_b = c.LengthParameter(b)
                # LengthParameter returns (bool, t) in IronPython
                ta = ok_a[1] if isinstance(ok_a, tuple) else ok_a
                tb = ok_b[1] if isinstance(ok_b, tuple) else ok_b
                seg = c.Trim(ta, tb)
                if seg is not None:
                    out_crvs.append(seg)
                    made += 1
            s += period
print('%d curves -> %d dashes (dash %.1f / gap %.1f)%s' % (len(cs), len(out_crvs), DASH, GAP, '' if ON else ' [BYPASSED]'))
# ---------- end dash ----------
dash_info = Panel(dash.out)

# ---- group: PROCESSOR - CHROMATIC ABERRATION fans one line into colour-shifted copies (step1..6)
ca_step_mm = Slider(1.2, range=0.05..5)
ca_steps = Slider(3, range=1..6)
ca_on_off_passthrough = CAOnOffPassthrough(True)
ca_direction_deg = ControlKnob(Decimals=0, Limit=True, Maximum=360, Minimum=0, Range=360, Value=315)
ca = GhPythonScript(
    crvs=fx_in_drag_a_slot_plug_here_then_wire_th,
    angle=ca_direction_deg,
    step_mm=ca_step_mm,
    steps=ca_steps,
    on=ca_on_off_passthrough)  # -> out, step1, step2, step3, step4, step5, step6; inputs crvs: list; disabled
#   port crvs: Curves to process. Feed a layer slot, or another processor output. (list)
# ---------- ca: Python ----------
# CHROMATIC ABERRATION processor - duplicates input curves into up to 6 copies
# offset progressively along a direction. Wire step1..step6 into LAYER slots in
# your ink sequence (e.g. red, orange, white, light blue, dark blue, black) -
# step1 sits at the input position, each next step shifts one step_mm further
# along the direction. Higher pen numbers plot later = overprint on top, so put
# the "core" colour (black) on the highest pen.
# PROCESSOR CONTRACT variant: curves in -> SIX curve outputs (per colour step).
# Inputs: crvs(list), angle(deg, 0 = +X), step_mm(offset between steps),
#         steps(int 1-6, active outputs), on(bool bypass: step1 = passthrough)
import Rhino.Geometry as rg
import rhinoscriptsyntax as rs
import scriptcontext as sc
import math
try:
    sc.doc = ghdoc
except:
    pass

ANG = float(angle) if angle is not None else 0.0
STEP = float(step_mm) if step_mm is not None else 1.2
if STEP < 0.05:
    STEP = 0.05
N = int(steps) if steps is not None else 6
if N < 1: N = 1
if N > 6: N = 6
ON = True if on is None else bool(on)

cs = []
if crvs:
    for c in crvs:
        cc = c if isinstance(c, rg.Curve) else rs.coercecurve(c)
        if cc is not None:
            cs.append(cc)

_dx = math.cos(math.radians(ANG))
_dy = math.sin(math.radians(ANG))

_outs = [[], [], [], [], [], []]
if not ON:
    _outs[0] = cs                        # bypass: originals on step1 only
else:
    for k in range(N):
        xf = rg.Transform.Translation(_dx*STEP*k, _dy*STEP*k, 0)
        for c in cs:
            d = c.DuplicateCurve()
            d.Transform(xf)
            _outs[k].append(d)

step1 = _outs[0]
step2 = _outs[1]
step3 = _outs[2]
step4 = _outs[3]
step5 = _outs[4]
step6 = _outs[5]
print('%d curves -> %d steps x %.2fmm at %.0fdeg%s' % (len(cs), N if ON else 1, STEP, ANG, '' if ON else ' [BYPASSED]'))
# ---------- end ca ----------
ca_info = Panel(ca.out)

# ----
pressure_on_off_passthrough = PRESSUREOnOffPassthrough(True)

pressure_mode = ValueList({"curvature (press in tight turns)": 0, "proximity (press where crowded)": 1, "image (press where dark)": 2, "noise (organic drift)": 3}, selected="curvature (press in tight turns)")
pressure_scale_radius_mm = Slider(100, range=1..200)
pressure_amount_mm = Slider(0.3, range=0..3)
pressure_detail_mm = Slider(7, range=0.2..10)
pressure_invert = BooleanToggle(False)
pressure = GhPythonScript(
    crvs=tone.out_crvs,
    mode=pressure_mode,
    amount=pressure_amount_mm,
    detail=pressure_detail_mm,
    scale=pressure_scale_radius_mm,
    image=input_image,
    invert=pressure_invert,
    on=pressure_on_off_passthrough)  # -> out, out_crvs; inputs crvs: list
#   port crvs: Curves to process. Feed a layer slot, or another processor output. (list)
# ---------- pressure: Python ----------
# PRESSURE processor - writes the PRESSURE CHANNEL into curves.
#
# HOW PRESSURE TRAVELS: a point's Z coordinate is its pen-pressure offset in mm.
# NEGATIVE Z = press harder (the spring mount compresses further). PLACE scales
# XY only, so Z survives fitting; GCODE adds it to the draw height when it emits
# each move. Because it rides on the geometry itself it survives resampling and
# chaining - stack several PRESSURE blocks and their effects ADD.
#
# Modes:
#   0 curvature - press harder through tight turns (calligraphic weight)
#   1 proximity - press harder where strokes crowd together (builds density)
#   2 image     - press harder where the picture is dark (photographic tone)
#   3 noise     - organic drifting weight
# PROCESSOR CONTRACT: curves in (`crvs`) -> same curves, pressure written.
# Inputs: crvs(list), mode(0-3), amount(mm of extra press at full strength),
#         detail(mm, resample spacing - how finely pressure can vary),
#         scale(mm, feature size for noise / search radius for proximity),
#         image(file path, mode 2), invert(bool), on(bool bypass)
import Rhino
import Rhino.Geometry as rg
import rhinoscriptsyntax as rs
import scriptcontext as sc
import math
import System
import System.Drawing as SD
from System.Collections.Generic import List
try:
    sc.doc = ghdoc
except:
    pass


def lattice(ix, iy, sd):
    n = (ix * 73856093) ^ (iy * 19349663) ^ (sd * 83492791)
    n = n & 0x7FFFFFFF
    n = (n * 1103515245 + 12345) & 0x7FFFFFFF
    return (n % 65536) / 65535.0


def vnoise(x, y, sd):
    ix = int(math.floor(x))
    iy = int(math.floor(y))
    fx = x - ix
    fy = y - iy
    ux = fx * fx * (3.0 - 2.0 * fx)
    uy = fy * fy * (3.0 - 2.0 * fy)
    v00 = lattice(ix, iy, sd)
    v10 = lattice(ix + 1, iy, sd)
    v01 = lattice(ix, iy + 1, sd)
    v11 = lattice(ix + 1, iy + 1, sd)
    a = v00 + (v10 - v00) * ux
    b = v01 + (v11 - v01) * ux
    return a + (b - a) * uy


def load_image(path, maxdim):
    """-> (byte buffer, stride, w, h) of a 24bpp copy, or None.
    LockBits + direct indexing: GetPixel per sample would be far too slow."""
    try:
        from System.Drawing.Imaging import PixelFormat, ImageLockMode
        from System.Runtime.InteropServices import Marshal
        src = SD.Bitmap(path)
        w = src.Width
        h = src.Height
        sc_f = 1.0
        if w > maxdim or h > maxdim:
            sc_f = float(maxdim) / float(max(w, h))
        tw = int(w * sc_f)
        th = int(h * sc_f)
        if tw < 1:
            tw = 1
        if th < 1:
            th = 1
        conv = SD.Bitmap(tw, th, PixelFormat.Format24bppRgb)
        gfx = SD.Graphics.FromImage(conv)
        gfx.DrawImage(src, 0, 0, tw, th)
        gfx.Dispose()
        src.Dispose()
        rect = SD.Rectangle(0, 0, tw, th)
        data = conv.LockBits(rect, ImageLockMode.ReadOnly, PixelFormat.Format24bppRgb)
        stride = data.Stride
        nbytes = abs(stride) * th
        buf = System.Array.CreateInstance(System.Byte, nbytes)
        Marshal.Copy(data.Scan0, buf, 0, nbytes)
        conv.UnlockBits(data)
        conv.Dispose()
        return (buf, stride, tw, th)
    except:
        return None


MODE = int(mode) if mode is not None else 0
AMT = float(amount) if amount is not None else 0.5
DET = float(detail) if detail is not None else 1.0
if DET < 0.2:
    DET = 0.2
SCL = float(scale) if scale is not None else 40.0
if SCL < 0.5:
    SCL = 0.5
INV = False if invert is None else bool(invert)
ON = True if on is None else bool(on)
IMGPATH = None
if image is not None:
    try:
        IMGPATH = str(image).strip('"')
    except:
        IMGPATH = None

cs = []
if crvs:
    for c in crvs:
        cc = c if isinstance(c, rg.Curve) else rs.coercecurve(c)
        if cc is not None:
            cs.append(cc)

out_crvs = []
info = ''
if not ON:
    out_crvs = cs
    info = '[BYPASSED]'
elif cs:
    # 1) resample every curve so pressure can vary along it
    polys = []
    for c in cs:
        L = c.GetLength()
        n = int(L / DET)
        if n < 1:
            n = 1
        ts = c.DivideByCount(n, True)
        pl = []
        if ts is None:
            pl.append(c.PointAtStart)
            pl.append(c.PointAtEnd)
            polys.append((c, pl, None))
        else:
            tl = []
            for t in ts:
                pl.append(c.PointAt(t))
                tl.append(t)
            polys.append((c, pl, tl))

    bb = rg.BoundingBox.Empty
    for item in polys:
        for p in item[1]:
            bb.Union(p)

    img = None
    imgnote = ''
    if MODE == 2:
        if IMGPATH:
            img = load_image(IMGPATH, 1400)
            if img is None:
                imgnote = ' (IMAGE FAILED TO LOAD)'
        else:
            imgnote = ' (NO IMAGE PATH)'
    ox = bb.Min.X
    oy = bb.Min.Y
    bw = bb.Max.X - ox
    bh = bb.Max.Y - oy
    if bw < 1e-6:
        bw = 1.0
    if bh < 1e-6:
        bh = 1.0
    dw = bw
    dh = bh
    if img is not None:
        ia = float(img[2]) / float(img[3])
        ba = bw / bh
        if ia > ba:
            dw = bw
            dh = bw / ia
        else:
            dh = bh
            dw = bh * ia
    ix0 = ox + (bw - dw) / 2.0
    iy0 = oy + (bh - dh) / 2.0

    # 2) proximity mode needs a spatial index of every point
    phash = {}
    if MODE == 1:
        for ci in range(len(polys)):
            for p in polys[ci][1]:
                key = (int(p.X / SCL), int(p.Y / SCL))
                if key not in phash:
                    phash[key] = []
                phash[key].append((p.X, p.Y, ci))

    # 3) raw value per point
    vals = []
    kmax = 0.0
    for ci in range(len(polys)):
        crv = polys[ci][0]
        pl = polys[ci][1]
        tl = polys[ci][2]
        row = []
        for pi in range(len(pl)):
            p = pl[pi]
            v = 0.0
            if MODE == 0:
                if tl is not None:
                    try:
                        k = crv.CurvatureAt(tl[pi])
                        v = k.Length
                    except:
                        v = 0.0
                if v > kmax:
                    kmax = v
            elif MODE == 1:
                gi = int(p.X / SCL)
                gj = int(p.Y / SCL)
                best = None
                for dj in [-1, 0, 1]:
                    for di in [-1, 0, 1]:
                        key = (gi + di, gj + dj)
                        if key not in phash:
                            continue
                        for q in phash[key]:
                            if q[2] == ci:
                                continue
                            dx = q[0] - p.X
                            dy = q[1] - p.Y
                            d = math.sqrt(dx * dx + dy * dy)
                            if best is None or d < best:
                                best = d
                if best is not None and best < SCL:
                    v = 1.0 - (best / SCL)
            elif MODE == 2:
                if img is not None:
                    u = (p.X - ix0) / dw
                    w2 = (p.Y - iy0) / dh
                    if 0.0 <= u <= 1.0 and 0.0 <= w2 <= 1.0:
                        px = int(u * (img[2] - 1))
                        py = int((1.0 - w2) * (img[3] - 1))
                        idx = py * img[1] + px * 3
                        b = img[0][idx]
                        g = img[0][idx + 1]
                        r = img[0][idx + 2]
                        lum = (0.299 * r + 0.587 * g + 0.114 * b) / 255.0
                        v = 1.0 - lum          # dark = more pressure
            else:
                v = vnoise(p.X / SCL, p.Y / SCL, 1)
            row.append(v)
        vals.append(row)

    # curvature normalises against the 90th percentile so one hairpin
    # doesn't flatten everything else
    if MODE == 0:
        allk = []
        for row in vals:
            for v in row:
                allk.append(v)
        allk.sort()
        ref = kmax
        if allk:
            ref = allk[int(len(allk) * 0.9)]
        if ref <= 1e-9:
            ref = 1.0
        for ri in range(len(vals)):
            for pi in range(len(vals[ri])):
                v = vals[ri][pi] / ref
                if v > 1.0:
                    v = 1.0
                vals[ri][pi] = v

    # 4) write Z (negative = press harder), ADDING to any existing pressure
    npts = 0
    vmin = 9e9
    vmax = -9e9
    for ci in range(len(polys)):
        pl = polys[ci][1]
        lp = List[rg.Point3d]()
        for pi in range(len(pl)):
            v = vals[ci][pi]
            if v < 0.0:
                v = 0.0
            if v > 1.0:
                v = 1.0
            if INV:
                v = 1.0 - v
            z = pl[pi].Z - AMT * v
            if z < vmin:
                vmin = z
            if z > vmax:
                vmax = z
            lp.Add(rg.Point3d(pl[pi].X, pl[pi].Y, z))
            npts += 1
        out_crvs.append(rg.PolylineCurve(lp))
    mnames = {0: 'curvature', 1: 'proximity', 2: 'image', 3: 'noise'}
    info = '%s, amount %.2fmm, detail %.1fmm, %d pts, Z %.2f..%.2f%s' % (
        mnames.get(MODE, '?'), AMT, DET, npts, vmin, vmax, imgnote)

print('%d curves -> %d pressured | %s' % (len(cs), len(out_crvs), info))
# ---------- end pressure ----------
pressure_info = Panel(pressure.out)

smoothpline = SmoothPolyline(Polyline=stipple.out_crvs, Strength=0.3, Times=3)
pressure_2_on_off_passthrough = PRESSURE2OnOffPassthrough(True)

pressure_mode_2 = ValueList({"curvature (press in tight turns)": 0, "proximity (press where crowded)": 1, "image (press where dark)": 2, "noise (organic drift)": 3}, selected="image (press where dark)")
pressure_scale_radius_mm_2 = Slider(100, range=1..200)
pressure_amount_mm_2 = Slider(2, range=0..3)
pressure_detail_mm_2 = Slider(1, range=0.2..10)
pressure_2 = GhPythonScript(
    crvs=pressure.out_crvs,
    mode=pressure_mode_2,
    amount=pressure_amount_mm_2,
    detail=pressure_detail_mm_2,
    scale=pressure_scale_radius_mm,
    image=input_image,
    invert=pressure_invert,
    on=pressure_2_on_off_passthrough)  # -> out, out_crvs; inputs crvs: list; same code as pressure

pressure_3_on_off_passthrough = PRESSURE3OnOffPassthrough(True)

pressure_mode_3 = ValueList({"curvature (press in tight turns)": 0, "proximity (press where crowded)": 1, "image (press where dark)": 2, "noise (organic drift)": 3}, selected="image (press where dark)")
pressure_scale_radius_mm_3 = Slider(100, range=1..200)
pressure_amount_mm_3 = Slider(2, range=0..3)
pressure_detail_mm_3 = Slider(1, range=0.2..10)
pressure_3 = GhPythonScript(
    crvs=contour.out_crvs,
    mode=pressure_mode_3,
    amount=pressure_amount_mm_3,
    detail=pressure_detail_mm_3,
    scale=pressure_scale_radius_mm,
    image=input_image,
    invert=pressure_invert,
    on=pressure_3_on_off_passthrough)  # -> out, out_crvs; inputs crvs: list; same code as pressure

slot_6_pen = ValueList({"OFF": 0, "Pen 1 [BLACK FINE]": 1, "Pen 2 [BLACK BOLD]": 2, "Pen 3 [BLACK ROLLER]": 3, "Pen 4 [RED FINE]": 4, "Pen 5 [CUSTOM 1]": 5, "Pen 6 [CUSTOM 2]": 6, "Pen 7 [CUSTOM 3]": 7, "Pen 8 [CUSTOM 4]": 8}, selected="Pen 2 [BLACK BOLD]")
slot_5_pen = ValueList({"OFF": 0, "Pen 1 [BLACK FINE]": 1, "Pen 2 [BLACK BOLD]": 2, "Pen 3 [BLACK ROLLER]": 3, "Pen 4 [RED FINE]": 4, "Pen 5 [CUSTOM 1]": 5, "Pen 6 [CUSTOM 2]": 6, "Pen 7 [CUSTOM 3]": 7, "Pen 8 [CUSTOM 4]": 8}, selected="Pen 2 [BLACK BOLD]")

# ---- group: LAYER TABLE any curves -> a slot; the pen # sets its pass (0 = off)
# LAYERING/PEN
#     SELECTION
slot_1_curves_plug_or_internalise_curves = SLOT1CurvesPlugOrInternaliseCurvesHere(ascii.out_crvs)  # "SLOT 1 curves (plug or internalise curves here)"
slot_3_curves_plug_or_internalise_curves = SLOT3CurvesPlugOrInternaliseCurvesHere(pressure_3.out_crvs)  # "SLOT 3 curves (plug or internalise curves here)"
slot_4_curves_plug_or_internalise_curves = SLOT4CurvesPlugOrInternaliseCurvesHere(pressure_2.out_crvs)  # "SLOT 4 curves (plug or internalise curves here)"
slot_2_curves_plug_or_internalise_curves = SLOT2CurvesPlugOrInternaliseCurvesHere(tone.out_crvs)  # "SLOT 2 curves (plug or internalise curves here)"
slot_1_pen = ValueList({"OFF": 0, "Pen 1 [BLACK FINE]": 1, "Pen 2 [BLACK BOLD]": 2, "Pen 3 [BLACK ROLLER]": 3, "Pen 4 [RED FINE]": 4, "Pen 5 [CUSTOM 1]": 5, "Pen 6 [CUSTOM 2]": 6, "Pen 7 [CUSTOM 3]": 7, "Pen 8 [CUSTOM 4]": 8}, selected="Pen 4 [RED FINE]")
slot_4_pen = ValueList({"OFF": 0, "Pen 1 [BLACK FINE]": 1, "Pen 2 [BLACK BOLD]": 2, "Pen 3 [BLACK ROLLER]": 3, "Pen 4 [RED FINE]": 4, "Pen 5 [CUSTOM 1]": 5, "Pen 6 [CUSTOM 2]": 6, "Pen 7 [CUSTOM 3]": 7, "Pen 8 [CUSTOM 4]": 8}, selected="Pen 2 [BLACK BOLD]")
slot_2_pen = ValueList({"OFF": 0, "Pen 1 [BLACK FINE]": 1, "Pen 2 [BLACK BOLD]": 2, "Pen 3 [BLACK ROLLER]": 3, "Pen 4 [RED FINE]": 4, "Pen 5 [CUSTOM 1]": 5, "Pen 6 [CUSTOM 2]": 6, "Pen 7 [CUSTOM 3]": 7, "Pen 8 [CUSTOM 4]": 8}, selected="Pen 2 [BLACK BOLD]")
slot_3_pen = ValueList({"OFF": 0, "Pen 1 [BLACK FINE]": 1, "Pen 2 [BLACK BOLD]": 2, "Pen 3 [BLACK ROLLER]": 3, "Pen 4 [RED FINE]": 4, "Pen 5 [CUSTOM 1]": 5, "Pen 6 [CUSTOM 2]": 6, "Pen 7 [CUSTOM 3]": 7, "Pen 8 [CUSTOM 4]": 8}, selected="Pen 3 [BLACK ROLLER]")
layers = GhPythonScript(
    curves1=slot_1_curves_plug_or_internalise_curves,
    pen1=slot_1_pen,
    curves2=flatten(slot_2_curves_plug_or_internalise_curves),
    pen2=slot_2_pen,
    curves3=flatten(slot_3_curves_plug_or_internalise_curves),
    pen3=slot_3_pen,
    curves4=slot_4_curves_plug_or_internalise_curves,
    pen4=slot_4_pen,
    curves5=frame.out_crvs,
    pen5=slot_5_pen,
    pen6=slot_6_pen)  # -> curves, pens, ghosted; inputs curves1: list, curves2: list, curves3: list, curves4: list, curves5: list, curves6: list
#   port curves1: Curves for slot 1. Any closed or open curves; this is the normal docking point for a processor output.
# ---------- layers: Python ----------
# LAYER TABLE: one row per source. pen # >= 1 -> plots in that pass; 0 -> off
# (off layers flow out as `ghosted`).
#
# Items arrive as GUIDS, not geometry - the inputs carry no type hint, so what
# lands in the script is a reference, not a curve. The table used to pass those
# straight through and let Grasshopper resolve them on the way out, which works
# right up until one of them will not resolve: PRESSURE emitted 2012 invalid
# polylines among 16630, GhPython null-dereferenced marshalling them, and the
# whole table died with "Object reference not set to an instance of an object" -
# zero curves, no pass, and an error naming neither the slot nor the source. It
# read as "slot 4 is broken" when slot 4 was fine and the data was rotten.
#
# So: coerce every item to real geometry HERE, drop what will not resolve or is
# invalid, and say how many went. This is the one place every processor funnels
# through, so a single guard covers every slot and every generator added later.
import Rhino.Geometry as rg
import rhinoscriptsyntax as rs
import scriptcontext as sc
try:
    sc.doc = ghdoc
except:
    pass

curves = []; pens = []; ghosted = []
slots = [(curves1, pen1), (curves2, pen2), (curves3, pen3),
         (curves4, pen4), (curves5, pen5), (curves6, pen6)]
dropped = [0, 0, 0, 0, 0, 0]
for idx in range(len(slots)):
    lst, pn = slots[idx]
    pnum = 0 if pn is None else int(pn)
    if not lst:
        continue
    for c in lst:
        cc = None
        if isinstance(c, rg.Curve):
            cc = c
        else:
            try:
                cc = rs.coercecurve(c)
            except:
                cc = None
        if cc is None:
            dropped[idx] += 1
            continue
        try:
            if not cc.IsValid:
                dropped[idx] += 1
                continue
        except:
            dropped[idx] += 1
            continue
        if pnum >= 1:
            curves.append(cc)
            pens.append(pnum)
        else:
            ghosted.append(cc)

msg = '%d curves plotting, %d ghosted' % (len(curves), len(ghosted))
bad = []
for i in range(6):
    if dropped[i]:
        bad.append('slot %d: %d' % (i + 1, dropped[i]))
if bad:
    msg += ' | DROPPED invalid curves -> %s (that source is emitting rubbish)' % ', '.join(bad)
print(msg)
# ---------- end layers ----------

# ---- group: PROCESSOR - THINOUT drops linework closer together than the pen is wide
thin_min_fragment_mm = Slider(1.5, range=0..20)
thinout_on_off_passthrough = THINOUTOnOffPassthrough(False)
thin_longest_strokes_first = BooleanToggle(True)
thinout = GhPythonScript(
    crvs=flatten(layers.curves),
    pens=flatten(layers.pens),
    spacing=penwidth.w,
    min_len=thin_min_fragment_mm,
    longest_first=thin_longest_strokes_first,
    on=thinout_on_off_passthrough)  # -> out, out_crvs, out_pens; inputs crvs: list, pens: list
#   port crvs: Curves to process. Feed a layer slot, or another processor output. (list)
# ---------- thinout: Python ----------
# THINOUT - drops linework the pen cannot actually distinguish.
#
# When strokes run closer together than the pen is wide, the second one lays
# ink on top of the first: no visual gain, full plot-time cost. This walks the
# curves and removes any PORTION that falls within `spacing` of ink already
# committed, keeping the parts that still contribute.
#
# Longest strokes are processed first by default, so the major linework
# survives and the redundant short stuff is what gets culled (process in the
# incoming order instead by turning `longest_first` off).
# A stroke is never culled by itself - only by previously kept strokes - so a
# curve cannot erase its own start.
# The pressure channel (point Z) survives; fragments are cut from the source.
# Sits in the MAIN FLOW between LAYERS and PLACE. Give it the pen list and it
# culls each pen against ITSELF only - a red stroke beside a black one is not
# redundant ink - and uses that pen's own width from pen_widths.json, so a
# 0.8mm roller culls far harder than a 0.3mm liner. `spacing` is the fallback
# when a pen has no stored width (or when no pens are wired).
# PROCESSOR CONTRACT: curves in (`crvs`) -> thinned curves out (`out_crvs`),
# with `out_pens` kept in step so it can feed PLACE directly.
# Inputs: crvs(list), pens(list int), spacing(mm fallback), min_len(mm, discard
#         shorter fragments), longest_first(bool), on(bool bypass)
import Rhino
import Rhino.Geometry as rg
import rhinoscriptsyntax as rs
import scriptcontext as sc
import math
from System.Collections.Generic import List
try:
    sc.doc = ghdoc
except:
    pass

SP = float(spacing) if spacing is not None else 0.4
if SP < 0.05:
    SP = 0.05
MINL = float(min_len) if min_len is not None else 1.5
if MINL < 0.0:
    MINL = 0.0
LONGEST = True if longest_first is None else bool(longest_first)
ON = True if on is None else bool(on)

cs = []
cp = []
if crvs:
    for i in range(len(crvs)):
        cc = crvs[i] if isinstance(crvs[i], rg.Curve) else rs.coercecurve(crvs[i])
        if cc is None:
            continue
        pn = 0
        if pens and i < len(pens) and pens[i] is not None:
            try:
                pn = int(pens[i])
            except:
                pn = 0
        cs.append(cc)
        cp.append(pn)

# per-pen widths, so each pen culls at its own line weight
widths = {}
try:
    import json
    _fh = open(r'C:\Users\john.chandler\voron_plotter\pen_widths.json')
    widths = json.loads(_fh.read())
    _fh.close()
except:
    widths = {}


def pen_space(pn):
    w = widths.get(str(pn))
    if w:
        return float(w)
    return SP


out_crvs = []
out_pens = []
info = ''
if not ON:
    out_crvs = cs
    out_pens = cp
    info = '[BYPASSED] %d curves pass through' % len(cs)
elif cs:
    order = []
    for i in range(len(cs)):
        order.append((cs[i].GetLength(), i))
    if LONGEST:
        order.sort()
        order.reverse()
    grids = {}                # committed ink per pen, hashed at that pen's width
    len_in = 0.0
    len_out = 0.0
    n_drop = 0
    for od in order:
        c = cs[od[1]]
        pn = cp[od[1]]
        SPP = pen_space(pn)
        HC = SPP * 0.5              # occupancy cell: half the pen width
        if HC < 0.05:
            HC = 0.05
        step = HC
        sp2 = SPP * SPP
        if pn not in grids:
            grids[pn] = {}
        grid = grids[pn]
        L = c.GetLength()
        len_in += L
        n = int(L / step)
        if n < 1:
            n = 1
        ts = c.DivideByCount(n, True)
        pts = []
        if ts:
            for t in ts:
                pts.append(c.PointAt(t))
        else:
            pts = [c.PointAtStart, c.PointAtEnd]
        # split into runs of points that are NOT already covered
        runs = []
        cur = []
        for p in pts:
            # Occupancy is a BOOLEAN grid at half the pen width, not a bucket of
            # points: storing points made this quadratic (dense artwork puts
            # thousands into one bucket and every new point rescanned them all).
            gi = int(p.X / HC)
            gj = int(p.Y / HC)
            hit = False
            for dj in [-1, 0, 1]:
                for di in [-1, 0, 1]:
                    if (gi + di, gj + dj) in grid:
                        hit = True
                        break
                if hit:
                    break
            if hit:
                if len(cur) > 1:
                    runs.append(cur)
                cur = []
            else:
                cur.append(p)
        if len(cur) > 1:
            runs.append(cur)
        # emit the survivors and commit their ink
        for run in runs:
            rl = 0.0
            for k in range(1, len(run)):
                rl += run[k - 1].DistanceTo(run[k])
            if rl < MINL:
                n_drop += 1
                continue
            lp = List[rg.Point3d]()
            for p in run:
                lp.Add(p)
            out_crvs.append(rg.PolylineCurve(lp))
            out_pens.append(pn)
            len_out += rl
            for p in run:
                grid[(int(p.X / HC), int(p.Y / HC))] = 1
    _pct = (100.0 * (len_in - len_out) / len_in) if len_in > 0.001 else 0.0
    _pens = sorted(grids.keys())
    _sp = ', '.join(['p%d@%.2f' % (q, pen_space(q)) for q in _pens])
    info = '%d -> %d strokes, ink %.2fm -> %.2fm (%.0f%% removed), %d tiny fragments dropped | per-pen %s' % (
        len(cs), len(out_crvs), len_in / 1000.0, len_out / 1000.0, _pct, n_drop, _sp)

print(info if info else 'no curves')
# ---------- end thinout ----------

# ----
polished_alu_black_internalised = BEDGEOMETRYInternalised([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])
polished_stainless_internalised = BEDGEOMETRYInternalised([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])
satin_alu_black_internalised = BEDGEOMETRYInternalised([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])
satin_alu_black_internalised_2 = BEDGEOMETRYInternalised(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)

# ---- group: BED GEOMETRY the 350mm plate, baked in - no Rhino model needed
bed_geometry_internalised = BEDGEOMETRYInternalised(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)

# ----
material = CreateMaterial(
    Diffuse=ColourSwatch(SwatchColor=RGB(122, 122, 122)),
    Specular=ColourSwatch(SwatchColor=RGB(255, 255, 255)),
    Emission=RGB(0, 0, 0),
    Transparency=0,
    Shine=Slider(46, range=0..100))
preview = CustomPreview(Geometry=bed_geometry_internalised, Material=material)

material_2 = CreateMaterial(
    Diffuse=ColourSwatch(SwatchColor=RGB(255, 255, 255)),
    Specular=ColourSwatch(SwatchColor=RGB(255, 255, 255)),
    Emission=RGB(0, 0, 0),
    Transparency=0,
    Shine=Slider(100, range=0..100))
preview_2 = CustomPreview(Geometry=polished_stainless_internalised, Material=material_2)

material_3 = CreateMaterial(
    Diffuse=ColourSwatch(SwatchColor=RGB(0, 0, 0)),
    Specular=ColourSwatch(SwatchColor=RGB(255, 255, 255)),
    Emission=RGB(0, 0, 0),
    Transparency=0,
    Shine=Slider(100, range=0..100))
preview_3 = CustomPreview(Geometry=polished_alu_black_internalised, Material=material_3)

material_4 = CreateMaterial(
    Diffuse=ColourSwatch(SwatchColor=RGB(48, 48, 48)),
    Specular=ColourSwatch(SwatchColor=RGB(255, 255, 255)),
    Emission=RGB(0, 0, 0),
    Transparency=0,
    Shine=Slider(46, range=0..100))
preview_4 = CustomPreview(Geometry=satin_alu_black_internalised, Material=material_4)

material_5 = CreateMaterial(
    Diffuse=ColourSwatch(SwatchColor=RGB(227, 227, 227)),
    Specular=ColourSwatch(SwatchColor=RGB(255, 255, 255)),
    Emission=RGB(0, 0, 0),
    Transparency=0,
    Shine=Slider(46, range=0..100))
preview_5 = CustomPreview(Geometry=satin_alu_black_internalised_2, Material=material_5)

# ---- group: SHIFT artwork XY (moves where the drawing lands)
shift_art_x = Button()
shift_reset_x_y_only = Button()
shift_art_y = Button()
shift_art_y_2 = Button()
shift_art_x_2 = Button()

# ----
start_ritual = ValueList({"QGL (level gantry)": "qgl", "Bed mesh": "mesh", "Alignment outline": "outline", "JC signature + cal": "sig", "Pen-load pause": "penload", "Pen tool-table offsets": "pentable"}, selected=["QGL (level gantry)", "Alignment outline", "Pen-load pause", "Pen tool-table offsets"])

pen_pause_hold_present_pen = Button()
pen_collet_pen_fitting_position = Button()
pen_resume_after_seating_pen = Button()

# ---- group: SHIFT pen Z (pressure)
shift_pen_z_lighter = Button()
shift_pen_z_harder = Button()

# ----
shift_step_xy_mm = Slider(0.1, range=0.01..2)
shift_step_z_mm = Slider(0.25, range=0..1)
midplot = MIDPLOT(
    pause=pen_pause_hold_present_pen,
    resume=pen_resume_after_seating_pen,
    collet=pen_collet_pen_fitting_position,
    x_minus=shift_art_x,
    x_plus=shift_art_x_2,
    y_minus=shift_art_y_2,
    y_plus=shift_art_y,
    z_minus=shift_pen_z_harder,
    z_plus=shift_pen_z_lighter,
    reset=shift_reset_x_y_only,
    step=shift_step_xy_mm,
    z_step=shift_step_z_mm)  # -> out
# ---------- midplot: Python ----------
# MID-PLOT - everything you touch while the ink is wet, in one console.
#
# Was PEN CONTROL and PEN TRIM as two components in two groups. They are always
# used together: you pause, swap the pen, then nudge the new tip into alignment
# and resume. Splitting them meant two boxes and a hunt, mid-plot, with a pen
# drying in your hand.
#
#   pause / resume : PEN_PAUSE parks at the pen-load point and waits;
#                    PEN_RESUME continues (no un-retract, no re-park)
#   collet         : PEN_COLLET parks at the QR-collet fitting position
#   x/y +-         : shift the DRAWING by `step` mm, live, for the rest of the pass
#   z +-           : pen DOWN (press harder) / UP (lighter) by `z_step`
#   reset          : clear the X/Y trim. LEAVES Z alone on purpose - zeroing Z
#                    mid-plot would lift the pen clean off the paper.
#
# Klipper accumulates the adjusts and they persist to the end of the plot, so
# the current total is reported after every press - a trim you cannot see is a
# trim you will forget you dialled in.
# Inputs: pause, resume, collet, x_minus, x_plus, y_minus, y_plus, z_minus,
#         z_plus, reset (buttons), step (mm/press X/Y), z_step (mm/press Z)
import urllib
import urllib2
import json

HOST = 'http://192.168.1.23:7125'
STEP = float(step) if step is not None else 0.1
if STEP < 0.0:
    STEP = 0.0
ZSTEP = float(z_step) if z_step is not None else 0.025
if ZSTEP < 0.0:
    ZSTEP = 0.0


def send(cmd):
    url = HOST + '/printer/gcode/script?script=' + urllib.quote(cmd)
    return urllib2.urlopen(urllib2.Request(url, ''), timeout=25).getcode()


def read_trim():
    try:
        u = HOST + '/printer/objects/query?gcode_move=homing_origin'
        d = json.loads(urllib2.urlopen(u, timeout=6).read())
        o = d['result']['status']['gcode_move']['homing_origin']
        return (o[0], o[1], o[2])
    except:
        return None


msg = 'pause -> swap -> trim -> resume   (XY step %.2f, Z step %.3f)' % (STEP, ZSTEP)
did = None
try:
    # ---- pen handling ----
    if pause:
        send('PEN_PAUSE')
        did = 'PEN_PAUSE sent - parked at the load point'
    elif resume:
        send('PEN_RESUME')
        did = 'PEN_RESUME sent'
    elif collet:
        send('PEN_COLLET')
        did = 'PEN_COLLET sent - at the collet fitting position'
    # ---- live trim ----
    elif x_plus:
        send('SET_GCODE_OFFSET X_ADJUST=%.3f MOVE=1' % STEP); did = 'X +%.2f' % STEP
    elif x_minus:
        send('SET_GCODE_OFFSET X_ADJUST=%.3f MOVE=1' % -STEP); did = 'X -%.2f' % STEP
    elif y_plus:
        send('SET_GCODE_OFFSET Y_ADJUST=%.3f MOVE=1' % STEP); did = 'Y +%.2f' % STEP
    elif y_minus:
        send('SET_GCODE_OFFSET Y_ADJUST=%.3f MOVE=1' % -STEP); did = 'Y -%.2f' % STEP
    elif z_plus:
        send('SET_GCODE_OFFSET Z_ADJUST=%.3f MOVE=1' % ZSTEP)
        did = 'Z +%.3f (lift, lighter)' % ZSTEP
    elif z_minus:
        send('SET_GCODE_OFFSET Z_ADJUST=%.3f MOVE=1' % -ZSTEP)
        did = 'Z -%.3f (down, harder)' % ZSTEP
    elif reset:
        send('SET_GCODE_OFFSET X=0 Y=0 MOVE=1')
        did = 'X/Y trim reset (Z kept)'
    if did is not None:
        t = read_trim()
        if t is not None:
            msg = '%s  ->  trim  X %+.2f  Y %+.2f  Z %+.3f' % (did, t[0], t[1], t[2])
        else:
            msg = '%s (sent)' % did
except Exception as e:
    msg = 'FAILED: %s' % str(e)

print(msg)
# ---------- end midplot ----------

# ---- group: COLOUR SEPARATION image -> one halftone pass per pen, screens angled apart
sep_halftone_pitch_mm = Slider(2, range=0.4..8)
sep_max_total_ink = Slider(2.5, range=0.5..4)
sep_gamma = Slider(3, range=0.2..3)
sep_screen = ValueList({"HALFTONE DOTS": 0, "LINE SCREEN": 1}, selected="HALFTONE DOTS")
sep_pen_numbers = Panel("""1
4
5""")

# ---- group: PLACEMENT METHOD
# POWER BUTTONS
artwork_position_xy_pad = MDSlider(
    SliderMode=0,
    slider_value=Point(0.5042857143, 0.5268239023, 0),
    x_domain=Domain(0, 350),
    y_domain=Domain(0, 350),
    z_domain=Domain(0, 1))
fit_to_paper_off_1_1_actual_size = BooleanToggle(True)
paper_margin_mm = Slider(10, range=0..40)
# PLACEMENT
placement = ValueList({"Registered paper": 0, "Bed centered": 1, "Direct (Rhino coords)": 2, "From graph (XY pad)": 3, "Corner stop (page size)": 4}, selected="Corner stop (page size)")
page_size = ValueList({"A4 landscape  297 x 210": "297x210", "A4 portrait   210 x 297": "210x297", "A5 landscape  210 x 148": "210x148", "A5 portrait   148 x 210": "148x210", "A3 landscape  420 x 297": "420x297", "A3 portrait   297 x 420": "297x420", "Letter landscape 279 x 216": "279.4x215.9", "Letter portrait  216 x 279": "215.9x279.4", "Square 200 x 200": "200x200"}, selected="A4 portrait   210 x 297")
centre_artwork_on_page = Button()
lock_placement = BooleanToggle(False)
scale = ValueList({"10%": 0.10, "25%": 0.25, "50%": 0.50, "75%": 0.75, "90%": 0.90, "100%  (actual)": 1.00, "110%": 1.10, "125%": 1.25, "150%": 1.50, "200%": 2.00, "300%": 3.00}, selected="75%")
corner_datum_pen_space = Point(Point(28, 26.1, 0))
centrepage = GhPythonScript(press=centre_artwork_on_page)  # -> out, a
#   port press: Button. Snaps the artwork to the middle of the registered paper.
# ---------- centrepage: Python ----------
# CENTRE ON PAGE - button utility for the "From graph" placement mode.
# Sets the ARTWORK position XY pad so the artwork's centre lands on the middle
# of the taught paper (or the bed centre if nothing has been taught).
#
# It reads paper_registration.json straight from disk rather than taking PLACE's
# `frame` output, because the pad FEEDS PLACE - wiring the frame back here would
# be a cycle. The pad is nudged from a scheduled solution (you cannot expire an
# upstream object mid-solve without Grasshopper complaining about recursion).
# Inputs: press(button)
import Grasshopper as gh
import json

REGFILE = r'C:\Users\john.chandler\voron_plotter\paper_registration.json'
PADNAME = 'ARTWORK position'
OFFY = -58.0          # new pen toolhead 2026-07-21: pen 58mm in front of nozzle
BED = 350.0


def apply_centre(d):
    """Self-contained on purpose: re-reads everything rather than closing over
    outer variables (GhPython's nested-scope lookup is not reliable)."""
    import json as _j
    import Rhino.Geometry as _rg
    _cx = 175.0
    _cy = 175.0
    try:
        _fh = open(r'C:\Users\john.chandler\voron_plotter\paper_registration.json')
        _reg = _j.loads(_fh.read())
        _fh.close()
        _p0 = _reg['p0']
        _p1 = _reg['p1']
        _p2 = _reg['p2']
        _cx = _p0[0] + ((_p1[0] - _p0[0]) + (_p2[0] - _p0[0])) / 2.0
        _cy = _p0[1] + ((_p1[1] - _p0[1]) + (_p2[1] - _p0[1])) / 2.0 - 58.0
    except:
        pass
    for _o in d.Objects:
        try:
            if _o.GetType().Name != 'GH_MultiDimensionalSlider':
                continue
            if not str(_o.NickName).startswith('ARTWORK position'):
                continue
            _xi = _o.XInterval
            _yi = _o.YInterval
            _nx = (_cx - _xi.T0) / (_xi.T1 - _xi.T0)
            _ny = (_cy - _yi.T0) / (_yi.T1 - _yi.T0)
            if _nx < 0.0:
                _nx = 0.0
            if _nx > 1.0:
                _nx = 1.0
            if _ny < 0.0:
                _ny = 0.0
            if _ny > 1.0:
                _ny = 1.0
            _o.Value = _rg.Point3d(_nx, _ny, 0.0)
            _o.ExpireSolution(False)
        except:
            pass


out = 'press to centre the artwork on the page'
if press:
    cx = BED / 2.0
    cy = BED / 2.0
    src = 'BED centre (no registration taught)'
    try:
        fh = open(REGFILE)
        reg = json.loads(fh.read())
        fh.close()
        p0 = reg['p0']
        p1 = reg['p1']
        p2 = reg['p2']
        cx = p0[0] + ((p1[0] - p0[0]) + (p2[0] - p0[0])) / 2.0
        cy = p0[1] + ((p1[1] - p0[1]) + (p2[1] - p0[1])) / 2.0 + OFFY
        src = 'PAPER centre'
    except:
        pass
    ghd = ghenv.Component.OnPingDocument()
    if ghd is None:
        out = 'no document'
    else:
        ghd.ScheduleSolution(10, gh.Kernel.GH_Document.GH_ScheduleDelegate(apply_centre))
        out = 'centred on %s -> (%.1f, %.1f)   [set PLACEMENT to "From graph" to use it]' % (src, cx, cy)
print(out)
# ---------- end centrepage ----------

# ---- group: TITLEBLOCK MAGI-style block, auto-sized to the registered paper
# TITLEBLOCK
titleblock_pen_a_linework = ValueList({"OFF": 0, "Pen 1 [BLACK FINE]": 1, "Pen 2 [BLACK BOLD]": 2, "Pen 3 [BLACK ROLLER]": 3, "Pen 4 [RED FINE]": 4, "Pen 5 [CUSTOM 1]": 5, "Pen 6 [CUSTOM 2]": 6, "Pen 7 [CUSTOM 3]": 7, "Pen 8 [CUSTOM 4]": 8}, selected="Pen 1 [BLACK FINE]")
titleblock_pen_b_accents = ValueList({"OFF": 0, "Pen 1 [BLACK FINE]": 1, "Pen 2 [BLACK BOLD]": 2, "Pen 3 [BLACK ROLLER]": 3, "Pen 4 [RED FINE]": 4, "Pen 5 [CUSTOM 1]": 5, "Pen 6 [CUSTOM 2]": 6, "Pen 7 [CUSTOM 3]": 7, "Pen 8 [CUSTOM 4]": 8}, selected="Pen 4 [RED FINE]")
titleblock_height_mm_0_auto = Slider(30, range=0..60)
titleblock_margin_mm = Slider(5, range=0..40)
titleblock_fill_sheet_width = BooleanToggle(True)
tb_title = Panel("UNIT 01")
tb_subtitle = Panel("PLEA TO THE ANGELS")
tb_sheet = Panel("EVA TEST 014")
titleblock_svg = TITLEBLOCKSvg("C:\Users\john.chandler\Downloads\titleblock.svg")

# ---- group: PLACEMENT METHOD (continued)
place = GhPythonScript(
    curves=flatten(thinout.out_crvs),
    pens=flatten(thinout.out_pens),
    dots=pentaps.dots,
    pmode=placement,
    graph=artwork_position_xy_pad,
    fit_paper=fit_to_paper_off_1_1_actual_size,
    scale=scale,
    reg_margin=paper_margin_mm,
    reserve_bottom=titleblock_height_mm_0_auto,
    lock=lock_placement,
    reg_sync=paperreg.reg_json,
    page=page_size,
    corner=corner_datum_pen_space)  # -> out, placed_curves, placed_pens, placed_dots, placed_ghost, frame; inputs curves: list, pens: list, dots: list, ghosted: list
#   port curves: Artwork curves to place on the paper, from THINOUT. (list)
# ---------- place: Python ----------
# PLACE component - the placement/mapping stage.
# Art-space curves/dots -> PEN-SPACE (physical) coordinates: output geometry is
# where INK physically lands on the bed. The pen->nozzle offset is applied by
# GCODE only when formatting emitted moves. Preview draws pen-space raw.
# LOCK: freezes the current mapping to placement_lock.json. While locked, layers
# can be toggled on/off or content changed and NOTHING shifts - the stored
# transform is applied verbatim. Unlocking deletes the lock file (live mapping).
# BYPASS (direct mode): no fitting/centering at all - input coordinates are
# taken literally as PEN positions on the bed (where ink lands); the only
# transform applied is the pen->nozzle offset compensation. Draw at bed coords
# in Rhino, plot exactly there. Overrides registration/centering/lock.
# Inputs: curves(list), pens(list), dots(list), ghosted(list, pen-0 layers),
#         pmode(0 registered / 1 bed-centred / 2 direct / 3 from graph),
#         graph(point from the XY pad - artwork centre in pen-space mm, pmode 3),
#         fit_paper(bool), reg_margin(mm), lock(bool), reg_sync(str)
# Outputs: placed_curves, placed_pens, placed_dots, placed_ghost, frame(json)
import Rhino.Geometry as rg
import rhinoscriptsyntax as rs
import scriptcontext as sc
import os, math, json
try:
    sc.doc = ghdoc
except:
    pass

BED = 350.0
# How far the PEN can reach in Y. The pen sits ahead of the nozzle, so the last
# ~58mm of bed depth is nozzle-only - the toolhead runs out of travel before the
# pen gets there. Matters for the corner-stop mode, where a portrait sheet butted
# into the front-left datum can extend past what the pen can actually draw on.
PENY = 292.0
OFFX = 0.0      # pen tip offset from nozzle (hardware constant)
# must match GCODE's OFFY - pen 1's own tip-to-nozzle distance, measured from
# the calibration dot (bed Y18.6): felt tip touches at nozzle Y70.5 -> 51.9mm
OFFY = -51.9
REGFILE = r'C:\Users\john.chandler\voron_plotter\paper_registration.json'
LOCKFILE = r'C:\Users\john.chandler\voron_plotter\placement_lock.json'
# pmode: 0 = registered paper, 1 = bed centered, 2 = direct (Rhino coords),
#        3 = from graph (the XY pad places the artwork's centre, pen-space mm),
#        4 = corner stop (physical datum marks + a page size from the dropdown)
PM = int(pmode) if pmode is not None else 0
UREG = (PM == 0)
BYPASS = (PM == 2)
GRAPH = (PM == 3)
CORNER = (PM == 4)

# ---- corner-stop datum -----------------------------------------------------
# Alignment marks scribed on the bed, one inch in on both axes. The sheet's
# FRONT-LEFT corner is butted into them, so the paper origin is known without
# teaching or a camera - which makes it repeatable across sessions, power
# cycles and paper changes in a way the taught corners are not.
#
# This is a PEN-SPACE coordinate, and deliberately unlike the taught corners:
# those are stored as NOZZLE positions and have the pen offset added back on
# use. A scribed mark is a physical spot on the bed, so it is already where the
# ink has to land, and adding the offset would push the page a pen-length out.
CORNER_X = 25.4
CORNER_Y = 25.4
if corner is not None:
    try:
        _cp = corner if isinstance(corner, rg.Point3d) else rs.coerce3dpoint(corner)
        if _cp is not None:
            CORNER_X = _cp.X
            CORNER_Y = _cp.Y
    except:
        pass

# Page size as "WxH" in mm, from the dropdown. Orientation is baked into the
# choice rather than being a separate toggle - a landscape A4 is simply
# 297x210 - because a rotate flag on top of a size is one more thing to get
# out of step with how the sheet is physically sitting.
PGW = 297.0
PGH = 210.0
_pgtxt = ''
if page is not None:
    try:
        _pgtxt = str(page).strip()
        _bits = _pgtxt.replace('X', 'x').split('x')
        if len(_bits) == 2:
            _w = float(_bits[0]); _h = float(_bits[1])
            if _w > 1.0 and _h > 1.0:
                PGW = _w; PGH = _h
    except:
        pass
GX = 175.0
GY = 175.0
if graph is not None:
    try:
        _gp = graph if isinstance(graph, rg.Point3d) else rs.coerce3dpoint(graph)
        if _gp is not None:
            GX = _gp.X
            GY = _gp.Y
    except:
        pass
REGM = float(reg_margin) if reg_margin is not None else 10.0
if REGM < 0.0:
    REGM = 0.0
FIT = True if fit_paper is None else bool(fit_paper)
LOCK = False if lock is None else bool(lock)
# scale multiplier, applied ON TOP of whatever the mode works out:
# FIT on  -> fraction of the fitted size (100% = fill the paper as before)
# FIT off -> absolute scale (100% = 1:1 actual size)
# Ignored in DIRECT mode, where coordinates are taken literally by definition.
SCALE = float(scale) if scale is not None else 1.0
if SCALE < 0.001:
    SCALE = 0.001
# Space kept clear along the BOTTOM of the sheet (mm) - wire this from the
# titleblock height and the artwork fits, and centres, in what is left above
# it. A small gap is added so the art never touches the block.
RESERVE = float(reserve_bottom) if reserve_bottom is not None else 0.0
if RESERVE < 0.0:
    RESERVE = 0.0
RES_GAP = 4.0 if RESERVE > 0.01 else 0.0

def _coerce_curves(lst, plist):
    cs = []; cp = []
    if lst:
        for i in range(len(lst)):
            cc = lst[i] if isinstance(lst[i], rg.Curve) else rs.coercecurve(lst[i])
            if cc is None:
                continue
            pn = 1
            if plist is not None and i < len(plist) and plist[i] is not None:
                try:
                    pn = int(plist[i])
                except:
                    pn = 1
            cs.append(cc); cp.append(pn)
    return cs, cp

cs, cpn = _coerce_curves(curves, pens)
gh_cs, _ = _coerce_curves(ghosted, None)
dp = []
if dots:
    for d in dots:
        if isinstance(d, rg.Point3d):
            dp.append(rg.Point3d(d))
        else:
            _p3 = rs.coerce3dpoint(d)
            if _p3 is not None:
                dp.append(rg.Point3d(_p3))

xs = []; ys = []
for cc in cs:
    bb = cc.GetBoundingBox(True)
    xs.append(bb.Min.X); xs.append(bb.Max.X)
    ys.append(bb.Min.Y); ys.append(bb.Max.Y)
for p in dp:
    xs.append(p.X); ys.append(p.Y)

reg = None
if UREG or BYPASS or GRAPH:   # non-registered modes still load the taught paper
                              # so the preview can show it for orientation
    try:
        fh = open(REGFILE)
        reg = json.loads(fh.read())
        fh.close()
    except:
        reg = None

# ---- live mapping ----
fr = {"mode": "centered", "scale": 1.0, "offx": OFFX, "offy": OFFY, "pwarn": 0, "bwarn": 0}
xfm = rg.Transform.Identity
if BYPASS:
    # direct: input coords ARE pen positions - pen-space pipeline means no
    # transform at all here (GCODE compensates to nozzle at emission)
    xfm = rg.Transform.Identity
    fr = {"mode": "direct", "scale": 1.0, "offx": OFFX, "offy": OFFY, "pwarn": 0, "bwarn": 0}
    if xs and (min(xs) < 0 or min(ys) < 0 or max(xs) > BED or max(ys) > BED):
        fr["bwarn"] = 1
    if reg:
        # taught paper (nozzle coords in the file) shown in PEN space for orientation
        _bp0 = reg['p0']; _bp1 = reg['p1']; _bp2 = reg['p2']
        _bux = _bp1[0]-_bp0[0]; _buy = _bp1[1]-_bp0[1]
        _bvx = _bp2[0]-_bp0[0]; _bvy = _bp2[1]-_bp0[1]
        _bwu = math.sqrt(_bux*_bux+_buy*_buy); _bhv = math.sqrt(_bvx*_bvx+_bvy*_bvy)
        fr["p0"] = [_bp0[0] + OFFX, _bp0[1] + OFFY]
        fr["eu"] = [_bux/_bwu, _buy/_bwu]
        fr["ev"] = [_bvx/_bhv, _bvy/_bhv]
        fr["wu"] = _bwu; fr["hv"] = _bhv
elif GRAPH and xs:
    # free placement: the XY pad is the artwork's CENTRE in pen-space mm.
    # FIT still scales to the taught paper if there is one; position is yours.
    s_ = 1.0
    if FIT and reg:
        _p0 = reg['p0']; _p1 = reg['p1']; _p2 = reg['p2']
        _wu = math.sqrt((_p1[0]-_p0[0])**2 + (_p1[1]-_p0[1])**2)
        _hv = math.sqrt((_p2[0]-_p0[0])**2 + (_p2[1]-_p0[1])**2)
        _uw = _wu - 2.0*REGM; _vh = _hv - 2.0*REGM
        _aw = max(xs)-min(xs); _ah = max(ys)-min(ys)
        if _aw > 0.001 and _ah > 0.001 and _uw > 0 and _vh > 0:
            s_ = min(_uw/_aw, _vh/_ah)
    s_ = s_ * SCALE
    _cx = (min(xs)+max(xs))/2.0
    _cy = (min(ys)+max(ys))/2.0
    xfm = rg.Transform.Translation(GX - _cx*s_, GY - _cy*s_, 0) * rg.Transform.Scale(rg.Plane.WorldXY, s_, s_, 1.0)
    fr = {"mode": "graph", "scale": s_, "offx": OFFX, "offy": OFFY, "pwarn": 0, "bwarn": 0,
          "gx": GX, "gy": GY, "fit": 1 if FIT else 0}
    _hw = (max(xs)-min(xs))*s_/2.0
    _hh = (max(ys)-min(ys))*s_/2.0
    if (GX-_hw) < 0 or (GY-_hh) < 0 or (GX+_hw) > BED or (GY+_hh) > BED:
        fr["bwarn"] = 1
    if reg:
        _bp0 = reg['p0']; _bp1 = reg['p1']; _bp2 = reg['p2']
        _bux = _bp1[0]-_bp0[0]; _buy = _bp1[1]-_bp0[1]
        _bvx = _bp2[0]-_bp0[0]; _bvy = _bp2[1]-_bp0[1]
        _bwu = math.sqrt(_bux*_bux+_buy*_buy); _bhv = math.sqrt(_bvx*_bvx+_bvy*_bvy)
        fr["p0"] = [_bp0[0] + OFFX, _bp0[1] + OFFY]
        fr["eu"] = [_bux/_bwu, _buy/_bwu]
        fr["ev"] = [_bvx/_bhv, _bvy/_bhv]
        fr["wu"] = _bwu; fr["hv"] = _bhv
elif CORNER and xs:
    # Corner stop: the page frame is known outright - origin at the scribed
    # marks, axis-aligned, size from the dropdown. No registration file, no
    # camera, no taught corners. Fitting and centring below are the same as
    # registered mode so the two behave identically once the frame exists.
    wu = PGW; hv = PGH
    eux = 1.0; euy = 0.0
    evx = 0.0; evy = 1.0
    aw = max(xs)-min(xs); ah = max(ys)-min(ys)
    uw = wu - 2.0*REGM
    vh = hv - 2.0*REGM - RESERVE - RES_GAP
    if vh < 1.0:
        vh = hv - 2.0*REGM
    s_ = 1.0
    if FIT and aw > 0.001 and ah > 0.001:
        s_ = min(uw/aw, vh/ah)
    s_ = s_ * SCALE
    if aw*s_ > uw + 0.01 or ah*s_ > vh + 0.01:
        fr["pwarn"] = 1
    offu = REGM + (uw - aw*s_)/2.0
    offv = REGM + RESERVE + RES_GAP + (vh - ah*s_)/2.0
    mnx = min(xs); mny = min(ys)
    # origin used verbatim - see the CORNER_X note above for why no pen offset
    _tgt = rg.Plane(rg.Point3d(CORNER_X, CORNER_Y, 0), rg.Vector3d(eux, euy, 0), rg.Vector3d(evx, evy, 0))
    xfm = rg.Transform.PlaneToPlane(rg.Plane.WorldXY, _tgt) * rg.Transform.Translation(offu - mnx*s_, offv - mny*s_, 0) * rg.Transform.Scale(rg.Plane.WorldXY, s_, s_, 1.0)
    fr = {"mode": "corner", "scale": s_, "p0": [CORNER_X, CORNER_Y], "eu": [eux, euy], "ev": [evx, evy],
          "wu": wu, "hv": hv, "regm": REGM, "offx": OFFX, "offy": OFFY,
          "pwarn": fr["pwarn"], "bwarn": 0, "fit": 1 if FIT else 0,
          "page": _pgtxt if _pgtxt else "%gx%g" % (PGW, PGH)}
    # Does the SHEET fit the machine? Separate from pwarn, which is about the
    # artwork overflowing the sheet. The pen reaches less far in Y than the bed
    # is deep, so a portrait A4 butted into this corner runs off the top - the
    # sheet is fine, the pen simply cannot get to the far end of it.
    if CORNER_X < 0 or CORNER_Y < 0 or (CORNER_X + PGW) > BED or (CORNER_Y + PGH) > PENY:
        fr["bwarn"] = 1
        fr["sheetover"] = 1
elif reg and xs:
    p0r = reg['p0']; p1r = reg['p1']; p2r = reg['p2']
    ux = p1r[0]-p0r[0]; uy = p1r[1]-p0r[1]
    vx = p2r[0]-p0r[0]; vy = p2r[1]-p0r[1]
    wu = math.sqrt(ux*ux+uy*uy); hv = math.sqrt(vx*vx+vy*vy)
    eux = ux/wu; euy = uy/wu
    evx = vx/hv; evy = vy/hv
    aw = max(xs)-min(xs); ah = max(ys)-min(ys)
    uw = wu - 2.0*REGM
    vh = hv - 2.0*REGM - RESERVE - RES_GAP     # titleblock strip kept clear
    if vh < 1.0:
        vh = hv - 2.0*REGM
    s_ = 1.0
    if FIT and aw > 0.001 and ah > 0.001:
        s_ = min(uw/aw, vh/ah)
    s_ = s_ * SCALE
    # warn whenever the FINAL size overflows the usable paper - covers a
    # scaled-up FIT as well as plain 1:1 oversize art
    if aw*s_ > uw + 0.01 or ah*s_ > vh + 0.01:
        fr["pwarn"] = 1
    offu = REGM + (uw - aw*s_)/2.0
    offv = REGM + RESERVE + RES_GAP + (vh - ah*s_)/2.0
    mnx = min(xs); mny = min(ys)
    # composed transform (struct field assignment on rg.Transform is unreliable
    # in IronPython): scale about origin -> offset in paper-local -> paper plane
    # target = taught paper frame in PEN space (taught corners are nozzle coords;
    # ink lands at nozzle + offset)
    _tgt = rg.Plane(rg.Point3d(p0r[0] + OFFX, p0r[1] + OFFY, 0), rg.Vector3d(eux, euy, 0), rg.Vector3d(evx, evy, 0))
    # XY-only scale: curve Z is the pressure channel and must survive FIT scaling
    xfm = rg.Transform.PlaneToPlane(rg.Plane.WorldXY, _tgt) * rg.Transform.Translation(offu - mnx*s_, offv - mny*s_, 0) * rg.Transform.Scale(rg.Plane.WorldXY, s_, s_, 1.0)
    fr = {"mode": "reg", "scale": s_, "p0": [p0r[0] + OFFX, p0r[1] + OFFY], "eu": [eux, euy], "ev": [evx, evy],
          "wu": wu, "hv": hv, "regm": REGM, "offx": OFFX, "offy": OFFY,
          "pwarn": fr["pwarn"], "bwarn": 0, "fit": 1 if FIT else 0}
elif xs:
    # center the INK on the bed (pen space: no offset terms)
    _cx = (min(xs)+max(xs))/2.0
    _cy = (min(ys)+max(ys))/2.0
    xfm = rg.Transform.Translation(BED/2.0 - _cx*SCALE, BED/2.0 - _cy*SCALE, 0) * rg.Transform.Scale(rg.Plane.WorldXY, SCALE, SCALE, 1.0)
    fr["scale"] = SCALE
    _hw = (max(xs)-min(xs))*SCALE/2.0
    _hh = (max(ys)-min(ys))*SCALE/2.0
    if (BED/2.0-_hw) < 0 or (BED/2.0-_hh) < 0 or (BED/2.0+_hw) > BED or (BED/2.0+_hh) > BED:
        fr["bwarn"] = 1
    if UREG and reg is None:
        fr["noregfile"] = 1

# ---- placement lock (not applicable in direct/bypass mode; lock file is
# left untouched so flipping back to LOCK resumes the frozen mapping) ----
lockmsg = ''
if BYPASS:
    fr["locked"] = 0
    lockmsg = 'DIRECT'
elif LOCK:
    stored = None
    try:
        fh = open(LOCKFILE)
        stored = json.loads(fh.read())
        fh.close()
    except:
        stored = None
    if stored:
        m = stored["m"]
        xfm = rg.Transform.Identity
        xfm.M00 = m[0]; xfm.M01 = m[1]; xfm.M03 = m[2]
        xfm.M10 = m[3]; xfm.M11 = m[4]; xfm.M13 = m[5]
        fr = stored["frame"]
        lockmsg = 'LOCKED (stored)'
    else:
        try:
            fh = open(LOCKFILE, 'w')
            fh.write(json.dumps({"m": [xfm.M00, xfm.M01, xfm.M03, xfm.M10, xfm.M11, xfm.M13], "frame": fr}))
            fh.close()
            lockmsg = 'LOCKED (captured now)'
        except Exception as e:
            lockmsg = 'LOCK SAVE FAILED: ' + str(e)
    fr["locked"] = 1
else:
    if os.path.isfile(LOCKFILE):
        try:
            os.remove(LOCKFILE)
        except:
            pass
    fr["locked"] = 0

out_c = []
for cc in cs:
    d = cc.DuplicateCurve()
    d.Transform(xfm)
    out_c.append(d)
out_g = []
for cc in gh_cs:
    d = cc.DuplicateCurve()
    d.Transform(xfm)
    out_g.append(d)
out_d = []
for p in dp:
    q = rg.Point3d(p)
    q.Transform(xfm)
    out_d.append(q)

# NOTE: output names must NOT match any input name (GhPython would emit the
# raw input variable instead of these).
placed_curves = out_c
placed_pens = cpn
placed_dots = out_d
placed_ghost = out_g
frame = json.dumps(fr)
_msg = '%s: %d curves, %d dots, %d ghost | scale %.3f %s' % (
    fr["mode"], len(out_c), len(out_d), len(out_g), fr.get("scale", 1.0), lockmsg)
if fr.get("mode") == "corner":
    _msg += ' | page %s at corner %g,%g -> X %g..%g Y %g..%g' % (
        fr.get("page", "?"), CORNER_X, CORNER_Y,
        CORNER_X, CORNER_X + PGW, CORNER_Y, CORNER_Y + PGH)
    if fr.get("sheetover"):
        _msg += ' | SHEET OUT OF REACH: the pen cannot reach past Y%g, so the far end of this page is undrawable' % PENY
if fr.get("pwarn"):
    _msg += ' | ARTWORK OVERFLOWS THE PAGE'
print(_msg)
# ---------- end place ----------

# ---- group: GCODE + sig offsets
signature_offset_xy_pad = MDSlider(
    SliderMode=0,
    slider_value=Point(0.4589051364, 0.5344329378, 0),
    x_domain=Domain(-60, 60),
    y_domain=Domain(-60, 60),
    z_domain=Domain(0, 1))
depoint_2 = DeconstructPoint(Point=reverse(signature_offset_xy_pad), System=PlaneXY(0, 0, 0))  # -> XCoordinate, YCoordinate, ZCoordinate
sig_anchor_artwork_bounds_off_paper_corn = BooleanToggle(False)  # "SIG anchor: artwork bounds (off = paper corner)"
tip_wear_comp_mm_per_m_0_off = Slider(0, range=0..0.5)
spikeyness_0_smooth_1_spiky = Slider(0, range=0..1)
toolhead_draw_height_mm = Slider(22.4, range=1..40)
weld_touching_ends_mm = Slider(0.1, range=0..3)
travel_speed_mm_min = Slider(6000, range=1000..20000)
pressure_gain_0_flat = Slider(1, range=0..3)
draw_speed_mm_min = Slider(3000, range=500..10000)
spring_preload_mm = Slider(0.2, range=0..3)
curve_resolution = ValueList({"Fine (0.5mm)": 0.5, "Normal (1.0mm)": 1.0, "Coarse (2.0mm)": 2.0}, selected="Normal (1.0mm)")
speed_profile = ValueList({"Careful (1500/4000)": 0, "Normal (3000/6000)": 1, "Fast (4500/9000)": 2, "Custom (use sliders)": 3}, selected="Normal (3000/6000)")
paper_stock = ValueList({"No paper comp": 0.0, "Printer paper (0.10)": 0.10, "Cartridge (0.15)": 0.15, "Bristol (0.25)": 0.25, "Watercolour (0.35)": 0.35, "Card (0.50)": 0.50}, selected="Printer paper (0.10)")
stroke_hop_mm = Slider(1, range=0..10)
accel_mm_s_2 = Slider(3000, range=100..20000)
pen_up_z_mm = Slider(37.5, range=0..50)
dot_ink = ValueList({"None (0ms)": 0, "Tap (30ms)": 30, "Normal (50ms)": 50, "Heavy (120ms)": 120, "Blob (300ms)": 300}, selected="Normal (50ms)")
write_plot_gcode = Button()

# ---- group: TITLEBLOCK MAGI-style block, auto-sized to the registered paper (continued)
titleblock = GhPythonScript(
    svg=titleblock_svg,
    frame=place.frame,
    margin=titleblock_margin_mm,
    height=titleblock_height_mm_0_auto,
    fill=titleblock_fill_sheet_width,
    title=tb_title,
    subtitle=tb_subtitle,
    sheet=tb_sheet,
    pen_a=titleblock_pen_a_linework,
    pen_b=titleblock_pen_b_accents,
    art=place.placed_curves,
    art_pens=place.placed_pens,
    draw_feed=draw_speed_mm_min)  # -> out, crvs, pens; inputs art: list, art_pens: list
#   port svg: Path to an SVG drawn into the titleblock, e.g. a logo. (file path)
# ---------- titleblock: Python ----------
# TITLEBLOCK - imports the plotter titleblock SVG and lays it on the registered
# paper, scaled to the sheet and rotated with it.
#
# The SVG is authored as pure single-stroke polylines at 180 x 40 mm with one
# top-level group per ink (`pen-1`, `pen-2`, `pen-3`). Each ink comes out on its
# own output so you can send it to whichever plotter pen you like.
# SVG's Y axis points DOWN, so it is flipped on import.
# Only M/L path commands and <circle> are parsed - that is all the design uses.
# Inputs: svg(file path), frame(json from PLACE), on(bool), margin(mm inset from
#         the paper edge), height(mm, 0 = keep the SVG's own proportion)
# Outputs: ink_a = the black linework (SVG pen-1)
#          ink_b = the accent inks merged (SVG pen-2 amber + pen-3 green)
# Two outputs so the block needs only two plotter pens; pick them with the two
# dropdowns beside it.
import Rhino.Geometry as rg
import scriptcontext as sc
import math
import re
import json
from System.Collections.Generic import List
try:
    sc.doc = ghdoc
except:
    pass

ON = True if on is None else bool(on)
MARGIN = float(margin) if margin is not None else 8.0
if MARGIN < 0.0:
    MARGIN = 0.0
HFORCE = float(height) if height is not None else 0.0
# fill: stretch the title zone so the block spans the sheet at the chosen
# height. Off = plain uniform scale (keeps the 180x40 proportion).
FILL = True if fill is None else bool(fill)
SVGW = 180.0
SVGH = 40.0
FONTDIR = r'C:\Users\john.chandler\voron_plotter'
WFILE = r'C:\Users\john.chandler\voron_plotter\pen_widths.json'

path = None
if svg is not None:
    try:
        path = str(svg).strip('"')
    except:
        path = None


def _d_to_polys(d):
    out = []
    cur = []
    for cmd, sx, sy in re.findall(r'([ML])\s*(-?[\d.]+)[\s,]+(-?[\d.]+)', d):
        p = (float(sx), float(sy))
        if cmd == 'M':
            if len(cur) > 1:
                out.append(cur)
            cur = [p]
        else:
            cur.append(p)
    if len(cur) > 1:
        out.append(cur)
    return out


def parse_ink(txt, gid, skip_ids):
    """polylines from one top-level <g id="pen-N"> block, plus the bounding box
    of every id we intend to redraw as live text"""
    out = []
    boxes = {}
    i = txt.find('id="%s"' % gid)
    if i < 0:
        return out, boxes
    j = txt.find('<g id="pen-', i + 10)
    if j < 0:
        j = len(txt)
    blk = txt[i:j]
    for pid, d in re.findall(r'<path\s+id="([^"]+)"\s+d="([^"]+)"', blk):
        polys = _d_to_polys(d)
        if pid in skip_ids:
            xs2 = []; ys2 = []
            for pl in polys:
                for q in pl:
                    xs2.append(q[0]); ys2.append(q[1])
            if xs2:
                boxes[pid] = (min(xs2), min(ys2), max(xs2), max(ys2))
            continue                    # dropped - live text replaces it
        for pl in polys:
            out.append(pl)
    # paths without an id (none in this file, but be safe)
    for d in re.findall(r'<path\s+d="([^"]+)"', blk):
        for pl in _d_to_polys(d):
            out.append(pl)
    for cx, cy, r in re.findall(r'<circle[^>]*cx="(-?[\d.]+)"[^>]*cy="(-?[\d.]+)"[^>]*r="(-?[\d.]+)"', blk):
        cx = float(cx); cy = float(cy); r = float(r)
        ring = []
        for k in range(33):
            a = 6.283185307 * k / 32.0
            ring.append((cx + r * math.cos(a), cy + r * math.sin(a)))
        out.append(ring)
    return out, boxes


ink1 = []
ink2 = []
ink3 = []
info = ''
if not ON:
    info = '[OFF]'
elif not path:
    info = 'no SVG path set'
else:
    txt = ''
    try:
        fh = open(path)
        txt = fh.read()
        fh.close()
    except Exception as e:
        txt = ''
        info = 'could not read SVG: %s' % str(e)
    if txt:
        # ---- live values ----------------------------------------------------
        # Each entry: svg id -> (text, alignment). The placeholder polylines for
        # these ids are dropped and redrawn with the stroke font at the same
        # position and cap height, so the block reports the real job.
        import sys
        if FONTDIR not in sys.path:
            sys.path.append(FONTDIR)
        import strokefont
        reload(strokefont)

        fr0 = {}
        try:
            fr0 = json.loads(frame) if frame else {}
        except:
            fr0 = {}
        # scale / paper straight from the placement frame
        _sc = fr0.get('scale', 1.0)
        if fr0.get('fit', 0):
            s_scale = 'FIT %d%%' % int(round(_sc * 100.0))
        elif abs(_sc - 1.0) < 0.001:
            s_scale = '1:1'
        else:
            s_scale = 'SCALED %d%%' % int(round(_sc * 100.0))
        if fr0.get('wu'):
            s_paper = '%d X %d' % (int(round(fr0['wu'])), int(round(fr0['hv'])))
        else:
            s_paper = 'UNREGISTERED'
        # Duration and the pen index are worked out HERE rather than read from
        # the manifest: the block is part of the job it describes, so taking
        # GCODE's output would make this component depend on itself.
        PEN_NAMES = {1: 'BLACK FINE', 2: 'BLACK BOLD', 3: 'BLACK ROLLER', 4: 'RED FINE',
                     5: 'CUSTOM 1', 6: 'CUSTOM 2', 7: 'CUSTOM 3', 8: 'CUSTOM 4'}
        s_dur = ''
        pen_rows = []
        _seen = []
        if art_pens:
            for q in art_pens:
                try:
                    v = int(q)
                except:
                    continue
                if v >= 1 and v not in _seen:
                    _seen.append(v)
        for v in sorted(_seen):
            pen_rows.append((str(v), PEN_NAMES.get(v, 'PEN %d' % v)))
        _dl = 0.0
        if art:
            for c in art:
                try:
                    _dl += c.GetLength()
                except:
                    pass
        _df = float(draw_feed) if draw_feed else 3000.0
        if _df > 1.0 and _dl > 0.0:
            # drawing time plus a travel/lift allowance - close enough for a stamp
            s_dur = 'EST %.1f MIN' % (_dl / _df * 1.45)
        widths = {}
        try:
            fh2 = open(WFILE)
            widths = json.loads(fh2.read())
            fh2.close()
        except:
            widths = {}
        import System
        s_date = System.DateTime.Now.ToString('yyyy.MM.dd')

        vals = {}
        vals['val-title'] = (str(title) if title else 'UNTITLED', 'left')
        vals['val-title-ghost'] = (str(title) if title else 'UNTITLED', 'left')
        vals['val-subtitle'] = (str(subtitle) if subtitle else '', 'left')
        vals['c-val-0'] = (s_date, 'right')
        vals['c-val-1'] = (str(sheet) if sheet else 'PLOT 001', 'right')
        vals['c-val-2'] = (s_scale, 'right')
        vals['c-val-3'] = (s_paper, 'right')
        vals['d-val-dur'] = (s_dur, 'right')
        vals['ft-val-plotter'] = ('VORON 2.4', 'left')
        # columns too narrow to take an arbitrary string - text is shrunk to fit
        maxw = {'d-ink-0': 10.6, 'd-ink-1': 10.6, 'd-ink-2': 10.6, 'd-ink-3': 10.6,
                'd-no-0': 3.2, 'd-no-1': 3.2, 'd-no-2': 3.2, 'd-no-3': 3.2,
                'd-mm-0': 7.0, 'd-mm-1': 7.0, 'd-mm-2': 7.0, 'd-mm-3': 7.0,
                'd-val-dur': 32.0, 'ft-val-plotter': 32.0,
                'c-val-0': 31.0, 'c-val-1': 31.0, 'c-val-2': 31.0, 'c-val-3': 31.0,
                'val-title': 60.0, 'val-title-ghost': 60.0, 'val-subtitle': 50.0}
        for r in range(4):
            if r < len(pen_rows):
                pn, nm = pen_rows[r]
                vals['d-no-%d' % r] = ('%02d' % int(pn), 'left')
                vals['d-ink-%d' % r] = (nm[:11], 'left')
                vals['d-mm-%d' % r] = ('%.2f' % float(widths.get(str(int(pn)), 0.45)), 'left')
            else:
                vals['d-no-%d' % r] = ('', 'left')
                vals['d-ink-%d' % r] = ('', 'left')
                vals['d-mm-%d' % r] = ('', 'left')

        raw = []
        allboxes = {}
        for gid in ['pen-1', 'pen-2', 'pen-3']:
            polys, boxes = parse_ink(txt, gid, vals)
            raw.append(polys)
            for k in boxes:
                allboxes[k] = (boxes[k], len(raw) - 1)
        # draw the replacements into the ink layer the placeholder came from
        for vid in vals:
            if vid not in allboxes:
                continue
            (bx0, by0, bx1, by1), ink_i = allboxes[vid]
            s, al = vals[vid]
            if not s:
                continue
            cap = by1 - by0
            if cap < 0.5:
                cap = 1.5
            mw = maxw.get(vid)
            if mw:
                got = strokefont.measure(s, cap, 0.14)
                if got > mw and got > 0.01:
                    cap = cap * (mw / got)      # shrink to fit its column
            ax = bx1 if al == 'right' else bx0
            for pl in strokefont.text(s, ax, by0, cap, 0.14, al):
                raw[ink_i].append([(px, by1 + by0 - py) for px, py in pl])  # back to SVG Y-down
        # ---- where does it go? ----
        fr = {}
        try:
            fr = json.loads(frame) if frame else {}
        except:
            fr = {}
        sc_f = 1.0
        if fr.get('p0') and fr.get('wu'):
            p0 = fr['p0']; eu = fr['eu']; ev = fr['ev']
            wu = float(fr['wu']); hv = float(fr['hv'])
            avail = wu - 2.0 * MARGIN
            if avail < 1.0:
                avail = wu
            sc_f = avail / SVGW
            if HFORCE > 0.01:
                sc_f = HFORCE / SVGH
            ou = MARGIN + (avail - SVGW * sc_f) / 2.0
            ov = MARGIN
            mode = 'on paper %.0fx%.0f' % (wu, hv)
        else:
            # no registration - sit it on the bed, bottom centre
            BED = 350.0
            avail = BED - 2.0 * MARGIN
            sc_f = avail / SVGW
            if HFORCE > 0.01:
                sc_f = HFORCE / SVGH
            p0 = [MARGIN, MARGIN]
            eu = [1.0, 0.0]
            ev = [0.0, 1.0]
            ou = (avail - SVGW * sc_f) / 2.0
            ov = 0.0
            mode = 'no registration - bed bottom'
        # ---- elastic width ----
        # The design pins every column except the title zone, which "absorbs
        # 100% of any width change". So scale UNIFORMLY (text never distorts),
        # then push everything right of the title zone outward to fill the
        # sheet - the title box stretches, its contents stay put.
        SPLIT = 78.0                      # title zone B ends here in SVG mm
        extra = 0.0
        if FILL and avail > 0.0:
            extra = avail - SVGW * sc_f
            if extra < 0.0:
                extra = 0.0
            ou = MARGIN                   # elastic: start at the margin
        outs = [ink1, ink2, ink3]
        n = 0
        for k in range(3):
            for poly in raw[k]:
                lp = List[rg.Point3d]()
                for q in poly:
                    u = ou + q[0] * sc_f
                    if q[0] >= SPLIT:
                        u += extra        # pinned-right columns slide outward
                    v = ov + (SVGH - q[1]) * sc_f       # SVG Y runs downward
                    lp.Add(rg.Point3d(p0[0] + eu[0] * u + ev[0] * v,
                                      p0[1] + eu[1] * u + ev[1] * v, 0))
                if lp.Count > 1:
                    outs[k].append(rg.PolylineCurve(lp))
                    n += 1
        info = '%d strokes (A %d / B %d), %.0f x %.0f mm%s, %s' % (
            n, len(ink1), len(ink2) + len(ink3), SVGW * sc_f + extra, SVGH * sc_f,
            (' (title zone stretched +%.0f)' % extra) if extra > 0.5 else '', mode)

# The block places ITSELF in paper coordinates, so it must not run through
# PLACE (it would be placed twice) and must not run through LAYERS (that feeds
# PLACE, which feeds this component's `frame` - a cycle). It merges straight
# into GCODE instead, carrying its own pen numbers.
PA = int(pen_a) if pen_a is not None else 1
PB = int(pen_b) if pen_b is not None else 1
crvs = []
pens = []
for c in ink1:
    crvs.append(c)
    pens.append(PA)
for c in (ink2 + ink3):
    crvs.append(c)
    pens.append(PB)

print(info)
# ---------- end titleblock ----------

# ---- group: PEN LEGEND / display
pen3_black_roller = ColourSwatch(SwatchColor=RGB(0, 0, 0))
pen1_black_fine = ColourSwatch(SwatchColor=RGB(20, 20, 20))
pen2_black_bold = ColourSwatch(SwatchColor=RGB(0, 0, 0))
exclusion_zone = ColourSwatch(SwatchColor=RGBA(220, 40, 40, 150))
pen5_custom_1 = ColourSwatch(SwatchColor=RGB(230, 185, 15))
pen6_custom_2 = ColourSwatch(SwatchColor=RGB(235, 120, 25))
pen7_custom_3 = ColourSwatch(SwatchColor=RGB(35, 190, 190))
pen8_custom_4 = ColourSwatch(SwatchColor=RGB(235, 90, 160))
signature_colour = ColourSwatch(SwatchColor=RGB(0, 150, 160))
pen4_red_fine = ColourSwatch(SwatchColor=RGB(255, 0, 0))
pen_1_colour = ColourSwatch(SwatchColor=RGB(0, 0, 0))
dots_colour = ColourSwatch(SwatchColor=RGB(255, 0, 0))

# ---- group: COLOUR SEPARATION image -> one halftone pass per pen, screens angled apart (continued)
separate = GhPythonScript(
    crvs=image_frame_art_rect_mm,
    image=input_image,
    inks=[pen1_black_fine, pen4_red_fine, pen5_custom_1],
    pens=sep_pen_numbers,
    cell=sep_halftone_pitch_mm,
    gamma=sep_gamma,
    max_ink=sep_max_total_ink,
    method=sep_screen)  # -> out, out_crvs, out_pens; inputs crvs: list, inks: list, pens: list, angles: list; disabled
# ---------- separate: Python ----------
# -*- coding: utf-8 -*-
# COLOUR SEPARATION - an image split into one plottable pass per pen.
#
# Each pen lays a translucent film of its own ink. On white paper that is
# SUBTRACTIVE: a pen does not add its colour, it removes the rest. So the
# separation works in absorption space (absorb = 1 - colour), where laying
# several inks on the same spot adds their absorptions together, and the job is
# to find how much of each ink reproduces the pixel:
#
#     minimise | sum_i ( x_i * absorb_i ) - absorb_target |^2 ,  0 <= x_i <= 1
#
# solved per cell by a few sweeps of coordinate descent (fast, always in range,
# and needs no matrix code). x_i is that pen's coverage 0..1 for the cell.
#
# Coverage is then drawn as a halftone: a dot whose AREA is proportional to
# coverage, on a grid rotated to that pen's own screen angle. Rotating each
# pen's screen is what stops the passes forming moire against each other - the
# same reason process printing uses 15/75/0/45 degrees.
#
# Inks are whatever pens you actually own: wire the colour swatches from the pen
# legend into `inks` and the matching pen numbers into `pens`. Separation is
# against those real colours, so a black/red/green set separates as a
# black/red/green set rather than pretending to be CMYK.
#
# GENERATOR CONTRACT: closed region(s) in (`crvs`) -> `out_crvs` + `out_pens`.
# Inputs: crvs(list, closed), image(file path), inks(list of colours),
#         pens(list of ints, parallel to inks), cell(mm halftone pitch),
#         angles(list of degrees, optional - defaults to process-style screens),
#         gamma(tone curve), max_ink(cap on total coverage per cell),
#         method(0 dots / 1 line screen), on(bool bypass)
import Rhino
import Rhino.Geometry as rg
import rhinoscriptsyntax as rs
import scriptcontext as sc
import math
import sys
import System
import System.Drawing as SD
from System.Collections.Generic import List
try:
    sc.doc = ghdoc
except:
    pass

# process-style screen angles, extended for up to 8 inks
DEF_ANGLES = [15.0, 75.0, 0.0, 45.0, 30.0, 60.0, 7.5, 82.5]


def load_rgb(path, maxdim):
    """image -> (bytes, stride, w, h) for point sampling"""
    try:
        from System.Drawing.Imaging import PixelFormat, ImageLockMode
        from System.Runtime.InteropServices import Marshal
        src = SD.Bitmap(path)
        w = src.Width; h = src.Height
        f = 1.0
        if w > maxdim or h > maxdim:
            f = float(maxdim) / float(max(w, h))
        tw = int(w * f); th = int(h * f)
        if tw < 1: tw = 1
        if th < 1: th = 1
        conv = SD.Bitmap(tw, th, PixelFormat.Format24bppRgb)
        g = SD.Graphics.FromImage(conv)
        g.InterpolationMode = SD.Drawing2D.InterpolationMode.HighQualityBilinear
        g.DrawImage(src, 0, 0, tw, th)
        g.Dispose(); src.Dispose()
        d = conv.LockBits(SD.Rectangle(0, 0, tw, th), ImageLockMode.ReadOnly,
                          PixelFormat.Format24bppRgb)
        stride = d.Stride
        nb = abs(stride) * th
        buf = System.Array.CreateInstance(System.Byte, nb)
        Marshal.Copy(d.Scan0, buf, 0, nb)
        conv.UnlockBits(d); conv.Dispose()
        return (buf, stride, tw, th)
    except:
        return None


def as_rgb(c):
    """a GH colour, a System.Drawing.Color, or '#rrggbb' -> (r, g, b) floats"""
    try:
        return (float(c.R), float(c.G), float(c.B))
    except:
        pass
    try:
        v = c.Value
        return (float(v.R), float(v.G), float(v.B))
    except:
        pass
    try:
        s = str(c).strip().lstrip('#')
        if len(s) == 6:
            return (float(int(s[0:2], 16)), float(int(s[2:4], 16)), float(int(s[4:6], 16)))
    except:
        pass
    return None


def spiral_dot(cx, cy, r, w):
    """a filled disc drawn the way a pen fills one: a spiral in from the rim,
    stepping by the pen's own width so the ink just meets"""
    if r <= w * 0.55:
        return [(cx - r * 0.5, cy), (cx + r * 0.5, cy)]
    pts = []
    turns = int(r / max(w, 0.05)) + 1
    steps = int(2.0 * math.pi * r / max(w * 0.9, 0.05)) + 8
    if steps > 900:
        steps = 900
    for i in range(steps + 1):
        t = float(i) / steps
        rr = r * (1.0 - t)
        a = 2.0 * math.pi * turns * t
        pts.append((cx + rr * math.cos(a), cy + rr * math.sin(a)))
    return pts


CELL = float(cell) if cell is not None else 3.0
if CELL < 0.4:
    CELL = 0.4
GAM = float(gamma) if gamma is not None else 1.0
if GAM < 0.05:
    GAM = 0.05
MAXINK = float(max_ink) if max_ink is not None else 2.2
if MAXINK < 0.2:
    MAXINK = 0.2
METHOD = int(method) if method is not None else 0
ON = True if on is None else bool(on)

IMG = None
if image is not None:
    try:
        IMG = str(image).strip('"')
    except:
        IMG = None

# pen widths drive how tightly each dot is filled
widths = {}
try:
    import json
    _fh = open(r'C:\Users\john.chandler\voron_plotter\pen_widths.json')
    widths = json.loads(_fh.read())
    _fh.close()
except:
    widths = {}

cs = []
if crvs:
    for c in crvs:
        cc = c if isinstance(c, rg.Curve) else rs.coercecurve(c)
        if cc is not None and cc.IsClosed:
            cs.append(cc)

INKS = []
PENS = []
if inks:
    for i in range(len(inks)):
        rgbv = as_rgb(inks[i])
        if rgbv is None:
            continue
        pnum = 1
        if pens and i < len(pens) and pens[i] is not None:
            try:
                pnum = int(pens[i])
            except:
                pnum = 1
        INKS.append(rgbv)
        PENS.append(pnum)
ANG = []
if angles:
    for a in angles:
        try:
            ANG.append(float(a))
        except:
            pass

out_crvs = []
out_pens = []
info = ''
if not ON:
    info = '[BYPASSED]'
elif not cs:
    info = 'needs a closed region to separate into'
elif not INKS:
    info = 'wire pen colours into `inks` (and matching pen numbers into `pens`)'
elif not IMG:
    info = 'no image'
else:
    img = load_rgb(IMG, 1400)
    if img is None:
        info = 'could not read the image'
    else:
        ibuf, istride, iw, ih = img
        nink = len(INKS)
        # ink absorption vectors, 0..1 per channel
        A = []
        for (r, g, b) in INKS:
            A.append((1.0 - r / 255.0, 1.0 - g / 255.0, 1.0 - b / 255.0))
        AA = []
        for a in A:
            AA.append(a[0]*a[0] + a[1]*a[1] + a[2]*a[2])
        bb = rg.BoundingBox.Empty
        for c in cs:
            bb.Union(c.GetBoundingBox(True))
        x0 = bb.Min.X; y0 = bb.Min.Y
        wid = bb.Max.X - x0; hei = bb.Max.Y - y0
        # fit the image into the region, preserving aspect
        idw = wid; idh = hei
        ia = float(iw) / float(ih)
        ba = wid / hei if hei > 0.001 else 1.0
        if ia > ba:
            idh = wid / ia
        else:
            idw = hei * ia
        ix0 = x0 + (wid - idw) / 2.0
        iy0 = y0 + (hei - idh) / 2.0
        plane = rg.Plane.WorldXY
        tol = 0.001
        diag = math.sqrt(wid*wid + hei*hei)
        ccx = x0 + wid / 2.0; ccy = y0 + hei / 2.0
        counts = [0] * nink
        cov_sum = [0.0] * nink
        ncell = 0
        lut = {}
        for pi in range(nink):
            ang = math.radians(ANG[pi] if pi < len(ANG) else DEF_ANGLES[pi % 8])
            ca = math.cos(ang); sa = math.sin(ang)
            pw = 0.3
            w = widths.get(str(PENS[pi]))
            if w:
                pw = float(w)
            nu = int(diag / CELL) + 2
            for iu in range(-nu, nu + 1):
                for iv in range(-nu, nu + 1):
                    u = iu * CELL; v = iv * CELL
                    px = ccx + u * ca - v * sa
                    py = ccy + u * sa + v * ca
                    if px < x0 or px > x0 + wid or py < y0 or py > y0 + hei:
                        continue
                    pt = rg.Point3d(px, py, 0)
                    hits = 0
                    for c in cs:
                        if c.Contains(pt, plane, tol) == rg.PointContainment.Inside:
                            hits += 1
                    if (hits % 2) == 0:
                        continue
                    uu = (px - ix0) / idw
                    vv = (py - iy0) / idh
                    if uu < 0.0 or uu > 1.0 or vv < 0.0 or vv > 1.0:
                        continue
                    sxp = int(uu * (iw - 1))
                    syp = int((1.0 - vv) * (ih - 1))
                    idx = syp * istride + sxp * 3
                    bch = ibuf[idx]; gch = ibuf[idx + 1]; rch = ibuf[idx + 2]
                    # Solve once per quantised colour, not once per cell. Real
                    # images use a few hundred distinct 4-bit colours, so this
                    # turns tens of thousands of solves into a few hundred and
                    # buys the sweep count needed for convergence.
                    ckey = (rch >> 4) * 289 + (gch >> 4) * 17 + (bch >> 4)
                    xs = lut.get(ckey)
                    if xs is None:
                        t0 = 1.0 - rch / 255.0
                        t1 = 1.0 - gch / 255.0
                        t2 = 1.0 - bch / 255.0
                        if GAM != 1.0:
                            t0 = math.pow(t0, GAM); t1 = math.pow(t1, GAM); t2 = math.pow(t2, GAM)
                        xs = [0.0] * nink
                        # 16 sweeps, inks in the order given. A near-black ink
                        # correlates with every other, so 4 sweeps leaves black
                        # over-assigned (pure red came out 23% black). Reordering
                        # to solve pale inks first fixes that but then builds
                        # black out of red+green instead of using the black pen -
                        # more ink, muddier. Converging properly fixes both.
                        for _sweep in range(16):
                            for j in range(nink):
                                if AA[j] < 1e-9:
                                    continue
                                r0 = t0; r1 = t1; r2 = t2
                                for m2 in range(nink):
                                    if m2 == j:
                                        continue
                                    r0 -= xs[m2] * A[m2][0]
                                    r1 -= xs[m2] * A[m2][1]
                                    r2 -= xs[m2] * A[m2][2]
                                xj = (r0*A[j][0] + r1*A[j][1] + r2*A[j][2]) / AA[j]
                                if xj < 0.0: xj = 0.0
                                if xj > 1.0: xj = 1.0
                                xs[j] = xj
                        tot = 0.0
                        for q in xs:
                            tot += q
                        if tot > MAXINK and tot > 0.0:
                            sc2 = MAXINK / tot
                            for j in range(nink):
                                xs[j] *= sc2
                        lut[ckey] = xs
                    x = xs[pi]
                    if pi == 0:
                        ncell += 1
                    if x < 0.04:
                        continue
                    cov_sum[pi] += x
                    counts[pi] += 1
                    if METHOD == 1:
                        # line screen: a dash across the cell, length by coverage
                        half = CELL * 0.5 * x
                        lp = List[rg.Point3d]()
                        lp.Add(rg.Point3d(px - half * ca, py - half * sa, 0))
                        lp.Add(rg.Point3d(px + half * ca, py + half * sa, 0))
                        out_crvs.append(rg.PolylineCurve(lp))
                        out_pens.append(PENS[pi])
                    else:
                        # dot AREA tracks coverage, so radius goes as its root
                        rad = CELL * 0.5 * math.sqrt(x)
                        pts = spiral_dot(px, py, rad, pw)
                        lp = List[rg.Point3d]()
                        for (qx, qy) in pts:
                            lp.Add(rg.Point3d(qx, qy, 0))
                        if lp.Count > 1:
                            out_crvs.append(rg.PolylineCurve(lp))
                            out_pens.append(PENS[pi])
        tl = 0.0
        for c in out_crvs:
            tl += c.GetLength()
        bits = ['%d strokes, %.2fm of line' % (len(out_crvs), tl / 1000.0)]
        bits.append('%d cells at %.1fmm' % (ncell, CELL))
        bits.append('method %s' % ('line screen' if METHOD == 1 else 'halftone dots'))
        for pi in range(nink):
            avg = (cov_sum[pi] / counts[pi]) if counts[pi] else 0.0
            bits.append('pen%d rgb(%d,%d,%d) @%.0fdeg: %d marks, mean cover %.0f%%' % (
                PENS[pi], int(INKS[pi][0]), int(INKS[pi][1]), int(INKS[pi][2]),
                ANG[pi] if pi < len(ANG) else DEF_ANGLES[pi % 8], counts[pi], avg * 100.0))
        info = ' | '.join(bits)

print(info)
# ---------- end separate ----------

# ---- group: PLOT upload + start, with the job manifest
plot_upload_start_voron = Button()

# ---- group: GCODE + sig offsets (continued)
gcode = GhPythonScript(
    curves=flatten([place.placed_curves, titleblock.crvs]),
    pens=flatten([place.placed_pens, titleblock.pens]),
    frame=place.frame,
    dots=place.placed_dots,
    dots_pen=dots_pen,
    dot_dwell=dot_ink,
    pen_down_z=toolhead_draw_height_mm,
    pen_up_z=pen_up_z_mm,
    hop=stroke_hop_mm,
    preload=spring_preload_mm,
    paper=paper_stock,
    pressure_gain=pressure_gain_0_flat,
    wear=tip_wear_comp_mm_per_m_0_off,
    speed_profile=speed_profile,
    draw_feed=draw_speed_mm_min,
    travel_feed=travel_speed_mm_min,
    accel=accel_mm_s_2,
    spikeyness=spikeyness_0_smooth_1_spiky,
    resolution=curve_resolution,
    weld=weld_touching_ends_mm,
    ritual=start_ritual,
    sig_x=depoint_2.XCoordinate,
    sig_y=depoint_2.YCoordinate,
    sig_art=sig_anchor_artwork_bounds_off_paper_corn,
    plot=plot_upload_start_voron,
    write=write_plot_gcode)  # -> out, gcode_preview, plan_pen1, plan_pen2, plan_pen3, plan_pen4, plan_pen5, plan_pen6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; inputs curves: list, pens: list, dots: list, ritual: list
# ---------- gcode: Python ----------
# GCODE component source - loaded into the GH GhPython component "GCODE".
# COORDINATE CONVENTION: the whole pipeline (PLACE outputs, plans, preview) is
# PEN-SPACE = physical ink positions. The pen->nozzle offset is applied HERE,
# only when formatting emitted G-code words (emit X = x - OFFX, Y = y - OFFY).
# PURE CONVERTER: expects curves/dots ALREADY PLACED in final pen coordinates
# (normally by the PLACE component; wire absolute-coordinate curves straight in
# to bypass placement entirely). `frame` json from PLACE carries placement info
# for the signature band, header and paper warnings.
# MULTI-PEN: parallel `pens` list groups strokes into passes; between passes the
# head presents for a pen swap (PEN_PAUSE PEN=n) and each pass draws its own
# calibration circle row (JC logo only on the first pass).
# Inputs: curves(list, placed), pens(list int), frame(str json), pen_down_z, pen_up_z,
#   draw_feed, travel_feed, resolution, do_qgl, do_mesh, write, accel, spikeyness,
#   pen_load, paper, hop, load_x, load_y, plot(button), preload, dots(list placed),
#   dot_dwell, dots_pen(int, 0=dots off), cal_sig, sig_x, sig_y, sig_art
# Outputs: out(manifest), gcode_preview, plan_pen1..plan_pen4 (planned strokes per
#   pen), plan_dots, plan_signature - the preview draws THESE, so what you see is
#   literally what will be emitted.
import Rhino.Geometry as rg
import rhinoscriptsyntax as rs
import scriptcontext as sc
import os, math, json, time
from System.Collections.Generic import List
try:
    sc.doc = ghdoc
except:
    pass

PDZ = float(pen_down_z) if pen_down_z is not None else 2.0
if PDZ < 1.0:
    PDZ = 1.0
PUZ = float(pen_up_z) if pen_up_z is not None else 8.0
# pressure channel gain: scales every curve's Z (the pressure carrier) at
# emission time, so the whole effect can be tuned without re-running the
# PRESSURE processors. 0 = ignore pressure entirely and plot flat.
PGAIN = float(pressure_gain) if pressure_gain is not None else 1.0
if PGAIN < 0.0:
    PGAIN = 0.0
# tip wear compensation (fast-wearing media: pastel, chalk, graphite stick).
# Z drops by `wear` mm for every METRE drawn, so contact pressure stays even
# as the tip shortens. Resets at each pass (pen swap = fresh tip).
WEAR = float(wear) if wear is not None else 0.0
if WEAR < 0.0:
    WEAR = 0.0
DF = int(draw_feed) if draw_feed is not None else 3000
TF = int(travel_feed) if travel_feed is not None else 6000
RES = float(resolution) if resolution is not None else 1.0
AC = int(accel) if accel is not None else 3000
# speed_profile: 0 Careful, 1 Normal, 2 Fast, 3 Custom (use the sliders above)
SPEED_PROFILES = {0: ('Careful', 1500, 4000, 1500), 1: ('Normal', 3000, 6000, 3000), 2: ('Fast', 4500, 9000, 5000)}
PROF = int(speed_profile) if speed_profile is not None else 3
PROF_NAME = 'Custom'
if PROF in SPEED_PROFILES:
    PROF_NAME, DF, TF, AC = SPEED_PROFILES[PROF]
SPIKE = float(spikeyness) if spikeyness is not None else 0.0
if SPIKE < 0.0: SPIKE = 0.0
if SPIKE > 1.0: SPIKE = 1.0
_base_scv = 8.0 + 4.0 * RES
if _base_scv > 24.0: _base_scv = 24.0
SCV = _base_scv * (1.0 - 0.95 * SPIKE)
if SCV < 0.5: SCV = 0.5
PAPER = float(paper) if paper is not None else 0.1
HOP = float(hop) if hop is not None else 3.0
# pen-load point is computed automatically AFTER placement is known: just
# outside the paper's front edge so the seating dot lands on waste bed,
# never the artwork (and bare-bed seating is what the PAPER comp assumes).
PRELOAD = float(preload) if preload is not None else 0.0
if PRELOAD < 0.0: PRELOAD = 0.0
# ritual: checklist of start-sequence steps (list of strings)
RIT = []
if ritual:
    for r in ritual:
        RIT.append(str(r).lower())
if ritual is None:
    RIT = ['qgl', 'outline', 'sig', 'penload']    # unwired fallback
QGL = 'qgl' in RIT
MESH = 'mesh' in RIT
PENLOAD = 'penload' in RIT
# apply each pen's stored tool-table datum at its swap (PEN_APPLY)
PENTABLE = 'pentable' in RIT
WRITE = False if write is None else bool(write)
PLOT = False if plot is None else bool(plot)
OFFX = 0.0      # pen tip offset from nozzle (pen 1 datum; matches PLACE)
# Pen 1 IS the datum, so this constant must equal pen 1's own tip-to-nozzle
# distance. Measured 2026-08-03 from the calibration dot (bed Y18.6): the felt
# tip touches at nozzle Y70.5, so 70.5 - 18.6 = 51.9. Re-measure this whenever
# pen 1 is re-datumed - every other pen is corrected relative to it, so getting
# this wrong shifts every plot by the difference.
OFFY = -51.9
DWELL = float(dot_dwell) if dot_dwell is not None else 50.0
if DWELL < 0.0: DWELL = 0.0
DPEN = int(dots_pen) if dots_pen is not None else 2
# THE PERMANENT PEN PALETTE (order = pass/draw order)
PEN_NAMES = {1: 'BLACK FINE', 2: 'BLACK BOLD', 3: 'BLACK ROLLER', 4: 'RED FINE',
             5: 'CUSTOM 1', 6: 'CUSTOM 2', 7: 'CUSTOM 3', 8: 'CUSTOM 4'}
def penname(n):
    return PEN_NAMES.get(n, 'PEN%d' % n)

CALSIG = 'sig' in RIT
# outline: before any pen pause, slowly trace the bounding box of everything
# that will be inked (hovering, pen not yet loaded) to verify paper alignment
OUTLINE = 'outline' in RIT
OUTLINE_F = 3600     # brisk but watchable (mm/min)
OUTLINE_DWELL = 250  # ms pause at each corner
# signature placement: nudge with sig_x/sig_y (mm); sig_art anchors it to the
# artwork bounds corner instead of the paper corner
SIGX = float(sig_x) if sig_x is not None else 0.0
SIGY = float(sig_y) if sig_y is not None else 0.0
SIGART = False if sig_art is None else bool(sig_art)
CAL_N = 5
CAL_R = 2.0
CAL_GAP = 8.0
CAL_PAUSE = 500

BED = 350.0
Z_SPEED = 900.0
DRAW_Z = PDZ + PAPER - PRELOAD
if DRAW_Z < 0.5: DRAW_Z = 0.5
HOP_Z = DRAW_Z + HOP
out_dir = r'C:\Users\john.chandler\voron_plotter'
out_file = os.path.join(out_dir, 'plot.gcode')

# placement frame from PLACE (or default when curves are wired in directly)
fr = {"mode": "direct", "scale": 1.0, "pwarn": 0, "bwarn": 0}
if frame:
    try:
        fr = json.loads(str(frame))
    except:
        fr = {"mode": "direct", "scale": 1.0, "pwarn": 0, "bwarn": 0}

def sample(crv):
    pts = []
    c = crv if isinstance(crv, rg.Curve) else rs.coercecurve(crv)
    if c is None:
        return pts
    # A small CLOSED shape (a plotted dot, a tiny circle) must not collapse into
    # a triangle just because its perimeter is near the sampling resolution -
    # give closed curves a floor on segment count regardless of RES.
    _L = c.GetLength()
    _n = int(_L / RES) if RES > 0.0001 else 1
    if c.IsClosed and _n < 12:
        _n = 12
    elif _n < 12 and _L < 30.0:
        # short OPEN curve: only give it the floor if it is genuinely curved
        # (a spiral-filled dot), never a straight dash - compare arc to chord
        _ch = c.PointAtStart.DistanceTo(c.PointAtEnd)
        if _L > _ch * 1.15:
            _n = 12
    if _n < 1:
        _n = 1
    ts = c.DivideByCount(_n, True)
    if ts:
        for t in ts:
            pts.append(c.PointAt(t))
    spt = c.PointAtStart; ept = c.PointAtEnd
    if len(pts) == 0 or pts[0].DistanceTo(spt) > 1e-6:
        pts.insert(0, spt)
    if len(pts) == 0 or pts[-1].DistanceTo(ept) > 1e-6:
        pts.append(ept)
    return pts

# ---- strokes tagged with pen numbers (already in final coords) ----
# PRESSURE CHANNEL: a curve's Z coordinate is a pressure offset in mm.
# Z=0 normal; negative = press harder (spring compresses); positive = lighter.
polys = []
xs = []; ys = []
press_pens = []
src = curves if curves else []
plist = pens if pens else []
for i in range(len(src)):
    p = sample(src[i])
    if len(p) >= 2:
        pn = 1
        if i < len(plist) and plist[i] is not None:
            try:
                pn = int(plist[i])
            except:
                pn = 1
        if pn < 1: pn = 1
        polys.append([p, pn])
        for pt in p:
            xs.append(pt.X); ys.append(pt.Y)
            if abs(pt.Z) > 0.01 and pn not in press_pens:
                press_pens.append(pn)

dpts = []
if dots:
    for d in dots:
        if isinstance(d, rg.Point3d):
            dpts.append(rg.Point3d(d))
        else:
            _p3 = rs.coerce3dpoint(d)
            if _p3 is not None:
                dpts.append(rg.Point3d(_p3))
    for d in dpts:
        xs.append(d.X); ys.append(d.Y)
if DPEN < 1:
    dpts = []

# ---- warnings (pen-space coords: machine travel is checked in nozzle frame) ----
warn = ''
if xs and (min(xs)-OFFX < 0 or min(ys)-OFFY < 0 or max(xs)-OFFX > BED or max(ys)-OFFY > BED):
    warn = '; WARNING: exceeds machine travel'
if fr.get("bwarn", 0):
    warn = (warn + '; WARNING: pen exceeds bed') if warn else '; WARNING: pen exceeds bed'
pwarn = '; NOTE: 1:1 art exceeds paper usable area' if fr.get("pwarn", 0) else ''

# ---- auto pen-load point (pen space): outside the paper front edge ----
LOADCLEAR = 15.0
if fr.get("p0") and fr.get("wu"):
    _lp0 = fr["p0"]; _leu = fr["eu"]; _lev = fr["ev"]
    LX = _lp0[0] + _leu[0]*(fr["wu"]/2.0) - _lev[0]*LOADCLEAR
    LY = _lp0[1] + _leu[1]*(fr["wu"]/2.0) - _lev[1]*LOADCLEAR
elif xs:
    LX = (min(xs)+max(xs))/2.0
    LY = min(ys) - 20.0
else:
    LX = 175.0; LY = 40.0
if LX < 10.0: LX = 10.0
if LX > 340.0: LX = 340.0
if LY < 5.0: LY = 5.0
if LY > 290.0: LY = 290.0

# ---- passes ----
_pset = []
for pl in polys:
    if pl[1] not in _pset:
        _pset.append(pl[1])
if dpts and DPEN not in _pset:
    _pset.append(DPEN)
passes = sorted(_pset)

# ---- calibration signature ----
# Clamp corrections, filled in once the signature's local extent is known so the
# whole block can be nudged back onto the sheet rigidly (see below).
_SIG_CU = 0.0
_SIG_CV = 0.0


def _sigbase():
    """anchor for the signature, in PAPER-LOCAL (u,v) mm. Both anchor modes work
    in the paper's frame so the signature rotates with a skewed sheet exactly
    like the artwork does."""
    _p0 = fr["p0"]; _eu = fr["eu"]; _ev = fr["ev"]; _rm = fr.get("regm", 10.0)
    if SIGART and xs:
        # artwork bounds corner, measured along the PAPER's axes
        _mu = None; _mv = None
        for _i in range(len(xs)):
            _dx = xs[_i] - _p0[0]; _dy = ys[_i] - _p0[1]
            _pu = _dx*_eu[0] + _dy*_eu[1]
            _pv = _dx*_ev[0] + _dy*_ev[1]
            if _mu is None or _pu < _mu: _mu = _pu
            if _mv is None or _pv < _mv: _mv = _pv
        _bv = _mv - 13.0
        if _bv < 1.0: _bv = 1.0
        return (_mu + SIGX, _bv + SIGY)
    return (_rm + SIGX, 1.0 + SIGY)


def _sigmap_local(lu, lv):
    if fr.get("mode") == "reg":
        _p0 = fr["p0"]; _eu = fr["eu"]; _ev = fr["ev"]
        _b = _sigbase()
        _u = _b[0] + _SIG_CU + lu
        _v = _b[1] + _SIG_CV + lv
        return (_p0[0] + _eu[0]*_u + _ev[0]*_v, _p0[1] + _eu[1]*_u + _ev[1]*_v)
    else:
        # no paper frame (direct / bed-centred / graph): axis-aligned under the art
        _bx = (min(xs) if xs else 30.0)
        _by = ((min(ys) - 13.0) if ys else 30.0)
        if _by < 2.0: _by = 2.0
        return (_bx + SIGX + lu, _by + SIGY + lv)

cal_sig_polys = []
cal_rows = {}
if CALSIG and passes:
    _W = 10.0; _H = 9.0; _g = 1.4
    _sig_local = []
    for i in range(4):
        _lx = i*_g; _rx = _W - i*_g; _b = i*_g
        _fr2 = 1.0 + (3-i)*0.9
        _mx = (_rx-_lx)/2.0 - 0.05
        if _fr2 > _mx: _fr2 = _mx
        _st = [(_lx, _b + _fr2 + 1.5)]
        for s in range(7):
            _t = math.radians(180.0 + 90.0*s/6.0)
            _st.append((_lx+_fr2+_fr2*math.cos(_t), _b+_fr2+_fr2*math.sin(_t)))
        for s in range(7):
            _t = math.radians(270.0 + 90.0*s/6.0)
            _st.append((_rx-_fr2+_fr2*math.cos(_t), _b+_fr2+_fr2*math.sin(_t)))
        _st.append((_rx, _H))
        _sig_local.append(_st)
    _ccx = _W + 3.0 + 4.5; _ccy = _H/2.0
    for _r in [4.5, 3.0, 1.5]:
        _arc = []
        for s in range(25):
            _t = math.radians(35.0 + 290.0*s/24.0)
            _arc.append((_ccx + _r*math.cos(_t), _ccy + _r*math.sin(_t)))
        _sig_local.append(_arc)
    _circ_u0 = _ccx + 4.5 + 4.0
    _rowlen = CAL_N*CAL_GAP + 6.0
    # ---- local extent of the WHOLE block (glyph + every calibration row) ----
    _lu0 = None; _lu1 = None; _lv0 = None; _lv1 = None
    _probe = []
    for _st in _sig_local:
        for q in _st: _probe.append(q)
    for k in range(len(passes)):
        for kk in range(CAL_N):
            _cu = _circ_u0 + k*_rowlen + CAL_R + kk*CAL_GAP
            _probe.append((_cu - CAL_R, 4.0 - CAL_R))
            _probe.append((_cu + CAL_R, 4.0 + CAL_R))
    for q in _probe:
        if _lu0 is None or q[0] < _lu0: _lu0 = q[0]
        if _lu1 is None or q[0] > _lu1: _lu1 = q[0]
        if _lv0 is None or q[1] < _lv0: _lv0 = q[1]
        if _lv1 is None or q[1] > _lv1: _lv1 = q[1]
    # ---- keep it ON the sheet: the offsets that suit one anchor mode can push
    # the block off the paper in the other, so nudge the whole thing back inside
    # (rigid shift - the signature never distorts). ----
    if fr.get("mode") == "reg" and _lu0 is not None:
        _bu, _bv = _sigbase()
        _wu = fr.get("wu", 0.0); _hv = fr.get("hv", 0.0)
        _m = 2.0
        if _bu + _lu0 < _m:
            _SIG_CU = _m - (_bu + _lu0)
        elif _wu > 0 and _bu + _lu1 > _wu - _m:
            _SIG_CU = (_wu - _m) - (_bu + _lu1)
            if _bu + _lu0 + _SIG_CU < _m: _SIG_CU = _m - (_bu + _lu0)
        if _bv + _lv0 < _m:
            _SIG_CV = _m - (_bv + _lv0)
        elif _hv > 0 and _bv + _lv1 > _hv - _m:
            _SIG_CV = (_hv - _m) - (_bv + _lv1)
            if _bv + _lv0 + _SIG_CV < _m: _SIG_CV = _m - (_bv + _lv0)
    for _st in _sig_local:
        cal_sig_polys.append([_sigmap_local(q[0], q[1]) for q in _st])
    for k in range(len(passes)):
        _marks = []
        for kk in range(CAL_N):
            _cu = _circ_u0 + k*_rowlen + CAL_R + kk*CAL_GAP
            _circ = []
            for s in range(21):
                _t = 6.283185307 * s / 20.0
                _circ.append(_sigmap_local(_cu + CAL_R*math.cos(_t), 4.0 + CAL_R*math.sin(_t)))
            _marks.append((_circ, _sigmap_local(_cu, 4.0)))
        cal_rows[k] = _marks
    _all = []
    for _st in cal_sig_polys:
        for q in _st: _all.append(q)
    for k in cal_rows:
        for _mk in cal_rows[k]:
            for q in _mk[0]: _all.append(q)
    for q in _all:
        if q[0] < 0 or q[1] < 0 or q[0] > BED or q[1] > BED:
            cal_sig_polys = []
            cal_rows = {}
            break

# ---- per-pass greedy ordering ----
# weld tolerance: strokes whose ends meet within this are drawn as one
WELD = float(weld) if weld is not None else 0.1
if WELD < 0.0:
    WELD = 0.0
n_welds = 0
_opt_notes = []
pass_strokes = {}
for k in range(len(passes)):
    pn = passes[k]
    mine = []
    for pl in polys:
        if pl[1] == pn:
            mine.append(pl[0])
    if k in cal_rows and cal_rows[k]:
        cx = cal_rows[k][0][1][0]; cy = cal_rows[k][0][1][1]
    else:
        cx = LX; cy = LY      # load point, pen space
    # ---- greedy nearest-end ordering, spatially indexed ----
    # Scanning every remaining stroke each step is O(n^2): at ~12k strokes that
    # is ~70M distance tests and minutes of solve. Bucket both endpoints into a
    # grid and search outward ring by ring instead, stopping once the next ring
    # cannot beat what we already have.
    ordered = []
    nrem = len(mine)
    if nrem:
        _ex = []; _ey = []
        for pl in mine:
            _ex.append(pl[0].X); _ex.append(pl[-1].X)
            _ey.append(pl[0].Y); _ey.append(pl[-1].Y)
        _gx0 = min(_ex); _gy0 = min(_ey)
        _w = max(_ex) - _gx0; _h = max(_ey) - _gy0
        _cell = math.sqrt(max(_w * _h, 1.0) / max(nrem, 1)) * 2.0
        if _cell < 1.0:
            _cell = 1.0
        _buckets = {}
        for i in range(nrem):
            for _e in (0, 1):
                _p = mine[i][0] if _e == 0 else mine[i][-1]
                _k = (int((_p.X - _gx0) / _cell), int((_p.Y - _gy0) / _cell))
                if _k not in _buckets:
                    _buckets[_k] = []
                _buckets[_k].append((i, _e))
        _used = [False] * nrem
        _left = nrem
        while _left > 0:
            _ci = int((cx - _gx0) / _cell); _cj = int((cy - _gy0) / _cell)
            bi = -1; brev = False; bd = None
            _ring = 0
            while True:
                _found_any = False
                for _dj in range(-_ring, _ring + 1):
                    for _di in range(-_ring, _ring + 1):
                        # only the shell of this ring
                        if _ring > 0 and abs(_di) != _ring and abs(_dj) != _ring:
                            continue
                        _k = (_ci + _di, _cj + _dj)
                        if _k not in _buckets:
                            continue
                        for (i, _e) in _buckets[_k]:
                            if _used[i]:
                                continue
                            _found_any = True
                            _p = mine[i][0] if _e == 0 else mine[i][-1]
                            _d = (_p.X - cx) ** 2 + (_p.Y - cy) ** 2
                            if bd is None or _d < bd:
                                bd = _d; bi = i; brev = (_e == 1)
                # a stroke one ring further out can still be closer than the
                # corner of this ring, so only stop when the ring's inner edge
                # is already beyond the best distance found
                if bd is not None and (_ring * _cell) ** 2 > bd:
                    break
                _ring += 1
                if _ring > 4000:
                    break
            if bi < 0:
                break
            _used[bi] = True
            _left -= 1
            pl = mine[bi]
            if brev:
                pl = list(reversed(pl))
            ordered.append(pl)
            cx = pl[-1].X; cy = pl[-1].Y

    # ---- 2-opt refinement of the travel order ----
    # Reversing the run of strokes p..q also reverses each stroke's direction,
    # and every link INSIDE that run keeps its length - so the whole move costs
    # just the two boundary links, which is what makes this affordable.
    #
    # Only worth running when it will actually pay. Measured on real jobs:
    #   2284 dense glyph strokes (median link 0.97mm): -5.5% travel, 5.0s solve
    #                                                  to save 1.6s of plotting
    #    286 sparse strokes      (median link 2.91mm): -14.6% travel, 0.5s solve
    #                                                  to save 2.0s of plotting
    # Greedy already picks the nearest free endpoint, so on tightly packed work
    # there is almost no slack left and the pass is a net loss. The gate below
    # compares predicted saving against predicted solve cost and skips it.
    n2 = len(ordered)
    opt_note = ''
    if n2 > 8:
        S_x = []; S_y = []; E_x = []; E_y = []
        for pl in ordered:
            S_x.append(pl[0].X); S_y.append(pl[0].Y)
            E_x.append(pl[-1].X); E_y.append(pl[-1].Y)
        t_before = 0.0; _px = 0.0; _py = 0.0
        _lk = []
        for _k2 in range(n2):
            _d = math.sqrt((S_x[_k2]-_px)**2 + (S_y[_k2]-_py)**2)
            t_before += _d; _lk.append(_d)
            _px = E_x[_k2]; _py = E_y[_k2]
        _lk.sort()
        _med = _lk[n2 // 2]
        gain_s = t_before * 0.10 / max(TF, 1) * 60.0   # ~10% is the typical win
        cost_s = n2 * 0.0022                            # measured solve cost/stroke
        if gain_s <= cost_s:
            opt_note = '2-opt skipped (would cost ~%.1fs of solve to save ~%.1fs of plotting)' % (cost_s, gain_s)
        else:
            _idx = list(range(n2))
            _rev = [False] * n2
            _t0 = time.clock()
            _moves = 0
            for _pass in range(6):
                if time.clock() - _t0 > 4.0:
                    break
                _eb = {}
                for _k2 in range(n2):
                    _key = (int(E_x[_k2] / _cell), int(E_y[_k2] / _cell))
                    if _key not in _eb:
                        _eb[_key] = []
                    _eb[_key].append(_k2)
                _gainpass = 0.0
                for p2 in range(n2):
                    if (p2 & 127) == 0 and time.clock() - _t0 > 4.0:
                        break
                    _ax = E_x[p2-1] if p2 > 0 else 0.0
                    _ay = E_y[p2-1] if p2 > 0 else 0.0
                    _cur = math.sqrt((S_x[p2]-_ax)**2 + (S_y[p2]-_ay)**2)
                    # a longer first link can still pay if the second shrinks more,
                    # so search past `cur` rather than pruning at it
                    _R = _cur + _med * 4.0 + _cell
                    _ci = int(_ax / _cell); _cj = int(_ay / _cell)
                    _rings = int(_R / _cell) + 1
                    if _rings > 6:
                        _rings = 6
                    _bd = -1e-9; _bq = -1
                    for _dj in range(-_rings, _rings + 1):
                        for _di in range(-_rings, _rings + 1):
                            _key = (_ci + _di, _cj + _dj)
                            if _key not in _eb:
                                continue
                            for q2 in _eb[_key]:
                                if q2 < p2:
                                    continue
                                _d1 = math.sqrt((E_x[q2]-_ax)**2 + (E_y[q2]-_ay)**2)
                                if _d1 > _R:
                                    continue
                                if q2 + 1 < n2:
                                    _o2 = math.sqrt((E_x[q2]-S_x[q2+1])**2 + (E_y[q2]-S_y[q2+1])**2)
                                    _n2b = math.sqrt((S_x[p2]-S_x[q2+1])**2 + (S_y[p2]-S_y[q2+1])**2)
                                else:
                                    _o2 = 0.0; _n2b = 0.0
                                _delta = (_d1 + _n2b) - (_cur + _o2)
                                if _delta < _bd:
                                    _bd = _delta; _bq = q2
                    if _bq > p2:
                        a2 = p2; b2 = _bq
                        S_x[a2:b2+1] = S_x[a2:b2+1][::-1]; S_y[a2:b2+1] = S_y[a2:b2+1][::-1]
                        E_x[a2:b2+1] = E_x[a2:b2+1][::-1]; E_y[a2:b2+1] = E_y[a2:b2+1][::-1]
                        for _k2 in range(a2, b2+1):
                            S_x[_k2], E_x[_k2] = E_x[_k2], S_x[_k2]
                            S_y[_k2], E_y[_k2] = E_y[_k2], S_y[_k2]
                        _idx[a2:b2+1] = _idx[a2:b2+1][::-1]
                        _sub = _rev[a2:b2+1][::-1]
                        for _k2 in range(len(_sub)):
                            _rev[a2 + _k2] = not _sub[_k2]
                        _gainpass += -_bd
                        _moves += 1
                if _gainpass < t_before * 0.001:
                    break
            if _moves:
                _new = []
                for _k2 in range(n2):
                    _pl = ordered[_idx[_k2]]
                    _new.append(list(reversed(_pl)) if _rev[_k2] else _pl)
                ordered = _new
                t_after = 0.0; _px = 0.0; _py = 0.0
                for _k2 in range(n2):
                    t_after += math.sqrt((S_x[_k2]-_px)**2 + (S_y[_k2]-_py)**2)
                    _px = E_x[_k2]; _py = E_y[_k2]
                opt_note = '2-opt: %d reversals, travel %.2fm -> %.2fm (%.0f%% less pen-up)' % (
                    _moves, t_before / 1000.0, t_after / 1000.0,
                    100.0 * (t_before - t_after) / t_before if t_before > 0 else 0.0)
            else:
                opt_note = '2-opt: no improving reversals found'
    if opt_note:
        _opt_notes.append('pen %d: %s' % (pn, opt_note))

    # ---- weld: a stroke that starts where the previous one ended is the SAME
    # line as far as the pen is concerned. Separate (unjoined) curves in Rhino
    # would otherwise lift, travel 0mm and drop again at every joint - wasted
    # time and an ink blob per corner. Greedy ordering already puts coincident
    # strokes back to back, so a single sweep catches them.
    if WELD > 0.0:
        _merged = []
        for pl in ordered:
            if _merged:
                _pv = _merged[-1]
                _dx = pl[0].X - _pv[-1].X; _dy = pl[0].Y - _pv[-1].Y
                if _dx*_dx + _dy*_dy <= WELD*WELD:
                    for _q in pl[1:]:
                        _pv.append(_q)      # drop the duplicated joint point
                    n_welds += 1
                    continue
            _merged.append(list(pl))
        ordered = _merged
    mydots = []
    if dpts and passes[k] == DPEN:
        _remd = list(dpts)
        while _remd:
            _bi = 0; _bd = None
            for i in range(len(_remd)):
                _d = (_remd[i].X-cx)*(_remd[i].X-cx) + (_remd[i].Y-cy)*(_remd[i].Y-cy)
                if _bd is None or _d < _bd:
                    _bd = _d; _bi = i
            _p = _remd.pop(_bi)
            mydots.append(_p)
            cx = _p.X; cy = _p.Y
    pass_strokes[k] = (ordered, mydots)

# ---- distance + time estimate ----
draw_d = 0.0; trav_d = 0.0; ndots_total = 0; nstrokes_total = 0
for k in pass_strokes:
    ordered, mydots = pass_strokes[k]
    px = LX; py = LY
    for pl in ordered:
        trav_d += math.sqrt((pl[0].X-px)*(pl[0].X-px) + (pl[0].Y-py)*(pl[0].Y-py))
        for i in range(1, len(pl)):
            draw_d += pl[i-1].DistanceTo(pl[i])
        px = pl[-1].X; py = pl[-1].Y
    for p in mydots:
        trav_d += math.sqrt((p.X-px)*(p.X-px) + (p.Y-py)*(p.Y-py))
        px = p.X; py = p.Y
    ndots_total += len(mydots)
    nstrokes_total += len(ordered)
z_d = (nstrokes_total + ndots_total)*2.0*HOP + len(passes)*2.0*(PUZ+10.0)
dwell_min = ndots_total*DWELL/60000.0
cal_min = 0.0
if cal_rows:
    _sig_d = 0.0
    for _st in cal_sig_polys:
        for i in range(1, len(_st)):
            _sig_d += math.sqrt((_st[i][0]-_st[i-1][0])**2 + (_st[i][1]-_st[i-1][1])**2)
    cal_min = _sig_d/float(DF) + (len(passes)*CAL_N*6.283185307*CAL_R)/float(DF) + (len(passes)*CAL_N*4.0*HOP)/Z_SPEED + (len(passes)*(2.0*CAL_N+2)*CAL_PAUSE)/60000.0
outline_min = 0.0
if OUTLINE and xs:
    outline_min = (2.0*((max(xs)-min(xs)) + (max(ys)-min(ys))))/float(OUTLINE_F) + (5.0*OUTLINE_DWELL + 1000.0)/60000.0
mins = draw_d/float(DF) + trav_d/float(TF) + z_d/Z_SPEED + dwell_min + cal_min + outline_min + (len(passes)-1)*0.5
est = '%.1f min (draw %.1fm, travel %.1fm)' % (mins, draw_d/1000.0, trav_d/1000.0)

# ---- build g-code ----
L = []
L.append('; Voron pen-plot (moves only, no heat) - MULTI-PEN')
L.append('; === settings ===')
L.append('; draw_height=%.3f paper=%.2f preload=%.2f -> draw_z=%.3f | hop=%.1f clearance=%.1f' % (PDZ, PAPER, PRELOAD, DRAW_Z, HOP, PUZ))
L.append('; draw=%d travel=%d mm/min | accel=%d | res=%.2f mm | scv=%.1f (spikeyness %.2f)' % (DF, TF, AC, RES, SCV, SPIKE))
L.append('; pen-load point (auto, off-paper): (%.0f,%.0f) | pen_offset=(%.1f,%.1f) qgl=%s mesh=%s' % (LX, LY, OFFX, OFFY, QGL, MESH))
if fr.get("mode") == "reg":
    L.append('; PLACEMENT: registered paper, %s scale=%.3f margin=%.1f p0=(%.1f,%.1f)' % ('FIT' if fr.get("fit", 1) else '1:1', fr.get("scale", 1.0), fr.get("regm", 10.0), fr["p0"][0], fr["p0"][1]))
elif fr.get("mode") == "centered":
    L.append('; PLACEMENT: bed-centered (pen-offset compensated)')
    if fr.get("noregfile", 0):
        L.append('; registration requested but paper_registration.json missing')
else:
    L.append('; PLACEMENT: direct (curves wired in already in machine coords)')
if pwarn:
    L.append(pwarn)
for k in range(len(passes)):
    ordered, mydots = pass_strokes[k]
    L.append('; PASS %d: pen %d [%s] -> %d strokes, %d dots' % (k+1, passes[k], penname(passes[k]), len(ordered), len(mydots)))
L.append('; est %s' % est)
if warn:
    L.append(warn)
L.append('CLEAR_PAUSE')
L.append('SET_GCODE_OFFSET Z=0')
L.append('G21')
L.append('G90')
# conditional homing + QGL (printer-side macro): skips whatever is already valid
# ---- probing interlock ----
# QGL and bed mesh both drive the NOZZLE down onto the bed. A pen sits BELOW
# the nozzle (pen 3 by 7.5mm), so if one is loaded it is crushed before the
# probe ever triggers. The job order already assumes the pen goes in later, at
# PEN_PAUSE - but nothing enforced it, and a pen was destroyed finding that out.
# Stop and make it explicit instead of trusting the running order.
if QGL or MESH:
    L.append('PLOT_PROBE_GUARD QGL=%d' % (1 if QGL else 0))
L.append('PLOT_HOME_QGL QGL=%d' % (1 if QGL else 0))
if MESH:
    # declare the plot region as an exclude_object so ADAPTIVE meshing scans
    # only it (no objects declared = Klipper falls back to FULL bed scan).
    # Region = everything drawn (strokes+dots+signature) in nozzle coords,
    # extended to cover the pen's contact zone (pen = nozzle + offset).
    _rxs = list(xs); _rys = list(ys)
    for _st in cal_sig_polys:
        for q in _st:
            _rxs.append(q[0]); _rys.append(q[1])
    for k in cal_rows:
        for _mk in cal_rows[k]:
            for q in _mk[0]:
                _rxs.append(q[0]); _rys.append(q[1])
    if _rxs:
        # union of pen-contact zone (raw) and nozzle-travel zone (raw - offset)
        _mx0 = min(min(_rxs), min(_rxs)-OFFX); _mx1 = max(max(_rxs), max(_rxs)-OFFX)
        _my0 = min(min(_rys), min(_rys)-OFFY); _my1 = max(max(_rys), max(_rys)-OFFY)
        if _mx0 < 0: _mx0 = 0.0
        if _my0 < 0: _my0 = 0.0
        if _mx1 > BED: _mx1 = BED
        if _my1 > BED: _my1 = BED
        _mcx = (_mx0+_mx1)/2.0; _mcy = (_my0+_my1)/2.0
        L.append('EXCLUDE_OBJECT_DEFINE NAME=plot_area CENTER=%.1f,%.1f POLYGON=[[%.1f,%.1f],[%.1f,%.1f],[%.1f,%.1f],[%.1f,%.1f]]' % (
            _mcx, _mcy, _mx0, _my0, _mx1, _my0, _mx1, _my1, _mx0, _my1))
    L.append('BED_MESH_CALIBRATE ADAPTIVE=1')
L.append('SET_VELOCITY_LIMIT ACCEL=%d SQUARE_CORNER_VELOCITY=%.1f' % (AC, SCV))
# Apply the first pass's pen datum BEFORE the outline, not just before its
# pass. Every Z here is expressed in pen 1's frame, so a pen that reaches
# lower - pen 3 touches at nozzle Z28.1 against pen 1's Z16.0 - is 12mm past
# contact at the "pen up" outline height and drags a rectangle across the bed.
# Applying the datum first puts the whole pre-pause sequence in the loaded
# pen's frame, and also makes the outline trace where the PEN goes rather than
# where the nozzle goes. Harmless when no pen is fitted: it is only an offset.
if PENTABLE and passes:
    L.append('PEN_APPLY PEN=%d   ; datum first, so pre-draw Z is in this pen\'s frame' % passes[0])
    L.append('M400')

if OUTLINE:
    # bounding box of everything inked: strokes + dots + signature
    _oxs = list(xs); _oys = list(ys)
    for _st in cal_sig_polys:
        for q in _st:
            _oxs.append(q[0]); _oys.append(q[1])
    for k in cal_rows:
        for _mk in cal_rows[k]:
            for q in _mk[0]:
                _oxs.append(q[0]); _oys.append(q[1])
    if _oxs:
        _ox0 = min(_oxs); _ox1 = max(_oxs)
        _oy0 = min(_oys); _oy1 = max(_oys)
        _oz = PUZ + 2.0
        L.append('; ---- alignment outline: tracing plot bounds (no pen loaded) ----')
        L.append('SET_DISPLAY_TEXT MSG="Outlining plot bounds - check alignment"')
        L.append('G1 Z%.3f F1200' % _oz)
        L.append('G0 X%.3f Y%.3f F%d' % (_ox0-OFFX, _oy0-OFFY, TF))
        L.append('G4 P%d' % OUTLINE_DWELL)
        L.append('G1 X%.3f Y%.3f F%d' % (_ox1-OFFX, _oy0-OFFY, OUTLINE_F))
        L.append('G4 P%d' % OUTLINE_DWELL)
        L.append('G1 X%.3f Y%.3f F%d' % (_ox1-OFFX, _oy1-OFFY, OUTLINE_F))
        L.append('G4 P%d' % OUTLINE_DWELL)
        L.append('G1 X%.3f Y%.3f F%d' % (_ox0-OFFX, _oy1-OFFY, OUTLINE_F))
        L.append('G4 P%d' % OUTLINE_DWELL)
        L.append('G1 X%.3f Y%.3f F%d' % (_ox0-OFFX, _oy0-OFFY, OUTLINE_F))
        L.append('M400')
        L.append('G4 P1000')
for k in range(len(passes)):
    pn = passes[k]
    ordered, mydots = pass_strokes[k]
    L.append('; ======== PASS %d of %d : PEN %d [%s] ========' % (k+1, len(passes), pn, penname(pn)))
    if k > 0 or PENLOAD:
        # Klipper splits parameters on whitespace, so a pen name with a space
        # in it ("BLACK ROLLER") arrives as a stray token and the whole command
        # is rejected as malformed. Every pen name has been two words since the
        # palette was relabelled, so this broke every plot until underscored.
        L.append('PEN_PAUSE Z=%.3f X=%.1f Y=%.1f PEN=%d COLOR=%s   ; load pen %d [%s], seat to bed, PEN_RESUME' % (
            PDZ, LX - OFFX, LY - OFFY, pn, penname(pn).replace(' ', '_'), pn, penname(pn)))
    if PENTABLE:
        # this pen's stored XYZ datum (see the PEN TOOL TABLE macros). Runs
        # AFTER the swap pause so the freshly-fitted pen is aligned before it
        # draws; a pen with no calibration simply zeroes the offsets.
        L.append('PEN_APPLY PEN=%d   ; tool-table offsets for pen %d' % (pn, pn))
        L.append('G1 Z%.3f F1200' % (PUZ + 10.0))
        L.append('M400')
    L.append('G1 Z%.3f F%d' % (PUZ, TF))
    if k in cal_rows and cal_rows[k]:
        L.append('; -- calibration row (pen %d [%s]): dial in Z now --' % (pn, penname(pn)))
        L.append('SET_DISPLAY_TEXT MSG="Pen %d [%s] marks - babystep Z now"' % (pn, penname(pn)))
        if k == 0 and cal_sig_polys:
            for _st in cal_sig_polys:
                L.append('G0 X%.3f Y%.3f F%d' % (_st[0][0]-OFFX, _st[0][1]-OFFY, TF))
                L.append('G1 Z%.3f F1200' % DRAW_Z)
                for q in _st[1:]:
                    L.append('G1 X%.3f Y%.3f F%d' % (q[0]-OFFX, q[1]-OFFY, DF))
                L.append('G1 Z%.3f F1200' % HOP_Z)
                L.append('G4 P%d' % CAL_PAUSE)
        for _mk in cal_rows[k]:
            _circ = _mk[0]
            L.append('G0 X%.3f Y%.3f F%d' % (_circ[0][0]-OFFX, _circ[0][1]-OFFY, TF))
            L.append('G1 Z%.3f F1200' % DRAW_Z)
            for q in _circ[1:]:
                L.append('G1 X%.3f Y%.3f F%d' % (q[0]-OFFX, q[1]-OFFY, DF))
            L.append('G1 Z%.3f F1200' % HOP_Z)
            L.append('G4 P%d' % CAL_PAUSE)
        for _mi in range(len(cal_rows[k])-1, -1, -1):
            _ctr = cal_rows[k][_mi][1]
            L.append('G0 X%.3f Y%.3f F%d' % (_ctr[0]-OFFX, _ctr[1]-OFFY, TF))
            L.append('G1 Z%.3f F1200' % DRAW_Z)
            L.append('G4 P%d' % max(int(DWELL), 100))
            L.append('G1 Z%.3f F1200' % HOP_Z)
            L.append('G4 P%d' % CAL_PAUSE)
        L.append('SET_DISPLAY_TEXT MSG="Plotting pass %d (pen %d [%s])..."' % (k+1, pn, penname(pn)))
    _wdist = 0.0        # mm drawn this pass, for tip wear comp (fresh tip per pass)
    for pl in ordered:
        L.append('G0 X%.3f Y%.3f F%d' % (pl[0].X-OFFX, pl[0].Y-OFFY, TF))
        _z0 = DRAW_Z + pl[0].Z * PGAIN - WEAR * _wdist / 1000.0
        if _z0 < 0.5: _z0 = 0.5
        if _z0 > HOP_Z: _z0 = HOP_Z
        L.append('G1 Z%.3f F%d' % (_z0, TF))
        _zc = _z0
        _pv = pl[0]
        for pt in pl[1:]:
            _wdist += _pv.DistanceTo(pt)
            _pv = pt
            _zt = DRAW_Z + pt.Z * PGAIN - WEAR * _wdist / 1000.0
            if _zt < 0.5: _zt = 0.5
            if _zt > HOP_Z: _zt = HOP_Z
            if abs(_zt - _zc) > 0.005:
                L.append('G1 X%.3f Y%.3f Z%.3f F%d' % (pt.X-OFFX, pt.Y-OFFY, _zt, DF))
                _zc = _zt
            else:
                L.append('G1 X%.3f Y%.3f F%d' % (pt.X-OFFX, pt.Y-OFFY, DF))
        L.append('G1 Z%.3f F%d' % (HOP_Z, TF))
    if mydots:
        L.append('; -- dots (pen %d) --' % pn)
        for p in mydots:
            L.append('G0 X%.3f Y%.3f F%d' % (p.X-OFFX, p.Y-OFFY, TF))
            _zd = DRAW_Z + p.Z * PGAIN - WEAR * _wdist / 1000.0
            if _zd < 0.5: _zd = 0.5
            if _zd > HOP_Z: _zd = HOP_Z
            L.append('G1 Z%.3f F1200' % _zd)
            if DWELL > 0:
                L.append('G4 P%d' % int(DWELL))
            L.append('G1 Z%.3f F1200' % HOP_Z)
    L.append('G1 Z%.3f F%d' % (PUZ + 10.0, TF))
# finish centered-X toward the back: clears the paper area for removal while
# staying 50mm shy of the Y350 extreme where the pen mount hits the frame.
# Steppers stay energized so homing/QGL survive for a follow-up plot.
L.append('G0 X175.0 Y300.0 F%d' % TF)
L.append('PEN_RESTORE_LIMITS')
L.append('SET_DISPLAY_TEXT MSG="Plot complete"')

nL = len(L)
prev = list(L[:26])
if nL > 30:
    prev.append('   ... (%d lines total - full file on WRITE) ...' % nL)
    prev.extend(L[-4:])
gcode_preview = '\n'.join(prev)

# ---- plan geometry: EXACTLY what will be emitted, for the preview ----
plan_pen1 = []; plan_pen2 = []; plan_pen3 = []; plan_pen4 = []
plan_pen5 = []; plan_pen6 = []; plan_pen7 = []; plan_pen8 = []
_buckets = [plan_pen1, plan_pen2, plan_pen3, plan_pen4, plan_pen5, plan_pen6, plan_pen7, plan_pen8]
for k in range(len(passes)):
    ordered, mydots = pass_strokes[k]
    pn = passes[k]
    _bi = pn - 1
    if _bi < 0: _bi = 0
    if _bi > 7: _bi = 7
    for pl in ordered:
        _lp = List[rg.Point3d]()
        for pt in pl:
            _lp.Add(rg.Point3d(pt))
        _buckets[_bi].append(rg.PolylineCurve(_lp))
plan_dots = []
for k in range(len(passes)):
    for p in pass_strokes[k][1]:
        plan_dots.append(rg.Point3d(p))
plan_signature = []
for _st in cal_sig_polys:
    _lp = List[rg.Point3d]()
    for q in _st:
        _lp.Add(rg.Point3d(q[0], q[1], 0))
    plan_signature.append(rg.PolylineCurve(_lp))
for k in cal_rows:
    for _mk in cal_rows[k]:
        _lp = List[rg.Point3d]()
        for q in _mk[0]:
            _lp.Add(rg.Point3d(q[0], q[1], 0))
        plan_signature.append(rg.PolylineCurve(_lp))
        plan_signature.append(rg.Circle(rg.Point3d(_mk[1][0], _mk[1][1], 0), 0.5).ToNurbsCurve())
# pen-load point marker (where the seating dot may land)
if passes:
    plan_signature.append(rg.Circle(rg.Point3d(LX, LY, 0), 2.5).ToNurbsCurve())
    plan_signature.append(rg.Circle(rg.Point3d(LX, LY, 0), 0.4).ToNurbsCurve())

# ---- job manifest ----
# how the size was arrived at - never call it "1:1" once a scale multiplier
# is in play, that reads as a contradiction next to the number
_sc = fr.get("scale", 1.0)
if fr.get("fit", 0):
    _how = 'FIT'
elif abs(_sc - 1.0) < 0.001:
    _how = '1:1'
else:
    _how = 'SCALED %d%%' % int(round(_sc * 100.0))

_mode_txt = 'DIRECT passthrough (curves plot at their Rhino coords, pen-compensated)'
if fr.get("mode") == "reg":
    _mode_txt = 'REGISTERED paper, %s scale %.2f' % (_how, _sc)
elif fr.get("mode") == "centered":
    _mode_txt = 'BED-CENTERED, %s scale %.2f' % (_how, _sc)
elif fr.get("mode") == "graph":
    _mode_txt = 'FROM GRAPH, centre (%.1f, %.1f), %s scale %.2f' % (
        fr.get("gx", 0.0), fr.get("gy", 0.0), _how, _sc)
if fr.get("locked", 0):
    _mode_txt += ' [PLACEMENT LOCKED]'
_man = []
_man.append('JOB: %d pass(es) | est %s' % (len(passes), est))
_man.append('placement: %s' % _mode_txt)
for k in range(len(passes)):
    ordered, mydots = pass_strokes[k]
    _dd = 0.0
    for pl in ordered:
        for i in range(1, len(pl)):
            _dd += pl[i-1].DistanceTo(pl[i])
    _man.append('PASS %d - pen %d [%s]: %d strokes (%.1fm)%s' % (k+1, passes[k], penname(passes[k]), len(ordered), _dd/1000.0, (', %d dots' % len(mydots)) if mydots else ''))
_man.append('speeds: %s (draw %d / travel %d / accel %d)' % (PROF_NAME, DF, TF, AC))
if n_welds:
    _man.append('welded %d touching stroke ends (%d pen lifts saved)' % (n_welds, n_welds))
for _q in _opt_notes:
    _man.append(_q)
if WEAR > 0.0001:
    _mx = 0.0
    for k in range(len(passes)):
        _dd2 = 0.0
        for pl in pass_strokes[k][0]:
            for i in range(1, len(pl)):
                _dd2 += pl[i-1].DistanceTo(pl[i])
        if _dd2 > _mx: _mx = _dd2
    _man.append('tip wear comp: %.2f mm/m -> Z drops up to %.3f mm by pass end (reset each pen)' % (WEAR, WEAR*_mx/1000.0))
_man.append('signature: %s' % ('ON (JC + %d cal rows)' % len(cal_rows) if cal_rows else 'off'))
if cal_rows and (abs(_SIG_CU) > 0.001 or abs(_SIG_CV) > 0.001):
    _man.append('  (signature nudged %+.1f,%+.1f mm to stay on the sheet)' % (_SIG_CU, _SIG_CV))
if MESH and xs:
    _man.append('mesh: adaptive over plot area only (pen offset included)')
if OUTLINE and xs:
    _man.append('alignment outline: ON (slow bbox trace before pen load)')
if press_pens:
    if PGAIN > 0.001:
        _man.append('pressure: gain %.2f on pen(s) %s' % (PGAIN, str(sorted(press_pens))))
    else:
        _man.append('pressure: present on pen(s) %s but gain 0 - plotting FLAT' % str(sorted(press_pens)))
if pwarn:
    _man.append('!! ART EXCEEDS PAPER (1:1) !!')
if warn:
    _man.append('!! OUT OF BOUNDS - PLOT blocked !!')
if fr.get("noregfile", 0):
    _man.append('!! registration requested but no file - centered fallback !!')
st = '\n'.join(_man)

gcode = None
if WRITE or PLOT:
    gcode = '\n'.join(L) + '\n'
if WRITE:
    try:
        if not os.path.isdir(out_dir):
            os.makedirs(out_dir)
    except:
        pass
    fh = open(out_file, 'w')
    fh.write(gcode)
    fh.close()
    st += '\nWROTE ' + out_file
if PLOT:
    if warn:
        st += '\nPLOT BLOCKED: out of bounds!'
    else:
        try:
            from System.Net import WebClient
            from System.Text import Encoding
            b = '----GHPenPlotBoundary'
            body = '--' + b + '\r\n'
            body += 'Content-Disposition: form-data; name="root"\r\n\r\ngcodes\r\n'
            body += '--' + b + '\r\n'
            body += 'Content-Disposition: form-data; name="file"; filename="plot.gcode"\r\n'
            body += 'Content-Type: text/plain\r\n\r\n'
            body += gcode
            body += '\r\n--' + b + '--\r\n'
            wc = WebClient()
            wc.Headers.Add('Content-Type', 'multipart/form-data; boundary=' + b)
            wc.UploadData('http://192.168.1.23:7125/server/files/upload', 'POST', Encoding.UTF8.GetBytes(body))
            wc2 = WebClient()
            wc2.UploadString('http://192.168.1.23:7125/printer/print/start?filename=plot.gcode', 'POST', '')
            st += '\nUPLOADED + PLOT STARTED on Voron'
        except Exception as ue:
            st += '\nPLOT FAILED: ' + str(ue)
print(st)
# ---------- end gcode ----------
# ----
preview_6 = GhPythonScript(
    frame=place.frame,
    plan_pen1=gcode.plan_pen1,
    plan_pen2=gcode.plan_pen2,
    plan_pen3=gcode.plan_pen3,
    plan_pen4=gcode.plan_pen4,
    plan_pen5=gcode.plan_pen5,
    plan_pen6=gcode.plan_pen6,
    plan_pen7=gcode.plan_pen7,
    plan_pen8=gcode.plan_pen8,
    plan_dots=gcode.plan_dots,
    plan_signature=gcode.plan_signature,
    dot_dwell=dot_ink,
    paper_mm=paper_stock)  # -> out, bed, paper, labels, view_pen1, view_pen2, view_pen3, view_pen4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; inputs plan_pen1: list, plan_pen2: list, plan_pen3: list, plan_pen4: list, plan_pen5: list, plan_pen6: list, plan_pen7: list, plan_pen8: list, plan_dots: list, plan_signature: list, ghosted: list
#   port frame: Paper outline from PLACE, drawn under the artwork so you can see the margins. (str)
# ---------- preview_6: Python ----------
# PREVIEW component - THIN DISPLAY SHELL. The whole pipeline is PEN-SPACE
# (physical ink positions), so plan geometry is drawn COMPLETELY RAW - zero
# transforms. Context: bed outline, registered paper quad, ghost layers,
# FRONT marker - all in the same physical frame (matches the bed STL).
# What you see is literally the emission plan.
# Inputs: plan_pen1..plan_pen4(list crv), plan_dots(list pt), plan_signature(list crv),
#         ghosted(list crv), frame(str), dot_dwell(ms - scales preview dot size),
#         paper_mm(paper thickness - paper renders as a slab with TOP at Z=0)
# Outputs: out, bed, paper, labels, view_pen1..view_pen4, view_dots, view_signature, view_ghost
import Rhino.Geometry as rg
import rhinoscriptsyntax as rs
import scriptcontext as sc
import Rhino as _R
import math, json
from System.Collections.Generic import List
try:
    sc.doc = ghdoc
except:
    pass

BED = 350.0

fr = {"mode": "direct"}
if frame:
    try:
        fr = json.loads(str(frame))
    except:
        fr = {"mode": "direct"}

def txt(s, hgt, px, py):
    out2 = []
    try:
        te = rg.TextEntity()
        te.Plane = rg.Plane(rg.Point3d(0, 0, 0), rg.Vector3d.ZAxis)
        te.PlainText = s
        te.TextHeight = hgt
        tcs = te.CreateCurves(_R.RhinoDoc.ActiveDoc.DimStyles.Current, False)
        if tcs and len(tcs) > 0:
            bb = rg.BoundingBox.Empty
            for t in tcs:
                bb.Union(t.GetBoundingBox(True))
            hh = bb.Max.Y - bb.Min.Y
            sf = hgt/hh if hh > 0.01 else 1.0
            ct = rg.Point3d((bb.Min.X+bb.Max.X)/2.0, (bb.Min.Y+bb.Max.Y)/2.0, 0)
            for t in tcs:
                t.Transform(rg.Transform.Scale(ct, sf))
            b2 = rg.BoundingBox.Empty
            for t in tcs:
                b2.Union(t.GetBoundingBox(True))
            nc = rg.Point3d((b2.Min.X+b2.Max.X)/2.0, (b2.Min.Y+b2.Max.Y)/2.0, 0)
            mv = rg.Transform.Translation(px-nc.X, py-nc.Y, 0)
            for t in tcs:
                t.Transform(mv)
                out2.append(t)
    except:
        pass
    return out2

def shift_curves(lst):
    # pen-space pipeline: no shifting - just coerce for display
    out2 = []
    if lst:
        for c in lst:
            cc = c if isinstance(c, rg.Curve) else rs.coercecurve(c)
            if cc is not None:
                out2.append(cc)
    return out2

view_pen1 = shift_curves(plan_pen1)
view_pen2 = shift_curves(plan_pen2)
view_pen3 = shift_curves(plan_pen3)
view_pen4 = shift_curves(plan_pen4)
view_pen5 = shift_curves(plan_pen5)
view_pen6 = shift_curves(plan_pen6)
view_pen7 = shift_curves(plan_pen7)
view_pen8 = shift_curves(plan_pen8)
view_signature = shift_curves(plan_signature)
view_ghost = shift_curves(ghosted)

# dot size approximates ink bleed: longer dwell = fatter dot
DWELL = float(dot_dwell) if dot_dwell is not None else 50.0
if DWELL < 0.0:
    DWELL = 0.0
_dot_r = 0.6 + DWELL * 0.004      # 0ms->0.6mm, 50->0.8, 250->1.6, 500->2.6
view_dots = []
if plan_dots:
    for d in plan_dots:
        p3 = d if isinstance(d, rg.Point3d) else rs.coerce3dpoint(d)
        if p3 is None:
            continue
        view_dots.append(rg.Circle(rg.Point3d(p3), _dot_r).ToNurbsCurve())

# ---- pressure overlay: pressured strokes chopped into pieces and drawn at a
# WIDTH set by press depth (|Z|) - thin where the pen skims, fat where it digs
# in. Weight rather than colour because that is what pressure physically does
# to a line: a colour wash sat on top of the artwork and hid it, so the preview
# showed a red field instead of the drawing underneath.
# Pixels, not mm (the Human preview takes screen thickness with Absolute=False).
import System.Drawing as SD
view_pressure = []
pressure_wt = []
PW_MIN = 1.0        # screen px at zero press
PW_MAX = 7.0        # screen px at full press
_praw = []          # (piece polyline pts, avg |z|)
_pmax = 0.0
for _plan in [plan_pen1, plan_pen2, plan_pen3, plan_pen4, plan_pen5, plan_pen6, plan_pen7, plan_pen8]:
    if not _plan:
        continue
    for c in _plan:
        cc = c if isinstance(c, rg.Curve) else rs.coercecurve(c)
        if cc is None:
            continue
        ok, pl = cc.TryGetPolyline()
        if not ok:
            continue
        _hasz = False
        for q in pl:
            if abs(q.Z) > 0.01:
                _hasz = True
                break
        if not _hasz:
            continue
        CH = 8
        i0 = 0
        while i0 < pl.Count - 1:
            i1 = i0 + CH
            if i1 > pl.Count - 1:
                i1 = pl.Count - 1
            zs = 0.0
            for k in range(i0, i1 + 1):
                zs += abs(pl[k].Z)
            za = zs / float(i1 - i0 + 1)
            if za > _pmax:
                _pmax = za
            _praw.append((i0, i1, pl, za))
            i0 = i1
PCAP = 6000
if _praw and _pmax > 0.001:
    # Sample EVENLY across the whole drawing. This used to stop collecting once
    # the budget was full, which took pieces in PLOT ORDER - so on a job with
    # more strokes than budget you saw only the ones that happened to plot
    # first: a diagonal slice sweeping across the sheet, which reads as a
    # skewed, broken overlay rather than an honest partial one. A stride keeps
    # the same budget and represents the whole drawing.
    _stride = 1
    if len(_praw) > PCAP:
        _stride = int(len(_praw) / PCAP) + 1
    for _ix in range(0, len(_praw), _stride):
        item = _praw[_ix]
        lp = List[rg.Point3d]()
        for k in range(item[0], item[1] + 1):
            q = item[2][k]
            lp.Add(rg.Point3d(q.X, q.Y, 0.05))
        view_pressure.append(rg.PolylineCurve(lp))
        t = item[3] / _pmax
        pressure_wt.append(PW_MIN + (PW_MAX - PW_MIN) * t)

bed = [rg.Rectangle3d(rg.Plane.WorldXY, rg.Interval(0, BED), rg.Interval(0, BED)).ToNurbsCurve()]
paper = []; labels = []

# ---- unreachable zone: the pen sits OFFY in front of the nozzle, so when the
# nozzle hits its Y limit the pen still stops short - that back strip can never
# be drawn on. Shown as a diagonally hatched red band.
OFFY_HW = -58.0                     # pen offset from nozzle (hardware constant)
view_exclusion = []
_ylim = BED + OFFY_HW               # highest Y the PEN can reach
if _ylim < BED - 0.5:
    _ex = rg.Rectangle3d(rg.Plane.WorldXY, rg.Interval(0, BED), rg.Interval(_ylim, BED)).ToNurbsCurve()
    view_exclusion.append(_ex)
    _hs = 9.0                       # hatch spacing
    _c = -BED
    while _c < BED * 2.0:
        _l = rg.LineCurve(rg.Point3d(-BED, -BED + _c, 0), rg.Point3d(BED * 2.0, BED * 2.0 + _c, 0))
        _xev = rg.Intersect.Intersection.CurveCurve(_l, _ex, 0.001, 0.001)
        _ts = []
        if _xev is not None:
            for _ev in _xev:
                _ts.append(_ev.ParameterA)
        if len(_ts) >= 2:
            _ts.sort()
            _seg = _l.Trim(_ts[0], _ts[-1])
            if _seg is not None and _seg.GetLength() > 0.5:
                view_exclusion.append(_seg)
        _c += _hs
if fr.get("p0"):     # paper whenever corners known (frame is already pen-space)
    p0 = [fr["p0"][0], fr["p0"][1]]
    eu = fr["eu"]; ev = fr["ev"]
    wu = fr["wu"]; hv = fr["hv"]
    # paper as a thin slab: top face at Z=0 (the drawing plane), thickness below
    _pth = float(paper_mm) if paper_mm is not None else 0.1
    if _pth < 0.02:
        _pth = 0.02
    _ppl = rg.Plane(rg.Point3d(p0[0], p0[1], 0), rg.Vector3d(eu[0], eu[1], 0), rg.Vector3d(ev[0], ev[1], 0))
    _pbox = rg.Box(_ppl, rg.Interval(0, wu), rg.Interval(0, hv), rg.Interval(-_pth, 0))
    _pbrep = rg.Brep.CreateFromBox(_pbox)
    if _pbrep is not None:
        paper.append(_pbrep)
    else:
        q = List[rg.Point3d]()
        q.Add(rg.Point3d(p0[0], p0[1], 0))
        q.Add(rg.Point3d(p0[0]+eu[0]*wu, p0[1]+eu[1]*wu, 0))
        q.Add(rg.Point3d(p0[0]+eu[0]*wu+ev[0]*hv, p0[1]+eu[1]*wu+ev[1]*hv, 0))
        q.Add(rg.Point3d(p0[0]+ev[0]*hv, p0[1]+ev[1]*hv, 0))
        q.Add(rg.Point3d(p0[0], p0[1], 0))
        paper.append(rg.PolylineCurve(q))
    _lbl = [('P0', p0), ('P1', [p0[0]+eu[0]*wu, p0[1]+eu[1]*wu]), ('P2', [p0[0]+ev[0]*hv, p0[1]+ev[1]*hv])]
    for nm, pp in _lbl:
        labels.append(rg.Circle(rg.Point3d(pp[0], pp[1], 0), 4.0).ToNurbsCurve())
        for t in txt(nm, 9.0, pp[0], pp[1]-12):
            labels.append(t)

cxm = BED/2.0
pts = List[rg.Point3d]()
pts.Add(rg.Point3d(cxm-16, -14, 0)); pts.Add(rg.Point3d(cxm, -46, 0))
pts.Add(rg.Point3d(cxm+16, -14, 0)); pts.Add(rg.Point3d(cxm-16, -14, 0))
labels.append(rg.PolylineCurve(pts))
ft = txt('FRONT', 20.0, cxm, -82)
if ft:
    for t in ft:
        labels.append(t)
else:
    labels.append(rg.TextDot('FRONT', rg.Point3d(cxm, -64, 0)))

print('plan: %d+%d+%d+%d strokes, %d dots, %d sig, %d ghost' % (len(view_pen1), len(view_pen2), len(view_pen3), len(view_pen4), len(view_dots), len(view_signature), len(view_ghost)))
# ---------- end preview_6 ----------

# ---- group: PEN LEGEND / display (continued)
edges = BrepEdges(Brep=preview_6.paper)  # -> Naked, flatten(Interior), NonManifold
join = JoinCurves(Curves=edges.Interior, Preserve=False)
preview_7 = CustomPreview(Geometry=preview_6.bed, Material=ColourSwatch(SwatchColor=RGB(110, 110, 110)))
preview_8 = CustomPreview(Geometry=preview_6.paper, Material=ColourSwatch(SwatchColor=RGB(255, 254, 252)))
preview_9 = CustomPreview(Geometry=preview_6.labels, Material=ColourSwatch(SwatchColor=RGB(0, 0, 0)))
preview_10 = CustomPreview(Geometry=preview_6.view_dots, Material=dots_colour)
preview_11 = CustomPreview(Geometry=preview_6.view_signature, Material=signature_colour)
preview_12 = CustomPreview(Geometry=join, Material=pen_1_colour)
preview_13 = CustomPreview(Geometry=preview_6.view_exclusion, Material=exclusion_zone)
previewlw = CustomPreviewLineweights(Geometry=preview_6.view_pen1, Shader=pen1_black_fine, Thickness=penwidth.t1, Absolute=False)
previewlw_2 = CustomPreviewLineweights(Geometry=preview_6.view_pen2, Shader=pen2_black_bold, Thickness=penwidth.t2, Absolute=False)
previewlw_3 = CustomPreviewLineweights(Geometry=preview_6.view_pen3, Shader=pen3_black_roller, Thickness=penwidth.t3, Absolute=False)
previewlw_4 = CustomPreviewLineweights(Geometry=preview_6.view_pen4, Shader=pen4_red_fine, Thickness=penwidth.t4, Absolute=False)
previewlw_5 = CustomPreviewLineweights(Geometry=preview_6.view_pen5, Shader=pen5_custom_1, Thickness=penwidth.t5, Absolute=False)
previewlw_6 = CustomPreviewLineweights(Geometry=preview_6.view_pen6, Shader=pen6_custom_2, Thickness=penwidth.t6, Absolute=False)
previewlw_7 = CustomPreviewLineweights(Geometry=preview_6.view_pen7, Shader=pen7_custom_3, Thickness=penwidth.t7, Absolute=False)
previewlw_8 = CustomPreviewLineweights(Geometry=preview_6.view_pen8, Shader=pen8_custom_4, Thickness=penwidth.t8, Absolute=False)
pressure_preview = CustomPreviewLineweights(Geometry=preview_6.view_pressure, Shader=pen1_black_fine, Thickness=preview_6.pressure_wt, Absolute=False)

# ---- group: PLOT upload + start, with the job manifest (continued)
job_manifest_receipt = Panel(gcode.out)
